# Grasshopper definition 03-plate-patch.ghx (Grasshopper 1.0.8)
# plug-ins: BridGHe

modello = ModelloDiIngresso(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)
panel = Panel("C:\Users\g.pacini\Documents\Repository\BridGHe\example\03-plate-patch\calcoli\grasshopper\model.st7")
# Patch test membranale di una piastra shell
# Unita N-mm. Materiale elastico E=210000 MPa, nu=0.3.
# Modello incorporato: menu del parametro per gestire i dati.
# Impostare il percorso .st7 prima di eseguire. Vedere example/README.md.
sa = StrausR3Analysis(Model=modello, Solver=0, AnalysisResults="Tension", OutputPath=panel, KeepRunning=False, ElementGuids="[]")
dm = DecomposeModel(Model=sa)  # -> Nodes, Beams, Plates
nr = NodeResults(Node=dm.Nodes)  # -> LoadCasesD, StepsD, Displacements, Rotations, LoadCasesF, StepsF, Forces, Moments
pr = PlateResults(Plate=dm.Plates)  # -> LoadCases, Nodes, Steps, Force, ForceMax, ForceMin, ForceAngle, ForceVonMises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
spostamenti_xyz_mm = Panel(nr.Displacements)
nxx_nyy_nxy_n_mm = Panel(pr.Force)
