# Grasshopper definition 04-moving-load.ghx (Grasshopper 1.0.8)
# plug-ins: BridGHe

modello = ModelloDiIngresso(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)
# Asse mobile su trave appoggiata
# Unita N-mm. Materiale elastico E=210000 MPa, nu=0.3.
# Modello incorporato: menu del parametro per gestire i dati.
# Impostare il percorso .st7 prima di eseguire. Vedere example/README.md.
toggle = BooleanToggle(False)
panel = Panel("C:\Users\g.pacini\Documents\Repository\BridGHe\example\04-moving-load\calcoli\grasshopper\model.st7")
mlanalysis = MovingStaticAnalysis(Model=modello, OutputPath=panel, Run=toggle)  # -> Model, Cases
dm = DecomposeModel(Model=mlanalysis.Model)  # -> Nodes, Beams, Plates
nr = NodeResults(Node=dm.Nodes)  # -> LoadCasesD, StepsD, Displacements, Rotations, LoadCasesF, StepsF, Forces, Moments
br = BeamResults(Beam=dm.Beams)  # -> LoadCases, Stations, Steps, ShearForces, BendingMoments, AxialForces, Torques
spostamenti_xyz_mm = Panel(nr.Displacements)
momenti_bm1_bm2_n_mm = Panel(br.BendingMoments)
