# Grasshopper definition 05-nonlinear-increments.ghx (Grasshopper 1.0.8)
# plug-ins: BridGHe

modello = ModelloDiIngresso(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)
panel = Panel("C:\Users\g.pacini\Documents\Repository\BridGHe\example\05-nonlinear-increments\calcoli\grasshopper\model.st7")
panel_2 = Panel("""Half
Double""")
# Incrementi del solutore non lineare in campo elastico
# Unita N-mm. Materiale elastico E=210000 MPa, nu=0.3.
# Modello incorporato: menu del parametro per gestire i dati.
# Impostare il percorso .st7 prima di eseguire. Vedere example/README.md.
sa = StrausR3Analysis(Model=modello, Solver=1, AnalysisResults=panel_2, OutputPath=panel, KeepRunning=False, ElementGuids="[]")
dm = DecomposeModel(Model=sa)  # -> Nodes, Beams, Plates
nr = NodeResults(Node=dm.Nodes)  # -> LoadCasesD, StepsD, Displacements, Rotations, LoadCasesF, StepsF, Forces, Moments
br = BeamResults(Beam=dm.Beams)  # -> LoadCases, Stations, Steps, ShearForces, BendingMoments, AxialForces, Torques
spostamenti_xyz_mm = Panel(nr.Displacements)
momenti_bm1_bm2_n_mm = Panel(br.BendingMoments)
