# Grasshopper definition 10-stage-selection.ghx (Grasshopper 1.0.8)
# plug-ins: BridGHe

panel = Panel("C:\Users\g.pacini\Documents\Repository\BridGHe\example\10-stage-selection\calcoli\grasshopper\model.st7")
# Fasi: piu incrementi, casi diversi e selezione parziale
# Unita N-mm. Materiale elastico E=210000 MPa, nu=0.3.
# Modello incorporato: menu del parametro per gestire i dati.
# Impostare il percorso .st7 prima di eseguire. Vedere example/README.md.
modello = ModelloDiIngresso(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)
panel_2 = Panel("""Full [Construction]
ULS [Service]""")
sa = StrausR3Analysis(Model=modello, Solver=2, AnalysisResults=panel_2, OutputPath=panel, KeepRunning=False, ElementGuids="[]")
dm = DecomposeModel(Model=sa)  # -> Nodes, Beams, Plates
nr = NodeResults(Node=dm.Nodes)  # -> LoadCasesD, StepsD, Displacements, Rotations, LoadCasesF, StepsF, Forces, Moments
br = BeamResults(Beam=dm.Beams)  # -> LoadCases, Stations, Steps, ShearForces, BendingMoments, AxialForces, Torques
spostamenti_xyz_mm = Panel(nr.Displacements)
momenti_bm1_bm2_n_mm = Panel(br.BendingMoments)
