# Grasshopper definition 11-ponte-graticcio.ghx (Grasshopper 1.0.8)
# plug-ins: BridGHe

# LEGGERE PRIMA: PONTE MISTO A GRATICCIO | N-mm-MPa
# Tre modelli elastici: acciaio / misto lungo termine / misto istantaneo.
# Geometria, carichi e proprieta sono visibili e modificabili nei parametri.
# Modificare parameters.json e rigenerare per cambiare coerentemente tutte le dipendenze.
# Run inizialmente false. File .st7 in TEMP, percorsi modificabili.
# BridgeChecks: solo N-Mx-Vy, esclusi T, M2 e V1. La combinazione iniziale è simmetrica; gli effetti fuori piano non sono verificati.
# Soletta e diaframmi sono travi equivalenti: non e una verifica normativa completa.
# FASE 1: Ponte graticcio / G1_GETTO
# Nodi 52 | Beam 69
appoggi_mm = Point([Point(0, -3750, 0), Point(30000, -3750, 0), Point(0, -1250, 0), Point(30000, -1250, 0), Point(0, 1250, 0), Point(30000, 1250, 0), Point(0, 3750, 0), Point(30000, 3750, 0)])
nodi_interni_mm = Point([Point(2500, -3750, 0), Point(5000, -3750, 0), Point(7500, -3750, 0), Point(10000, -3750, 0), Point(12500, -3750, 0), Point(15000, -3750, 0)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])
assi_longitudinali_mm = Curve([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])
assi_trasversali_mm = Curve([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])
# FASE 2: Ponte graticcio / G2_PERMANENTI
# Nodi 52 | Beam 87
appoggi_mm_2 = Point([Point(0, -3750, 0), Point(30000, -3750, 0), Point(0, -1250, 0), Point(30000, -1250, 0), Point(0, 1250, 0), Point(30000, 1250, 0), Point(0, 3750, 0), Point(30000, 3750, 0)])
nodi_interni_mm_2 = Point([Point(2500, -3750, 0), Point(5000, -3750, 0), Point(7500, -3750, 0), Point(10000, -3750, 0), Point(12500, -3750, 0), Point(15000, -3750, 0)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])
assi_longitudinali_mm_2 = Curve([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])
assi_trasversali_mm_2 = Curve([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])
# FASE 3: Ponte graticcio / Q_UDL
# Nodi 52 | Beam 87
appoggi_mm_3 = Point([Point(0, -3750, 0), Point(30000, -3750, 0), Point(0, -1250, 0), Point(30000, -1250, 0), Point(0, 1250, 0), Point(30000, 1250, 0), Point(0, 3750, 0), Point(30000, 3750, 0)])
nodi_interni_mm_3 = Point([Point(2500, -3750, 0), Point(5000, -3750, 0), Point(7500, -3750, 0), Point(10000, -3750, 0), Point(12500, -3750, 0), Point(15000, -3750, 0)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])
assi_longitudinali_mm_3 = Curve([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])
assi_trasversali_mm_3 = Curve([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])
proprieta_a_i11_i22_j_n_mm = ProprietaAI11I22JNMm([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])
proprieta_a_i11_i22_j_n_mm_2 = ProprietaAI11I22JNMm([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])
proprieta_a_i11_i22_j_n_mm_3 = ProprietaAI11I22JNMm([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])
proprieta_a_i11_i22_j_n_mm_4 = ProprietaAI11I22JNMm([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])
proprieta_a_i11_i22_j_n_mm_5 = ProprietaAI11I22JNMm([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])
proprieta_a_i11_i22_j_n_mm_6 = ProprietaAI11I22JNMm([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])
N = Node(Point=appoggi_mm)
N_2 = Node(Point=nodi_interni_mm)
N_3 = Node(Point=appoggi_mm_2)
N_4 = Node(Point=nodi_interni_mm_2)
N_5 = Node(Point=appoggi_mm_3)
N_6 = Node(Point=nodi_interni_mm_3)
tx_ty_tz = TxTyTz([True, True, True])
rx_ry_rz = RxRyRz([False, False, True])
tx_ty_tz_2 = TxTyTz([True, True, False])
rx_ry_rz_2 = RxRyRz([False, False, True])
tx_ty_tz_3 = TxTyTz([True, True, True])
rx_ry_rz_3 = RxRyRz([False, False, True])
tx_ty_tz_4 = TxTyTz([True, True, False])
rx_ry_rz_4 = RxRyRz([False, False, True])
tx_ty_tz_5 = TxTyTz([True, True, True])
rx_ry_rz_5 = RxRyRz([False, False, True])
tx_ty_tz_6 = TxTyTz([True, True, False])
rx_ry_rz_6 = RxRyRz([False, False, True])
nr = Restraints(Node=N, Transational=tx_ty_tz, Rotation=rx_ry_rz)
nr_2 = Restraints(Node=N_2, Transational=tx_ty_tz_2, Rotation=rx_ry_rz_2)
nr_3 = Restraints(Node=N_3, Transational=tx_ty_tz_3, Rotation=rx_ry_rz_3)
nr_4 = Restraints(Node=N_4, Transational=tx_ty_tz_4, Rotation=rx_ry_rz_4)
nr_5 = Restraints(Node=N_5, Transational=tx_ty_tz_5, Rotation=rx_ry_rz_5)
nr_6 = Restraints(Node=N_6, Transational=tx_ty_tz_6, Rotation=rx_ry_rz_6)
bm = Beam(Line=assi_longitudinali_mm, Property=proprieta_a_i11_i22_j_n_mm, Angle=0)
bm_2 = Beam(Line=assi_trasversali_mm, Property=proprieta_a_i11_i22_j_n_mm_2, Angle=0)
bm_3 = Beam(Line=assi_longitudinali_mm_2, Property=proprieta_a_i11_i22_j_n_mm_3, Angle=0)
bm_4 = Beam(Line=assi_trasversali_mm_2, Property=proprieta_a_i11_i22_j_n_mm_4, Angle=0)
bm_5 = Beam(Line=assi_longitudinali_mm_3, Property=proprieta_a_i11_i22_j_n_mm_5, Angle=0)
bm_6 = Beam(Line=assi_trasversali_mm_3, Property=proprieta_a_i11_i22_j_n_mm_6, Angle=0)
super_elementi = Panel("""G1
G1
G1
G1
G1
G1
G1
G1
G1
G1
G1
G1
G2
G2
G2
G2
G2
G2
G2
G2
G2
G2
G2
G2
G3
G3
G3
G3
G3
G3
G3
G3
G3
G3
G3
G3
G4
G4
G4
G4
G4
G4
G4
G4
G4
G4
G4
G4""")
super_elementi_2 = Panel("""G1
G1
G1
G1
G1
G1
G1
G1
G1
G1
G1
G1
G2
G2
G2
G2
G2
G2
G2
G2
G2
G2
G2
G2
G3
G3
G3
G3
G3
G3
G3
G3
G3
G3
G3
G3
G4
G4
G4
G4
G4
G4
G4
G4
G4
G4
G4
G4""")
super_elementi_3 = Panel("""G1
G1
G1
G1
G1
G1
G1
G1
G1
G1
G1
G1
G2
G2
G2
G2
G2
G2
G2
G2
G2
G2
G2
G2
G3
G3
G3
G3
G3
G3
G3
G3
G3
G3
G3
G3
G4
G4
G4
G4
G4
G4
G4
G4
G4
G4
G4
G4""")
g1_getto = G1_GETTO(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)
forze_g1_getto_n = Vector([Vector(0, 0, -27534.325), Vector(0, 0, -27534.325), Vector(0, 0, -27534.325), Vector(0, 0, -27534.325), Vector(0, 0, -27534.325), Vector(0, 0, -27534.325), Vector(0, 0, -27534.325), Vector(0, 0, -27534.325)])
g1_getto_2 = G1_GETTO(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)
forze_g1_getto_n_2 = Vector([Vector(0, 0, -55068.65), Vector(0, 0, -55068.65), Vector(0, 0, -55068.65), Vector(0, 0, -55068.65), Vector(0, 0, -55068.65), Vector(0, 0, -55068.65)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])
g2_permanenti = G2_PERMANENTI(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)
forze_g2_permanenti_n = Vector([Vector(0, 0, -7812.5), Vector(0, 0, -7812.5), Vector(0, 0, -7812.5), Vector(0, 0, -7812.5), Vector(0, 0, -7812.5), Vector(0, 0, -7812.5), Vector(0, 0, -7812.5), Vector(0, 0, -7812.5)])
g2_permanenti_2 = G2_PERMANENTI(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)
forze_g2_permanenti_n_2 = Vector([Vector(0, 0, -15625), Vector(0, 0, -15625), Vector(0, 0, -15625), Vector(0, 0, -15625), Vector(0, 0, -15625), Vector(0, 0, -15625)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])
q_udl = Q_UDL(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)
forze_q_udl_n = Vector([Vector(0, 0, -7812.5), Vector(0, 0, -7812.5), Vector(0, 0, -7812.5), Vector(0, 0, -7812.5), Vector(0, 0, -7812.5), Vector(0, 0, -7812.5), Vector(0, 0, -7812.5), Vector(0, 0, -7812.5)])
q_udl_2 = Q_UDL(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)
forze_q_udl_n_2 = Vector([Vector(0, 0, -15625), Vector(0, 0, -15625), Vector(0, 0, -15625), Vector(0, 0, -15625), Vector(0, 0, -15625), Vector(0, 0, -15625)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])
nl = NodeLoad(Node=nr, LoadCase=g1_getto, Force=forze_g1_getto_n)
nl_2 = NodeLoad(Node=nr_2, LoadCase=g1_getto_2, Force=forze_g1_getto_n_2)
nl_3 = NodeLoad(Node=nr_3, LoadCase=g2_permanenti, Force=forze_g2_permanenti_n)
nl_4 = NodeLoad(Node=nr_4, LoadCase=g2_permanenti_2, Force=forze_g2_permanenti_n_2)
nl_5 = NodeLoad(Node=nr_5, LoadCase=q_udl, Force=forze_q_udl_n)
nl_6 = NodeLoad(Node=nr_6, LoadCase=q_udl_2, Force=forze_q_udl_n_2)
se = SuperElement(Element=bm, Name=super_elementi)
se_2 = SuperElement(Element=bm_3, Name=super_elementi_2)
se_3 = SuperElement(Element=bm_5, Name=super_elementi_3)
id_straus = Panel("""1
2
3
4
5
6
7
8
9
10
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""")
id_straus_2 = Panel("""49
50
51
55
56
57
61
62
63
67
68
69
73
74
75
79
80
81
85
86
87""")
id_straus_3 = Panel("""1
2
3
4
5
6
7
8
9
10
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""")
id_straus_4 = Panel("""49
50
51
52
53
54
55
56
57
58
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""")
id_straus_5 = Panel("""1
2
3
4
5
6
7
8
9
10
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""")
id_straus_6 = Panel("""49
50
51
52
53
54
55
56
57
58
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""")
q_ecc = Q_ECC(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)
forze_q_ecc_n = Vector([Vector(0, 0, 0), Vector(0, 0, 0), Vector(0, 0, 0), Vector(0, 0, 0), Vector(0, 0, 0), Vector(0, 0, 0), Vector(0, 0, 0), Vector(0, 0, 0)])
q_ecc_2 = Q_ECC(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)
forze_q_ecc_n_2 = Vector([Vector(0, 0, 0), Vector(0, 0, 0), Vector(0, 0, 0), Vector(0, 0, 0), Vector(0, 0, 0), Vector(0, 0, 0), Vector(0, 0, 0), Vector(0, 0, 0), Vector(0, 0, 0), Vector(0, 0, 0)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])
nl_7 = NodeLoad(Node=nl_5, LoadCase=q_ecc, Force=forze_q_ecc_n)
nl_8 = NodeLoad(Node=nl_6, LoadCase=q_ecc_2, Force=forze_q_ecc_n_2)
ei = ElementId(Element=se, ID=id_straus)
ei_2 = ElementId(Element=bm_2, ID=id_straus_2)
ei_3 = ElementId(Element=se_2, ID=id_straus_3)
ei_4 = ElementId(Element=bm_4, ID=id_straus_4)
ei_5 = ElementId(Element=se_3, ID=id_straus_5)
ei_6 = ElementId(Element=bm_6, ID=id_straus_6)
q_mirror = Q_MIRROR(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)
forze_q_mirror_n = Vector([Vector(0, 0, 0), Vector(0, 0, 0), Vector(0, 0, 0), Vector(0, 0, 0), Vector(0, 0, 0), Vector(0, 0, 0), Vector(0, 0, 0), Vector(0, 0, 0)])
q_mirror_2 = Q_MIRROR(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)
forze_q_mirror_n_2 = Vector([Vector(0, 0, 0), Vector(0, 0, 0), Vector(0, 0, 0), Vector(0, 0, 0), Vector(0, 0, -45000), Vector(0, 0, -60000), Vector(0, 0, -45000), Vector(0, 0, 0), Vector(0, 0, 0), Vector(0, 0, 0)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])
nl_9 = NodeLoad(Node=nl_7, LoadCase=q_mirror, Force=forze_q_mirror_n)
nl_10 = NodeLoad(Node=nl_8, LoadCase=q_mirror_2, Force=forze_q_mirror_n_2)
bm_7 = BuildModel(Elements=[nl, nl_2, ei, ei_2], Name="Ponte graticcio / G1_GETTO", Units=2)
bm_8 = BuildModel(Elements=[nl_3, nl_4, ei_3, ei_4], Name="Ponte graticcio / G2_PERMANENTI", Units=2)
bm_9 = BuildModel(Elements=[nl_9, nl_10, ei_5, ei_6], Name="Ponte graticcio / Q_UDL", Units=2)
percorso_veicolo_2_assi = PercorsoVeicolo2Assi("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")
casi_da_leggere = Panel("G1_GETTO")
file_straus = Panel("C:\Users\g.pacini\Documents\Repository\BridGHe\example\11-ponte-graticcio\calcoli\gh-phase-0.st7")
casi_da_leggere_2 = Panel("G2_PERMANENTI")
file_straus_2 = Panel("C:\Users\g.pacini\Documents\Repository\BridGHe\example\11-ponte-graticcio\calcoli\gh-phase-1.st7")
casi_da_leggere_3 = Panel("""Q_UDL
Q_ECC
Q_MIRROR""")
file_straus_3 = Panel("C:\Users\g.pacini\Documents\Repository\BridGHe\example\11-ponte-graticcio\calcoli\gh-phase-2.st7")
file_mobile = Panel("C:\Users\g.pacini\Documents\Repository\BridGHe\example\11-ponte-graticcio\calcoli\gh-moving.st7")
mlmodel = AttachMovingPaths(Model=bm_9, Paths=percorso_veicolo_2_assi)
sa = StrausR3Analysis(Model=bm_7, Solver=0, AnalysisResults=casi_da_leggere, OutputPath=file_straus, KeepRunning=False, ElementGuids="[]")
sa_2 = StrausR3Analysis(Model=bm_8, Solver=0, AnalysisResults=casi_da_leggere_2, OutputPath=file_straus_2, KeepRunning=False, ElementGuids="[]")
sa_3 = StrausR3Analysis(Model=bm_9, Solver=0, AnalysisResults=casi_da_leggere_3, OutputPath=file_straus_3, KeepRunning=False, ElementGuids="[]")
dm = DecomposeModel(Model=sa)  # -> Nodes, Beams, Plates
dm_2 = DecomposeModel(Model=sa_2)  # -> Nodes, Beams, Plates
dm_3 = DecomposeModel(Model=sa_3)  # -> Nodes, Beams, Plates
mlanalysis = MovingStaticAnalysis(Model=mlmodel, OutputPath=file_mobile, Run=False)  # -> Model, Cases
nr_7 = NodeResults(Node=dm.Nodes)  # -> LoadCasesD, StepsD, Displacements, Rotations, LoadCasesF, StepsF, Forces, Moments
nr_8 = NodeResults(Node=dm_2.Nodes)  # -> LoadCasesD, StepsD, Displacements, Rotations, LoadCasesF, StepsF, Forces, Moments
nr_9 = NodeResults(Node=dm_3.Nodes)  # -> LoadCasesD, StepsD, Displacements, Rotations, LoadCasesF, StepsF, Forces, Moments
br = BeamResults(Beam=dm.Beams)  # -> LoadCases, Stations, Steps, ShearForces, BendingMoments, AxialForces, Torques
br_2 = BeamResults(Beam=dm_2.Beams)  # -> LoadCases, Stations, Steps, ShearForces, BendingMoments, AxialForces, Torques
br_3 = BeamResults(Beam=dm_3.Beams)  # -> LoadCases, Stations, Steps, ShearForces, BendingMoments, AxialForces, Torques
posizioni_mobili_generate = Panel(mlanalysis.Cases)
spostamenti_mm = Panel(nr_7.Displacements)
bm1_bm2_n_mm = Panel(br.BendingMoments)
torsione_n_mm_conservata = Panel(br.Torques)
spostamenti_mm_2 = Panel(nr_8.Displacements)
bm1_bm2_n_mm_2 = Panel(br_2.BendingMoments)
torsione_n_mm_conservata_2 = Panel(br_2.Torques)
spostamenti_mm_3 = Panel(nr_9.Displacements)
bm1_bm2_n_mm_3 = Panel(br_3.BendingMoments)
torsione_n_mm_conservata_3 = Panel(br_3.Torques)
travi_principali = Panel("""G1
G2
G3
G4""")
travi_principali_2 = Panel("""G1
G2
G3
G4""")
travi_principali_3 = Panel("""G1
G2
G3
G4""")
# BRIDGE_CHECKS - CAMPO COPERTO: Combinazione SLS simmetrica, coefficienti 1.0.
# Sezione lorda, soletta non fessurata, armature escluse.
# 5 contributi: G1, G2, Q_UDL, ritiro lungo termine, deformazione istantanea.
# Per il traffico eccentrico conservare T e usare un verificatore dedicato.
# Dopo le analisi: Run Build BridGHe Model, poi Run Super Element Check.
# Non alimentare questo merge con i risultati TOTALI delle fasi di getto.
sef = SuperElementFilter(BridGHeModel=sa, SuperElement=travi_principali)
sef_2 = SuperElementFilter(BridGHeModel=sa_2, SuperElement=travi_principali_2)
sef_3 = SuperElementFilter(BridGHeModel=sa_3, SuperElement=travi_principali_3)
bm_10 = BuildModel(Elements=flatten(sef), Name="Risultati longitudinali fase 0", Units=2)
bm_11 = BuildModel(Elements=flatten(sef_2), Name="Risultati longitudinali fase 1", Units=2)
bm_12 = BuildModel(Elements=flatten(sef_3), Name="Risultati longitudinali fase 2", Units=2)
caso_sorgente = CasoSorgente(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)
caso_sorgente_2 = CasoSorgente(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)
caso_sorgente_3 = CasoSorgente(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)
shrinkageaction = BridgeShrinkageAction(ActionID="RITIRO", StrainIncrement=-0.0001, PrimaryOnly=True, Response=0)
shrinkageaction_2 = BridgeShrinkageAction(ActionID="DEF_IST", StrainIncrement=-5e-05, PrimaryOnly=True, Response=1)
action = BridgeAction(ActionID="G1", Model=bm_10, Case=caso_sorgente, Behavior=0)
action_2 = BridgeAction(ActionID="G2", Model=bm_11, Case=caso_sorgente_2, Behavior=1)
action_3 = BridgeAction(ActionID="Q", Model=bm_12, Case=caso_sorgente_3, Behavior=2)
sls_simmetrico_id_azioni = Data(Tree({0}: ["", "G1", "G2", "Q", "RITIRO", "DEF_IST"], {1}: ["SLS_SIMMETRICO", "1", "1", "1", "1", "1"]))
phase = BridgePhase(Number=10, Name="G1_GETTO", SectionState=0, Actions=action)
phase_2 = BridgePhase(Number=20, Name="G2_PERMANENTI", SectionState=1, Actions=[action_2, shrinkageaction])
phase_3 = BridgePhase(Number=30, Name="Q_UDL", SectionState=1, Actions=[action_3, shrinkageaction_2])
buildbridge = BuildBridGHeModel(
    Models=[bm_10, bm_11, bm_12],
    Phases=[phase, phase_2, phase_3],
    Combinations=sls_simmetrico_id_azioni,
    Calculation=0,
    AdditionalPhaseMembers=False)  # -> Model, Phases, Diagnostics
travi_verificate = Panel("""G1
G2
G3
G4""")
sef_4 = SuperElementFilter(BridGHeModel=buildbridge.Model, SuperElement=travi_verificate)
sezione_mista_h1600_soletta_250 = SezioneMistaH1600Soletta250(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)
cb = CompositeBeam(Beam=sef_4, SectionStart=sezione_mista_h1600_soletta_250, SectionEnd=sezione_mista_h1600_soletta_250)
sec = SuperElementCheck(
    BridGHeModel=buildbridge.Model,
    SuperElementBeam=flatten(cb),
    WebLocalInstability=False,
    TopFlangeLocalInstability=False,
    BottomFlangeLocalInstability=False)  # -> TensionCheck, TauB, TensionForces
csltr = CompositeSectionLinearTensionResults(LinearTensionResults=sec.TensionCheck)  # -> Point1_ConcreteEpsilon, Point1_ConcreteSigma, Point2_RebarSigma, Point3_RebarSigma, Point4_ConcreteSigma, Point5_SteelSigma, Point6_SteelSigma, Point6_SteelTau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
sigma_cls_superiore_mpa = Panel(csltr.Point1_ConcreteSigma)
# ESITI DA NON CONFONDERE: TauB non disponibile: output NaN.
# Tensioni elastiche non equivalgono a verifica SLU.
# Instabilita, connessione, fatica, soletta locale, appoggi e azioni orizzontali: da verificare a parte.
# La deformazione istantanea imposta e un incremento separato; non ripetere lo stesso ritiro.
sigma_acciaio_inferiore_mpa = Panel(csltr.Point8_SteelSigma)
