# Grasshopper definition 15-curvo-2campate.ghx (Grasshopper 1.0.8)
# plug-ins: BridGHe

nodi_mm = Point(Point(0, -3750, 0))
nodi_mm_2 = Point([Point(1074.205259, -3745.337622, 0), Point(2148.329576, -3731.350837, 0), Point(3222.292012, -3708.040701, 0), Point(4296.011643, -3675.40897, 0), Point(5369.407563, -3633.458103, 0), Point(6442.39889, -3582.19126, 0)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])
nodi_mm_3 = Point([Point(25595.15799, -1074.152433, 0), Point(0, -1250, 0), Point(25078.0841, 1371.790041, 0), Point(49071.64083, 9123.778175, 0), Point(0, 1250, 0), Point(24561.0102, 3817.732514, 0), Point(48059.85442, 11409.88584, 0), Point(0, 3750, 0), Point(24043.9363, 6263.674988, 0), Point(47048.06801, 13695.99351, 0)])
nodi_mm_4 = Point(Point(50083.42724, 6837.670509, 0))
assi_longitudinali = Curve([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])
assi_trasversali = Curve([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])
nodi_mm_5 = Point(Point(0, -3750, 0))
nodi_mm_6 = Point([Point(1074.205259, -3745.337622, 0), Point(2148.329576, -3731.350837, 0), Point(3222.292012, -3708.040701, 0), Point(4296.011643, -3675.40897, 0), Point(5369.407563, -3633.458103, 0), Point(6442.39889, -3582.19126, 0)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])
nodi_mm_7 = Point([Point(25595.15799, -1074.152433, 0), Point(0, -1250, 0), Point(25078.0841, 1371.790041, 0), Point(49071.64083, 9123.778175, 0), Point(0, 1250, 0), Point(24561.0102, 3817.732514, 0), Point(48059.85442, 11409.88584, 0), Point(0, 3750, 0), Point(24043.9363, 6263.674988, 0), Point(47048.06801, 13695.99351, 0)])
nodi_mm_8 = Point(Point(50083.42724, 6837.670509, 0))
assi_longitudinali_2 = Curve([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])
assi_trasversali_2 = Curve([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])
nodi_mm_9 = Point(Point(0, -3750, 0))
nodi_mm_10 = Point([Point(1074.205259, -3745.337622, 0), Point(2148.329576, -3731.350837, 0), Point(3222.292012, -3708.040701, 0), Point(4296.011643, -3675.40897, 0), Point(5369.407563, -3633.458103, 0), Point(6442.39889, -3582.19126, 0)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])
nodi_mm_11 = Point([Point(25595.15799, -1074.152433, 0), Point(0, -1250, 0), Point(25078.0841, 1371.790041, 0), Point(49071.64083, 9123.778175, 0), Point(0, 1250, 0), Point(24561.0102, 3817.732514, 0), Point(48059.85442, 11409.88584, 0), Point(0, 3750, 0), Point(24043.9363, 6263.674988, 0), Point(47048.06801, 13695.99351, 0)])
nodi_mm_12 = Point(Point(50083.42724, 6837.670509, 0))
assi_longitudinali_3 = Curve([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])
assi_trasversali_3 = Curve([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])
nodi_mm_13 = Point(Point(0, -3750, 0))
nodi_mm_14 = Point([Point(1074.205259, -3745.337622, 0), Point(2148.329576, -3731.350837, 0), Point(3222.292012, -3708.040701, 0), Point(4296.011643, -3675.40897, 0), Point(5369.407563, -3633.458103, 0), Point(6442.39889, -3582.19126, 0)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])
nodi_mm_15 = Point([Point(25595.15799, -1074.152433, 0), Point(0, -1250, 0), Point(25078.0841, 1371.790041, 0), Point(49071.64083, 9123.778175, 0), Point(0, 1250, 0), Point(24561.0102, 3817.732514, 0), Point(48059.85442, 11409.88584, 0), Point(0, 3750, 0), Point(24043.9363, 6263.674988, 0), Point(47048.06801, 13695.99351, 0)])
nodi_mm_16 = Point(Point(50083.42724, 6837.670509, 0))
assi_longitudinali_4 = Curve([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])
assi_trasversali_4 = Curve([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])
# LEGGERE: Curvo continuo 25 + 25 m / R 120 m | N-mm-MPa
# 3 FASI + RITIRO LONGITUDINALE: quattro analisi incrementali con le rispettive rigidezze.
# G1 acciaio/getto; G2 misto lungo termine; Q misto istantaneo; RITIRO misto lungo termine.
# Ritiro: pre-strain e gradiente per effetti globali + una sola autotensione di sezione.
# Geometrie e proprieta editabili. Per modifiche coerenti usare parameters.json e rigenerare.
# Attivare CALCOLA 4 MODELLI; poi Run Build BridGHe Model e Run Super Element Check.
# Verifiche N-Mx-Vy: T, M2 e V1 esclusi dal checker e conservati nei risultati FEM; gli effetti esclusi non sono verificati.
contributo_1 = Panel("Curvo continuo 25 + 25 m / R 120 m / G1_GETTO")
contributo_2 = Panel("Curvo continuo 25 + 25 m / R 120 m / G2_PERMANENTI")
contributo_3 = Panel("Curvo continuo 25 + 25 m / R 120 m / Q_TRAFFICO")
contributo_4 = Panel("Curvo continuo 25 + 25 m / R 120 m / RITIRO")
proprieta_equivalenti_a_i11_i22_j = ProprietaEquivalentiAI11I22J(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)
proprieta_equivalenti_a_i11_i22_j_2 = ProprietaEquivalentiAI11I22J([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])
proprieta_equivalenti_a_i11_i22_j_3 = ProprietaEquivalentiAI11I22J(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)
proprieta_equivalenti_a_i11_i22_j_4 = ProprietaEquivalentiAI11I22J([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])
proprieta_equivalenti_a_i11_i22_j_5 = ProprietaEquivalentiAI11I22J(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)
proprieta_equivalenti_a_i11_i22_j_6 = ProprietaEquivalentiAI11I22J([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])
proprieta_equivalenti_a_i11_i22_j_7 = ProprietaEquivalentiAI11I22J(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)
proprieta_equivalenti_a_i11_i22_j_8 = ProprietaEquivalentiAI11I22J([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])
N = Node(Point=nodi_mm)
N_2 = Node(Point=nodi_mm_2)
N_3 = Node(Point=nodi_mm_3)
N_4 = Node(Point=nodi_mm_4)
N_5 = Node(Point=nodi_mm_5)
N_6 = Node(Point=nodi_mm_6)
N_7 = Node(Point=nodi_mm_7)
N_8 = Node(Point=nodi_mm_8)
N_9 = Node(Point=nodi_mm_9)
N_10 = Node(Point=nodi_mm_10)
N_11 = Node(Point=nodi_mm_11)
N_12 = Node(Point=nodi_mm_12)
N_13 = Node(Point=nodi_mm_13)
N_14 = Node(Point=nodi_mm_14)
N_15 = Node(Point=nodi_mm_15)
N_16 = Node(Point=nodi_mm_16)
tx_ty_tz = TxTyTz([True, True, True])
rx_ry_rz = RxRyRz([False, False, False])
tx_ty_tz_2 = TxTyTz([False, False, False])
rx_ry_rz_2 = RxRyRz([False, False, False])
tx_ty_tz_3 = TxTyTz([False, False, True])
rx_ry_rz_3 = RxRyRz([False, False, False])
tx_ty_tz_4 = TxTyTz([False, True, True])
rx_ry_rz_4 = RxRyRz([False, False, False])
tx_ty_tz_5 = TxTyTz([True, True, True])
rx_ry_rz_5 = RxRyRz([False, False, False])
tx_ty_tz_6 = TxTyTz([False, False, False])
rx_ry_rz_6 = RxRyRz([False, False, False])
tx_ty_tz_7 = TxTyTz([False, False, True])
rx_ry_rz_7 = RxRyRz([False, False, False])
tx_ty_tz_8 = TxTyTz([False, True, True])
rx_ry_rz_8 = RxRyRz([False, False, False])
tx_ty_tz_9 = TxTyTz([True, True, True])
rx_ry_rz_9 = RxRyRz([False, False, False])
tx_ty_tz_10 = TxTyTz([False, False, False])
rx_ry_rz_10 = RxRyRz([False, False, False])
tx_ty_tz_11 = TxTyTz([False, False, True])
rx_ry_rz_11 = RxRyRz([False, False, False])
tx_ty_tz_12 = TxTyTz([False, True, True])
rx_ry_rz_12 = RxRyRz([False, False, False])
tx_ty_tz_13 = TxTyTz([True, True, True])
rx_ry_rz_13 = RxRyRz([False, False, False])
tx_ty_tz_14 = TxTyTz([False, False, False])
rx_ry_rz_14 = RxRyRz([False, False, False])
tx_ty_tz_15 = TxTyTz([False, False, True])
rx_ry_rz_15 = RxRyRz([False, False, False])
tx_ty_tz_16 = TxTyTz([False, True, True])
rx_ry_rz_16 = RxRyRz([False, False, False])
bm = Beam(Line=assi_longitudinali, Property=proprieta_equivalenti_a_i11_i22_j, Angle=0)
bm_2 = Beam(Line=assi_trasversali, Property=proprieta_equivalenti_a_i11_i22_j_2, Angle=0)
bm_3 = Beam(Line=assi_longitudinali_2, Property=proprieta_equivalenti_a_i11_i22_j_3, Angle=0)
bm_4 = Beam(Line=assi_trasversali_2, Property=proprieta_equivalenti_a_i11_i22_j_4, Angle=0)
bm_5 = Beam(Line=assi_longitudinali_3, Property=proprieta_equivalenti_a_i11_i22_j_5, Angle=0)
bm_6 = Beam(Line=assi_trasversali_3, Property=proprieta_equivalenti_a_i11_i22_j_6, Angle=0)
bm_7 = Beam(Line=assi_longitudinali_4, Property=proprieta_equivalenti_a_i11_i22_j_7, Angle=0)
bm_8 = Beam(Line=assi_trasversali_4, Property=proprieta_equivalenti_a_i11_i22_j_8, Angle=0)
nr = Restraints(Node=N, Transational=tx_ty_tz, Rotation=rx_ry_rz)
nr_2 = Restraints(Node=N_2, Transational=tx_ty_tz_2, Rotation=rx_ry_rz_2)
nr_3 = Restraints(Node=N_3, Transational=tx_ty_tz_3, Rotation=rx_ry_rz_3)
nr_4 = Restraints(Node=N_4, Transational=tx_ty_tz_4, Rotation=rx_ry_rz_4)
nr_5 = Restraints(Node=N_5, Transational=tx_ty_tz_5, Rotation=rx_ry_rz_5)
nr_6 = Restraints(Node=N_6, Transational=tx_ty_tz_6, Rotation=rx_ry_rz_6)
nr_7 = Restraints(Node=N_7, Transational=tx_ty_tz_7, Rotation=rx_ry_rz_7)
nr_8 = Restraints(Node=N_8, Transational=tx_ty_tz_8, Rotation=rx_ry_rz_8)
nr_9 = Restraints(Node=N_9, Transational=tx_ty_tz_9, Rotation=rx_ry_rz_9)
nr_10 = Restraints(Node=N_10, Transational=tx_ty_tz_10, Rotation=rx_ry_rz_10)
nr_11 = Restraints(Node=N_11, Transational=tx_ty_tz_11, Rotation=rx_ry_rz_11)
nr_12 = Restraints(Node=N_12, Transational=tx_ty_tz_12, Rotation=rx_ry_rz_12)
nr_13 = Restraints(Node=N_13, Transational=tx_ty_tz_13, Rotation=rx_ry_rz_13)
nr_14 = Restraints(Node=N_14, Transational=tx_ty_tz_14, Rotation=rx_ry_rz_14)
nr_15 = Restraints(Node=N_15, Transational=tx_ty_tz_15, Rotation=rx_ry_rz_15)
nr_16 = Restraints(Node=N_16, Transational=tx_ty_tz_16, Rotation=rx_ry_rz_16)
gruppi_longitudinali = Panel("""G1
G1
G1
G1
G1
G1
G1
G1
G1
G1
G1
G1
G1
G1
G1
G1
G1
G1
G1
G1
G1
G1
G1
G1
G1
G1
G1
G1
G1
G1
G1
G1
G1
G1
G1
G1
G1
G1
G1
G1
G1
G1
G1
G1
G1
G1
G1
G1
G2
G2
G2
G2
G2
G2
G2
G2
G2
G2
G2
G2
G2
G2
G2
G2
G2
G2
G2
G2
G2
G2
G2
G2
G2
G2
G2
G2
G2
G2
G2
G2
G2
G2
G2
G2
G2
G2
G2
G2
G2
G2
G2
G2
G2
G2
G2
G2
G3
G3
G3
G3
G3
G3
G3
G3
G3
G3
G3
G3
G3
G3
G3
G3
G3
G3
G3
G3
G3
G3
G3
G3
G3
G3
G3
G3
G3
G3
G3
G3
G3
G3
G3
G3
G3
G3
G3
G3
G3
G3
G3
G3
G3
G3
G3
G3
G4
G4
G4
G4
G4
G4
G4
G4
G4
G4
G4
G4
G4
G4
G4
G4
G4
G4
G4
G4
G4
G4
G4
G4
G4
G4
G4
G4
G4
G4
G4
G4
G4
G4
G4
G4
G4
G4
G4
G4
G4
G4
G4
G4
G4
G4
G4
G4""")
gruppi_longitudinali_2 = Panel("""G1
G1
G1
G1
G1
G1
G1
G1
G1
G1
G1
G1
G1
G1
G1
G1
G1
G1
G1
G1
G1
G1
G1
G1
G1
G1
G1
G1
G1
G1
G1
G1
G1
G1
G1
G1
G1
G1
G1
G1
G1
G1
G1
G1
G1
G1
G1
G1
G2
G2
G2
G2
G2
G2
G2
G2
G2
G2
G2
G2
G2
G2
G2
G2
G2
G2
G2
G2
G2
G2
G2
G2
G2
G2
G2
G2
G2
G2
G2
G2
G2
G2
G2
G2
G2
G2
G2
G2
G2
G2
G2
G2
G2
G2
G2
G2
G3
G3
G3
G3
G3
G3
G3
G3
G3
G3
G3
G3
G3
G3
G3
G3
G3
G3
G3
G3
G3
G3
G3
G3
G3
G3
G3
G3
G3
G3
G3
G3
G3
G3
G3
G3
G3
G3
G3
G3
G3
G3
G3
G3
G3
G3
G3
G3
G4
G4
G4
G4
G4
G4
G4
G4
G4
G4
G4
G4
G4
G4
G4
G4
G4
G4
G4
G4
G4
G4
G4
G4
G4
G4
G4
G4
G4
G4
G4
G4
G4
G4
G4
G4
G4
G4
G4
G4
G4
G4
G4
G4
G4
G4
G4
G4""")
gruppi_longitudinali_3 = Panel("""G1
G1
G1
G1
G1
G1
G1
G1
G1
G1
G1
G1
G1
G1
G1
G1
G1
G1
G1
G1
G1
G1
G1
G1
G1
G1
G1
G1
G1
G1
G1
G1
G1
G1
G1
G1
G1
G1
G1
G1
G1
G1
G1
G1
G1
G1
G1
G1
G2
G2
G2
G2
G2
G2
G2
G2
G2
G2
G2
G2
G2
G2
G2
G2
G2
G2
G2
G2
G2
G2
G2
G2
G2
G2
G2
G2
G2
G2
G2
G2
G2
G2
G2
G2
G2
G2
G2
G2
G2
G2
G2
G2
G2
G2
G2
G2
G3
G3
G3
G3
G3
G3
G3
G3
G3
G3
G3
G3
G3
G3
G3
G3
G3
G3
G3
G3
G3
G3
G3
G3
G3
G3
G3
G3
G3
G3
G3
G3
G3
G3
G3
G3
G3
G3
G3
G3
G3
G3
G3
G3
G3
G3
G3
G3
G4
G4
G4
G4
G4
G4
G4
G4
G4
G4
G4
G4
G4
G4
G4
G4
G4
G4
G4
G4
G4
G4
G4
G4
G4
G4
G4
G4
G4
G4
G4
G4
G4
G4
G4
G4
G4
G4
G4
G4
G4
G4
G4
G4
G4
G4
G4
G4""")
gruppi_longitudinali_4 = Panel("""G1
G1
G1
G1
G1
G1
G1
G1
G1
G1
G1
G1
G1
G1
G1
G1
G1
G1
G1
G1
G1
G1
G1
G1
G1
G1
G1
G1
G1
G1
G1
G1
G1
G1
G1
G1
G1
G1
G1
G1
G1
G1
G1
G1
G1
G1
G1
G1
G2
G2
G2
G2
G2
G2
G2
G2
G2
G2
G2
G2
G2
G2
G2
G2
G2
G2
G2
G2
G2
G2
G2
G2
G2
G2
G2
G2
G2
G2
G2
G2
G2
G2
G2
G2
G2
G2
G2
G2
G2
G2
G2
G2
G2
G2
G2
G2
G3
G3
G3
G3
G3
G3
G3
G3
G3
G3
G3
G3
G3
G3
G3
G3
G3
G3
G3
G3
G3
G3
G3
G3
G3
G3
G3
G3
G3
G3
G3
G3
G3
G3
G3
G3
G3
G3
G3
G3
G3
G3
G3
G3
G3
G3
G3
G3
G4
G4
G4
G4
G4
G4
G4
G4
G4
G4
G4
G4
G4
G4
G4
G4
G4
G4
G4
G4
G4
G4
G4
G4
G4
G4
G4
G4
G4
G4
G4
G4
G4
G4
G4
G4
G4
G4
G4
G4
G4
G4
G4
G4
G4
G4
G4
G4""")
g1_getto = G1_GETTO(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)
forze_nodali_n = Vector(Vector(0, 0, -11875.64221))
g1_getto_2 = G1_GETTO(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)
forze_nodali_n_2 = Vector([Vector(0, 0, -23751.28441), Vector(0, 0, -23751.28441), Vector(0, 0, -23751.28441), Vector(0, 0, -23751.28441), Vector(0, 0, -23751.28441), Vector(0, 0, -23751.28441)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])
g1_getto_3 = G1_GETTO(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)
forze_nodali_n_3 = Vector([Vector(0, 0, -23751.28441), Vector(0, 0, -11635.73024), Vector(0, 0, -23271.46049), Vector(0, 0, -11635.73024), Vector(0, 0, -11395.81828), Vector(0, 0, -22791.63656), Vector(0, 0, -11395.81828), Vector(0, 0, -11155.90632), Vector(0, 0, -22311.81263), Vector(0, 0, -11155.90632)])
g1_getto_4 = G1_GETTO(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)
forze_nodali_n_4 = Vector(Vector(0, 0, -11875.64221))
g2_permanenti = G2_PERMANENTI(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)
forze_nodali_n_5 = Vector(Vector(0, 0, -3356.923054))
g2_permanenti_2 = G2_PERMANENTI(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)
forze_nodali_n_6 = Vector([Vector(0, 0, -6713.846108), Vector(0, 0, -6713.846108), Vector(0, 0, -6713.846108), Vector(0, 0, -6713.846108), Vector(0, 0, -6713.846108), Vector(0, 0, -6713.846108)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])
g2_permanenti_3 = G2_PERMANENTI(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)
forze_nodali_n_7 = Vector([Vector(0, 0, -6713.846108), Vector(0, 0, -3289.106427), Vector(0, 0, -6578.212853), Vector(0, 0, -3289.106427), Vector(0, 0, -3221.289799), Vector(0, 0, -6442.579599), Vector(0, 0, -3221.289799), Vector(0, 0, -3153.473172), Vector(0, 0, -6306.946344), Vector(0, 0, -3153.473172)])
g2_permanenti_4 = G2_PERMANENTI(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)
forze_nodali_n_8 = Vector(Vector(0, 0, -3356.923054))
q_traffico = Q_TRAFFICO(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)
forze_nodali_n_9 = Vector(Vector(0, 0, -3356.923054))
q_traffico_2 = Q_TRAFFICO(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)
forze_nodali_n_10 = Vector([Vector(0, 0, -6713.846108), Vector(0, 0, -6713.846108), Vector(0, 0, -6713.846108), Vector(0, 0, -6713.846108), Vector(0, 0, -6713.846108), Vector(0, 0, -6713.846108)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])
q_traffico_3 = Q_TRAFFICO(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)
forze_nodali_n_11 = Vector([Vector(0, 0, -6713.846108), Vector(0, 0, -3289.106427), Vector(0, 0, -6578.212853), Vector(0, 0, -3289.106427), Vector(0, 0, -3221.289799), Vector(0, 0, -6442.579599), Vector(0, 0, -3221.289799), Vector(0, 0, -3153.473172), Vector(0, 0, -6306.946344), Vector(0, 0, -3153.473172)])
q_traffico_4 = Q_TRAFFICO(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)
forze_nodali_n_12 = Vector(Vector(0, 0, -3356.923054))
ritiro = RITIRO(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)
forze_nodali_n_13 = Vector(Vector(0, 0, 0))
ritiro_2 = RITIRO(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)
forze_nodali_n_14 = Vector([Vector(0, 0, 0), Vector(0, 0, 0), Vector(0, 0, 0), Vector(0, 0, 0), Vector(0, 0, 0), Vector(0, 0, 0)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])
ritiro_3 = RITIRO(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)
forze_nodali_n_15 = Vector([Vector(0, 0, 0), Vector(0, 0, 0), Vector(0, 0, 0), Vector(0, 0, 0), Vector(0, 0, 0), Vector(0, 0, 0), Vector(0, 0, 0), Vector(0, 0, 0), Vector(0, 0, 0), Vector(0, 0, 0)])
ritiro_4 = RITIRO(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)
forze_nodali_n_16 = Vector(Vector(0, 0, 0))
se = SuperElement(Element=bm, Name=gruppi_longitudinali)
se_2 = SuperElement(Element=bm_3, Name=gruppi_longitudinali_2)
se_3 = SuperElement(Element=bm_5, Name=gruppi_longitudinali_3)
se_4 = SuperElement(Element=bm_7, Name=gruppi_longitudinali_4)
ritiro_nativo = RitiroNativo(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)
nl = NodeLoad(Node=nr, LoadCase=g1_getto, Force=forze_nodali_n)
nl_2 = NodeLoad(Node=nr_2, LoadCase=g1_getto_2, Force=forze_nodali_n_2)
nl_3 = NodeLoad(Node=nr_3, LoadCase=g1_getto_3, Force=forze_nodali_n_3)
nl_4 = NodeLoad(Node=nr_4, LoadCase=g1_getto_4, Force=forze_nodali_n_4)
nl_5 = NodeLoad(Node=nr_5, LoadCase=g2_permanenti, Force=forze_nodali_n_5)
nl_6 = NodeLoad(Node=nr_6, LoadCase=g2_permanenti_2, Force=forze_nodali_n_6)
nl_7 = NodeLoad(Node=nr_7, LoadCase=g2_permanenti_3, Force=forze_nodali_n_7)
nl_8 = NodeLoad(Node=nr_8, LoadCase=g2_permanenti_4, Force=forze_nodali_n_8)
nl_9 = NodeLoad(Node=nr_9, LoadCase=q_traffico, Force=forze_nodali_n_9)
nl_10 = NodeLoad(Node=nr_10, LoadCase=q_traffico_2, Force=forze_nodali_n_10)
nl_11 = NodeLoad(Node=nr_11, LoadCase=q_traffico_3, Force=forze_nodali_n_11)
nl_12 = NodeLoad(Node=nr_12, LoadCase=q_traffico_4, Force=forze_nodali_n_12)
nl_13 = NodeLoad(Node=nr_13, LoadCase=ritiro, Force=forze_nodali_n_13)
nl_14 = NodeLoad(Node=nr_14, LoadCase=ritiro_2, Force=forze_nodali_n_14)
nl_15 = NodeLoad(Node=nr_15, LoadCase=ritiro_3, Force=forze_nodali_n_15)
nl_16 = NodeLoad(Node=nr_16, LoadCase=ritiro_4, Force=forze_nodali_n_16)
bpl = BeamPreLoad(Beam=se_4, LoadCase=ritiro_nativo, Type=1, Value=3.10554956e-05)
bgl = BeamGradientLoad(Beam=bpl, LoadCase=ritiro_nativo, Axis1=0, Axis2=-0.003899772251)
id_elementi = Panel("""1
2
3
4
5
6
7
8
9
10
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""")
id_elementi_2 = Panel("""193
194
195
205
206
207
217
218
219
229
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""")
id_elementi_3 = Panel("""1
2
3
4
5
6
7
8
9
10
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""")
id_elementi_4 = Panel("""193
194
195
196
197
198
199
200
201
202
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""")
id_elementi_5 = Panel("""1
2
3
4
5
6
7
8
9
10
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""")
id_elementi_6 = Panel("""193
194
195
196
197
198
199
200
201
202
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""")
id_elementi_7 = Panel("""1
2
3
4
5
6
7
8
9
10
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""")
id_elementi_8 = Panel("""193
194
195
196
197
198
199
200
201
202
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""")
calcola_4_modelli = BooleanToggle(False)
ei = ElementId(Element=se, ID=id_elementi)
ei_2 = ElementId(Element=bm_2, ID=id_elementi_2)
ei_3 = ElementId(Element=se_2, ID=id_elementi_3)
ei_4 = ElementId(Element=bm_4, ID=id_elementi_4)
ei_5 = ElementId(Element=se_3, ID=id_elementi_5)
ei_6 = ElementId(Element=bm_6, ID=id_elementi_6)
ei_7 = ElementId(Element=bgl, ID=id_elementi_7)
ei_8 = ElementId(Element=bm_8, ID=id_elementi_8)
bm_9 = BuildModel(Elements=[nl, nl_2, nl_3, nl_4, ei, ei_2], Name="Curvo continuo 25 + 25 m / R 120 m / G1_GETTO", Units=2)
bm_10 = BuildModel(Elements=[nl_5, nl_6, nl_7, nl_8, ei_3, ei_4], Name="Curvo continuo 25 + 25 m / R 120 m / G2_PERMANENTI", Units=2)
bm_11 = BuildModel(Elements=[nl_9, nl_10, nl_11, nl_12, ei_5, ei_6], Name="Curvo continuo 25 + 25 m / R 120 m / Q_TRAFFICO", Units=2)
bm_12 = BuildModel(Elements=[nl_13, nl_14, nl_15, nl_16, ei_7, ei_8], Name="Curvo continuo 25 + 25 m / R 120 m / RITIRO", Units=2)
file_straus = Panel("C:\Users\g.pacini\Documents\Repository\BridGHe\example\15-curvo-2campate\calcoli\gh-G1_GETTO.st7")
file_straus_2 = Panel("C:\Users\g.pacini\Documents\Repository\BridGHe\example\15-curvo-2campate\calcoli\gh-G2_PERMANENTI.st7")
file_straus_3 = Panel("C:\Users\g.pacini\Documents\Repository\BridGHe\example\15-curvo-2campate\calcoli\gh-Q_TRAFFICO.st7")
file_straus_4 = Panel("C:\Users\g.pacini\Documents\Repository\BridGHe\example\15-curvo-2campate\calcoli\gh-RITIRO.st7")
sa = StrausR3Analysis(
    Model=bm_9,
    Solver=0,
    AnalysisResults="G1_GETTO",
    OutputPath=file_straus,
    KeepRunning=calcola_4_modelli,
    ElementGuids="[]")
sa_2 = StrausR3Analysis(
    Model=bm_10,
    Solver=0,
    AnalysisResults="G2_PERMANENTI",
    OutputPath=file_straus_2,
    KeepRunning=calcola_4_modelli,
    ElementGuids="[]")
sa_3 = StrausR3Analysis(
    Model=bm_11,
    Solver=0,
    AnalysisResults="Q_TRAFFICO",
    OutputPath=file_straus_3,
    KeepRunning=calcola_4_modelli,
    ElementGuids="[]")
sa_4 = StrausR3Analysis(
    Model=bm_12,
    Solver=0,
    AnalysisResults="RITIRO",
    OutputPath=file_straus_4,
    KeepRunning=calcola_4_modelli,
    ElementGuids="[]")
dm = DecomposeModel(Model=sa)  # -> Nodes, Beams, Plates
dm_2 = DecomposeModel(Model=sa_2)  # -> Nodes, Beams, Plates
dm_3 = DecomposeModel(Model=sa_3)  # -> Nodes, Beams, Plates
dm_4 = DecomposeModel(Model=sa_4)  # -> Nodes, Beams, Plates
nr_17 = NodeResults(Node=dm.Nodes)  # -> LoadCasesD, StepsD, Displacements, Rotations, LoadCasesF, StepsF, Forces, Moments
nr_18 = NodeResults(Node=dm_2.Nodes)  # -> LoadCasesD, StepsD, Displacements, Rotations, LoadCasesF, StepsF, Forces, Moments
nr_19 = NodeResults(Node=dm_3.Nodes)  # -> LoadCasesD, StepsD, Displacements, Rotations, LoadCasesF, StepsF, Forces, Moments
nr_20 = NodeResults(Node=dm_4.Nodes)  # -> LoadCasesD, StepsD, Displacements, Rotations, LoadCasesF, StepsF, Forces, Moments
br = BeamResults(Beam=dm.Beams)  # -> LoadCases, Stations, Steps, ShearForces, BendingMoments, AxialForces, Torques
br_2 = BeamResults(Beam=dm_2.Beams)  # -> LoadCases, Stations, Steps, ShearForces, BendingMoments, AxialForces, Torques
br_3 = BeamResults(Beam=dm_3.Beams)  # -> LoadCases, Stations, Steps, ShearForces, BendingMoments, AxialForces, Torques
br_4 = BeamResults(Beam=dm_4.Beams)  # -> LoadCases, Stations, Steps, ShearForces, BendingMoments, AxialForces, Torques
u_mm = Panel(nr_17.Displacements)
bm1_bm2_nmm = Panel(br.BendingMoments)
t_nmm_conservata = Panel(br.Torques)
u_mm_2 = Panel(nr_18.Displacements)
bm1_bm2_nmm_2 = Panel(br_2.BendingMoments)
t_nmm_conservata_2 = Panel(br_2.Torques)
u_mm_3 = Panel(nr_19.Displacements)
bm1_bm2_nmm_3 = Panel(br_3.BendingMoments)
t_nmm_conservata_3 = Panel(br_3.Torques)
u_mm_4 = Panel(nr_20.Displacements)
bm1_bm2_nmm_4 = Panel(br_4.BendingMoments)
t_nmm_conservata_4 = Panel(br_4.Torques)
longitudinali = Panel("""G1
G2
G3
G4""")
longitudinali_2 = Panel("""G1
G2
G3
G4""")
longitudinali_3 = Panel("""G1
G2
G3
G4""")
longitudinali_4 = Panel("""G1
G2
G3
G4""")
# BridGHe: SLS dimostrativo con coefficienti unitari: G1 + G2 + Q + ritiro primario e secondario.
# RITIRO: un unico coefficiente per secondario FEM e strain primario; n ritiro = Ninf in questi modelli storici.
# Nei CSV i quattro contributi restano distinti. Soletta lorda non fessurata, armature escluse.
# CURVE: non attivare la verifica aspettandosi un esito completo. Il motore N-M-V rifiuta T/M2.
# Nessuna cancellazione o proiezione delle sollecitazioni non supportate.
sef = SuperElementFilter(BridGHeModel=sa, SuperElement=longitudinali)
sef_2 = SuperElementFilter(BridGHeModel=sa_2, SuperElement=longitudinali_2)
sef_3 = SuperElementFilter(BridGHeModel=sa_3, SuperElement=longitudinali_3)
sef_4 = SuperElementFilter(BridGHeModel=sa_4, SuperElement=longitudinali_4)
intstiff = BridgeIntermediateStiffener(
    Enabled=True,
    Layout=0,
    Width=200,
    Thickness=20,
    RightWidth=200,
    RightThickness=20,
    LeftPanel=4166.666667,
    RightPanel=4166.666667,
    EqualPanels=True,
    LengthFactor=1,
    ExternalCompressionKN=0,
    LoadX=0,
    CheckWelds=True,
    WeldThroat=6)
# PIOLI E IRRIGIDITORI gPC: Definizioni dei dettagli collegate ai risultati di sezione.
# Prima trave selezionata: appoggio e primo diaframma interno.
# Pioli: 2 x diam.22, h180, passo200 mm. Piatti intermedi 200x20, appoggio 250x25 mm.
# Reazione d'appoggio dimostrativa SLS: somma dei quattro casi; sostituire con inviluppo SLU per il progetto.
# Le verifiche conservano lo stato limite e l’ipotesi N-Mx-Vy del risultato sorgente; T, M2 e V1 restano esclusi anche nei dettagli.
# I dettagli non aggiungono automaticamente rigidezza o peso al graticcio equivalente.
studs = BridgeStuds(
    Enabled=True,
    CountPerRow=2,
    Diameter=22,
    Height=180,
    LongitudinalPitch=200,
    TransversePitch=150,
    Fu=450,
    GammaV=1.25,
    HeadDiameter=35,
    HeadThickness=10,
    RequiredCover=40,
    RepeatedActionDetail=True)
supstiff = BridgeSupportStiffener(
    Enabled=True,
    Layout=0,
    Width=250,
    Thickness=25,
    RightWidth=250,
    RightThickness=25,
    Location=1,
    LeftPanel=4166.666667,
    RightPanel=4166.666667,
    ReactionKN=338.8733964,
    EndDistance=250,
    LoadX=0,
    LoadZ=0,
    FootprintLength=400,
    FootprintWidth=600,
    LengthFactor=1,
    RigidEndPost=False,
    EndPostSpacing=300,
    CheckWelds=True,
    WeldThroat=8)
bm_13 = BuildModel(Elements=flatten(sef), Units=2)
bm_14 = BuildModel(Elements=flatten(sef_2), Units=2)
bm_15 = BuildModel(Elements=flatten(sef_3), Units=2)
bm_16 = BuildModel(Elements=flatten(sef_4), Units=2)
caso_sorgente = CasoSorgente(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)
caso_sorgente_2 = CasoSorgente(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)
caso_sorgente_3 = CasoSorgente(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)
caso_sorgente_4 = CasoSorgente(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)
shrinkageaction = BridgeShrinkageAction(ActionID="RITIRO", Model=bm_16, Case=caso_sorgente_4, StrainIncrement=-0.0001, PrimaryOnly=False, Response=0)
action = BridgeAction(ActionID="G1", Model=bm_13, Case=caso_sorgente, Behavior=0)
action_2 = BridgeAction(ActionID="G2", Model=bm_14, Case=caso_sorgente_2, Behavior=1)
action_3 = BridgeAction(ActionID="Q", Model=bm_15, Case=caso_sorgente_3, Behavior=2)
combinazione_sls_per_id_azione = Data(Tree({0}: ["", "G1", "G2", "Q", "RITIRO"], {1}: ["SLS_3F_RITIRO", "1", "1", "1", "1"]))
phase = BridgePhase(Number=10, Name="G1_GETTO", SectionState=0, Actions=action)
phase_2 = BridgePhase(Number=20, Name="G2_PERMANENTI", SectionState=1, Actions=action_2)
phase_3 = BridgePhase(Number=30, Name="Q_TRAFFICO", SectionState=1, Actions=action_3)
phase_4 = BridgePhase(Number=40, Name="RITIRO", SectionState=1, Actions=shrinkageaction)
buildbridge = BuildBridGHeModel(
    Models=[bm_13, bm_14, bm_15, bm_16],
    Phases=[phase, phase_2, phase_3, phase_4],
    Combinations=combinazione_sls_per_id_azione,
    Calculation=0,
    AdditionalPhaseMembers=False)  # -> Model, Phases, Diagnostics
travi = Panel("""G1
G2
G3
G4""")
sef_5 = SuperElementFilter(BridGHeModel=buildbridge.Model, SuperElement=travi)
h1600_soletta_250_b_2500 = H1600Soletta250B2500(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)
cb = CompositeBeam(Beam=sef_5, SectionStart=h1600_soletta_250_b_2500, SectionEnd=h1600_soletta_250_b_2500)
sec = SuperElementCheck(
    BridGHeModel=buildbridge.Model,
    SuperElementBeam=flatten(cb),
    WebLocalInstability=False,
    TopFlangeLocalInstability=False,
    BottomFlangeLocalInstability=False)  # -> TensionCheck, TauB, TensionForces
item = ListItem(List=flatten(sec.TensionCheck), Index=0, Wrap=True)
item_2 = ListItem(List=flatten(sec.TensionCheck), Index=20, Wrap=True)
detailcheck = BridgeDetailCheck(SectionResult=item, Studs=studs, SupportStiffener=supstiff)  # -> SectionResult, Check, Demand, Resistance, Units, Ratio, Status, Warnings
detailcheck_2 = BridgeDetailCheck(SectionResult=item_2, Studs=studs, IntermediateStiffener=intstiff)  # -> SectionResult, Check, Demand, Resistance, Units, Ratio, Status, Warnings
dettagli_appoggio = Panel(detailcheck.Status)
dettagli_intermedio = Panel(detailcheck_2.Status)
csltr = CompositeSectionLinearTensionResults(LinearTensionResults=sec.TensionCheck)  # -> Point1_ConcreteEpsilon, Point1_ConcreteSigma, Point2_RebarSigma, Point3_RebarSigma, Point4_ConcreteSigma, Point5_SteelSigma, Point6_SteelSigma, Point6_SteelTau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
sigma_cls_mpa = Panel(csltr.Point1_ConcreteSigma)
sigma_acciaio_mpa = Panel(csltr.Point8_SteelSigma)
