# Grasshopper definition 19-flusso-acciaio-misto_REV003.ghx (Grasshopper 1.0.8)
# plug-ins: BridGHe

# REV003 - flusso a fasi: Ponte a graticcio 30 + 30 m, impalcato 12 m, 3 travi e traversi ogni 5 m. N-mm-MPa.
# 1. Sezioni -> modello acciaio -> override n infinito / n0 / n ritiro.
# 2. CALCOLA 4 MODELLI STRAUS = true, poi false.
# 3. Run Build BridGHe Model, poi Run Super Element Check.
# Fasi 10/20/30/40; gli ID G1/G2/Q/RITIRO non dipendono dall'ordine dei modelli.
# RITIRO unisce strain primario e sollecitazioni FEM con un unico coefficiente.
# Rieseguire le analisi dopo ogni modifica della geometria, delle proprietà o dei carichi.
s355 = S355(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)
c32_40 = C3240(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)
b450 = B450(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)
g1 = Curve([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])
g2 = Curve([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])
g3 = Curve([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])
traversi = Curve([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])
nodi_appoggi = Point(Point(0, -4000, 0))
nodi_appoggi_2 = Point([Point(2500, -4000, 0), Point(5000, -4000, 0), Point(7500, -4000, 0), Point(10000, -4000, 0), Point(12500, -4000, 0), Point(15000, -4000, 0)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])
nodi_appoggi_3 = Point([Point(30000, -4000, 0), Point(0, 0, 0), Point(30000, 0, 0), Point(60000, 0, 0), Point(0, 4000, 0), Point(30000, 4000, 0), Point(60000, 4000, 0)])
nodi_appoggi_4 = Point(Point(60000, -4000, 0))
n0 = Panel("7")
n_infinito = Panel("18")
n_ritiro = Panel("12")
delta_epsilon_cs = Panel("-0.00020000000000000001")
N = Node(Point=nodi_appoggi)
N_2 = Node(Point=nodi_appoggi_2)
N_3 = Node(Point=nodi_appoggi_3)
N_4 = Node(Point=nodi_appoggi_4)
I = ISection(
    BottomFlangeWidth=800,
    TopFlangeWidth=600,
    Height=2000,
    BottomFlangeThickness=40,
    TopFlangeThickness=30,
    WebThickness=15,
    Radius=0)
I_2 = ISection(
    BottomFlangeWidth=600,
    TopFlangeWidth=500,
    Height=1600,
    BottomFlangeThickness=40,
    TopFlangeThickness=30,
    WebThickness=16,
    Radius=0)
I_3 = ISection(
    BottomFlangeWidth=300,
    TopFlangeWidth=300,
    Height=800,
    BottomFlangeThickness=20,
    TopFlangeThickness=20,
    WebThickness=12,
    Radius=0)
tx_ty_tz = TxTyTz([True, True, True])
rx_ry_rz_libere = RxRyRzLibere([False, False, False])
tx_ty_tz_2 = TxTyTz([False, False, False])
rx_ry_rz_libere_2 = RxRyRzLibere([False, False, False])
tx_ty_tz_3 = TxTyTz([False, False, True])
rx_ry_rz_libere_3 = RxRyRzLibere([False, False, False])
tx_ty_tz_4 = TxTyTz([False, True, True])
rx_ry_rz_libere_4 = RxRyRzLibere([False, False, False])
slab = ConcreteSlabSection(Height=250, Width=3000, RebarArea=3000, TopConcreteCover=45, BottomRebarArea=2000, BottomConcreteCover=50)
slab_2 = ConcreteSlabSection(Height=250, Width=3000, RebarArea=3000, TopConcreteCover=45, BottomRebarArea=2000, BottomConcreteCover=50)
id_stabili = Panel("""1
2
3
4
5
6
7
8
9
10
11
12
13
14
15
16
17
18
19
20
21
22
23
24""")
id_stabili_2 = Panel("""25
26
27
28
29
30
31
32
33
34
35
36
37
38
39
40
41
42
43
44
45
46
47
48""")
id_stabili_3 = Panel("""49
50
51
52
53
54
55
56
57
58
59
60
61
62
63
64
65
66
67
68
69
70
71
72""")
id_stabili_4 = Panel("""73
74
75
76
77
78
79
80
81
82
83
84
85
86
87
88
89
90
91
92
93
94
95
96
97
98""")
nr = Restraints(Node=N, Transational=tx_ty_tz, Rotation=rx_ry_rz_libere)
nr_2 = Restraints(Node=N_2, Transational=tx_ty_tz_2, Rotation=rx_ry_rz_libere_2)
nr_3 = Restraints(Node=N_3, Transational=tx_ty_tz_3, Rotation=rx_ry_rz_libere_3)
nr_4 = Restraints(Node=N_4, Transational=tx_ty_tz_4, Rotation=rx_ry_rz_libere_4)
bp = BeamProperty(
    Name="Traversi H800",
    Type=5,
    Section=I_3,
    Material=s355,
    Name_2="Traversi H800",
    Type_2=5,
    Section_2=I_3,
    Material_2=s355,
    Release=1)  # -> Property, Property_2
bm = Beam(Line=traversi, Property=bp.Property_2, Angle=0)
se = SuperElement(Element=bm, Name="CROSS")
cs = CompositeBeamProperty(
    Name="Spina H2000 + soletta efficace 3000x250",
    ConcreteSlabSection=slab,
    SteelSection=I,
    ConcreteMaterial=c32_40,
    SteelMaterial=s355,
    ReinforcementMaterial=b450,
    N0=n0,
    N=n_infinito,
    NRitiro=n_ritiro,
    ConsiderConcrete=True,
    ConsiderRebars=True)  # -> CompositeSection, OnlySteelProperty, N0BeamSection, NBeamSection, NRitiroBeamSection
bm_2 = Beam(Line=g2, Property=cs.OnlySteelProperty, Angle=0)
se_2 = SuperElement(Element=bm_2, Name="G2")
cs_2 = CompositeBeamProperty(
    Name="Laterali H1600 + soletta efficace 3000x250",
    ConcreteSlabSection=slab_2,
    SteelSection=I_2,
    ConcreteMaterial=c32_40,
    SteelMaterial=s355,
    ReinforcementMaterial=b450,
    N0=n0,
    N=n_infinito,
    NRitiro=n_ritiro,
    ConsiderConcrete=True,
    ConsiderRebars=True)  # -> CompositeSection, OnlySteelProperty, N0BeamSection, NBeamSection, NRitiroBeamSection
bm_3 = Beam(Line=g1, Property=cs_2.OnlySteelProperty, Angle=0)
bm_4 = Beam(Line=g3, Property=cs_2.OnlySteelProperty, Angle=0)
se_3 = SuperElement(Element=bm_3, Name="G1")
se_4 = SuperElement(Element=bm_4, Name="G3")
ei = ElementId(Element=se_3, ID=id_stabili)
ei_2 = ElementId(Element=se_2, ID=id_stabili_2)
ei_3 = ElementId(Element=se_4, ID=id_stabili_3)
ei_4 = ElementId(Element=se, ID=id_stabili_4)
bm_5 = BuildModel(Elements=flatten([ei, ei_2, ei_3, ei_4, nr, nr_2, nr_3, nr_4]), Name="Ponte base acciaio 30+30 m", Units=2)
dm = DecomposeModel(Model=bm_5)  # -> Nodes, Beams, Plates
gruppi = Panel("G2")
gruppi_2 = Panel("""G1
G3""")
gruppi_3 = Panel("CROSS")
sef = SuperElementFilter(BridGHeModel=bm_5, SuperElement=gruppi)
sef_2 = SuperElementFilter(BridGHeModel=bm_5, SuperElement=gruppi_2)
sef_3 = SuperElementFilter(BridGHeModel=bm_5, SuperElement=gruppi_3)
calcola_4_modelli_straus = BooleanToggle(False)
g1_getto = G1_GETTO(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)
g2_permanenti = G2_PERMANENTI(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)
q_traffico = Q_TRAFFICO(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)
ritiro_fem = RITIRO_FEM(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)
modello_1 = Panel("G1_GETTO")
modello_2 = Panel("G2_PERMANENTI")
modello_3 = Panel("Q_TRAFFICO")
modello_4 = Panel("RITIRO_FEM")
shrinkage = CompositeShrinkageActions(CompositeProperty=cs.CompositeSection, ConcreteStrain=delta_epsilon_cs)  # -> StrausPreStrain, Axis2ThermalGradient, FreeCentroidStrain, FreeCurvature
shrinkage_2 = CompositeShrinkageActions(CompositeProperty=cs_2.CompositeSection, ConcreteStrain=delta_epsilon_cs)  # -> StrausPreStrain, Axis2ThermalGradient, FreeCentroidStrain, FreeCurvature
bo = BeamOverride(Beam=sef, Property=cs.NBeamSection)
bo_2 = BeamOverride(Beam=sef_2, Property=cs_2.NBeamSection)
bo_3 = BeamOverride(Beam=sef, Property=cs.N0BeamSection)
bo_4 = BeamOverride(Beam=sef_2, Property=cs_2.N0BeamSection)
bo_5 = BeamOverride(Beam=sef, Property=cs.NRitiroBeamSection)
bo_6 = BeamOverride(Beam=sef_2, Property=cs_2.NRitiroBeamSection)
bdl = BeamDistributedLoad(Beam=sef, LoadCase=g1_getto, Type=0, Direction=1, PA=-33, A=0, B=0)
bdl_2 = BeamDistributedLoad(Beam=sef_2, LoadCase=g1_getto, Type=0, Direction=1, PA=-33, A=0, B=0)
bdl_3 = BeamDistributedLoad(Beam=bo, LoadCase=g2_permanenti, Type=0, Direction=1, PA=-10, A=0, B=0)
bdl_4 = BeamDistributedLoad(Beam=bo_2, LoadCase=g2_permanenti, Type=0, Direction=1, PA=-10, A=0, B=0)
bdl_5 = BeamDistributedLoad(Beam=bo_3, LoadCase=q_traffico, Type=0, Direction=1, PA=-10, A=0, B=0)
bdl_6 = BeamDistributedLoad(Beam=bo_4, LoadCase=q_traffico, Type=0, Direction=1, PA=-10, A=0, B=0)
bpl = BeamPreLoad(Beam=bo_5, LoadCase=ritiro_fem, Type=1, Value=shrinkage.StrausPreStrain)
bpl_2 = BeamPreLoad(Beam=bo_6, LoadCase=ritiro_fem, Type=1, Value=shrinkage_2.StrausPreStrain)
bgl = BeamGradientLoad(Beam=bpl, LoadCase=ritiro_fem, Axis1=0, Axis2=shrinkage.Axis2ThermalGradient)
bgl_2 = BeamGradientLoad(Beam=bpl_2, LoadCase=ritiro_fem, Axis1=0, Axis2=shrinkage_2.Axis2ThermalGradient)
bm_6 = BuildModel(Elements=flatten([dm.Nodes, sef_3, bdl, bdl_2]), Name="G1_GETTO", Units=2)
bm_7 = BuildModel(Elements=flatten([dm.Nodes, sef_3, bdl_3, bdl_4]), Name="G2_PERMANENTI", Units=2)
bm_8 = BuildModel(Elements=flatten([dm.Nodes, sef_3, bdl_5, bdl_6]), Name="Q_TRAFFICO", Units=2)
bm_9 = BuildModel(Elements=flatten([dm.Nodes, sef_3, bgl, bgl_2]), Name="RITIRO_FEM", Units=2)
sa = StrausR3Analysis(
    Model=bm_6,
    Solver=0,
    AnalysisResults="G1_GETTO",
    OutputPath="C:\Users\g.pacini\Documents\Repository\BridGHe\example\19-flusso-acciaio-misto\calcoli\REV003-G1_GETTO.st7",
    KeepRunning=calcola_4_modelli_straus,
    ElementGuids="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")
sa_2 = StrausR3Analysis(
    Model=bm_7,
    Solver=0,
    AnalysisResults="G2_PERMANENTI",
    OutputPath="C:\Users\g.pacini\Documents\Repository\BridGHe\example\19-flusso-acciaio-misto\calcoli\REV003-G2_PERMANENTI.st7",
    KeepRunning=calcola_4_modelli_straus,
    ElementGuids="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")
sa_3 = StrausR3Analysis(
    Model=bm_8,
    Solver=0,
    AnalysisResults="Q_TRAFFICO",
    OutputPath="C:\Users\g.pacini\Documents\Repository\BridGHe\example\19-flusso-acciaio-misto\calcoli\REV003-Q_TRAFFICO.st7",
    KeepRunning=calcola_4_modelli_straus,
    ElementGuids="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")
sa_4 = StrausR3Analysis(
    Model=bm_9,
    Solver=0,
    AnalysisResults="RITIRO_FEM",
    OutputPath="C:\Users\g.pacini\Documents\Repository\BridGHe\example\19-flusso-acciaio-misto\calcoli\REV003-RITIRO_FEM.st7",
    KeepRunning=calcola_4_modelli_straus,
    ElementGuids="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")
sef_4 = SuperElementFilter(BridGHeModel=sa, SuperElement="G2")
sef_5 = SuperElementFilter(BridGHeModel=sa_2, SuperElement="G2")
sef_6 = SuperElementFilter(BridGHeModel=sa_3, SuperElement="G2")
sef_7 = SuperElementFilter(BridGHeModel=sa_4, SuperElement="G2")
bm_10 = BuildModel(Elements=flatten(sef_4), Units=2)
bm_11 = BuildModel(Elements=flatten(sef_5), Units=2)
bm_12 = BuildModel(Elements=flatten(sef_6), Units=2)
bm_13 = BuildModel(Elements=flatten(sef_7), Units=2)
# CAMPO E IPOTESI: Modello tridimensionale: 75 nodi, 72 beam longitudinali + 26 traversi. Appoggi a x=0/30/60 m; rotazioni libere.
# Tre sezioni di acciaio; soletta equivalente di larghezza efficace 3 m per trave, due file di armature.
# I traversi mantengono la rigidezza d'acciaio: soletta trasversale non modellata.
# G1=33, G2=10, Q=10 N/mm per longitudinale: valori didattici, non peso proprio automatico.
# Il checker è collegato alla sola spina G2, con carichi simmetrici. Le laterali conservano gli effetti torsionali nel FEM.
# TEST_Q20 e TEST_G2_10 riprendono i fattori maggiorati di REV002: non sono combinazioni normative.
# Il vento di REV002 resta nel file originale: richiede torsione/flessione deviata, fuori dal campo del checker H.
# Cumulative conserva il metodo numerico; LinearHistory segue gli incrementi N-M e non verifica tau/pioli.
# La verifica di un ponte richiede anche carichi mobili, combinazioni di progetto, torsione, fatica, connessioni e stabilità.
coefficienti_didattici_per_id_azione = Data(Tree({0}: ["", "G1", "G2", "Q", "RITIRO"], {1}: ["SLS_DEMO", "1", "1", "1", "1"], {2}: ["TEST_Q20", "1.3", "1.5", "20", "1"], {3}: ["TEST_G2_10", "1", "10", "1.3", "1"]))
shrinkageaction = BridgeShrinkageAction(ActionID="RITIRO", Model=bm_13, Case=ritiro_fem, StrainIncrement=delta_epsilon_cs, PrimaryOnly=False, Response=0)
action = BridgeAction(ActionID="G1", Model=bm_10, Case=g1_getto, Behavior=0)
action_2 = BridgeAction(ActionID="G2", Model=bm_11, Case=g2_permanenti, Behavior=1)
action_3 = BridgeAction(ActionID="Q", Model=bm_12, Case=q_traffico, Behavior=2)
phase = BridgePhase(Number=10, Name="G1_GETTO", SectionState=0, Actions=action)
phase_2 = BridgePhase(Number=20, Name="G2_PERMANENTI", SectionState=1, Actions=action_2)
phase_3 = BridgePhase(Number=30, Name="Q_TRAFFICO", SectionState=1, Actions=action_3)
phase_4 = BridgePhase(Number=40, Name="RITIRO_FEM", SectionState=1, Actions=shrinkageaction)
buildbridge = BuildBridGHeModel(
    Models=[bm_10, bm_11, bm_12, bm_13],
    Phases=[phase, phase_2, phase_3, phase_4],
    Combinations=coefficienti_didattici_per_id_azione,
    Calculation=0,
    AdditionalPhaseMembers=False)  # -> Model, Phases, Diagnostics
display = DisplaySettings(
    Enabled=True,
    Geometry=True,
    Sections=True,
    Shaded=True,
    Reinforcement=True,
    Loads=True,
    Supports=True,
    Releases=True,
    OtherAttributes=True,
    Axes=False,
    Labels=False,
    SymbolScale=1,
    LoadScale=1,
    Transparency=0.65)
sef_8 = SuperElementFilter(BridGHeModel=buildbridge.Model, SuperElement="G2")
cb = CompositeBeam(Beam=sef, SectionStart=cs.CompositeSection)
cb_2 = CompositeBeam(Beam=sef_2, SectionStart=cs_2.CompositeSection)
fase_origine = Panel(buildbridge.Phases)
cb_3 = CompositeBeam(Beam=sef_8, SectionStart=cs.CompositeSection)
preview = PreviewBridGHeModel(ModelElements=bm_5, Settings=display)
preview_2 = PreviewBridGHeModel(ModelElements=cb, Settings=display)
preview_3 = PreviewBridGHeModel(ModelElements=cb_2, Settings=display)
sec = SuperElementCheck(
    BridGHeModel=buildbridge.Model,
    SuperElementBeam=cb_3,
    WebLocalInstability=False,
    TopFlangeLocalInstability=False,
    BottomFlangeLocalInstability=False)  # -> TensionCheck, TauB, TensionForces
forceplot = BridgeForcePlot(
    BridGHeModel=buildbridge.Model,
    SuperElementBeam=cb_3,
    Results=sec.TensionForces,
    Quantity=4,
    ShowMinMaxCombo=True,
    KeepRunning=True)  # -> SVG, File, Minimum, Maximum
stressplot = BridgeStressPlot(
    BridGHeModel=buildbridge.Model,
    SuperElementBeam=cb_3,
    Results=sec.TensionCheck,
    Quantity=4,
    ShowMinMaxCombo=True,
    KeepRunning=True)  # -> SVG, File, Minimum, Maximum
plotpreview = BridgePlotPreview(SVG=flatten(forceplot.SVG), Index=0, Width=600)
plotpreview_2 = BridgePlotPreview(SVG=flatten(stressplot.SVG), Index=0, Width=600)
