# Grasshopper definition 19-flusso-acciaio-misto_REV002.ghx (Grasshopper 1.0.8)
# plug-ins: TT Toolbox, BridGHe

larghezza_piattabanda_superiore = Slider(600, range=0..1000)
larghezza_piattabanda_inferiore = Slider(800, range=0..1000)
spessore_piattabanda_superiore = Slider(30, range=0..100)
spessore_piattabanda_inferiore = Slider(40, range=0..100)
spessore_anima = Slider(15, range=0..100)
altezza = Slider(2000, range=0..10000)

larghezza_soletta_collaborante = Slider(2500, range=0..10000)
diametro_armatura_superiore = Slider(16, range=10..32)
diametro_armatura_inferiore = Slider(16, range=10..32)
passo_armatura_superiore_cm = Slider(10, range=10..25)
passo_armatura_inferiore_cm = Slider(10, range=10..25)
copriferro_superiore_mm = Slider(50, range=0..100)
copriferro_inferiore_mm = Slider(50, range=0..100)
altezza_soletta = Slider(300, range=0..1000)

i_section = ISection(
    BottomFlangeWidth=larghezza_piattabanda_superiore,
    TopFlangeWidth=larghezza_piattabanda_inferiore,
    Height=altezza,
    BottomFlangeThickness=spessore_piattabanda_superiore,
    TopFlangeThickness=spessore_piattabanda_inferiore,
    WebThickness=spessore_anima,
    Radius=0)

# ----
# Input Curve della travata
_12_elementi_2_campate_da_12000_mm = Curve([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])

# ----
# COME USARE: 01 | Un unico modello acciaio assemblato.
# 02 | Tre copie con Beam Override: n infinito, n0, n ritiro.
# 03 | Quattro analisi Straus incrementali; non sommare modelli già cumulativi.
# 04 | Merge ordinato e matching esplicito dei casi; poi assegnazione della sezione mista e verifica.
# Aprire: risultati Straus già memorizzati. Premere Run su Build BridGHe Model, poi Run su Super Element Check.
# Se si modificano input: CALCOLA = true, poi false, poi i due Run.
# Esempio didattico di trave continua a due campate 12 + 12 m, N-mm-MPa. Non è un progetto completo di ponte.
panel = Panel("C32/40")

# ----
# Nodo Iniziale
appoggio_fisso = Point(Point(0, 0, 0))

# ----
# Nodo Finale
appoggi_scorrevoli = Point([Point(12000, 0, 0), Point(24000, 0, 0)])

# ----
# Nodo Intermedi
nodi_intermedi_vincoli_fuori_piano = Point([Point(2000, 0, 0), Point(4000, 0, 0), Point(6000, 0, 0), Point(8000, 0, 0), Point(10000, 0, 0), Point(14000, 0, 0), Point(16000, 0, 0), Point(18000, 0, 0), Point(20000, 0, 0), Point(22000, 0, 0)])

concrete = Concrete(Name=panel, Grade=6)
steel = Steel(Name="S355", Grade=2)
cluster = Cluster(radius=diametro_armatura_superiore, A=larghezza_soletta_collaborante, B=passo_armatura_superiore_cm)
cluster_2 = Cluster(radius=diametro_armatura_inferiore, A=larghezza_soletta_collaborante, B=passo_armatura_inferiore_cm)

# ---- group: SEZIONE UNICA - proprietà di fase
b450 = B450(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)
concrete_slab_section = ConcreteSlabSection(
    Height=250,
    Width=3000,
    RebarArea=cluster,
    TopConcreteCover=copriferro_superiore_mm,
    BottomRebarArea=cluster_2,
    BottomConcreteCover=copriferro_inferiore_mm)
n0 = Panel("7")
n_infinito = Panel("18")
n_ritiro = Panel("12")
epsilon_ritiro = Panel("-0.00020000000000000001")
composite_beam_property = CompositeBeamProperty(
    Name="H1600 + soletta 3000x250",
    ConcreteSlabSection=concrete_slab_section,
    SteelSection=i_section,
    ConcreteMaterial=concrete,
    SteelMaterial=steel,
    ReinforcementMaterial=b450,
    N0=n0,
    N=n_infinito,
    ConsiderRebars=True,
    NRitiro=n_ritiro)  # -> CompositeSection, OnlySteelProperty, N0BeamSection, NBeamSection, NRitiroBeamSection
composite_shrinkage_actions = CompositeShrinkageActions(CompositeProperty=composite_beam_property.CompositeSection, ConcreteStrain=epsilon_ritiro)  # -> StrausPreStrain, Axis2ThermalGradient, FreeCentroidStrain, FreeCurvature

# ----
group = Group("Travi Principali::Trave 1")
beam = Beam(Line=_12_elementi_2_campate_da_12000_mm, Property=composite_beam_property.OnlySteelProperty, Groups=group, Angle=0)
node = Node(Point=appoggio_fisso)
node_2 = Node(Point=appoggi_scorrevoli)
node_3 = Node(Point=nodi_intermedi_vincoli_fuori_piano)
tx_ty_tz = TxTyTz([True, True, True])
rx_ry_rz = RxRyRz([True, False, True])
tx_ty_tz_2 = TxTyTz([False, True, True])
rx_ry_rz_2 = RxRyRz([True, False, True])
tx_ty_tz_3 = TxTyTz([False, True, False])
rx_ry_rz_3 = RxRyRz([True, False, True])
beam_output_stations = BeamOutputStations(Beam=beam, OutputStations=Slider(4, range=0..10))
restraints = Restraints(Node=node, Transational=tx_ty_tz, Rotation=rx_ry_rz)
restraints_2 = Restraints(Node=node_2, Transational=tx_ty_tz_2, Rotation=rx_ry_rz_2)
restraints_3 = Restraints(Node=node_3, Transational=tx_ty_tz_3, Rotation=rx_ry_rz_3)
super_element = SuperElement(Element=beam_output_stations, Name="SE_Travata 1")
list_length = ListLength(List=super_element)
series = Series(Start=1, Step=1, Count=list_length)
element_id = ElementId(Element=super_element, ID=series)
merge = Merge(Data1=flatten(element_id), Data2=flatten(restraints), Data3=flatten(restraints_2), Data4=flatten(restraints_3))
build_model = BuildModel(Elements=merge, Name="Base - solo acciaio", Units=2)
decompose_model = DecomposeModel(Model=build_model)  # -> Nodes, Beams, Plates
beam_filter = BeamFilter(Beams=decompose_model.Beams, Units=2, Groups=group)  # -> Beams, Others

# ---- group: FASE 4
modello_4 = Panel("RITIRO_PRIMARIO | n ritiro = 12")
beam_filter_2 = BeamFilter(Beams=beam_filter.Beams, Units=2, Groups=group)  # -> Beams, Others
load_case = LoadCase(Name="RITIRO_PRIMARIO", GravityNSM=False)
composite_beam_strain = CompositeBeamStrain(Beam=beam_filter_2.Beams, LoadCase=load_case, Strain=epsilon_ritiro)
build_model_2 = BuildModel(Elements=composite_beam_strain, Name="Risultati 4", Units=2)

# ----
calcola_4_modelli_straus = BooleanToggle(False)

# ---- group: FASE 3
panel_2 = Panel("""Q_TRAFFICO
WIND_1""")
modello_3 = Panel("Q_TRAFFICO | n0 = 7")
beam_override = BeamOverride(Beam=beam_filter.Beams, Property=composite_beam_property.N0BeamSection)
load_case_2 = LoadCase(Name=panel_2, GravityNSM=False)
beam_distributed_load = BeamDistributedLoad(Beam=beam_override, LoadCase=load_case_2, Type=0, Direction=1, PA=-12, A=0, B=0)
build_model_3 = BuildModel(Elements=flatten([beam_distributed_load, decompose_model.Nodes]), Name="Q_TRAFFICO", Units=2)
straus_r3_analysis = StrausR3Analysis(
    Model=build_model_3,
    Solver=0,
    AnalysisResults=panel_2,
    OutputPath="C:\Users\g.pacini\Documents\Repository\BridGHe\example\19-flusso-acciaio-misto\archivio\REV001\calcoli\Q_TRAFFICO.st7",
    KeepRunning=calcola_4_modelli_straus,
    ElementGuids="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")

# ---- group: FASE 2
panel_3 = Panel("""G2_SOLETTA
G2_FINITURE
G2_BARRIERE""")
modello_2 = Panel("G2_PERMANENTI | n infinito = 18")
beam_override_2 = BeamOverride(Beam=beam_filter.Beams, Property=composite_beam_property.NBeamSection)
load_case_3 = LoadCase(Name=panel_3, GravityNSM=False)
beam_distributed_load_2 = BeamDistributedLoad(Beam=beam_override_2, LoadCase=load_case_3, Type=0, Direction=1, PA=-4, A=0, B=0)
list_length_2 = ListLength(List=panel_3)
duplicate_data = DuplicateData(Data=1, Number=list_length_2, Order=True)
load_combination = LoadCombination(Name="G2_PERMANENTI", LoadCases=load_case_3, Coefficients=duplicate_data)
build_model_4 = BuildModel(
    Elements=flatten([beam_distributed_load_2, decompose_model.Nodes]),
    Name="G2_PERMANENTI",
    Units=2,
    LoadCombinations=load_combination)
straus_r3_analysis_2 = StrausR3Analysis(
    Model=build_model_4,
    Solver=0,
    AnalysisResults="G2_PERMANENTI",
    OutputPath="C:\Users\g.pacini\Documents\Repository\BridGHe\example\19-flusso-acciaio-misto\archivio\REV001\calcoli\G2_PERMANENTI.st7",
    KeepRunning=calcola_4_modelli_straus,
    ElementGuids="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")

# ---- group: FASE 1
modello_1 = Panel("G1_GETTO | solo acciaio")
load_case_4 = LoadCase(Name="G1_GETTO", GravityNSM=False)
beam_distributed_load_3 = BeamDistributedLoad(Beam=beam_filter.Beams, LoadCase=load_case_4, Type=0, Direction=1, PA=-8, A=0, B=0)
build_model_5 = BuildModel(Elements=flatten([beam_distributed_load_3, decompose_model.Nodes]), Name="G1_GETTO", Units=2)
straus_r3_analysis_3 = StrausR3Analysis(
    Model=build_model_5,
    Solver=0,
    AnalysisResults="G1_GETTO",
    OutputPath="C:\Users\g.pacini\Documents\Repository\BridGHe\example\19-flusso-acciaio-misto\archivio\REV001\calcoli\G1_GETTO.st7",
    KeepRunning=calcola_4_modelli_straus,
    ElementGuids="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")

# ----
load_case_5 = LoadCase(Name="RITIRO_FEM_GRAD", GravityNSM=False)
list_length_3 = ListLength(List=panel_3)
duplicate_data_2 = DuplicateData(Data=1, Number=list_length_3, Order=True)
results = ValueList({"Dead", "RITIRO_FEM", "RITIRO_FEM_GRAD"}, selected="RITIRO_FEM")  # disabled
results_2 = ValueList({"Dead", "RITIRO_FEM_GRAD", "RITIRO_FEM_LIN", "RITIRO_FEM"}, selected="RITIRO_FEM")

# ----
# Preview Model Fase 0
display_settings = DisplaySettings(
    Enabled=True,
    Geometry=True,
    Sections=True,
    Shaded=True,
    Reinforcement=True,
    Loads=False,
    Supports=True,
    Releases=True,
    OtherAttributes=True,
    Axes=False,
    Labels=False,
    SymbolScale=1,
    LoadScale=1,
    Transparency=0.65)
preview_bridghe_model = PreviewBridGHeModel(ModelElements=build_model_5, Settings=display_settings)

# ----
# Preview Model Fase 1
display_settings_2 = DisplaySettings(
    Enabled=True,
    Geometry=True,
    Sections=True,
    Shaded=True,
    Reinforcement=True,
    Loads=False,
    Supports=True,
    Releases=True,
    OtherAttributes=True,
    Axes=False,
    Labels=False,
    SymbolScale=1,
    LoadScale=1,
    Transparency=0.65)
preview_bridghe_model_2 = PreviewBridGHeModel(ModelElements=build_model_4, Settings=display_settings_2)

# ----
# Preview Model Fase 2
display_settings_3 = DisplaySettings(
    Enabled=True,
    Geometry=True,
    Sections=True,
    Shaded=True,
    Reinforcement=True,
    Loads=False,
    Supports=True,
    Releases=True,
    OtherAttributes=True,
    Axes=False,
    Labels=False,
    SymbolScale=1,
    LoadScale=1,
    Transparency=0.65)
preview_bridghe_model_3 = PreviewBridGHeModel(ModelElements=build_model_3, Settings=display_settings_3)

panel_4 = Panel("C:\Users\g.pacini\Documents\Repository\BridGHe\example\19-flusso-acciaio-misto\archivio\REV002\Combo_REV002.xlsx")
phase_ninf_strain_load_cases = ValueList({"5-RITIRO_PRIMARIO"}, selected="5-RITIRO_PRIMARIO")
phase_n0_strain_load_cases = ValueList({"5-RITIRO_PRIMARIO"}, selected=[])
phase_n_ritiro_fem_load_cases = ValueList({"1-G1_GETTO", "2-G2_PERMANENTI", "3-Q_TRAFFICO", "3-WIND_1", "4-RITIRO_FEM"}, selected="4-RITIRO_FEM")
phase_ninf_load_cases = ValueList({"1-G1_GETTO", "2-G2_PERMANENTI", "3-Q_TRAFFICO", "3-WIND_1", "4-RITIRO_FEM"}, selected="2-G2_PERMANENTI")
phase_n0_load_cases = ValueList({"1-G1_GETTO", "2-G2_PERMANENTI", "3-Q_TRAFFICO", "3-WIND_1", "4-RITIRO_FEM"}, selected=["3-Q_TRAFFICO", "3-WIND_1"])
phase_inf_load_cases = ValueList({"1-G1_GETTO", "2-G2_PERMANENTI", "3-Q_TRAFFICO", "3-WIND_1", "4-RITIRO_FEM"}, selected="1-G1_GETTO")
read_excel_sheet = ReadExcelSheet(Run=Toggle(True), FilePath=panel_4, Worksheet="COMBINAZIONI", Listen=False)  # -> UserMessages, Columns, Rows
super_element_2 = ValueList({"SE_Travata 1"}, selected="SE_Travata 1")
# LIMITI DELL'ESEMPIO: Analisi lineari incrementali di una trave nel piano, soletta non fessurata.
# Tre fasi di carico + ritiro FEM + autotensione.
# Le fasi usano le stesse geometrie, ID, assi e vincoli.
# J è quello dell'acciaio, come nel componente precedente.
# Coefficienti unitari didattici: nessuna combinazione normativa è implicita.
# Tau b resta NaN; non usare questo output come verifica della connessione.
# Restano da definire SLU, fatica, pioli, instabilità, soletta trasversale e azioni orizzontali.
super_element_3 = ValueList({"SE_Travata 1"}, selected="SE_Travata 1")
display_settings_4 = DisplaySettings(
    Enabled=True,
    Geometry=True,
    Sections=True,
    Shaded=True,
    Reinforcement=True,
    Loads=False,
    Supports=True,
    Releases=True,
    OtherAttributes=True,
    Axes=False,
    Labels=False,
    SymbolScale=1,
    LoadScale=1,
    Transparency=0.65)
bridghe_panel = BridGHePanel()
bridge_intermediate_stiffener = BridgeIntermediateStiffener(
    Enabled=True,
    Layout=0,
    Width=200,
    Thickness=20,
    RightWidth=200,
    RightThickness=20,
    LeftPanel=3333.333333,
    RightPanel=3333.333333,
    EqualPanels=True,
    LengthFactor=1,
    ExternalCompressionKN=0,
    LoadX=0,
    CheckWelds=True,
    WeldThroat=6)
# PIOLI E IRRIGIDITORI gPC: Definizioni dei dettagli collegate ai risultati di sezione.
# Prima trave selezionata: appoggio e primo diaframma interno.
# Pioli: 2 x diam.22, h180, passo200 mm. Piatti intermedi 200x20, appoggio 250x25 mm.
# Reazione d'appoggio dimostrativa SLS: somma dei quattro casi; sostituire con inviluppo SLU per il progetto.
# Le verifiche conservano lo stato limite del risultato sorgente. Nei curvi BridgeChecks blocca prima la torsione H.
# I dettagli non aggiungono automaticamente rigidezza o peso al graticcio equivalente.
bridge_studs = BridgeStuds(
    Enabled=True,
    CountPerRow=2,
    Diameter=22,
    Height=180,
    LongitudinalPitch=200,
    TransversePitch=150,
    Fu=450,
    GammaV=1.25,
    HeadDiameter=35,
    HeadThickness=10,
    RequiredCover=40,
    RepeatedActionDetail=True)
bridge_support_stiffener = BridgeSupportStiffener(
    Enabled=True,
    Layout=0,
    Width=250,
    Thickness=25,
    RightWidth=250,
    RightThickness=25,
    Location=1,
    LeftPanel=3333.333333,
    RightPanel=3333.333333,
    ReactionKN=228.9770519,
    EndDistance=250,
    LoadX=0,
    LoadZ=0,
    FootprintLength=400,
    FootprintWidth=600,
    LengthFactor=1,
    RigidEndPost=False,
    EndPostSpacing=300,
    CheckWelds=True,
    WeldThroat=8)

# ---- group: FASE 4
modello_4_2 = Panel("RITIRO_FEM | n ritiro = 12")
beam_override_3 = BeamOverride(Beam=beam_filter.Beams, Property=composite_beam_property.NRitiroBeamSection)
load_case_6 = LoadCase(Name="RITIRO_FEM_LIN", GravityNSM=False)
beam_preload = BeamPreLoad(Beam=beam_override_3, LoadCase=load_case_6, Type=1, Value=composite_shrinkage_actions.StrausPreStrain)
beam_gradient_load = BeamGradientLoad(Beam=beam_preload, LoadCase=load_case_5, Axis1=0, Axis2=composite_shrinkage_actions.Axis2ThermalGradient)

# ----
merge_2 = Merge(Data1=load_case_6, Data2=load_case_5)
load_combination_2 = LoadCombination(Name="RITIRO_FEM", LoadCases=merge_2, Coefficients=duplicate_data_2)

# ---- group: FASE 4 (continued)
build_model_6 = BuildModel(
    Elements=flatten([beam_gradient_load, decompose_model.Nodes]),
    Name="RITIRO_FEM",
    Units=2,
    LoadCombinations=load_combination_2)
straus_r3_analysis_4 = StrausR3Analysis(
    Model=build_model_6,
    Solver=0,
    AnalysisResults=results_2,
    OutputPath="C:\Users\g.pacini\Documents\Repository\BridGHe\example\19-flusso-acciaio-misto\archivio\REV002\calcoli\RITIRO_FEM.st7",
    KeepRunning=calcola_4_modelli_straus,
    ElementGuids="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")

# ----
# Preview Model Fase 3
display_settings_5 = DisplaySettings(
    Enabled=True,
    Geometry=True,
    Sections=True,
    Shaded=True,
    Reinforcement=True,
    Loads=False,
    Supports=True,
    Releases=True,
    OtherAttributes=True,
    Axes=False,
    Labels=False,
    SymbolScale=1,
    LoadScale=1,
    Transparency=0.65)
preview_bridghe_model_4 = PreviewBridGHeModel(ModelElements=build_model_6, Settings=display_settings_5)

# ----
# ORIGINE E FASE: REV002: matching delle fasi corretto.
# 4-RITIRO_FEM va nell'ultimo input, Phase n ritiro FEM Load Cases.
# 5-RITIRO_PRIMARIO va in Phase Ninf strain Load Cases.
# Il prefisso e quello dell'ordine dei cinque modelli nel merge.
# Combo_REV002.xlsx e invariato: manca la colonna 4-RITIRO_FEM, quindi le sue sollecitazioni non entrano nelle combinazioni attuali. Definirne i coefficienti per includerle.
# Risultati Straus memorizzati: CALCOLA=false; premere Run su Build BridGHe Model e Super Element Check.
merge_3 = Merge(
    Data1=flatten(straus_r3_analysis_3),
    Data2=flatten(straus_r3_analysis_2),
    Data3=flatten(straus_r3_analysis),
    Data4=flatten(straus_r3_analysis_4),
    Data5=flatten(build_model_2))
build_bridghe_model = BuildBridGHeModel(
    BridGHeModels=flatten(merge_3),
    LoadCombinations=read_excel_sheet.Rows,
    PhaseInfLoadCases=phase_inf_load_cases,
    PhaseNinfLoadCases=phase_ninf_load_cases,
    PhaseN0LoadCases=phase_n0_load_cases,
    PhaseNinfStrainLoadCases=phase_ninf_strain_load_cases,
    PhaseNRitiroFEMLoadCases=phase_n_ritiro_fem_load_cases)
super_element_filter = SuperElementFilter(BridGHeModel=build_bridghe_model, SuperElement=super_element_2)
composite_beam = CompositeBeam(Beam=super_element_filter, SectionStart=composite_beam_property.CompositeSection)
preview_bridghe_model_5 = PreviewBridGHeModel(ModelElements=composite_beam, Settings=display_settings_4)
super_element_check = SuperElementCheck(
    BridGHeModel=build_bridghe_model,
    SuperElementBeam=composite_beam,
    WebLocalInstability=False,
    TopFlangeLocalInstability=False,
    BottomFlangeLocalInstability=False)  # -> TensionCheck, TauB, TensionForces
composite_section_linear_tension_results = CompositeSectionLinearTensionResults(LinearTensionResults=super_element_check.TensionCheck)  # -> Point1_ConcreteEpsilon, Point1_ConcreteSigma, Point2_RebarSigma, Point3_RebarSigma, Point4_ConcreteSigma, Point5_SteelSigma, Point6_SteelSigma, Point6_SteelTau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
bridge_stress_plot = BridgeStressPlot(
    BridGHeModel=build_bridghe_model,
    SuperElementBeam=composite_beam,
    Results=super_element_check.TensionCheck,
    Quantity=6,
    ShowMinMaxCombo=True,
    FilePath="C:\Temp\diagramma.png",
    KeepRunning=False)  # -> SVG, File, Minimum, Maximum
bridge_force_plot = BridgeForcePlot(
    BridGHeModel=build_bridghe_model,
    SuperElementBeam=composite_beam,
    Results=super_element_check.TensionForces,
    Quantity=4,
    ShowMinMaxCombo=True,
    FilePath="C:\Temp\diagramma.png",
    KeepRunning=False)  # -> SVG, File, Minimum, Maximum
sigma_cls_superiore_mpa = Panel(composite_section_linear_tension_results.Point1_ConcreteSigma)
sigma_armatura_superiore_mpa = Panel(composite_section_linear_tension_results.Point2_RebarSigma)
sigma_armatura_inferiore_mpa = Panel(composite_section_linear_tension_results.Point3_RebarSigma)
sigma_acciaio_inferiore_mpa = Panel(composite_section_linear_tension_results.Point8_SteelSigma)
bridge_plot_preview = BridgePlotPreview(SVG=flatten(bridge_stress_plot.SVG), Index=0, Width=600)
list_item = ListItem(List=flatten(super_element_check.TensionCheck), Index=0, Wrap=True)
list_item_2 = ListItem(List=flatten(super_element_check.TensionCheck), Index=10, Wrap=True)
bridge_detail_check = BridgeDetailCheck(SectionResult=list_item, Studs=bridge_studs, SupportStiffener=bridge_support_stiffener)  # -> SectionResult, Check, Demand, Resistance, Units, Ratio, Status, Warnings
bridge_detail_check_2 = BridgeDetailCheck(SectionResult=list_item_2, Studs=bridge_studs, IntermediateStiffener=bridge_intermediate_stiffener)  # -> SectionResult, Check, Demand, Resistance, Units, Ratio, Status, Warnings
dettagli_appoggio = Panel(bridge_detail_check.Status)
dettagli_intermedio = Panel(bridge_detail_check_2.Status)

# ==== cluster Cluster
radius = ClusterInput()
A = ClusterInput()
B = ClusterInput()
circle = Circle(Plane=PlaneXY(0, 0, 0), Radius=expr("x/2", radius))
division = Division(A=A, B=B)
multiplication = Multiplication(A=division, B=0.1)
area = Area(Geometry=circle)  # -> Area, Centroid
multiplication_2 = Multiplication(A=area.Area, B=multiplication)
result = ClusterOutput(multiplication_2)
