# Grasshopper definition 23-audit-modello-fase.ghx (Grasshopper 1.0.8)
# plug-ins: BridGHe

# 23 | AUDIT E COPIA DI FASE
# Dati dimostrativi: due travi parallele, volutamente disconnesse. Il warning DISCONNECTED è atteso.
# Phase Model modifica solo B0 e invalida i risultati; non esegue Straus. Consultare README.md.
audit = BridgeModelAudit(Model=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, Tolerance=1e-06)  # -> NoInputErrors, Severity, Code, Element, Description, Model
panel = Panel(audit.Description)
phasemodel = BridgePhaseModel(
    Model=audit.Model,
    Name="Risposta omogeneizzata da analizzare",
    BeamIDs="B0",
    Property=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,
    ClearLoads=True)
audit_2 = BridgeModelAudit(Model=phasemodel, Tolerance=1e-06)  # -> NoInputErrors, Severity, Code, Element, Description, Model
panel_2 = Panel(audit_2.Description)
