# Grasshopper definition 24-inviluppi-concomitanti.ghx (Grasshopper 1.0.8)
# plug-ins: BridGHe

# 24 | INVILUPPI CONCOMITANTI
# Campioni numerici controllati, non una soluzione FEM: G e Q con passo mobile 2. Unità N mm.
# M3 minimo Q conserva N=-50, V2=13, V3=-17, T=19, M2=-23 dello stesso campione. Reazione Fz=-120; spostamento Uz=-10.
resultcases = BridgeResultCases(Model=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)  # -> Cases, CaseByStep, Step, StepType, R, Count, Units
beamenv = BridgeBeamEnvelope(Model=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, Component=5, Mode=2)  # -> ElementID, Station, Value, Case, Step, StepType, Concomitant, Result, Coverage, Units
bearingenv = BridgeBearingEnvelope(Model=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, Component=2, Mode=2)  # -> ElementID, Station, Value, Case, Step, StepType, Concomitant, Result, Coverage, Units
dispenv = BridgeDisplacementEnvelope(Model=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, Component=2, Mode=2)  # -> ElementID, Station, Value, Case, Step, StepType, Concomitant, Result, Coverage, Units
panel = Panel(resultcases.Cases)
panel_2 = Panel(beamenv.Value)
panel_3 = Panel(bearingenv.Value)
panel_4 = Panel(dispenv.Value)
