# Grasshopper definition 25-fasi-combinazioni.ghx (Grasshopper 1.0.8)
# plug-ins: BridGHe

shrinkageaction = BridgeShrinkageAction(ActionID="CS", StrainIncrement=-0.0002, PrimaryOnly=True, Response=0)
# 25 | FASI E COMBINAZIONI PER ACTION ID
# Due fasi dimostrative: G1 acciaio e CS ritiro primario. I dati FEM G sono campioni controllati.
# Action Combinations riceve colonne CS,G1 e produce il formato Build. SLS: 0.7,1. Primary Only esclude effetti di vincolo del ritiro.
action = BridgeAction(ActionID="G1", Model=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, Case="G", Behavior=0)
phase = BridgePhase(Number=10, Name="Acciaio", SectionState=0, Actions=action)
phase_2 = BridgePhase(Number=20, Name="Ritiro", SectionState=1, Actions=shrinkageaction)
phasetable = BridgePhaseTable(Phases=[phase_2, phase])  # -> Phases, Number, Name, Day, SectionState, ActionID, Behavior, Source, Case, Strain
actioncomb = BridgeActionCombinations(Phases=phasetable.Phases, ActionIDs=["CS", "G1"], Names="SLS", Coefficients=[0.7, 1])  # -> Table, OmittedActions
panel = Panel(actioncomb.Table)
buildbridge = BuildBridGHeModel(
    Models=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,
    Phases=phasetable.Phases,
    Combinations=actioncomb.Table,
    Calculation=0,
    AdditionalPhaseMembers=False)  # -> Model, Phases, Diagnostics
panel_2 = Panel(buildbridge.Phases)
