# Grasshopper definition 26-riepilogo-verifiche-gpc.ghx (Grasshopper 1.0.8)
# plug-ins: BridGHe

# 26 | RIEPILOGO DELLE VERIFICHE GPC
# Sezione H mista di esempio; quattro incrementi assegnati in kN/kNm, senza analisi FEM globale.
# Il riepilogo conserva stato e note GPC. Un rapporto assente è NaN, non zero. Il massimo non è una verifica complessiva del ponte.
geometry = BridgeSectionGeometry(
    SlabWidth=2200,
    SlabHeight=250,
    WebHeight=1330,
    WebThickness=16,
    TopWidth=450,
    TopThickness=30,
    BottomWidth=600,
    BottomThickness=40,
    SecondBottomEnabled=False,
    SecondBottomWidth=600,
    SecondBottomThickness=20,
    SectionType=0,
    WebOffset=0,
    WebSpacing=1800)
studs = BridgeStuds(
    Enabled=True,
    CountPerRow=2,
    Diameter=22,
    Height=180,
    LongitudinalPitch=200,
    TransversePitch=150,
    Fu=450,
    GammaV=1.25,
    HeadDiameter=35,
    HeadThickness=10,
    RequiredCover=40,
    RepeatedActionDetail=True)
bridgecheck = BridgeSectionCheck(
    Geometry=geometry,
    Concrete=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,
    Steel=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,
    Phases=[{Data="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", Kind="BridgePhase"}, {Data="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", Kind="BridgePhase"}, {Data="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", Kind="BridgePhase"}, {Data="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", Kind="BridgePhase"}],
    Details=studs)  # -> Results, Phases, Warnings, NativeAnalysis
formato_etichette = ValueList({"Completa": 0, "Trave e stazione": 1, "Combinazione": 2, "Fase": 3}, selected="Completa")
resultlabels = BridgeResultLabels(Results=bridgecheck.Results, Format=formato_etichette)
checksummary = BridgeCheckSummary(Results=bridgecheck.Results, Labels=resultlabels)  # -> Label, Phase, Check, Ratio, Status, Units, Notes, MaximumFiniteRatio, UnavailableRatios, GoverningLabels
panel = Panel(checksummary.GoverningLabels)
panel_2 = Panel(checksummary.Status)
