# Grasshopper definition 27-ritiro-confronti.ghx (Grasshopper 1.0.8)
# plug-ins: BridGHe

# 27 | RITIRO INCREMENTALE E CONFRONTO NUMERICO
# Ritiro cumulativo assegnato: -100, -200, -250 microstrain ai giorni 7,28,100. Inserimento in forma adimensionale.
# Confronto dimostrativo su due campioni con ordine invertito: unità e punti fisici uguali. Non costituisce uno studio di convergenza FEM.
shrinkinc = BridgeShrinkageIncrements(Days=[7, 28, 100], CumulativeStrain=[-0.0001, -0.0002, -0.00025], InitialStrain=0)  # -> Increment, Days, TotalIncrement
panel = Panel(shrinkinc.Increment)
compare = BridgeResultComparison(
    ReferenceKeys=["G2/x=15m/Uz", "G2/x=30m/Uz"],
    ReferenceValues=[-10, -20],
    CandidateKeys=["G2/x=30m/Uz", "G2/x=15m/Uz"],
    CandidateValues=[-20.1, -10.02],
    AbsoluteTolerance=1e-06,
    RelativeTolerance=0.01)  # -> AllWithinTolerance, Key, Difference, RelativeDifference, WithinTolerance
panel_2 = Panel(compare.Difference)
