# Grasshopper definition 32-simple-bridge-reticolare-curvo.ghx (Grasshopper 1.0.8)
# plug-ins: BridGHe

# ---- group: Bridge Support Lines
# PROCEDURA: 32 | SIMPLE BRIDGE RETICOLARE | CURVO R=250 m
# Geometria in mm: campate 30+40+30 m, tre travi a -4/0/+4 m, soletta 12 m x 250 mm.
# Modifica i pannelli: appoggi, interassi, quote, conci, traversi, passo soletta. Nessun carico o analisi.
# Il concio 24-36 m attraversa la pila a 30 m. Il giunto aggiuntivo a 18 m interessa solo G2.
# Members + Member IDs hanno gli stessi percorsi. Famiglie: 0 travi, 1 traversi pieni, 2/3 correnti, 4 montanti, 5 diagonali.
# Deck Beams: soletta a metà spessore; Deck Connections -> Bridge Connections mode 0 per link rigidi.
# Grillage Geometry include la famiglia 8: assegnare esplicitamente una proprietà cls. Bridge Geometry mantiene la sola carpenteria.
progressive_appoggi_mm = Panel("""0
30000
70000
100000""")
tracciato_3d_mm = Curve(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)
sghembi_appoggi_deg = Panel("""0
12
-8
0""")
supportlines = BridgeSupportLines(Alignment=tracciato_3d_mm, SupportStations=progressive_appoggi_mm, SkewAngles=sghembi_appoggi_deg)  # -> SupportLines, SpanLengths, SupportCentres

# ---- group: Bridge Girder Axes
offsets_travi_mm = Panel("""-4000
0
4000""")
quote_assi_mm = Panel("-1500")
girderaxes = BridgeGirderAxes(TransverseOffsets=offsets_travi_mm, AxisLevels=quote_assi_mm)  # -> GirderAxes, GirderCount

# ---- group: Bridge Crossfall Table
coppie_progressiva_pendenza = Number(Tree({0}: [0, -2], {1}: [50000, 2], {2}: [100000, 3]))
crossfalltable = BridgeCrossfallTable(CrossfallTable=coppie_progressiva_pendenza)  # -> Percentages, Stations

# ---- group: Bridge Truss Diaphragms
passo_traversi_mm = Panel("5000")
altezza_reticolo_mm = Panel("1500")
trussdiaphragms = BridgeTrussDiaphragms(
    MaximumSpacing=passo_traversi_mm,
    AtSupports=True,
    TrussHeight=altezza_reticolo_mm,
    PanelsPerBay=2,
    Pattern=2,
    ConnectX=False)

# ---- group: Bridge Joint Tree
giunti_mm_0_comuni_2_solo_g2 = Number(Tree({0}: [12000, 24000, 36000, 48000, 60000, 72000, 84000], {2}: [18000]))
jointtree = BridgeJointTree(JointTree=giunti_mm_0_comuni_2_solo_g2)

# ---- group: Bridge Mesh Settings
lunghezza_massima_mm = Panel("2500")
errore_di_corda_mm = Panel("5")
passo_soletta_mm = Panel("2000")
meshsettings = BridgeMeshSettings(MaximumElementLength=lunghezza_massima_mm, ChordTolerance=errore_di_corda_mm, SlabBeamSpacing=passo_soletta_mm)

# ----
fabrication = BridgeFabricationSegments(Alignment=tracciato_3d_mm, GirderAxes=girderaxes.GirderAxes, JointSets=jointtree, MaximumSegmentLength=12000)  # -> FabricationPlan, SegmentCount, SegmentIDs, StartStations, EndStations, SegmentLengths

# ---- group: Bridge Slab Layout
larghezze_sx_dx_mm = Panel("""6000
6000""")
spessore_soletta_mm = Panel("250")
slablayout = BridgeSlabLayout(
    SideWidths=larghezze_sx_dx_mm,
    Thickness=spessore_soletta_mm,
    CrossfallPercent=crossfalltable.Percentages,
    CrossfallStations=crossfalltable.Stations)

# ----
bridgeassembly = BridgeGeometryAssembly(
    Alignment=tracciato_3d_mm,
    SupportLines=supportlines.SupportLines,
    GirderAxes=girderaxes.GirderAxes,
    SlabLayout=slablayout,
    FabricationPlan=fabrication.FabricationPlan,
    Diaphragms=trussdiaphragms)
bridgetruss_mesh = BridgeGrillageMesh(BridgeDefinition=bridgeassembly, MeshSettings=meshsettings, Labels=False)  # -> Members, MemberIDs, Longitudinals, DiaphragmMembers, Nodes, SupportPoints, JointPoints, Deck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
informazioni = Panel(bridgetruss_mesh.Information)
conci_girder_segment_start_end = Panel(bridgetruss_mesh.SegmentRanges)
topologia_degli_assi = Panel(bridgetruss_mesh.Topology)
larghezze_tributarie_soletta_mm = Panel(bridgetruss_mesh.DeckStripWidths)
rigidlinks = BridgeRigidLinks(ConnectionAxes=flatten(bridgetruss_mesh.DeckConnections))  # -> Elements, Information
