# Grasshopper definition 33-consigliatore-campate.ghx (Grasshopper 1.0.8)
# plug-ins: BridGHe

minimum_span = Panel("20000")
maximum_span = Panel("45000")
target_span = Panel("35000")
clearance = Panel("2000")
# 33 | CONSIGLIATORE CAMPATE: 33 | CONSIGLIATORE CAMPATE
# Tracciato 100 m; fascia vietata x=40..60 m. Modificare griglia, luce obiettivo e penalità delle pile.
# Le alternative sono ottimi geometrici sulla griglia scelta; non sono predimensionamenti resistenti.
# Unità N, mm, MPa. Nessuna analisi Straus avviata. Procedura e controlli nel README della cartella.
spanadvice = BridgeSpanAdvisor(
    Alignment=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,
    ForbiddenRegions=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,
    MinimumSpan=minimum_span,
    MaximumSpan=maximum_span,
    TargetSpan=target_span,
    CandidateGrid=1000,
    Clearance=clearance,
    Alternatives=3,
    PierPenalty=0.1,
    EndSpanRatio=1)  # -> SupportStations, SupportPoints, SpanLengths, Scores, Information
support_stations = Panel(spanadvice.SupportStations)
span_lengths = Panel(spanadvice.SpanLengths)
information = Panel(spanadvice.Information)
