# Grasshopper definition 35-assegnazione-membri.ghx (Grasshopper 1.0.8)
# plug-ins: BridGHe

# 35 | ASSEGNAZIONE MEMBRI: 35 | ASSEGNAZIONE MEMBRI
# Ponte curvo a tre travi, conci indipendenti dalle campate.
# Gli ID FEM sono numerici; Physical IDs e gruppi conservano famiglia/trave/concio. Le proprietà sono dimostrative.
# Unità N, mm, MPa. Nessuna analisi Straus avviata. Procedura e controlli nel README della cartella.
crossfalltable = BridgeCrossfallTable()  # -> Percentages, Stations
soliddiaphragms = BridgeSolidDiaphragms(MaximumSpacing=5000, AtSupports=True)
jointtree = BridgeJointTree(JointTree=[12000, 24000, 36000, 48000, 60000, 72000, 84000])
meshsettings = BridgeMeshSettings(MaximumElementLength=2500, ChordTolerance=5, SlabBeamSpacing=0)

# ---- group: Bridge Support Lines
tracciato_r_250_m = Curve(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)
support_stations = Panel("""0
30000
70000
100000""")
supportlines = BridgeSupportLines(Alignment=tracciato_r_250_m, SupportStations=support_stations, SkewAngles=0)  # -> SupportLines, SpanLengths, SupportCentres

# ---- group: Bridge Girder Axes
girder_offsets = Panel("""-4000
0
4000""")
girderaxes = BridgeGirderAxes(TransverseOffsets=girder_offsets, AxisLevels=-1500)  # -> GirderAxes, GirderCount

# ----
slablayout = BridgeSlabLayout(SideWidths=6000, Thickness=250, CrossfallPercent=crossfalltable.Percentages, CrossfallStations=crossfalltable.Stations)

# ---- group: Bridge Family Property
proprietà_acciaio_n_mm_sostituibile = Data(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)
familyproperty = BridgeFamilyProperty(Property=proprietà_acciaio_n_mm_sostituibile, Family=-1)

# ----
fabrication = BridgeFabricationSegments(Alignment=tracciato_r_250_m, GirderAxes=girderaxes.GirderAxes, JointSets=jointtree, MaximumSegmentLength=12000)  # -> FabricationPlan, SegmentCount, SegmentIDs, StartStations, EndStations, SegmentLengths
bridgeassembly = BridgeGeometryAssembly(
    Alignment=tracciato_r_250_m,
    SupportLines=supportlines.SupportLines,
    GirderAxes=girderaxes.GirderAxes,
    SlabLayout=slablayout,
    FabricationPlan=fabrication.FabricationPlan,
    Diaphragms=soliddiaphragms)
bridgesolid_mesh = BridgeGrillageMesh(BridgeDefinition=bridgeassembly, MeshSettings=meshsettings, Labels=False)  # -> Members, MemberIDs, Longitudinals, DiaphragmMembers, Nodes, SupportPoints, JointPoints, Deck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
femmembers = BridgeFEMMembers(BridgeGeometry=bridgesolid_mesh.BridgeGeometry, FamilyProperties=familyproperty)  # -> Beams, PhysicalIDs, Unassigned, Information
physical_ids = Panel(femmembers.PhysicalIDs)
information = Panel(femmembers.Information)
