# Grasshopper definition 36-appoggi-orientati.ghx (Grasshopper 1.0.8)
# plug-ins: BridGHe

# 36 | APPOGGI: 36 | APPOGGI
# Dodici appoggi: tre travi per quattro allineamenti. Centro prima spalla fisso, guide longitudinali al centro delle altre linee.
# Gli appoggi esterni sono multidirezionali; le rotazioni sono libere. La preview mostra gli assi effettivi dei vincoli.
# Unità N, mm, MPa. Nessuna analisi Straus avviata. Procedura e controlli nel README della cartella.
crossfalltable = BridgeCrossfallTable()  # -> Percentages, Stations
soliddiaphragms = BridgeSolidDiaphragms(MaximumSpacing=5000, AtSupports=True)
jointtree = BridgeJointTree(JointTree=[12000, 24000, 36000, 48000, 60000, 72000, 84000])
meshsettings = BridgeMeshSettings(MaximumElementLength=2500, ChordTolerance=5, SlabBeamSpacing=0)

# ---- group: Bridge Support Lines
tracciato_r_250_m = Curve(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)
support_stations = Panel("""0
30000
70000
100000""")
supportlines = BridgeSupportLines(Alignment=tracciato_r_250_m, SupportStations=support_stations, SkewAngles=0)  # -> SupportLines, SpanLengths, SupportCentres

# ---- group: Bridge Girder Axes
girder_offsets = Panel("""-4000
0
4000""")
girderaxes = BridgeGirderAxes(TransverseOffsets=girder_offsets, AxisLevels=-1500)  # -> GirderAxes, GirderCount

# ----
slablayout = BridgeSlabLayout(SideWidths=6000, Thickness=250, CrossfallPercent=crossfalltable.Percentages, CrossfallStations=crossfalltable.Stations)
fabrication = BridgeFabricationSegments(Alignment=tracciato_r_250_m, GirderAxes=girderaxes.GirderAxes, JointSets=jointtree, MaximumSegmentLength=12000)  # -> FabricationPlan, SegmentCount, SegmentIDs, StartStations, EndStations, SegmentLengths
bridgeassembly = BridgeGeometryAssembly(
    Alignment=tracciato_r_250_m,
    SupportLines=supportlines.SupportLines,
    GirderAxes=girderaxes.GirderAxes,
    SlabLayout=slablayout,
    FabricationPlan=fabrication.FabricationPlan,
    Diaphragms=soliddiaphragms)
bridgesolid_mesh = BridgeGrillageMesh(BridgeDefinition=bridgeassembly, MeshSettings=meshsettings, Labels=False)  # -> Members, MemberIDs, Longitudinals, DiaphragmMembers, Nodes, SupportPoints, JointPoints, Deck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
bearings = BridgeBearings(
    BridgeGeometry=bridgesolid_mesh.BridgeGeometry,
    Types=[2, 0, 2, 2, 1, 2, 2, 1, 2, 2, 1, 2],
    GuideAngle=0,
    TranslationStiffness=Vector(0, 0, 0),
    RotationStiffness=Vector(0, 0, 0))  # -> Nodes, Frames, Labels
labels = Panel(bearings.Labels)
