# Grasshopper definition 37-connessioni-offset.ghx (Grasshopper 1.0.8)
# plug-ins: BridGHe

# 37 | CONNESSIONI: 37 | CONNESSIONI
# Tre rappresentazioni distinte: link rigido Straus, asta deformabile con proprietà, offset locale della sezione.
# I link non sono travi con rigidezza artificiosamente grande. Le linee vanno collegate ai vertici FEM previsti.
# Unità N, mm, MPa. Nessuna analisi Straus avviata. Procedura e controlli nel README della cartella.
rigidlinks = BridgeRigidLinks(ConnectionAxes=[Line((0, 0, -1500), (0, 0, -125)), Line((5000, 0, -1500), (5000, 0, -125))])  # -> Elements, Information

# ---- group: Bridge Connection Beams
asta_elastica_proprietà_esplicita = Data(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)
connectionbeams = BridgeConnectionBeams(
    ConnectionAxes=[Line((0, 0, -1500), (0, 0, -125)), Line((5000, 0, -1500), (5000, 0, -125))],
    ConnectionProperty=asta_elastica_proprietà_esplicita)  # -> Elements, Information

# ---- group: Bridge Beam Offsets
trave_da_spostare = Data(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)
beamoffsets = BridgeBeamOffsets(Beams=trave_da_spostare, LocalOffset=Vector(0, 100, 0))  # -> Beams, Information

# ----
information = Panel(rigidlinks.Information)
information_2 = Panel(connectionbeams.Information)
information_3 = Panel(beamoffsets.Information)
