# Grasshopper definition 38-controventi-longitudinali.ghx (Grasshopper 1.0.8)
# plug-ins: BridGHe

# 38 | CONTROVENTI LONGITUDINALI: 38 | CONTROVENTI LONGITUDINALI
# Controventi X fra 0, 12.345 e 30 m, nelle due maglie trasversali. Le aste delle travi vengono divise agli attacchi.
# Pattern 0/1/2: X, V, Warren. Cambiare Normal Offset genera i montanti di collegamento.
# Unità N, mm, MPa. Nessuna analisi Straus avviata. Procedura e controlli nel README della cartella.
crossfalltable = BridgeCrossfallTable()  # -> Percentages, Stations
soliddiaphragms = BridgeSolidDiaphragms(MaximumSpacing=5000, AtSupports=True)
jointtree = BridgeJointTree(JointTree=[12000, 24000, 36000, 48000, 60000, 72000, 84000])
meshsettings = BridgeMeshSettings(MaximumElementLength=2500, ChordTolerance=5, SlabBeamSpacing=0)

# ---- group: Bridge Support Lines
tracciato_100_m = Curve(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)
support_stations = Panel("""0
30000
70000
100000""")
supportlines = BridgeSupportLines(Alignment=tracciato_100_m, SupportStations=support_stations, SkewAngles=0)  # -> SupportLines, SpanLengths, SupportCentres

# ---- group: Bridge Girder Axes
girder_offsets = Panel("""-4000
0
4000""")
girderaxes = BridgeGirderAxes(TransverseOffsets=girder_offsets, AxisLevels=-1500)  # -> GirderAxes, GirderCount

# ----
slablayout = BridgeSlabLayout(SideWidths=6000, Thickness=250, CrossfallPercent=crossfalltable.Percentages, CrossfallStations=crossfalltable.Stations)

# ---- group: Bridge Family Property
proprietà_acciaio_n_mm_sostituibile = Data(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)
familyproperty = BridgeFamilyProperty(Property=proprietà_acciaio_n_mm_sostituibile, Family=-1)

# ----
fabrication = BridgeFabricationSegments(Alignment=tracciato_100_m, GirderAxes=girderaxes.GirderAxes, JointSets=jointtree, MaximumSegmentLength=12000)  # -> FabricationPlan, SegmentCount, SegmentIDs, StartStations, EndStations, SegmentLengths
bridgeassembly = BridgeGeometryAssembly(
    Alignment=tracciato_100_m,
    SupportLines=supportlines.SupportLines,
    GirderAxes=girderaxes.GirderAxes,
    SlabLayout=slablayout,
    FabricationPlan=fabrication.FabricationPlan,
    Diaphragms=soliddiaphragms)
bridgesolid_mesh = BridgeGrillageMesh(BridgeDefinition=bridgeassembly, MeshSettings=meshsettings, Labels=False)  # -> Members, MemberIDs, Longitudinals, DiaphragmMembers, Nodes, SupportPoints, JointPoints, Deck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

# ---- group: Bridge Longitudinal Bracing
stations = Panel("""0
12345
30000""")
longbracing = BridgeLongitudinalBracing(BridgeGeometry=bridgesolid_mesh.BridgeGeometry, Stations=stations, Pattern=0, NormalOffset=0, ConnectX=False)  # -> BridgeGeometry, AddedMembers, Information

# ----
femmembers = BridgeFEMMembers(BridgeGeometry=longbracing.BridgeGeometry, FamilyProperties=familyproperty)  # -> Beams, PhysicalIDs, Unassigned, Information
information = Panel(longbracing.Information)
information_2 = Panel(femmembers.Information)
