# Grasshopper definition 39-soletta-getti.ghx (Grasshopper 1.0.8)
# plug-ins: BridGHe

# 39 | MESH SOLETTA: 39 | MESH SOLETTA
# Ponte curvo con plate triangolari sulla superficie media e tre zone di getto.
# Usare BG in uscita per assegnare le travi. Connection Lines definisce collegamenti da creare esplicitamente con Bridge Connections.
# Unità N, mm, MPa. Nessuna analisi Straus avviata. Procedura e controlli nel README della cartella.
crossfalltable = BridgeCrossfallTable()  # -> Percentages, Stations
soliddiaphragms = BridgeSolidDiaphragms(MaximumSpacing=5000, AtSupports=True)
jointtree = BridgeJointTree(JointTree=[12000, 24000, 36000, 48000, 60000, 72000, 84000])
meshsettings = BridgeMeshSettings(MaximumElementLength=2500, ChordTolerance=5, SlabBeamSpacing=0)

# ---- group: Bridge Support Lines
tracciato_r_250_m = Curve(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)
support_stations = Panel("""0
30000
70000
100000""")
supportlines = BridgeSupportLines(Alignment=tracciato_r_250_m, SupportStations=support_stations, SkewAngles=0)  # -> SupportLines, SpanLengths, SupportCentres

# ---- group: Bridge Girder Axes
girder_offsets = Panel("""-4000
0
4000""")
girderaxes = BridgeGirderAxes(TransverseOffsets=girder_offsets, AxisLevels=-1500)  # -> GirderAxes, GirderCount

# ----
slablayout = BridgeSlabLayout(SideWidths=6000, Thickness=250, CrossfallPercent=crossfalltable.Percentages, CrossfallStations=crossfalltable.Stations)

# ---- group: Bridge Family Property
proprietà_acciaio_n_mm_sostituibile = Data(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)
familyproperty = BridgeFamilyProperty(Property=proprietà_acciaio_n_mm_sostituibile, Family=-1)

# ----
fabrication = BridgeFabricationSegments(Alignment=tracciato_r_250_m, GirderAxes=girderaxes.GirderAxes, JointSets=jointtree, MaximumSegmentLength=12000)  # -> FabricationPlan, SegmentCount, SegmentIDs, StartStations, EndStations, SegmentLengths
bridgeassembly = BridgeGeometryAssembly(
    Alignment=tracciato_r_250_m,
    SupportLines=supportlines.SupportLines,
    GirderAxes=girderaxes.GirderAxes,
    SlabLayout=slablayout,
    FabricationPlan=fabrication.FabricationPlan,
    Diaphragms=soliddiaphragms)
bridgesolid_mesh = BridgeGrillageMesh(BridgeDefinition=bridgeassembly, MeshSettings=meshsettings, Labels=False)  # -> Members, MemberIDs, Longitudinals, DiaphragmMembers, Nodes, SupportPoints, JointPoints, Deck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

# ---- group: Bridge Deck Mesh
shell_c_t_250_mm_e_34000_mpa = Data(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)
pour_boundaries = Panel("""30000
70000""")
deckmesh = BridgeDeckMesh(
    BridgeGeometry=bridgesolid_mesh.BridgeGeometry,
    PlateProperty=shell_c_t_250_mm_e_34000_mpa,
    LongitudinalMeshLength=5000,
    TransverseMeshLength=3000,
    PourBoundaries=pour_boundaries,
    Triangles=True)  # -> BridgeGeometry, Mesh, Plates, ConnectionLines, Stations, Information

# ----
femmembers = BridgeFEMMembers(BridgeGeometry=deckmesh.BridgeGeometry, FamilyProperties=familyproperty)  # -> Beams, PhysicalIDs, Unassigned, Information
information = Panel(deckmesh.Information)
