# Grasshopper definition 40-sequenza-costruttiva.ghx (Grasshopper 1.0.8)
# plug-ins: BridGHe

# 40 | SEQUENZA COSTRUTTIVA: 40 | SEQUENZA COSTRUTTIVA
# Tre snapshot indipendenti: primo concio G2, trave G2 completa, struttura intera.
# Fasi 10/20/30 ai giorni 0/7/28. Nessun trasferimento automatico di deformazioni o storia dal modello precedente.
# Unità N, mm, MPa. Nessuna analisi Straus avviata. Procedura e controlli nel README della cartella.
phase = BridgePhase(Number=10, Name="Primo concio G2", SectionState=1, Day=0)
crossfalltable = BridgeCrossfallTable()  # -> Percentages, Stations
soliddiaphragms = BridgeSolidDiaphragms(MaximumSpacing=5000, AtSupports=True)
phase_2 = BridgePhase(Number=20, Name="Trave G2", SectionState=1, Day=7)
jointtree = BridgeJointTree(JointTree=[12000, 24000, 36000, 48000, 60000, 72000, 84000])
phase_3 = BridgePhase(Number=30, Name="Struttura completa", SectionState=1, Day=28)
meshsettings = BridgeMeshSettings(MaximumElementLength=2500, ChordTolerance=5, SlabBeamSpacing=0)

# ---- group: Bridge Support Lines
tracciato_100_m = Curve(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)
support_stations = Panel("""0
30000
70000
100000""")
supportlines = BridgeSupportLines(Alignment=tracciato_100_m, SupportStations=support_stations, SkewAngles=0)  # -> SupportLines, SpanLengths, SupportCentres

# ---- group: Bridge Girder Axes
girder_offsets = Panel("""-4000
0
4000""")
girderaxes = BridgeGirderAxes(TransverseOffsets=girder_offsets, AxisLevels=-1500)  # -> GirderAxes, GirderCount

# ----
slablayout = BridgeSlabLayout(SideWidths=6000, Thickness=250, CrossfallPercent=crossfalltable.Percentages, CrossfallStations=crossfalltable.Stations)

# ---- group: Bridge Family Property
proprietà_acciaio_n_mm_sostituibile = Data(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)
familyproperty = BridgeFamilyProperty(Property=proprietà_acciaio_n_mm_sostituibile, Family=-1)

# ----
fabrication = BridgeFabricationSegments(Alignment=tracciato_100_m, GirderAxes=girderaxes.GirderAxes, JointSets=jointtree, MaximumSegmentLength=12000)  # -> FabricationPlan, SegmentCount, SegmentIDs, StartStations, EndStations, SegmentLengths
bridgeassembly = BridgeGeometryAssembly(
    Alignment=tracciato_100_m,
    SupportLines=supportlines.SupportLines,
    GirderAxes=girderaxes.GirderAxes,
    SlabLayout=slablayout,
    FabricationPlan=fabrication.FabricationPlan,
    Diaphragms=soliddiaphragms)
bridgesolid_mesh = BridgeGrillageMesh(BridgeDefinition=bridgeassembly, MeshSettings=meshsettings, Labels=False)  # -> Members, MemberIDs, Longitudinals, DiaphragmMembers, Nodes, SupportPoints, JointPoints, Deck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
femmembers = BridgeFEMMembers(BridgeGeometry=bridgesolid_mesh.BridgeGeometry, FamilyProperties=familyproperty)  # -> Beams, PhysicalIDs, Unassigned, Information
bm = BuildModel(Elements=femmembers.Beams, Name="Sequenza geometrica", Units=2)
construction = BridgeConstructionSequence(Model=bm, Phase=phase, PhysicalIDs="Girder:2:1", ActiveBearingIDs="*", EnableBearings=True)  # -> PhaseModel, NativeStage, Phase, ActivePhysicalIDs, AvailableGroups, Information
construction_2 = BridgeConstructionSequence(Model=bm, Phase=phase_2, ActiveGroups="Girder\Group2", ActiveBearingIDs="*", EnableBearings=True)  # -> PhaseModel, NativeStage, Phase, ActivePhysicalIDs, AvailableGroups, Information
construction_3 = BridgeConstructionSequence(Model=bm, Phase=phase_3, ActiveBearingIDs="*", EnableBearings=True)  # -> PhaseModel, NativeStage, Phase, ActivePhysicalIDs, AvailableGroups, Information
information = Panel(construction.Information)
information_2 = Panel(construction_2.Information)
information_3 = Panel(construction_3.Information)
