# Grasshopper definition 42-frecce-controfreccia.ghx (Grasshopper 1.0.8)
# plug-ins: BridGHe

# 42 | FRECCE E CONTROFRECCIA: 42 | FRECCE E CONTROFRECCIA
# DATI SINTETICI: parabola con freccia relativa 20 mm e cedimenti u=-5-0.0002s.
# A s=15 m: assoluta -28 mm, relativa -20 mm, controfreccia +20 mm. Display Scale cambia solo le curve.
# Unità N, mm, MPa. Nessuna analisi Straus avviata. Procedura e controlli nel README della cartella.
modello_con_spostamenti_sintetici = Data(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)
geometria_dei_campioni = Data(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)
case = Panel("G1")
display_scale = Panel("100")
camber = BridgeDeflectionCamber(
    Model=modello_con_spostamenti_sintetici,
    BridgeGeometry=geometria_dei_campioni,
    Girder=1,
    Case=case,
    Step=0,
    Direction=Vector(0, 0, 1),
    CamberFactor=1,
    RelativeCamber=True,
    DisplayScale=display_scale)  # -> Stations, AbsoluteDisplacement, RelativeDeflection, Camber, DeflectedCurve, CamberCurve, Source, Information
relative_deflection = Panel(camber.RelativeDeflection)
camber_2 = Panel(camber.Camber)
