# Grasshopper definition 43-storie-fatica.ghx (Grasshopper 1.0.8)
# plug-ins: BridGHe

# 43 | STORIE PER FATICA: 43 | STORIE PER FATICA
# Storia ordinata dimostrativa 0,10,2,8,0: cicli di ampiezza 10 e 6.
# A sinistra valori diretti in MPa; a destra stessa storia da campioni FEM SINTETICI N. Nessuna curva S-N o danno automatico.
# Unità N, mm, MPa. Nessuna analisi Straus avviata. Procedura e controlli nel README della cartella.
values = Panel("""0
10
2
8
0""")
fatiguehistory = BridgeFatigueHistory(Values=values, Station=0, ForceComponent=4, ResponseUnits="MPa", Exponent=3, ReferenceCycles=1)  # -> History, Sources, Ranges, Means, CycleCounts, EquivalentRange, Units, Information
equivalent_range = Panel(fatiguehistory.EquivalentRange)
ordered_cases = Panel("""Q0
Q1
Q2
Q3
Q4""")
transito_sintetico_non_straus = Data(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)
fatiguehistory_2 = BridgeFatigueHistory(
    Model=transito_sintetico_non_straus,
    BeamID="1",
    Station=500,
    OrderedCases=ordered_cases,
    ForceComponent=0,
    ResponseUnits="MPa",
    Exponent=3,
    ReferenceCycles=1)  # -> History, Sources, Ranges, Means, CycleCounts, EquivalentRange, Units, Information
sources = Panel(fatiguehistory_2.Sources)
