# Grasshopper definition 44-mappa-verifiche.ghx (Grasshopper 1.0.8)
# plug-ins: BridGHe

# 44 | MAPPA VERIFICHE: 44 | MAPPA VERIFICHE
# Controlli locali gPC su una sezione di esempio, con azioni assegnate direttamente: nessuna soluzione FEM globale.
# Solo l'asta 1 riceve controlli. Tutte le altre restano grigie: non sono verificate.
# Unità N, mm, MPa. Nessuna analisi Straus avviata. Procedura e controlli nel README della cartella.
crossfalltable = BridgeCrossfallTable()  # -> Percentages, Stations
soliddiaphragms = BridgeSolidDiaphragms(MaximumSpacing=5000, AtSupports=True)
jointtree = BridgeJointTree(JointTree=[12000, 24000, 36000, 48000, 60000, 72000, 84000])
meshsettings = BridgeMeshSettings(MaximumElementLength=2500, ChordTolerance=5, SlabBeamSpacing=0)
geometry = BridgeSectionGeometry(
    SlabWidth=2200,
    SlabHeight=250,
    WebHeight=1330,
    WebThickness=16,
    TopWidth=450,
    TopThickness=30,
    BottomWidth=600,
    BottomThickness=40,
    SecondBottomEnabled=False,
    SecondBottomWidth=600,
    SecondBottomThickness=20,
    SectionType=0,
    WebOffset=0,
    WebSpacing=1800)
studs = BridgeStuds(
    Enabled=True,
    CountPerRow=2,
    Diameter=22,
    Height=180,
    LongitudinalPitch=200,
    TransversePitch=150,
    Fu=450,
    GammaV=1.25,
    HeadDiameter=35,
    HeadThickness=10,
    RequiredCover=40,
    RepeatedActionDetail=True)

# ---- group: Bridge Support Lines
tracciato_100_m = Curve(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)
support_stations = Panel("""0
30000
70000
100000""")
supportlines = BridgeSupportLines(Alignment=tracciato_100_m, SupportStations=support_stations, SkewAngles=0)  # -> SupportLines, SpanLengths, SupportCentres

# ---- group: Bridge Girder Axes
girder_offsets = Panel("""-4000
0
4000""")
girderaxes = BridgeGirderAxes(TransverseOffsets=girder_offsets, AxisLevels=-1500)  # -> GirderAxes, GirderCount

# ----
slablayout = BridgeSlabLayout(SideWidths=6000, Thickness=250, CrossfallPercent=crossfalltable.Percentages, CrossfallStations=crossfalltable.Stations)

# ---- group: Bridge Family Property
proprietà_acciaio_n_mm_sostituibile = Data(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)
familyproperty = BridgeFamilyProperty(Property=proprietà_acciaio_n_mm_sostituibile, Family=-1)

# ---- group: Bridge Section Check
incrementi_locali_dimostrativi = Data([{Data="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", Kind="BridgePhase"}, {Data="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", Kind="BridgePhase"}])
s355 = Data(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)
c30 = Data(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)
bridgecheck = BridgeSectionCheck(Geometry=geometry, Concrete=c30, Steel=s355, Phases=incrementi_locali_dimostrativi, Details=studs)  # -> Results, Phases, Warnings, NativeAnalysis

# ----
fabrication = BridgeFabricationSegments(Alignment=tracciato_100_m, GirderAxes=girderaxes.GirderAxes, JointSets=jointtree, MaximumSegmentLength=12000)  # -> FabricationPlan, SegmentCount, SegmentIDs, StartStations, EndStations, SegmentLengths
bridgeassembly = BridgeGeometryAssembly(
    Alignment=tracciato_100_m,
    SupportLines=supportlines.SupportLines,
    GirderAxes=girderaxes.GirderAxes,
    SlabLayout=slablayout,
    FabricationPlan=fabrication.FabricationPlan,
    Diaphragms=soliddiaphragms)
bridgesolid_mesh = BridgeGrillageMesh(BridgeDefinition=bridgeassembly, MeshSettings=meshsettings, Labels=False)  # -> Members, MemberIDs, Longitudinals, DiaphragmMembers, Nodes, SupportPoints, JointPoints, Deck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
femmembers = BridgeFEMMembers(BridgeGeometry=bridgesolid_mesh.BridgeGeometry, FamilyProperties=familyproperty)  # -> Beams, PhysicalIDs, Unassigned, Information
bm = BuildModel(Elements=femmembers.Beams, Units=2)
checkmap = BridgeCheckMap(Model=bm, Results=bridgecheck.Results, BeamIDs=["1", "1"], Stations=[0, 0], Cases=["Demo-G1", "Demo-G2"], Labels=False)  # -> Axes, Colours, BeamIDs, MaximumRatios, Unavailable, Governing, Information
governing = Panel(checkmap.Governing)
information = Panel(checkmap.Information)
