# Grasshopper definition 45-ponte-completo-fasi.ghx (Grasshopper 1.0.8)
# plug-ins: BridGHe

# 45 | PONTE COMPLETO: GEOMETRIA → MODELLO → FASI: 45 | PONTE COMPLETO: GEOMETRIA → MODELLO → FASI
# Ponte curvo 30+40+30 m, tre travi, conci da 12 m, controventi Warren, soletta shell in tre getti, link rigidi e appoggi orientati.
# Tre snapshot: acciaio, primo getto, soletta completa. Modello senza carichi: proprietà e schema da dimensionare. Non è una verifica del ponte.
# Unità N, mm, MPa. Nessuna analisi Straus avviata. Procedura e controlli nel README della cartella.
crossfalltable = BridgeCrossfallTable()  # -> Percentages, Stations
soliddiaphragms = BridgeSolidDiaphragms(MaximumSpacing=5000, AtSupports=True)
phase = BridgePhase(Number=10, Name="Acciaio", SectionState=0, Day=0)
jointtree = BridgeJointTree(JointTree=[12000, 24000, 36000, 48000, 60000, 72000, 84000])
meshsettings = BridgeMeshSettings(MaximumElementLength=2500, ChordTolerance=5, SlabBeamSpacing=0)
phase_2 = BridgePhase(Number=20, Name="Primo getto attivo", SectionState=1, Day=7)
phase_3 = BridgePhase(Number=30, Name="Soletta completa", SectionState=1, Day=28)

# ---- group: Bridge Support Lines
tracciato_r_250_m = Curve(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)
support_stations = Panel("""0
30000
70000
100000""")
supportlines = BridgeSupportLines(Alignment=tracciato_r_250_m, SupportStations=support_stations, SkewAngles=0)  # -> SupportLines, SpanLengths, SupportCentres

# ---- group: Bridge Girder Axes
girder_offsets = Panel("""-4000
0
4000""")
girderaxes = BridgeGirderAxes(TransverseOffsets=girder_offsets, AxisLevels=-1500)  # -> GirderAxes, GirderCount

# ----
slablayout = BridgeSlabLayout(SideWidths=6000, Thickness=250, CrossfallPercent=crossfalltable.Percentages, CrossfallStations=crossfalltable.Stations)

# ---- group: Bridge Family Property
proprietà_acciaio_n_mm_sostituibile = Data(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)
familyproperty = BridgeFamilyProperty(Property=proprietà_acciaio_n_mm_sostituibile, Family=-1)

# ----
fabrication = BridgeFabricationSegments(Alignment=tracciato_r_250_m, GirderAxes=girderaxes.GirderAxes, JointSets=jointtree, MaximumSegmentLength=12000)  # -> FabricationPlan, SegmentCount, SegmentIDs, StartStations, EndStations, SegmentLengths
bridgeassembly = BridgeGeometryAssembly(
    Alignment=tracciato_r_250_m,
    SupportLines=supportlines.SupportLines,
    GirderAxes=girderaxes.GirderAxes,
    SlabLayout=slablayout,
    FabricationPlan=fabrication.FabricationPlan,
    Diaphragms=soliddiaphragms)
bridgesolid_mesh = BridgeGrillageMesh(BridgeDefinition=bridgeassembly, MeshSettings=meshsettings, Labels=False)  # -> Members, MemberIDs, Longitudinals, DiaphragmMembers, Nodes, SupportPoints, JointPoints, Deck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

# ---- group: Bridge Longitudinal Bracing
stations = Panel("""0
10000
20000
30000
40000
50000
60000
70000
80000
90000
100000""")
longbracing = BridgeLongitudinalBracing(BridgeGeometry=bridgesolid_mesh.BridgeGeometry, Stations=stations, Pattern=2, NormalOffset=0, ConnectX=False)  # -> BridgeGeometry, AddedMembers, Information

# ---- group: Bridge Deck Mesh
shell_c_t_250_mm_e_34000_mpa = Data(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)
pour_boundaries = Panel("""30000
70000""")
deckmesh = BridgeDeckMesh(
    BridgeGeometry=longbracing.BridgeGeometry,
    PlateProperty=shell_c_t_250_mm_e_34000_mpa,
    LongitudinalMeshLength=5000,
    TransverseMeshLength=3000,
    PourBoundaries=pour_boundaries,
    Triangles=True)  # -> BridgeGeometry, Mesh, Plates, ConnectionLines, Stations, Information

# ----
femmembers = BridgeFEMMembers(BridgeGeometry=deckmesh.BridgeGeometry, FamilyProperties=familyproperty)  # -> Beams, PhysicalIDs, Unassigned, Information
bearings = BridgeBearings(
    BridgeGeometry=deckmesh.BridgeGeometry,
    Types=[2, 0, 2, 2, 1, 2, 2, 1, 2, 2, 1, 2],
    GuideAngle=0,
    TranslationStiffness=Vector(0, 0, 0),
    RotationStiffness=Vector(0, 0, 0))  # -> Nodes, Frames, Labels
rigidlinks = BridgeRigidLinks(ConnectionAxes=deckmesh.ConnectionLines)  # -> Elements, Information
bm = BuildModel(
    Elements=flatten([femmembers.Beams, deckmesh.Plates, bearings.Nodes, rigidlinks.Elements]),
    Name="Ponte curvo acciaio-shell 30+40+30",
    Units=2)
construction = BridgeConstructionSequence(
    Model=bm,
    Phase=phase,
    ActiveGroups=["Girder", "SolidDiaphragm", "LongitudinalBracing"],
    ActiveBearingIDs="*",
    EnableBearings=True)  # -> PhaseModel, NativeStage, Phase, ActivePhysicalIDs, AvailableGroups, Information
construction_2 = BridgeConstructionSequence(
    Model=bm,
    Phase=phase_2,
    ActiveGroups=["Girder", "SolidDiaphragm", "LongitudinalBracing", "Deck\Pour1"],
    ActiveBearingIDs="*",
    EnableBearings=True)  # -> PhaseModel, NativeStage, Phase, ActivePhysicalIDs, AvailableGroups, Information
construction_3 = BridgeConstructionSequence(Model=bm, Phase=phase_3, ActiveBearingIDs="*", EnableBearings=True)  # -> PhaseModel, NativeStage, Phase, ActivePhysicalIDs, AvailableGroups, Information
audit = BridgeModelAudit(
    Model=bm,
    Tolerance=1e-06,
    BridgeGeometry=deckmesh.BridgeGeometry,
    PhaseModels=flatten([construction.PhaseModel, construction_2.PhaseModel, construction_3.PhaseModel]))  # -> NoInputErrors, Severity, Code, Element, Description, Model
information = Panel(construction.Information)
information_2 = Panel(construction_2.Information)
information_3 = Panel(construction_3.Information)
description = Panel(audit.Description)
