# Grasshopper definition 46-combinazioni-excel.ghx (Grasshopper 1.0.8)
# plug-ins: BridGHe

shrinkageaction = BridgeShrinkageAction(ActionID="RITIRO", Model=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, Case="G", StrainIncrement=-0.0002, PrimaryOnly=False, Response=0)
# 46 | EXCEL DELLE COMBINAZIONI
# Quattro Action ID, tre fasi, ritiro FEM + strain. I quattro modelli hanno tutti un caso sorgente chiamato G: le intestazioni corrette sono G1, G2, Q, RITIRO.
# Campioni FEM sintetici su due aste, nessun solutore. Coefficienti DEMO senza valore normativo.
action = BridgeAction(ActionID="G1", Model=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, Case="G", Behavior=0)
action_2 = BridgeAction(ActionID="G2", Model=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, Case="G", Behavior=1)
action_3 = BridgeAction(ActionID="Q", Model=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, Case="G", Behavior=2)
phase = BridgePhase(Number=10, Name="Getto su acciaio", SectionState=0, Actions=action, Day=0)
phase_2 = BridgePhase(Number=20, Name="Permanenti portati", SectionState=1, Actions=action_2, Day=28)
phase_3 = BridgePhase(Number=30, Name="Esercizio e ritiro", SectionState=1, Actions=[action_3, shrinkageaction], Day=365)
_1_crea_template = BridgeCombinationExcel(Models=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, Phases=[phase_3, phase_2, phase], File="Template.xlsx", Mode=0, Rows=20, Overwrite=False)  # -> File, Table, ActionIDs, Summary
# 1. Crea: scegli un file nuovo e premi Run.
# 2. Compila Combinations; conserva Actions.
# 3. Leggi: scegli il file compilato e premi Run.
# 4. Premi Run su Build BridGHe Model.
# Template.xlsx è vuoto; Combinations.xlsx contiene due righe dimostrative già compilate.
_2_leggi_excel = BridgeCombinationExcel(
    Models=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,
    Phases=[phase_3, phase_2, phase],
    File="Combinations.xlsx",
    Mode=1,
    Rows=20,
    Overwrite=False)  # -> File, Table, ActionIDs, Summary
buildbridge = BuildBridGHeModel(
    Models=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,
    Phases=[phase, phase_2, phase_3],
    Combinations=_2_leggi_excel.Table,
    Calculation=0,
    AdditionalPhaseMembers=False)  # -> Model, Phases, Diagnostics
panel = Panel(_2_leggi_excel.Table)
