# Grasshopper definition 47-integrazione-modello.ghx (Grasshopper 1.0.8)
# plug-ins: BridGHe

# 47 | DAL MODELLO AI DETTAGLI: Risultati Straus già calcolati dell'esempio 19 REV003; estratto G2, beam 36, x=27.5..30 m.
# 1. Run su Build BridGHe Model. 2. Run su Super Element Check. I dettagli si aggiornano a valle. Nessuna licenza richiesta per questa riproduzione.
# La tabella DEMO usa fattori unitari. Ultimate nel Detail Check serve a mostrare i controlli; NON rende questi carichi una combinazione normativa SLU.
# Per il tuo modello sostituisci Models/Phases/tabella e proprietà mista. R=900 kN è assegnata per l'esempio, non estratta automaticamente dai risultati nodali.
g1_getto_risultati_nativi_archiviati = Data(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)
g2_permanenti_risultati_nativi_archiviat = Data(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)  # "G2_PERMANENTI — risultati nativi archiviati"
q_traffico_risultati_nativi_archiviati = Data(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)
ritiro_fem_risultati_nativi_archiviati = Data(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)
demo_fattori_1_nessuna_selezione_normati = Data(Tree({0}: ["", "G1", "G2", "Q", "RITIRO"], {1}: ["DEMO", "1", "1", "1", "1"]))  # "DEMO — fattori 1, nessuna selezione normativa"
spina_h2000_soletta_3000x250_n0_7_ninf_1 = Data(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)  # "Spina H2000 + soletta 3000x250; n0=7 nInf=18 nR=12"
etichette_del_campione_aggiornare_se_cam = Text(Tree({0;0}: ["G2 / beam36 / x=27500 mm / DEMO"], {0;1}: ["G2 / beam36 / x=28125 mm / DEMO"], {0;2}: ["G2 / beam36 / x=28750 mm / DEMO"], {0;3}: ["G2 / beam36 / x=29375 mm / DEMO"], {0;4}: ["G2 / beam36 / x=30000 mm / DEMO"]))  # "Etichette del campione — aggiornare se cambiano stazioni o combo"
g1 = BridgeAction(ActionID="G1", Model=g1_getto_risultati_nativi_archiviati, Case="G1_GETTO", Behavior=0)
fase_1 = BridgePhase(Number=10, Name="G1", SectionState=0, Actions=g1)
g2 = BridgeAction(ActionID="G2", Model=g2_permanenti_risultati_nativi_archiviat, Case="G2_PERMANENTI", Behavior=1)
fase_2 = BridgePhase(Number=20, Name="G2", SectionState=1, Actions=g2)
Q = BridgeAction(ActionID="Q", Model=q_traffico_risultati_nativi_archiviati, Case="Q_TRAFFICO", Behavior=2)
fase_3 = BridgePhase(Number=30, Name="Q", SectionState=1, Actions=Q)
ritiro = BridgeShrinkageAction(
    ActionID="RITIRO",
    Model=ritiro_fem_risultati_nativi_archiviati,
    Case="RITIRO_FEM",
    StrainIncrement=-0.0002,
    PrimaryOnly=False,
    Response=0)
fase_4 = BridgePhase(Number=40, Name="RITIRO", SectionState=1, Actions=ritiro)
_1_run_cumulative = BuildBridGHeModel(
    Models=g1_getto_risultati_nativi_archiviati,
    Phases=[fase_1, fase_2, fase_3, fase_4],
    Combinations=demo_fattori_1_nessuna_selezione_normati,
    Calculation=0)  # -> Model, Phases, Diagnostics
seleziona_g2 = SuperElementFilter(BridGHeModel=_1_run_cumulative.Model, SuperElement="G2")
proprietà_fisica_mista = CompositeBeam(Beam=seleziona_g2, SectionStart=spina_h2000_soletta_3000x250_n0_7_ninf_1)
_2_run_verifica_superelemento = SuperElementCheck(
    BridGHeModel=_1_run_cumulative.Model,
    SuperElementBeam=proprietà_fisica_mista,
    WebLocalInstability=True,
    TopFlangeLocalInstability=True,
    BottomFlangeLocalInstability=True)  # -> TensionCheck, TauB, TensionForces
pioli_2x22_passo200 = BridgeStuds(
    Enabled=True,
    CountPerRow=2,
    Diameter=22,
    Height=180,
    LongitudinalPitch=200,
    TransversePitch=150,
    Fu=450,
    GammaV=1.25,
    HeadDiameter=35,
    HeadThickness=10,
    RequiredCover=40,
    RepeatedActionDetail=True)
intermedi_200x20_pannelli2m = BridgeIntermediateStiffener(
    Enabled=True,
    Layout=0,
    Width=200,
    Thickness=20,
    RightWidth=200,
    RightThickness=20,
    LeftPanel=2000,
    RightPanel=4000,
    EqualPanels=True,
    LengthFactor=1,
    ExternalCompressionKN=0,
    LoadX=0,
    CheckWelds=True,
    WeldThroat=6)
appoggio_r900kn_assegnato = BridgeSupportStiffener(
    Enabled=True,
    Layout=0,
    Width=200,
    Thickness=25,
    RightWidth=250,
    RightThickness=25,
    Location=0,
    LeftPanel=2000,
    RightPanel=2000,
    ReactionKN=900,
    EndDistance=250,
    LoadX=0,
    LoadZ=0,
    FootprintLength=400,
    FootprintWidth=600,
    LengthFactor=1,
    RigidEndPost=False,
    EndPostSpacing=300,
    CheckWelds=True,
    WeldThroat=10)
ultimate_solo_dimostrazione = BridgeAnalysisOptions(
    Standard=1,
    LimitState=0,
    Class4=True,
    TopFlangeBuckling=True,
    BottomFlangeBuckling=True,
    WebBuckling=True,
    CommonLoadY=0,
    GammaM0=1.05,
    GammaM1=1.1,
    GammaM2=1.25,
    GammaC=1.5,
    GammaS=1.15,
    AlphaCC=0.85,
    ShearEta=1.2)
_3_dettagli_sulle_stesse_azioni = BridgeDetailCheck(
    SectionResult=_2_run_verifica_superelemento.TensionCheck,
    Studs=pioli_2x22_passo200,
    IntermediateStiffener=intermedi_200x20_pannelli2m,
    SupportStiffener=appoggio_r900kn_assegnato,
    Options=ultimate_solo_dimostrazione)  # -> SectionResult, Check, Demand, Resistance, Units, Ratio, Status, Warnings
pioli_per_stazione_e_combo = BridgeStudResults(SectionResult=_3_dettagli_sulle_stesse_azioni.SectionResult)  # -> ConnectionFlow, ForcePerStud, ResistancePerStud, ResistancePerLength, ForceRatio, Phase, PhaseFlow, Warnings
tutti_gli_esiti_locali = BridgeCheckSummary(Results=_3_dettagli_sulle_stesse_azioni.SectionResult, Labels=etichette_del_campione_aggiornare_se_cam)  # -> Label, Phase, Check, Ratio, Status, Units, Notes, MaximumFiniteRatio, UnavailableRatios, GoverningLabels
flusso_n_mm = Panel(pioli_per_stazione_e_combo.ConnectionFlow)
forza_per_piolo_kn = Panel(pioli_per_stazione_e_combo.ForcePerStud)
# PERCORSO E LIMITI: Tension Check contiene BridgeStressResult, non soltanto tensioni. Conservare l'albero {indice beam;indice stazione}; gli item sono le combinazioni.
# Details di Layout è una lista di definizioni geometriche: non collegarla indiscriminatamente a Results. Suddividere le zone e associare il dettaglio alla sua stazione.
# Calculation=1 LinearHistory NON è supportato da Detail Check. L'opzione Ultimate non genera coefficienti né altera le azioni FEM.
# Per appoggi reali usare la reazione compressiva corretta, con unità e associazione di combinazione coerenti. R=900 in questo file è dimostrativa.
rapporto_piolo = Panel(pioli_per_stazione_e_combo.ForceRatio)
controlli = Panel(_3_dettagli_sulle_stesse_azioni.Check)
riepilogo_controllo_governante_per_stazi = Panel(tutti_gli_esiti_locali.GoverningLabels)  # "Riepilogo — controllo governante per stazione"
rapporti_stesso_ordine = Panel(_3_dettagli_sulle_stesse_azioni.Ratio)
