# Grasshopper definition 48-report-word.ghx (Grasshopper 1.0.8)
# plug-ins: BridGHe

# 47 | DAL MODELLO AI DETTAGLI: Risultati Straus già calcolati dell'esempio 19 REV003; estratto G2, beam 36, x=27.5..30 m.
# 1. Run su Build BridGHe Model. 2. Run su Super Element Check. I dettagli si aggiornano a valle. Nessuna licenza richiesta per questa riproduzione.
# La tabella DEMO usa fattori unitari. Ultimate nel Detail Check serve a mostrare i controlli; NON rende questi carichi una combinazione normativa SLU.
# Per il tuo modello sostituisci Models/Phases/tabella e proprietà mista. R=900 kN è assegnata per l'esempio, non estratta automaticamente dai risultati nodali.
g1_getto_risultati_nativi_archiviati = Data(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)
g2_permanenti_risultati_nativi_archiviat = Data(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)  # "G2_PERMANENTI — risultati nativi archiviati"
q_traffico_risultati_nativi_archiviati = Data(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)
ritiro_fem_risultati_nativi_archiviati = Data(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)
ritiro = BridgeShrinkageAction(
    ActionID="RITIRO",
    Model=ritiro_fem_risultati_nativi_archiviati,
    Case="RITIRO_FEM",
    StrainIncrement=-0.0002,
    PrimaryOnly=False,
    Response=0)
g1 = BridgeAction(ActionID="G1", Model=g1_getto_risultati_nativi_archiviati, Case="G1_GETTO", Behavior=0)
g2 = BridgeAction(ActionID="G2", Model=g2_permanenti_risultati_nativi_archiviat, Case="G2_PERMANENTI", Behavior=1)
Q = BridgeAction(ActionID="Q", Model=q_traffico_risultati_nativi_archiviati, Case="Q_TRAFFICO", Behavior=2)
fase_1 = BridgePhase(Number=10, Name="G1", SectionState=0, Actions=g1)
fase_2 = BridgePhase(Number=20, Name="G2", SectionState=1, Actions=g2)
fase_3 = BridgePhase(Number=30, Name="Q", SectionState=1, Actions=Q)
fase_4 = BridgePhase(Number=40, Name="RITIRO", SectionState=1, Actions=ritiro)
demo_fattori_1_nessuna_selezione_normati = Data(Tree({0}: ["", "G1", "G2", "Q", "RITIRO"], {1}: ["DEMO", "1", "1", "1", "1"]))  # "DEMO — fattori 1, nessuna selezione normativa"
_1_run_cumulative = BuildBridGHeModel(
    Models=g1_getto_risultati_nativi_archiviati,
    Phases=[fase_1, fase_2, fase_3, fase_4],
    Combinations=demo_fattori_1_nessuna_selezione_normati,
    Calculation=0,
    AdditionalPhaseMembers=False)  # -> Model, Phases, Diagnostics
seleziona_g2 = SuperElementFilter(BridGHeModel=_1_run_cumulative.Model, SuperElement="G2")
spina_h2000_soletta_3000x250_n0_7_ninf_1 = Data(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)  # "Spina H2000 + soletta 3000x250; n0=7 nInf=18 nR=12"
proprietà_fisica_mista = CompositeBeam(Beam=seleziona_g2, SectionStart=spina_h2000_soletta_3000x250_n0_7_ninf_1)
intermedi_200x20_pannelli2m = BridgeIntermediateStiffener(
    Enabled=True,
    Layout=0,
    Width=200,
    Thickness=20,
    RightWidth=200,
    RightThickness=20,
    LeftPanel=2000,
    RightPanel=4000,
    EqualPanels=True,
    LengthFactor=1,
    ExternalCompressionKN=0,
    LoadX=0,
    CheckWelds=True,
    WeldThroat=6)
pioli_2x22_passo200 = BridgeStuds(
    Enabled=True,
    CountPerRow=2,
    Diameter=22,
    Height=180,
    LongitudinalPitch=200,
    TransversePitch=150,
    Fu=450,
    GammaV=1.25,
    HeadDiameter=35,
    HeadThickness=10,
    RequiredCover=40,
    RepeatedActionDetail=True)
_2_run_verifica_superelemento = SuperElementCheck(
    BridGHeModel=_1_run_cumulative.Model,
    SuperElementBeam=proprietà_fisica_mista,
    WebLocalInstability=True,
    TopFlangeLocalInstability=True,
    BottomFlangeLocalInstability=True)  # -> TensionCheck, TauB, TensionForces
appoggio_r900kn_assegnato = BridgeSupportStiffener(
    Enabled=True,
    Layout=0,
    Width=200,
    Thickness=25,
    RightWidth=250,
    RightThickness=25,
    Location=0,
    LeftPanel=2000,
    RightPanel=2000,
    ReactionKN=900,
    EndDistance=250,
    LoadX=0,
    LoadZ=0,
    FootprintLength=400,
    FootprintWidth=600,
    LengthFactor=1,
    RigidEndPost=False,
    EndPostSpacing=300,
    CheckWelds=True,
    WeldThroat=10)
ultimate_solo_dimostrazione = BridgeAnalysisOptions(
    Standard=1,
    LimitState=0,
    Class4=True,
    TopFlangeBuckling=True,
    BottomFlangeBuckling=True,
    WebBuckling=True,
    CommonLoadY=0,
    GammaM0=1.05,
    GammaM1=1.1,
    GammaM2=1.25,
    GammaC=1.5,
    GammaS=1.15,
    AlphaCC=0.85,
    ShearEta=1.2)
_3_dettagli_sulle_stesse_azioni = BridgeDetailCheck(
    SectionResult=_2_run_verifica_superelemento.TensionCheck,
    Studs=pioli_2x22_passo200,
    IntermediateStiffener=intermedi_200x20_pannelli2m,
    SupportStiffener=appoggio_r900kn_assegnato,
    Options=ultimate_solo_dimostrazione)  # -> SectionResult, Check, Demand, Resistance, Units, Ratio, Status, Warnings
tutti_gli_esiti_locali = BridgeCheckSummary(Results=_3_dettagli_sulle_stesse_azioni.SectionResult)  # -> Label, Phase, Check, Ratio, Status, Units, Notes, MaximumFiniteRatio, UnavailableRatios, GoverningLabels
pioli_per_stazione_e_combo = BridgeStudResults(SectionResult=_3_dettagli_sulle_stesse_azioni.SectionResult)  # -> ConnectionFlow, ForcePerStud, ResistancePerStud, ResistancePerLength, ForceRatio, Phase, PhaseFlow, Warnings
flusso_n_mm = Panel(pioli_per_stazione_e_combo.ConnectionFlow)
forza_per_piolo_kn = Panel(pioli_per_stazione_e_combo.ForcePerStud)
# PERCORSO E LIMITI: Tension Check contiene BridgeStressResult, non soltanto tensioni. Conservare l'albero {indice beam;indice stazione}; gli item sono le combinazioni.
# Details di Layout è una lista di definizioni geometriche: non collegarla indiscriminatamente a Results. Suddividere le zone e associare il dettaglio alla sua stazione.
# Calculation=1 LinearHistory NON è supportato da Detail Check. L'opzione Ultimate non genera coefficienti né altera le azioni FEM.
# Per appoggi reali usare la reazione compressiva corretta, con unità e associazione di combinazione coerenti. R=900 in questo file è dimostrativa.
rapporto_piolo = Panel(pioli_per_stazione_e_combo.ForceRatio)
controlli = Panel(_3_dettagli_sulle_stesse_azioni.Check)
riepilogo_controllo_governante_per_stazi = Panel(tutti_gli_esiti_locali.GoverningLabels)  # "Riepilogo — controllo governante per stazione"
rapporti_stesso_ordine = Panel(_3_dettagli_sulle_stesse_azioni.Ratio)
voce_gpc_inviluppo_wr = ValueList({"Inviluppo WR di tutte le verifiche": 0, "Intermedio · rigidezza pannelli": 1, "Intermedio · stabilità e pressoflessione II ordine": 2, "Intermedio · freccia fuori piano": 3, "Intermedio · rigidezza torsionale": 4, "Intermedio · piatti entro classe 3": 5, "Intermedio · ingombro tra piattabande": 6, "Intermedio · saldature verticali all’anima": 7, "Intermedio · saldature alle flange": 8, "Intermedio · gola minima": 9, "Intermedio · lunghezza efficace cordone": 10, "Intermedio · collegamenti": 11}, selected="Inviluppo WR di tutte le verifiche")
voce_gpc_inviluppo_wr_2 = ValueList({"Inviluppo WR di tutte le verifiche": 0, "Appoggio · stabilità e pressoflessione II ordine": 1, "Appoggio · freccia fuori piano": 2, "Appoggio · rigidezza torsionale": 3, "Appoggio · piatti entro classe 3": 4, "Appoggio · ingombro tra piattabande": 5, "Appoggio · saldature verticali all’anima": 6, "Appoggio · saldature alle flange": 7, "Appoggio · gola minima": 8, "Appoggio · lunghezza efficace cordone": 9, "Appoggio · collegamenti": 10, "Appoggio · impronta trasversale sotto i piatti": 11, "Appoggio · impronta longitudinale": 12, "Appoggio · impronta entro l’estremità": 13, "Appoggio · contatto piatti/flangia": 14, "Terminale · due coppie bilaterali simmetriche": 15, "Terminale · area di ciascuna coppia": 16, "Terminale · distanza e > 0,1 hw": 17, "Terminale · e entro il pannello": 18, "Terminale · reazione e ancoraggio combinati": 19, "Seconda coppia terminale · stabilità e pressoflessione II ordine": 20, "Seconda coppia terminale · freccia fuori piano": 21, "Seconda coppia terminale · rigidezza torsionale": 22, "Seconda coppia terminale · piatti entro classe 3": 23, "Seconda coppia terminale · ingombro tra piattabande": 24, "Seconda coppia terminale · saldature verticali all’anima": 25, "Seconda coppia terminale · saldature alle flange": 26, "Seconda coppia terminale · gola minima": 27, "Seconda coppia terminale · lunghezza efficace cordone": 28, "Seconda coppia terminale · collegamenti": 29}, selected="Inviluppo WR di tutte le verifiche")
intermedio_wr_a_s_0_m = BridgeIntermediateStiffenerPlot(
    BridGHeModel=_1_run_cumulative.Model,
    SuperElementBeam=proprietà_fisica_mista,
    Results=_3_dettagli_sulle_stesse_azioni.SectionResult,
    Check=voce_gpc_inviluppo_wr,
    ShowMinMaxCombo=True,
    GraphicTitle="Intermedio — WR a s=0 m",
    KeepRunning=True,
    Display=0,
    Stations=0)  # -> SVG, File, Minimum, Maximum, GoverningChecks, UnavailableChecks
voce_governante = Panel(intermedio_wr_a_s_0_m.GoverningChecks)
appoggio_wr_a_s_2_5_m = BridgeSupportStiffenerPlot(
    BridGHeModel=_1_run_cumulative.Model,
    SuperElementBeam=proprietà_fisica_mista,
    Results=_3_dettagli_sulle_stesse_azioni.SectionResult,
    Check=voce_gpc_inviluppo_wr_2,
    ShowMinMaxCombo=True,
    GraphicTitle="Appoggio — WR a s=2.5 m",
    KeepRunning=True,
    Display=0,
    Stations=2.5)  # -> SVG, File, Minimum, Maximum, GoverningChecks, UnavailableChecks
voce_governante_2 = Panel(appoggio_wr_a_s_2_5_m.GoverningChecks)
# GRAFICI DEI DETTAGLI: Pioli: confronto PEd/PRd. Irrigiditori: selezionare Inviluppo WR o una singola voce nella Value List. Display=0 WR; 1 domanda; 2 limite; 3 confronto.
# Stations è in metri dall'inizio dell'estratto: 0 m = X globale 27.5 m; 2.5 m = pila a X globale 30 m. Dettagli assegnati a queste due posizioni per il tutorial.
# La definizione intermedia e i pannelli da 2 m restano ipotesi locali dimostrative: il plot non deriva automaticamente il passo reale o la reazione dagli elementi FEM.
# I punti degli irrigiditori non sono interpolati. Ogni WR deriva da GPC; l'inviluppo richiede tutte le voci applicabili. Leggere Governing checks e Unavailable checks.
pioli_ped_prd = BridgeStudPlot(
    BridGHeModel=_1_run_cumulative.Model,
    SuperElementBeam=proprietà_fisica_mista,
    Results=_3_dettagli_sulle_stesse_azioni.SectionResult,
    Quantity=5,
    ShowMinMaxCombo=True,
    GraphicTitle="Pioli — PEd / PRd",
    KeepRunning=True)  # -> SVG, File, Minimum, Maximum
pioli_ped_prd_preview = BridgePlotPreview(SVG=flatten(pioli_ped_prd.SVG), Index=0, Width=600)
intermedio_wr_a_s_0_m_preview = BridgePlotPreview(SVG=flatten(intermedio_wr_a_s_0_m.SVG), Index=0, Width=600)
appoggio_wr_a_s_2_5_m_preview = BridgePlotPreview(SVG=flatten(appoggio_wr_a_s_2_5_m.SVG), Index=0, Width=600)
capitoli_del_report = ValueList({"Modello": 0, "Sezioni e materiali": 1, "Fasi e combinazioni": 2, "Verifiche": 3, "Casi governanti": 4, "Grafici": 5, "Tabulato completo": 6}, selected=["Modello", "Sezioni e materiali", "Fasi e combinazioni", "Verifiche", "Casi governanti", "Grafici"])
# 48 | REPORT WORD DA TEMPLATE
# 1 Run su Build BridGHe Model. 2 Run su Super Element Check. 3 Generate su Bridge Report.
# Scegliere i capitoli nella checklist. Il riepilogo resta sempre presente. Modificare il template Word per stili, logo e ordine dei capitoli.
# Il file contiene risultati nativi archiviati dell'esempio 19, estratto beam 36. Coefficienti unitari e reazione 900 kN sono DEMO; non costituiscono una verifica completa.
# Il report già generato è nella stessa cartella. Per sostituirlo chiuderlo in Word e attivare Overwrite, oppure cambiare File. Nessuna scrittura automatica alla riapertura.
report = BridgeReport(
    Results=_3_dettagli_sulle_stesse_azioni.SectionResult,
    Template="Template_BridGHe.docx",
    File="Report_esempio.docx",
    Topics=capitoli_del_report,
    Model=_1_run_cumulative.Model,
    Title="Verifiche della trave mista e dei dettagli",
    Project="Esempio 48 dimostrativo",
    Author="BridGHe",
    Revision="01",
    SVG=[pioli_ped_prd.SVG, intermedio_wr_a_s_0_m.SVG, appoggio_wr_a_s_2_5_m.SVG],
    Overwrite=False)  # -> File, Summary, Warnings, ReportID
