# Grasshopper definition 49-ponte-parametrico.ghx (Grasshopper 1.0.8)
# plug-ins: BridGHe

# COME USARE IL PONTE PARAMETRICO: 49 | PONTE PARAMETRICO — INPUT A SINISTRA / COMPONENTI AL CENTRO / OUTPUT A DESTRA
# Unità: N, mm, MPa. Slider numero campate/travi, luce/interasse; liste opzionali per geometrie non regolari.
# Diaframmi reticolari: True = X/V/Warren; False = anima piena. La preview del modello è in basso al centro.
# SEZIONI CONCI: tabella nel gruppo 05b. Una riga per Gx-Cy; * segue gli slider base. Pulsante Tabella conci per aggiornare i giunti.
# La soletta è a graticcio: assi trasversali alla quota reale, link eccentrici e proprietà per ogni fascia.
# La quota degli assi travi è un input indipendente: aggiornarla se cambia il baricentro della sezione.
# Modelli senza carichi e senza analisi. La rigidezza longitudinale mista va assegnata nelle fasi tramite override delle sezioni.
# Il modello è predisposto per Straus. Per luci/interassi/sezioni modificati: verificare appoggi, proprietà e calibrazione del graticcio.
# README e script di rigenerazione nella cartella 49-ponte-parametrico.
# Procedura geometria: Flusso modulare: campate, tracciato, travi, soletta, conci, mesh e vincoli sono definiti separatamente.
collegamento_trave_soletta = ValueList({"Link cinematico rigido": 0, "Asta deformabile con proprietà esplicita": 1}, selected="Link cinematico rigido")
proprietà_aste_di_collegamento_necessari = Data()  # "Proprietà aste di collegamento — necessaria solo nel modo 1 (opzionale)"
collegamenti_eccentrici_trave_soletta_be = Data()  # "Collegamenti eccentrici trave-soletta | Beams (opzionale)"
collegamenti_eccentrici_trave_soletta_of = Panel("0,0,0")  # "Collegamenti eccentrici trave-soletta | Offset"

# ---- group: Bridge Span Stations
numero_campate = Slider(3, range=1..12)
lunghezza_campata_regolare_mm = Slider(30000, range=5000..80000)
lunghezze_campate_diverse_mm_sostituisco = Number()  # "Lunghezze campate diverse [mm] — sostituiscono numero e luce (opzionale)"
prolungamento_prima_del_primo_appoggio_m = Slider(0, range=0..15000)  # "Prolungamento prima del primo appoggio [mm]"
prolungamento_dopo_ultimo_appoggio_mm = Slider(0, range=0..15000)
spanstations = BridgeSpanStations(
    SpanCount=numero_campate,
    UniformSpanLength=lunghezza_campata_regolare_mm,
    SpanLengths=lunghezze_campate_diverse_mm_sostituisco,
    StartOverhang=prolungamento_prima_del_primo_appoggio_m,
    EndOverhang=prolungamento_dopo_ultimo_appoggio_mm)  # -> SupportStations, SpanLengths, AlignmentLength

# ---- group: Bridge Regular Girders
numero_travi_longitudinali = Slider(3, range=2..10)
interasse_regolare_travi_mm = Slider(3500, range=1000..10000)
offset_trasversali_non_uniformi_mm_destr = Number()  # "Offset trasversali non uniformi [mm] — destra negativi (opzionale)"
regulargirders = BridgeRegularGirders(
    GirderCount=numero_travi_longitudinali,
    GirderSpacing=interasse_regolare_travi_mm,
    ExplicitOffsets=offset_trasversali_non_uniformi_mm_destr)

# ---- group: Bridge Crossfall Table
pendenza_trasversale_soletta = Slider(0, range=-8..8)
crossfalltable = BridgeCrossfallTable(CrossfallTable=pendenza_trasversale_soletta)  # -> Percentages, Stations

# ---- group: Bridge Solid Diaphragms
progressive_diaframmi_personalizzate_mm = Number()  # "Progressive diaframmi personalizzate [mm] (opzionale)"
passo_massimo_diaframmi_mm = Slider(6000, range=0..15000)
diaframmi_sulle_linee_di_appoggio = BooleanToggle(True)
soliddiaphragms = BridgeSolidDiaphragms(
    Stations=progressive_diaframmi_personalizzate_mm,
    MaximumSpacing=passo_massimo_diaframmi_mm,
    AtSupports=diaframmi_sulle_linee_di_appoggio)

# ---- group: Bridge Joint Tree
giunti_mm_rami_0_comuni_n_trave_n_opzion = Number()  # "Giunti [mm] — rami {0} comuni, {n} trave n (opzionale)"
jointtree = BridgeJointTree(JointTree=giunti_mm_rami_0_comuni_n_trave_n_opzion)

# ---- group: Bridge Truss Diaphragms
altezza_reticolo_dei_diaframmi_mm = Slider(1800, range=500..4000)
numero_pannelli_reticolari_fra_due_travi = Slider(2, range=1..8)
schema_diaframma_reticolare = ValueList({"X": 0, "V": 1, "Warren": 2}, selected="X")
nodo_all_incrocio_delle_diagonali_x = BooleanToggle(False)
trussdiaphragms = BridgeTrussDiaphragms(
    Stations=progressive_diaframmi_personalizzate_mm,
    MaximumSpacing=passo_massimo_diaframmi_mm,
    AtSupports=diaframmi_sulle_linee_di_appoggio,
    TrussHeight=altezza_reticolo_dei_diaframmi_mm,
    PanelsPerBay=numero_pannelli_reticolari_fra_due_travi,
    Pattern=schema_diaframma_reticolare,
    ConnectX=nodo_all_incrocio_delle_diagonali_x)

# ---- group: Bridge Mesh Settings
lunghezza_massima_elementi_longitudinali = Slider(3000, range=500..6000)  # "Lunghezza massima elementi longitudinali [mm]"
tolleranza_discretizzazione_in_curva_mm = Slider(5, range=0.1..20)
passo_massimo_aste_trasversali_soletta_m = Slider(3000, range=500..6000)  # "Passo massimo aste trasversali soletta [mm]"
progressive_soletta_personalizzate_mm_so = Number()  # "Progressive soletta personalizzate [mm] — sostituiscono il passo (opzionale)"
meshsettings = BridgeMeshSettings(
    MaximumElementLength=lunghezza_massima_elementi_longitudinali,
    ChordTolerance=tolleranza_discretizzazione_in_curva_mm,
    SlabBeamSpacing=passo_massimo_aste_trasversali_soletta_m,
    SlabBeamStations=progressive_soletta_personalizzate_mm_so)

# ---- group: Steel
nome_materiale_acciaio = Panel("Acciaio carpenteria")
classe_acciaio = ValueList({"S235": 0, "S275": 1, "S355": 2, "S450": 3}, selected="S355")
materiale_carpenteria = Steel(Name=nome_materiale_acciaio, Grade=classe_acciaio)

# ---- group: Concrete
nome_materiale_calcestruzzo = Panel("Calcestruzzo soletta")
classe_calcestruzzo = ValueList({"C25/30": 4, "C28/35": 5, "C32/40": 6, "C35/45": 7, "C40/50": 8, "C45/55": 9, "C50/60": 10}, selected="C32/40")
materiale_soletta = Concrete(Name=nome_materiale_calcestruzzo, Grade=classe_calcestruzzo)

# ---- group: I Section
sezione_travi_principali_larghezza_ala_i = Slider(600, range=1..1200)  # "Sezione travi principali | Larghezza ala inferiore [mm]"
sezione_travi_principali_larghezza_ala_s = Slider(600, range=1..1200)  # "Sezione travi principali | Larghezza ala superiore [mm]"
sezione_travi_principali_altezza_totale = Slider(2500, range=1..5000)  # "Sezione travi principali | Altezza totale [mm]"
sezione_travi_principali_spessore_ala_in = Slider(30, range=1..60)  # "Sezione travi principali | Spessore ala inferiore [mm]"
sezione_travi_principali_spessore_ala_su = Slider(30, range=1..60)  # "Sezione travi principali | Spessore ala superiore [mm]"
sezione_travi_principali_spessore_anima = Slider(16, range=1..50)  # "Sezione travi principali | Spessore anima [mm]"
sezione_travi_principali_raggio_raccordo = Slider(0, range=0..50)  # "Sezione travi principali | Raggio raccordo [mm]"
sezione_travi_principali = ISection(
    BottomFlangeWidth=sezione_travi_principali_larghezza_ala_i,
    TopFlangeWidth=sezione_travi_principali_larghezza_ala_s,
    Height=sezione_travi_principali_altezza_totale,
    BottomFlangeThickness=sezione_travi_principali_spessore_ala_in,
    TopFlangeThickness=sezione_travi_principali_spessore_ala_su,
    WebThickness=sezione_travi_principali_spessore_anima,
    Radius=sezione_travi_principali_raggio_raccordo)

sezione_diaframma_pieno_larghezza_ala_in = Slider(300, range=1..600)  # "Sezione diaframma pieno | Larghezza ala inferiore [mm]"
sezione_diaframma_pieno_larghezza_ala_su = Slider(300, range=1..600)  # "Sezione diaframma pieno | Larghezza ala superiore [mm]"
sezione_diaframma_pieno_altezza_totale_m = Slider(900, range=1..1800)  # "Sezione diaframma pieno | Altezza totale [mm]"
sezione_diaframma_pieno_spessore_ala_inf = Slider(20, range=1..50)  # "Sezione diaframma pieno | Spessore ala inferiore [mm]"
sezione_diaframma_pieno_spessore_ala_sup = Slider(20, range=1..50)  # "Sezione diaframma pieno | Spessore ala superiore [mm]"
sezione_diaframma_pieno_spessore_anima_m = Slider(12, range=1..50)  # "Sezione diaframma pieno | Spessore anima [mm]"
sezione_diaframma_pieno_raggio_raccordo = Slider(0, range=0..50)  # "Sezione diaframma pieno | Raggio raccordo [mm]"
sezione_diaframma_pieno = ISection(
    BottomFlangeWidth=sezione_diaframma_pieno_larghezza_ala_in,
    TopFlangeWidth=sezione_diaframma_pieno_larghezza_ala_su,
    Height=sezione_diaframma_pieno_altezza_totale_m,
    BottomFlangeThickness=sezione_diaframma_pieno_spessore_ala_inf,
    TopFlangeThickness=sezione_diaframma_pieno_spessore_ala_sup,
    WebThickness=sezione_diaframma_pieno_spessore_anima_m,
    Radius=sezione_diaframma_pieno_raggio_raccordo)

# ---- group: Hollow Rect
correnti_reticolari_altezza_mm = Slider(250, range=50..600)
correnti_reticolari_larghezza_mm = Slider(250, range=50..600)
correnti_reticolari_spessore_orizzontale = Slider(10, range=2..30)  # "Correnti reticolari | Spessore orizzontale [mm]"
correnti_reticolari_spessore_verticale_m = Slider(10, range=2..30)  # "Correnti reticolari | Spessore verticale [mm]"
correnti_reticolari = HollowRect(
    Height=correnti_reticolari_altezza_mm,
    Base=correnti_reticolari_larghezza_mm,
    HorizontalThickness=correnti_reticolari_spessore_orizzontale,
    VerticalThickness=correnti_reticolari_spessore_verticale_m)

montanti_reticolari_altezza_mm = Slider(200, range=50..600)
montanti_reticolari_larghezza_mm = Slider(200, range=50..600)
montanti_reticolari_spessore_orizzontale = Slider(8, range=2..30)  # "Montanti reticolari | Spessore orizzontale [mm]"
montanti_reticolari_spessore_verticale_m = Slider(8, range=2..30)  # "Montanti reticolari | Spessore verticale [mm]"
montanti_reticolari = HollowRect(
    Height=montanti_reticolari_altezza_mm,
    Base=montanti_reticolari_larghezza_mm,
    HorizontalThickness=montanti_reticolari_spessore_orizzontale,
    VerticalThickness=montanti_reticolari_spessore_verticale_m)

diagonali_e_controventi_altezza_mm = Slider(180, range=50..600)
diagonali_e_controventi_larghezza_mm = Slider(180, range=50..600)
diagonali_e_controventi_spessore_orizzon = Slider(8, range=2..30)  # "Diagonali e controventi | Spessore orizzontale [mm]"
diagonali_e_controventi_spessore_vertica = Slider(8, range=2..30)  # "Diagonali e controventi | Spessore verticale [mm]"
diagonali_e_controventi = HollowRect(
    Height=diagonali_e_controventi_altezza_mm,
    Base=diagonali_e_controventi_larghezza_mm,
    HorizontalThickness=diagonali_e_controventi_spessore_orizzon,
    VerticalThickness=diagonali_e_controventi_spessore_vertica)

# ---- group: Reinforcement Steel B450C
materiale_armature_b450c_name = Panel("B450C")
materiale_armature_b450c = ReinforcementSteelB450C(Name=materiale_armature_b450c_name)  # -> Material, Information

# ---- group: Concrete Slab Section
spessore_soletta_mm = Slider(300, range=150..500)
larghezza_efficace_soletta_per_singola_t = Slider(3500, range=500..10000)  # "Larghezza efficace soletta per singola trave [mm]"
area_totale_armatura_superiore_sulla_lar = Slider(3500, range=0..15000)  # "Area totale armatura superiore sulla larghezza efficace [mm²]"
distanza_asse_armatura_superiore_dall_es = Slider(50, range=10..150)  # "Distanza asse armatura superiore dall'estradosso [mm]"
area_totale_armatura_inferiore_sulla_lar = Slider(3500, range=0..15000)  # "Area totale armatura inferiore sulla larghezza efficace [mm²]"
distanza_asse_armatura_inferiore_dall_in = Slider(50, range=10..150)  # "Distanza asse armatura inferiore dall'intradosso [mm]"
sezione_soletta_per_il_misto = ConcreteSlabSection(
    Height=spessore_soletta_mm,
    Width=larghezza_efficace_soletta_per_singola_t,
    RebarArea=area_totale_armatura_superiore_sulla_lar,
    TopConcreteCover=distanza_asse_armatura_superiore_dall_es,
    BottomRebarArea=area_totale_armatura_inferiore_sulla_lar,
    BottomConcreteCover=distanza_asse_armatura_inferiore_dall_in)

# ---- group: Display Settings
opzioni_preview_enabled = BooleanToggle(True)
opzioni_preview_geometry = BooleanToggle(True)
opzioni_preview_sections = BooleanToggle(True)
opzioni_preview_shaded = BooleanToggle(True)
opzioni_preview_reinforcement = BooleanToggle(True)
opzioni_preview_loads = BooleanToggle(True)
opzioni_preview_supports = BooleanToggle(True)
opzioni_preview_releases = BooleanToggle(True)
opzioni_preview_otherattributes = BooleanToggle(True)
opzioni_preview_axes = BooleanToggle(False)
opzioni_preview_labels = BooleanToggle(False)
opzioni_preview_symbol_scale = Slider(1, range=0..2)
opzioni_preview_load_scale = Slider(1, range=0..2)
opzioni_preview_transparency = Slider(0.65, range=0..1.3)
opzioni_preview_load_case_vuoto = Text("")
opzioni_preview = DisplaySettings(
    Enabled=opzioni_preview_enabled,
    Geometry=opzioni_preview_geometry,
    Sections=opzioni_preview_sections,
    Shaded=opzioni_preview_shaded,
    Reinforcement=opzioni_preview_reinforcement,
    Loads=opzioni_preview_loads,
    Supports=opzioni_preview_supports,
    Releases=opzioni_preview_releases,
    OtherAttributes=opzioni_preview_otherattributes,
    Axes=opzioni_preview_axes,
    Labels=opzioni_preview_labels,
    SymbolScale=opzioni_preview_symbol_scale,
    LoadScale=opzioni_preview_load_scale,
    Transparency=opzioni_preview_transparency,
    LoadCase=opzioni_preview_load_case_vuoto)

# ---- group: Bridge Alignment Curve
raggio_in_pianta_mm_0_rettilineo_segno_l = Slider(0, range=-1000000..1000000)  # "Raggio in pianta [mm] — 0 rettilineo; segno = lato curva"
origine_del_tracciato_mm = Panel("0,0,0")
rotazione_iniziale_tracciato_deg = Slider(0, range=-180..180)
tracciato_rhino_3d_lunghezza_campate_pro = Curve()  # "Tracciato Rhino 3D — lunghezza = campate + prolungamenti (opzionale)"
alignmentcurve = BridgeAlignmentCurve(
    Length=spanstations.AlignmentLength,
    Radius=raggio_in_pianta_mm_0_rettilineo_segno_l,
    Origin=origine_del_tracciato_mm,
    Heading=rotazione_iniziale_tracciato_deg,
    CustomAlignment=tracciato_rhino_3d_lunghezza_campate_pro)

# ---- group: Bridge Deck Widths
sbalzo_laterale_sinistro_soletta_mm = Slider(1500, range=0..4000)
sbalzo_laterale_destro_soletta_mm = Slider(1500, range=0..4000)
deckwidths = BridgeDeckWidths(
    GirderOffsets=regulargirders,
    LeftCantilever=sbalzo_laterale_sinistro_soletta_mm,
    RightCantilever=sbalzo_laterale_destro_soletta_mm)

# ---- group: Bridge Bearing Pattern
tipi_appoggi_personalizzati_ordine_appog = Integer()  # "Tipi appoggi personalizzati — ordine appoggio poi trave (opzionale)"
bearingpattern = BridgeBearingPattern(
    SupportStations=spanstations.SupportStations,
    GirderOffsets=regulargirders,
    BearingTypes=tipi_appoggi_personalizzati_ordine_appog)

# ---- group: Bridge Girder Axes
quota_assi_travi_rispetto_all_estradosso = Slider(-1550, range=-5000..-300)  # "Quota assi travi rispetto all'estradosso [mm]"
girderaxes = BridgeGirderAxes(TransverseOffsets=regulargirders, AxisLevels=quota_assi_travi_rispetto_all_estradosso)  # -> GirderAxes, GirderCount

# ---- group: Bridge Diaphragm Choice
diaframmi_reticolari_false_anima_piena = BooleanToggle(False)
diaphragmchoice = BridgeDiaphragmChoice(UseTruss=diaframmi_reticolari_false_anima_piena, SolidDiaphragms=soliddiaphragms, TrussDiaphragms=trussdiaphragms)

# ----
progressive_appoggi = ProgressiveAppoggi(spanstations.SupportStations)
offset_effettivi_travi = OffsetEffettiviTravi(regulargirders)
luci_effettive_campate = LuciEffettiveCampate(spanstations.SpanLengths)

# ---- group: Beam Property
travi_principali_nome_proprietà = Panel("Travi principali")
travi_principali_formulazione_fem = ValueList({"Beam con flessione e torsione": 5, "Truss solo assiale": 2}, selected="Beam con flessione e torsione")
travi_principali = BeamProperty(
    Name=travi_principali_nome_proprietà,
    Type=travi_principali_formulazione_fem,
    Section=sezione_travi_principali,
    Material=materiale_carpenteria,
    Name_2=travi_principali_nome_proprietà,
    Type_2=travi_principali_formulazione_fem,
    Section_2=sezione_travi_principali,
    Material_2=materiale_carpenteria,
    Release=1)  # -> Property, Property_2

traversi_pieni_nome_proprietà = Panel("Traversi pieni")
traversi_pieni_formulazione_fem = ValueList({"Beam con flessione e torsione": 5, "Truss solo assiale": 2}, selected="Beam con flessione e torsione")
traversi_pieni = BeamProperty(
    Name=traversi_pieni_nome_proprietà,
    Type=traversi_pieni_formulazione_fem,
    Section=sezione_diaframma_pieno,
    Material=materiale_carpenteria,
    Name_2=traversi_pieni_nome_proprietà,
    Type_2=traversi_pieni_formulazione_fem,
    Section_2=sezione_diaframma_pieno,
    Material_2=materiale_carpenteria,
    Release=1)  # -> Property, Property_2

correnti_nome_proprietà = Panel("Correnti")
correnti_formulazione_fem = ValueList({"Beam con flessione e torsione": 5, "Truss solo assiale": 2}, selected="Beam con flessione e torsione")
correnti = BeamProperty(
    Name=correnti_nome_proprietà,
    Type=correnti_formulazione_fem,
    Section=correnti_reticolari,
    Material=materiale_carpenteria,
    Name_2=correnti_nome_proprietà,
    Type_2=correnti_formulazione_fem,
    Section_2=correnti_reticolari,
    Material_2=materiale_carpenteria,
    Release=1)  # -> Property, Property_2

montanti_nome_proprietà = Panel("Montanti")
montanti_formulazione_fem = ValueList({"Beam con flessione e torsione": 5, "Truss solo assiale": 2}, selected="Beam con flessione e torsione")
montanti = BeamProperty(
    Name=montanti_nome_proprietà,
    Type=montanti_formulazione_fem,
    Section=montanti_reticolari,
    Material=materiale_carpenteria,
    Name_2=montanti_nome_proprietà,
    Type_2=montanti_formulazione_fem,
    Section_2=montanti_reticolari,
    Material_2=materiale_carpenteria,
    Release=1)  # -> Property, Property_2

diagonali_nome_proprietà = Panel("Diagonali")
diagonali_formulazione_fem = ValueList({"Beam con flessione e torsione": 5, "Truss solo assiale": 2}, selected="Beam con flessione e torsione")
diagonali = BeamProperty(
    Name=diagonali_nome_proprietà,
    Type=diagonali_formulazione_fem,
    Section=diagonali_e_controventi,
    Material=materiale_carpenteria,
    Name_2=diagonali_nome_proprietà,
    Type_2=diagonali_formulazione_fem,
    Section_2=diagonali_e_controventi,
    Material_2=materiale_carpenteria,
    Release=1)  # -> Property, Property_2

# ----
materiale_acciaio = MaterialeAcciaio(materiale_carpenteria)
materiale_calcestruzzo = MaterialeCalcestruzzo(materiale_soletta)
materiale_armature_b450c_2 = MaterialeArmatureB450C(materiale_armature_b450c.Material)
soletta_con_due_file_di_armature_per_sez = SolettaConDueFileDiArmaturePerSezioneMista(sezione_soletta_per_il_misto)
sezione_acciaio_base_le_sezioni_effettiv = SezioneAcciaioBASELeSezioniEffettiveSonoDistintePerConcio(sezione_travi_principali)

# ---- group: Bridge Support Lines
sghembo_appoggi_deg_prevedere_prolungame = Slider(0, range=-45..45)  # "Sghembo appoggi [deg] — prevedere prolungamenti agli estremi"
supportlines = BridgeSupportLines(
    Alignment=alignmentcurve,
    SupportStations=spanstations.SupportStations,
    SkewAngles=sghembo_appoggi_deg_prevedere_prolungame)  # -> SupportLines, SpanLengths, SupportCentres

# ---- group: Bridge Bracing Stations
passo_massimo_controventi_longitudinali = Slider(6000, range=1000..15000)  # "Passo massimo controventi longitudinali [mm]"
bracingstations = BridgeBracingStations(
    Alignment=alignmentcurve,
    SupportStations=spanstations.SupportStations,
    MaximumPanelLength=passo_massimo_controventi_longitudinali)

# ---- group: Bridge Fabrication Segments
lunghezza_massima_concio_mm = Slider(12000, range=0..24000)
fabrication = BridgeFabricationSegments(
    Alignment=alignmentcurve,
    GirderAxes=girderaxes.GirderAxes,
    JointSets=jointtree,
    MaximumSegmentLength=lunghezza_massima_concio_mm)  # -> FabricationPlan, SegmentCount, SegmentIDs, StartStations, EndStations, SegmentLengths

# ---- group: Bridge Slab Layout
quota_asse_soletta_mm_vuoto_metà_spessor = Number()  # "Quota asse soletta [mm] — vuoto = metà spessore (opzionale)"
slablayout = BridgeSlabLayout(
    SideWidths=deckwidths,
    Thickness=spessore_soletta_mm,
    CrossfallPercent=crossfalltable.Percentages,
    CrossfallStations=crossfalltable.Stations,
    SlabAxisLevel=quota_asse_soletta_mm_vuoto_metà_spessor)

# ----
tracciato_effettivo = TracciatoEffettivo(alignmentcurve)
proprietà_fem_travi_principali = ProprietàFEMTraviPrincipali(travi_principali.Property_2)
proprietà_fem_traversi_pieni = ProprietàFEMTraversiPieni(traversi_pieni.Property_2)

# ---- group: Bridge Family Property
famiglia_proprietà_di_base_1_tutte_le_fa = Panel("-1")  # "Famiglia proprietà di base — -1 tutte le famiglie acciaio"
familyproperty = BridgeFamilyProperty(Property=travi_principali.Property_2, Family=famiglia_proprietà_di_base_1_tutte_le_fa)

# ----
proprietà_fem_correnti = ProprietàFEMCorrenti(correnti.Property_2)
proprietà_fem_montanti = ProprietàFEMMontanti(montanti.Property_2)
proprietà_fem_diagonali = ProprietàFEMDiagonali(diagonali.Property_2)

# ---- group: Bridge Section Schedule
famiglia_1_inizio_assegnazione_mm = Slider(0, range=0..200000)
codice_famiglia_1 = Slider(1, range=0..8)
proprietà_famiglia_1_group = Slider(0, range=0..10)
proprietà_famiglia_1_segment = Slider(0, range=0..10)
proprietà_famiglia_1_start_scale = Panel("1,1,0")
proprietà_famiglia_1_end_scale = Panel("1,1,0")
proprietà_famiglia_1 = BridgeSectionSchedule(
    Property=traversi_pieni.Property_2,
    Start=famiglia_1_inizio_assegnazione_mm,
    End=spanstations.AlignmentLength,
    Family=codice_famiglia_1,
    Group=proprietà_famiglia_1_group,
    Segment=proprietà_famiglia_1_segment,
    StartScale=proprietà_famiglia_1_start_scale,
    EndScale=proprietà_famiglia_1_end_scale)

famiglia_2_inizio_assegnazione_mm = Slider(0, range=0..200000)
codice_famiglia_2 = Slider(2, range=0..8)
proprietà_famiglia_2_group = Slider(0, range=0..10)
proprietà_famiglia_2_segment = Slider(0, range=0..10)
proprietà_famiglia_2_start_scale = Panel("1,1,0")
proprietà_famiglia_2_end_scale = Panel("1,1,0")
proprietà_famiglia_2 = BridgeSectionSchedule(
    Property=correnti.Property_2,
    Start=famiglia_2_inizio_assegnazione_mm,
    End=spanstations.AlignmentLength,
    Family=codice_famiglia_2,
    Group=proprietà_famiglia_2_group,
    Segment=proprietà_famiglia_2_segment,
    StartScale=proprietà_famiglia_2_start_scale,
    EndScale=proprietà_famiglia_2_end_scale)

famiglia_3_inizio_assegnazione_mm = Slider(0, range=0..200000)
codice_famiglia_3 = Slider(3, range=0..8)
proprietà_famiglia_3_group = Slider(0, range=0..10)
proprietà_famiglia_3_segment = Slider(0, range=0..10)
proprietà_famiglia_3_start_scale = Panel("1,1,0")
proprietà_famiglia_3_end_scale = Panel("1,1,0")
proprietà_famiglia_3 = BridgeSectionSchedule(
    Property=correnti.Property_2,
    Start=famiglia_3_inizio_assegnazione_mm,
    End=spanstations.AlignmentLength,
    Family=codice_famiglia_3,
    Group=proprietà_famiglia_3_group,
    Segment=proprietà_famiglia_3_segment,
    StartScale=proprietà_famiglia_3_start_scale,
    EndScale=proprietà_famiglia_3_end_scale)

famiglia_4_inizio_assegnazione_mm = Slider(0, range=0..200000)
codice_famiglia_4 = Slider(4, range=0..8)
proprietà_famiglia_4_group = Slider(0, range=0..10)
proprietà_famiglia_4_segment = Slider(0, range=0..10)
proprietà_famiglia_4_start_scale = Panel("1,1,0")
proprietà_famiglia_4_end_scale = Panel("1,1,0")
proprietà_famiglia_4 = BridgeSectionSchedule(
    Property=montanti.Property_2,
    Start=famiglia_4_inizio_assegnazione_mm,
    End=spanstations.AlignmentLength,
    Family=codice_famiglia_4,
    Group=proprietà_famiglia_4_group,
    Segment=proprietà_famiglia_4_segment,
    StartScale=proprietà_famiglia_4_start_scale,
    EndScale=proprietà_famiglia_4_end_scale)

famiglia_5_inizio_assegnazione_mm = Slider(0, range=0..200000)
codice_famiglia_5 = Slider(5, range=0..8)
proprietà_famiglia_5_group = Slider(0, range=0..10)
proprietà_famiglia_5_segment = Slider(0, range=0..10)
proprietà_famiglia_5_start_scale = Panel("1,1,0")
proprietà_famiglia_5_end_scale = Panel("1,1,0")
proprietà_famiglia_5 = BridgeSectionSchedule(
    Property=diagonali.Property_2,
    Start=famiglia_5_inizio_assegnazione_mm,
    End=spanstations.AlignmentLength,
    Family=codice_famiglia_5,
    Group=proprietà_famiglia_5_group,
    Segment=proprietà_famiglia_5_segment,
    StartScale=proprietà_famiglia_5_start_scale,
    EndScale=proprietà_famiglia_5_end_scale)

famiglia_6_inizio_assegnazione_mm = Slider(0, range=0..200000)
codice_famiglia_6 = Slider(6, range=0..8)
proprietà_famiglia_6_group = Slider(0, range=0..10)
proprietà_famiglia_6_segment = Slider(0, range=0..10)
proprietà_famiglia_6_start_scale = Panel("1,1,0")
proprietà_famiglia_6_end_scale = Panel("1,1,0")
proprietà_famiglia_6 = BridgeSectionSchedule(
    Property=diagonali.Property_2,
    Start=famiglia_6_inizio_assegnazione_mm,
    End=spanstations.AlignmentLength,
    Family=codice_famiglia_6,
    Group=proprietà_famiglia_6_group,
    Segment=proprietà_famiglia_6_segment,
    StartScale=proprietà_famiglia_6_start_scale,
    EndScale=proprietà_famiglia_6_end_scale)

famiglia_7_inizio_assegnazione_mm = Slider(0, range=0..200000)
codice_famiglia_7 = Slider(7, range=0..8)
proprietà_famiglia_7_group = Slider(0, range=0..10)
proprietà_famiglia_7_segment = Slider(0, range=0..10)
proprietà_famiglia_7_start_scale = Panel("1,1,0")
proprietà_famiglia_7_end_scale = Panel("1,1,0")
proprietà_famiglia_7 = BridgeSectionSchedule(
    Property=montanti.Property_2,
    Start=famiglia_7_inizio_assegnazione_mm,
    End=spanstations.AlignmentLength,
    Family=codice_famiglia_7,
    Group=proprietà_famiglia_7_group,
    Segment=proprietà_famiglia_7_segment,
    StartScale=proprietà_famiglia_7_start_scale,
    EndScale=proprietà_famiglia_7_end_scale)

# ----
bridgeassembly = BridgeGeometryAssembly(
    Alignment=alignmentcurve,
    SupportLines=supportlines.SupportLines,
    GirderAxes=girderaxes.GirderAxes,
    SlabLayout=slablayout,
    FabricationPlan=fabrication.FabricationPlan,
    Diaphragms=diaphragmchoice)
progressive_campi_controventi = ProgressiveCampiControventi(bracingstations)

# ---- group: Bridge Grillage Mesh
mostra_etichette_geometriche = BooleanToggle(False)
ponte_geometrico_mesh = BridgeGrillageMesh(BridgeDefinition=bridgeassembly, MeshSettings=meshsettings, Labels=mostra_etichette_geometriche)  # -> Members, MemberIDs, Longitudinals, DiaphragmMembers, Nodes, SupportPoints, JointPoints, Deck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

# ----
assi_carpenteria_per_famiglia = AssiCarpenteriaPerFamiglia(ponte_geometrico_mesh.Members)
id_degli_assi = IDDegliAssi(ponte_geometrico_mesh.MemberIDs)
travi_longitudinali_per_concio = TraviLongitudinaliPerConcio(ponte_geometrico_mesh.Longitudinals)
diaframmi_per_famiglia = DiaframmiPerFamiglia(ponte_geometrico_mesh.DiaphragmMembers)
nodi_geometrici_carpenteria = NodiGeometriciCarpenteria(ponte_geometrico_mesh.Nodes)
punti_di_appoggio = PuntiDiAppoggio(ponte_geometrico_mesh.SupportPoints)
punti_dei_giunti_di_concio = PuntiDeiGiuntiDiConcio(ponte_geometrico_mesh.JointPoints)
volume_geometrico_soletta = VolumeGeometricoSoletta(ponte_geometrico_mesh.Deck)
bordi_soletta = BordiSoletta(ponte_geometrico_mesh.DeckEdges)
riferimenti_locali = RiferimentiLocali(ponte_geometrico_mesh.Frames)
progressive_mesh = ProgressiveMesh(ponte_geometrico_mesh.Stations)
tabella_topologia = TabellaTopologia(ponte_geometrico_mesh.Topology)
tabella_conci = TabellaConci(ponte_geometrico_mesh.SegmentRanges)
informazioni_geometria = InformazioniGeometria(ponte_geometrico_mesh.Information)
geometria_carpenteria_di_base = GeometriaCarpenteriaDiBase(ponte_geometrico_mesh.BridgeGeometry)
assi_trasversali_soletta = AssiTrasversaliSoletta(ponte_geometrico_mesh.DeckBeams)
assi_eccentricità_trave_soletta = AssiEccentricitàTraveSoletta(ponte_geometrico_mesh.DeckConnections)
progressive_fasce_soletta = ProgressiveFasceSoletta(ponte_geometrico_mesh.DeckBeamStations)
larghezze_tributarie_fasce = LarghezzeTributarieFasce(ponte_geometrico_mesh.DeckStripWidths)
geometria_acciaio_fasce_soletta = GeometriaAcciaioFasceSoletta(ponte_geometrico_mesh.GrillageGeometry)
id_fasce_soletta = IDFasceSoletta(ponte_geometrico_mesh.DeckMemberIDs)

# ---- group: Bridge Longitudinal Bracing
campi_tra_travi_da_controventare_vuoto_t = Integer()  # "Campi tra travi da controventare — vuoto = tutti (opzionale)"
schema_controventi_longitudinali = ValueList({"X": 0, "V": 1, "Alternati": 2}, selected="X")
offset_normale_controventi_dagli_assi_tr = Slider(0, range=-3000..3000)  # "Offset normale controventi dagli assi travi [mm]"
nodo_all_incrocio_controventi_x = BooleanToggle(False)
numeri_campi_longitudinali_da_omettere_o = Integer()  # "Numeri campi longitudinali da omettere (opzionale)"
controventi_longitudinali = BridgeLongitudinalBracing(
    BridgeGeometry=ponte_geometrico_mesh.BridgeGeometry,
    Stations=bracingstations,
    Bays=campi_tra_travi_da_controventare_vuoto_t,
    Pattern=schema_controventi_longitudinali,
    NormalOffset=offset_normale_controventi_dagli_assi_tr,
    ConnectX=nodo_all_incrocio_controventi_x,
    OmittedPanels=numeri_campi_longitudinali_da_omettere_o)  # -> BridgeGeometry, AddedMembers, Information

# ---- group: Bridge Slab Grillage
fasce_soletta_fem_name = Panel("Soletta trasversale")
fasce_soletta_fem = BridgeSlabGrillage(GrillageGeometry=ponte_geometrico_mesh.GrillageGeometry, ConcreteMaterial=materiale_soletta, Name=fasce_soletta_fem_name)  # -> Beams, Properties, StripWidths, MemberIDs, Information

# ----
rigidlinks = BridgeRigidLinks(ConnectionAxes=flatten(ponte_geometrico_mesh.DeckConnections))  # -> Elements, Information
assi_controventi_generati_secondo_selett = AssiControventiGeneratiSecondoSelettorePerIlModello(controventi_longitudinali.AddedMembers)

# ---- group: List Item
aggiungi_controventi_longitudinali = BooleanToggle(True)
geometria_con_senza_controventi_wrap = BooleanToggle(True)
geometria_con_senza_controventi = ListItem(
    List=flatten([ponte_geometrico_mesh.BridgeGeometry, controventi_longitudinali.BridgeGeometry]),
    Index=aggiungi_controventi_longitudinali,
    Wrap=geometria_con_senza_controventi_wrap)

# ----
elementi_fem_fasce_soletta = ElementiFEMFasceSoletta(fasce_soletta_fem.Beams)
proprietà_individuali_fasce_soletta = ProprietàIndividualiFasceSoletta(fasce_soletta_fem.Properties)
larghezze_individuali_fasce_fem_mm = LarghezzeIndividualiFasceFEMMm(fasce_soletta_fem.StripWidths)
id_fasce_fem = IDFasceFEM(fasce_soletta_fem.MemberIDs)
link_rigidi_oppure_aste_di_collegamento = LinkRigidiOppureAsteDiCollegamento(rigidlinks.Elements)
geometria_carpenteria_con_opzione_contro = GeometriaCarpenteriaConOpzioneControventi(geometria_con_senza_controventi)

# ---- group: Bridge Segment Sections
sezioni_conci_mm_slider_sezione_base = Panel("""# ID; s_inizio_mm; s_fine_mm; b_inf_mm; b_sup_mm; h_mm; t_inf_mm; t_sup_mm; tw_mm; r_mm
G1-C1; 0; 11250; *; *; *; *; *; *; *
G1-C2; 11250; 22500; *; *; *; *; *; *; *
G1-C3; 22500; 33750; *; *; *; *; *; *; *
G1-C4; 33750; 45000; *; *; *; *; *; *; *
G1-C5; 45000; 56250; *; *; *; *; *; *; *
G1-C6; 56250; 67500; *; *; *; *; *; *; *
G1-C7; 67500; 78750; *; *; *; *; *; *; *
G1-C8; 78750; 90000; *; *; *; *; *; *; *
G2-C1; 0; 11250; *; *; *; *; *; *; *
G2-C2; 11250; 22500; *; *; *; *; *; *; *
G2-C3; 22500; 33750; *; *; *; *; *; *; *
G2-C4; 33750; 45000; *; *; *; *; *; *; *
G2-C5; 45000; 56250; *; *; *; *; *; *; *
G2-C6; 56250; 67500; *; *; *; *; *; *; *
G2-C7; 67500; 78750; *; *; *; *; *; *; *
G2-C8; 78750; 90000; *; *; *; *; *; *; *
G3-C1; 0; 11250; *; *; *; *; *; *; *
G3-C2; 11250; 22500; *; *; *; *; *; *; *
G3-C3; 22500; 33750; *; *; *; *; *; *; *
G3-C4; 33750; 45000; *; *; *; *; *; *; *
G3-C5; 45000; 56250; *; *; *; *; *; *; *
G3-C6; 56250; 67500; *; *; *; *; *; *; *
G3-C7; 67500; 78750; *; *; *; *; *; *; *
G3-C8; 78750; 90000; *; *; *; *; *; *; *""")
sezione_di_ogni_concio = BridgeSegmentSections(
    FabricationPlan=geometria_con_senza_controventi,
    BaseProperty=travi_principali.Property_2,
    SectionTable=sezioni_conci_mm_slider_sezione_base)  # -> Schedule, Properties, Sections, SegmentIDs, ResolvedTable, TopOffsets, Information

# ---- group: Bridge Bearings
selezione_appoggi_vuoto_tutti_opzionale = Integer()
selezione_travi_agli_appoggi_vuoto_tutte = Integer()  # "Selezione travi agli appoggi — vuoto = tutte (opzionale)"
rotazione_guide_degli_appoggi_deg = Slider(0, range=-180..180)
rigidezze_elastiche_kx_ky_kz_n_mm = Panel("0,0,0")
rigidezze_elastiche_krx_kry_krz_n_mm_rad = Panel("0,0,0")
piano_degli_appoggi_vuoto_tangente_orizz = Plane()  # "Piano degli appoggi — vuoto = tangente orizzontale (opzionale)"
appoggi_orientati = BridgeBearings(
    BridgeGeometry=geometria_con_senza_controventi,
    Supports=selezione_appoggi_vuoto_tutti_opzionale,
    Girders=selezione_travi_agli_appoggi_vuoto_tutte,
    Types=bearingpattern,
    GuideAngle=rotazione_guide_degli_appoggi_deg,
    TranslationStiffness=rigidezze_elastiche_kx_ky_kz_n_mm,
    RotationStiffness=rigidezze_elastiche_krx_kry_krz_n_mm_rad,
    Orientation=piano_degli_appoggi_vuoto_tangente_orizz)  # -> Nodes, Frames, Labels

# ----
femmembers = BridgeFEMMembers(
    BridgeGeometry=geometria_con_senza_controventi,
    FamilyProperties=familyproperty,
    SectionRules=flatten([sezione_di_ogni_concio.Schedule, proprietà_famiglia_1, proprietà_famiglia_2, proprietà_famiglia_3, proprietà_famiglia_4, proprietà_famiglia_5, proprietà_famiglia_6, proprietà_famiglia_7]))  # -> Beams, PhysicalIDs, Unassigned, Information
sezione_acciaio_di_ciascun_concio_per_se = SezioneAcciaioDiCiascunConcioPerSezioniMisteEOverride(sezione_di_ogni_concio.Sections)
proprietà_fem_di_ciascun_concio = ProprietàFEMDiCiascunConcio(sezione_di_ogni_concio.Properties)
id_ordinati_delle_sezioni_g_trave_c_conc = IDOrdinatiDelleSezioniGTraveCConcio(sezione_di_ogni_concio.SegmentIDs)
regole_effettive_di_assegnazione_delle_s = RegoleEffettiveDiAssegnazioneDelleSezioniAiConci(sezione_di_ogni_concio.Schedule)
dimensioni_effettive_di_ciascuna_sezione = DimensioniEffettiveDiCiascunaSezioneMm(sezione_di_ogni_concio.ResolvedTable)
quota_ala_superiore_rispetto_al_baricent = QuotaAlaSuperioreRispettoAlBaricentroPerConcioMm(sezione_di_ogni_concio.TopOffsets)
diagnostica_sezioni_e_aggiornamento_tabe = DiagnosticaSezioniEAggiornamentoTabellaConci(sezione_di_ogni_concio.Information)
nodi_con_vincoli_e_molle = NodiConVincoliEMolle(appoggi_orientati.Nodes)
piani_locali_dei_vincoli = PianiLocaliDeiVincoli(appoggi_orientati.Frames)
id_appoggio_e_tipo_vincolo = IDAppoggioETipoVincolo(appoggi_orientati.Labels)

# ---- group: Build Model
modello_sola_carpenteria_nome_modello = Panel("Modello sola carpenteria")
modello_sola_carpenteria_unità_del_model = ValueList({"N, mm, MPa": 2}, selected="N, mm, MPa")  # "Modello sola carpenteria | Unità del modello"
modello_sola_carpenteria_load_combinatio = LoadCombinations()  # "Modello sola carpenteria | Load Combinations (opzionale)"
modello_sola_carpenteria_staged_construc = Data()  # "Modello sola carpenteria | Staged constructions (opzionale)"
modello_sola_carpenteria = BuildModel(
    Elements=flatten([femmembers.Beams, appoggi_orientati.Nodes]),
    Name=modello_sola_carpenteria_nome_modello,
    Units=modello_sola_carpenteria_unità_del_model,
    LoadCombinations=modello_sola_carpenteria_load_combinatio,
    StagedConstructions=modello_sola_carpenteria_staged_construc)

# ----
elementi_fem_carpenteria = ElementiFEMCarpenteria(femmembers.Beams)
id_fisici_carpenteria = IDFisiciCarpenteria(femmembers.PhysicalIDs)
assi_privi_di_proprietà_deve_essere_vuot = AssiPriviDiProprietàDeveEssereVuoto(femmembers.Unassigned)

# ---- group: Build Model
modello_graticcio_con_soletta_nome_model = Panel("Modello graticcio con soletta")  # "Modello graticcio con soletta | Nome modello"
modello_graticcio_con_soletta_unità_del = ValueList({"N, mm, MPa": 2}, selected="N, mm, MPa")  # "Modello graticcio con soletta | Unità del modello"
modello_graticcio_con_soletta_load_combi = LoadCombinations()  # "Modello graticcio con soletta | Load Combinations (opzionale)"
modello_graticcio_con_soletta_staged_con = Data()  # "Modello graticcio con soletta | Staged constructions (opzionale)"
modello_graticcio_con_soletta = BuildModel(
    Elements=flatten([femmembers.Beams, appoggi_orientati.Nodes, fasce_soletta_fem.Beams, rigidlinks.Elements]),
    Name=modello_graticcio_con_soletta_nome_model,
    Units=modello_graticcio_con_soletta_unità_del,
    LoadCombinations=modello_graticcio_con_soletta_load_combi,
    StagedConstructions=modello_graticcio_con_soletta_staged_con)

# ----
modello_acciaio_base_per_fasi_di_getto = MODELLOACCIAIOBasePerFasiDiGetto(modello_sola_carpenteria)
entità_fem_assemblate = DecomposeModel(Model=modello_graticcio_con_soletta)  # -> Nodes, Beams, Plates
modello_graticcio_ingresso_per_straus = MODELLOGRATICCIOIngressoPerStraus(modello_graticcio_con_soletta)

# ---- group: Bridge Model Audit
tolleranza_audit_del_modello_mm = Slider(0.001, range=0.001..1)
controllo_connessioni_e_proprietà_bridge = Data()  # "Controllo connessioni e proprietà | Bridge Geometry (opzionale)"
controllo_connessioni_e_proprietà_phase = Data()  # "Controllo connessioni e proprietà | Phase Models (opzionale)"
controllo_connessioni_e_proprietà = BridgeModelAudit(
    Model=modello_graticcio_con_soletta,
    Tolerance=tolleranza_audit_del_modello_mm,
    BridgeGeometry=controllo_connessioni_e_proprietà_bridge,
    PhaseModels=controllo_connessioni_e_proprietà_phase)  # -> NoInputErrors, Severity, Code, Element, Description, Model

# ----
preview_del_graticcio = PreviewBridGHeModel(ModelElements=modello_graticcio_con_soletta, Settings=opzioni_preview)
tutti_i_nodi_fem_assemblati = TuttiINodiFEMAssemblati(entità_fem_assemblate.Nodes)
tutti_gli_elementi_beam_assemblati = TuttiGliElementiBeamAssemblati(entità_fem_assemblate.Beams)
audit_assenza_errori_negli_input = AuditAssenzaErroriNegliInput(controllo_connessioni_e_proprietà.NoInputErrors)
codici_diagnostici = CodiciDiagnostici(controllo_connessioni_e_proprietà.Code)
descrizione_diagnostica_del_modello = DescrizioneDiagnosticaDelModello(controllo_connessioni_e_proprietà.Description)
