# Grasshopper definition 50-ponte-quattro-modelli_REV002.ghx (Grasshopper 1.0.8)
# plug-ins: BridGHe

unit_x = UnitX(Factor=1)
panel = Panel("""60000
120000
160000""")

# ---- group: 01 | GEOMETRIA — tracciato, campate, travi, diaframmi e conci / Disposizione diaframmi
diaframmi_sulle_linee_di_appoggio = BooleanToggle(True)
schema_diaframma_reticolare = ValueList({"X": 0, "V": 1, "Warren": 2}, selected="X")
nodo_all_incrocio_delle_diagonali_x = BooleanToggle(False)
progressive_diaframmi_personalizzate_mm = Number()  # "Progressive diaframmi personalizzate [mm] (opzionale)"
passo_massimo_diaframmi_mm = Slider(5000, range=0..15000)
altezza_reticolo_dei_diaframmi_mm = Slider(1800, range=500..4000)
numero_pannelli_reticolari_fra_due_travi = Slider(2, range=1..8)
disposizione_diaframmi = BridgeDiaphragms(
    Stations=progressive_diaframmi_personalizzate_mm,
    MaximumSpacing=passo_massimo_diaframmi_mm,
    AtSupports=diaframmi_sulle_linee_di_appoggio,
    TrussHeight=altezza_reticolo_dei_diaframmi_mm,
    PanelsPerBay=numero_pannelli_reticolari_fra_due_travi,
    Pattern=schema_diaframma_reticolare,
    ConnectX=nodo_all_incrocio_delle_diagonali_x)

# ---- group: 02 | MATERIALI E SEZIONI — acciaio, soletta e misto per concio / Materiale carpenteria
# 02 | MATERIALI E SEZIONI — acciaio, soletta e misto per concio: 02 | MATERIALI E SEZIONI — acciaio, soletta e misto per concio
# Input espliciti a sinistra di ciascun componente; output nominati a destra. Seguire il flusso →
nome_materiale_acciaio = Panel("Acciaio carpenteria")
classe_acciaio = ValueList({"S235": 0, "S275": 1, "S355": 2, "S450": 3}, selected="S355")
materiale_carpenteria = Steel(Name=nome_materiale_acciaio, Grade=classe_acciaio)
materiale_acciaio = MaterialeAcciaio(materiale_carpenteria)

# ---- group: 02 | MATERIALI E SEZIONI — acciaio, soletta e misto per concio / Materiale soletta
nome_materiale_calcestruzzo = Panel("Calcestruzzo soletta")
classe_calcestruzzo = ValueList({"C25/30": 4, "C28/35": 5, "C32/40": 6, "C35/45": 7, "C40/50": 8, "C45/55": 9, "C50/60": 10}, selected="C32/40")
materiale_soletta = Concrete(Name=nome_materiale_calcestruzzo, Grade=classe_calcestruzzo)
materiale_calcestruzzo = MaterialeCalcestruzzo(materiale_soletta)

# ---- group: 02 | MATERIALI E SEZIONI — acciaio, soletta e misto per concio / Materiale armature B450C
materiale_armature_b450c_name = Panel("B450C")
materiale_armature_b450c = ReinforcementSteelB450C(Name=materiale_armature_b450c_name)  # -> Material, Information
materiale_armature_b450c_2 = MaterialeArmatureB450C(materiale_armature_b450c.Material)

# ---- group: 02 | MATERIALI E SEZIONI — acciaio, soletta e misto per concio / A+B
poisson_fasce_soletta = Slider(0.2, range=0..0.49)
costante_1_per_1_nu = Panel("1")
addition = Addition(A=poisson_fasce_soletta, B=costante_1_per_1_nu)

# ---- group: 02 | MATERIALI E SEZIONI — acciaio, soletta e misto per concio / 2(1+nu)
costante_2_per_g_e_2_1_nu = Panel("2")
_2_1_nu = Multiplication(A=addition, B=costante_2_per_g_e_2_1_nu)

# ---- group: 02 | MATERIALI E SEZIONI — acciaio, soletta e misto per concio / A/B
modulo_elastico_fasce_soletta_e_mpa = Slider(30000, range=1000..50000)
division = Division(A=modulo_elastico_fasce_soletta_e_mpa, B=_2_1_nu)

# ---- group: 02 | MATERIALI E SEZIONI — acciaio, soletta e misto per concio / Cls soletta senza peso
nome_materiale_fittizio_soletta = Panel("Soletta fittizia — densità zero")
tipo_materiale_soletta = TipoMaterialeSoletta({"Calcestruzzo": 1}, selected="Calcestruzzo")
unità_materiale_soletta = UnitàMaterialeSoletta({"N mm MPa": 2}, selected="N mm MPa")
densità_materiale_fittizio_zero_t_mm³ = Slider(0, range=0..1e-08)
dilatazione_termica_cls_1_k = Slider(1e-05, range=0..3e-05)
materiale_soletta_usa_poisson = MaterialeSolettaUsaPoisson(True)
resistenza_cls_fittizio_mpa = Slider(32, range=1..80)
resistenza_acciaio_non_usata_dal_materia = Slider(0, range=0..1)
cls_soletta_senza_peso = CustomMaterial(
    Name=nome_materiale_fittizio_soletta,
    Kind=tipo_materiale_soletta,
    Units=unità_materiale_soletta,
    ModulusMPa=modulo_elastico_fasce_soletta_e_mpa,
    PoissonRatio=poisson_fasce_soletta,
    ThermalExpansion1C=dilatazione_termica_cls_1_k,
    ShearModulusMPa=division,
    UsePoisson=materiale_soletta_usa_poisson,
    DensityTonMm³=densità_materiale_fittizio_zero_t_mm³,
    YieldingMPa=resistenza_cls_fittizio_mpa,
    StrengthForSteelMPa=resistenza_acciaio_non_usata_dal_materia)
materiale_delle_fasce_trasversali_cls_se = MaterialeDelleFasceTrasversaliClsSenzaPeso(cls_soletta_senza_peso)

# ---- group: 02 | MATERIALI E SEZIONI — acciaio, soletta e misto per concio / Sezione travi principali
sezione_travi_principali_larghezza_ala_i = Slider(600, range=1..1200)  # "Sezione travi principali | Larghezza ala inferiore [mm]"
sezione_travi_principali_larghezza_ala_s = Slider(600, range=1..1200)  # "Sezione travi principali | Larghezza ala superiore [mm]"
sezione_travi_principali_altezza_totale = Slider(2500, range=1..5000)  # "Sezione travi principali | Altezza totale [mm]"
sezione_travi_principali_spessore_ala_in = Slider(30, range=1..60)  # "Sezione travi principali | Spessore ala inferiore [mm]"
sezione_travi_principali_spessore_ala_su = Slider(30, range=1..60)  # "Sezione travi principali | Spessore ala superiore [mm]"
sezione_travi_principali_spessore_anima = Slider(16, range=1..50)  # "Sezione travi principali | Spessore anima [mm]"
sezione_travi_principali_raggio_raccordo = Slider(0, range=0..50)  # "Sezione travi principali | Raggio raccordo [mm]"
sezione_travi_principali = ISection(
    BottomFlangeWidth=sezione_travi_principali_larghezza_ala_i,
    TopFlangeWidth=sezione_travi_principali_larghezza_ala_s,
    Height=sezione_travi_principali_altezza_totale,
    BottomFlangeThickness=sezione_travi_principali_spessore_ala_in,
    TopFlangeThickness=sezione_travi_principali_spessore_ala_su,
    WebThickness=sezione_travi_principali_spessore_anima,
    Radius=sezione_travi_principali_raggio_raccordo)
sezione_acciaio_base_le_sezioni_effettiv = SezioneAcciaioBASELeSezioniEffettiveSonoDistintePerConcio(sezione_travi_principali)

# ---- group: 02 | MATERIALI E SEZIONI — acciaio, soletta e misto per concio / Sezione diaframma pieno
sezione_diaframma_pieno_larghezza_ala_in = Slider(300, range=1..600)  # "Sezione diaframma pieno | Larghezza ala inferiore [mm]"
sezione_diaframma_pieno_larghezza_ala_su = Slider(300, range=1..600)  # "Sezione diaframma pieno | Larghezza ala superiore [mm]"
sezione_diaframma_pieno_altezza_totale_m = Slider(900, range=1..1800)  # "Sezione diaframma pieno | Altezza totale [mm]"
sezione_diaframma_pieno_spessore_ala_inf = Slider(20, range=1..50)  # "Sezione diaframma pieno | Spessore ala inferiore [mm]"
sezione_diaframma_pieno_spessore_ala_sup = Slider(20, range=1..50)  # "Sezione diaframma pieno | Spessore ala superiore [mm]"
sezione_diaframma_pieno_spessore_anima_m = Slider(12, range=1..50)  # "Sezione diaframma pieno | Spessore anima [mm]"
sezione_diaframma_pieno_raggio_raccordo = Slider(0, range=0..50)  # "Sezione diaframma pieno | Raggio raccordo [mm]"
sezione_diaframma_pieno = ISection(
    BottomFlangeWidth=sezione_diaframma_pieno_larghezza_ala_in,
    TopFlangeWidth=sezione_diaframma_pieno_larghezza_ala_su,
    Height=sezione_diaframma_pieno_altezza_totale_m,
    BottomFlangeThickness=sezione_diaframma_pieno_spessore_ala_inf,
    TopFlangeThickness=sezione_diaframma_pieno_spessore_ala_sup,
    WebThickness=sezione_diaframma_pieno_spessore_anima_m,
    Radius=sezione_diaframma_pieno_raggio_raccordo)

# ---- group: 02 | MATERIALI E SEZIONI — acciaio, soletta e misto per concio / Correnti reticolari
correnti_reticolari_altezza_mm = Slider(250, range=50..600)
correnti_reticolari_larghezza_mm = Slider(250, range=50..600)
correnti_reticolari_spessore_orizzontale = Slider(10, range=2..30)  # "Correnti reticolari | Spessore orizzontale [mm]"
correnti_reticolari_spessore_verticale_m = Slider(10, range=2..30)  # "Correnti reticolari | Spessore verticale [mm]"
correnti_reticolari = HollowRect(
    Height=correnti_reticolari_altezza_mm,
    Base=correnti_reticolari_larghezza_mm,
    HorizontalThickness=correnti_reticolari_spessore_orizzontale,
    VerticalThickness=correnti_reticolari_spessore_verticale_m)

# ---- group: 02 | MATERIALI E SEZIONI — acciaio, soletta e misto per concio / Montanti reticolari
montanti_reticolari_altezza_mm = Slider(200, range=50..600)
montanti_reticolari_larghezza_mm = Slider(200, range=50..600)
montanti_reticolari_spessore_orizzontale = Slider(8, range=2..30)  # "Montanti reticolari | Spessore orizzontale [mm]"
montanti_reticolari_spessore_verticale_m = Slider(8, range=2..30)  # "Montanti reticolari | Spessore verticale [mm]"
montanti_reticolari = HollowRect(
    Height=montanti_reticolari_altezza_mm,
    Base=montanti_reticolari_larghezza_mm,
    HorizontalThickness=montanti_reticolari_spessore_orizzontale,
    VerticalThickness=montanti_reticolari_spessore_verticale_m)

# ---- group: 02 | MATERIALI E SEZIONI — acciaio, soletta e misto per concio / Diagonali e controventi
diagonali_e_controventi_altezza_mm = Slider(180, range=50..600)
diagonali_e_controventi_larghezza_mm = Slider(180, range=50..600)
diagonali_e_controventi_spessore_orizzon = Slider(8, range=2..30)  # "Diagonali e controventi | Spessore orizzontale [mm]"
diagonali_e_controventi_spessore_vertica = Slider(8, range=2..30)  # "Diagonali e controventi | Spessore verticale [mm]"
diagonali_e_controventi = HollowRect(
    Height=diagonali_e_controventi_altezza_mm,
    Base=diagonali_e_controventi_larghezza_mm,
    HorizontalThickness=diagonali_e_controventi_spessore_orizzon,
    VerticalThickness=diagonali_e_controventi_spessore_vertica)

# ---- group: 02 | MATERIALI E SEZIONI — acciaio, soletta e misto per concio / Travi principali
travi_principali_nome_proprietà = Panel("Travi principali")
travi_principali_formulazione_fem = ValueList({"Beam con flessione e torsione": 5, "Truss solo assiale": 2}, selected="Beam con flessione e torsione")
travi_principali = BeamProperty(
    Name=travi_principali_nome_proprietà,
    Type=travi_principali_formulazione_fem,
    Section=sezione_travi_principali,
    Material=materiale_carpenteria,
    Name_2=travi_principali_nome_proprietà,
    Type_2=travi_principali_formulazione_fem,
    Section_2=sezione_travi_principali,
    Material_2=materiale_carpenteria,
    Release=1)  # -> Property, Property_2
proprietà_fem_travi_principali = ProprietàFEMTraviPrincipali(travi_principali.Property_2)

# ---- group: 02 | MATERIALI E SEZIONI — acciaio, soletta e misto per concio / Traversi pieni
traversi_pieni_nome_proprietà = Panel("Traversi pieni")
traversi_pieni_formulazione_fem = ValueList({"Beam con flessione e torsione": 5, "Truss solo assiale": 2}, selected="Beam con flessione e torsione")
traversi_pieni = BeamProperty(
    Name=traversi_pieni_nome_proprietà,
    Type=traversi_pieni_formulazione_fem,
    Section=sezione_diaframma_pieno,
    Material=materiale_carpenteria,
    Name_2=traversi_pieni_nome_proprietà,
    Type_2=traversi_pieni_formulazione_fem,
    Section_2=sezione_diaframma_pieno,
    Material_2=materiale_carpenteria,
    Release=1)  # -> Property, Property_2
proprietà_fem_traversi_pieni = ProprietàFEMTraversiPieni(traversi_pieni.Property_2)

# ---- group: 02 | MATERIALI E SEZIONI — acciaio, soletta e misto per concio / Correnti
correnti_nome_proprietà = Panel("Correnti")
correnti_formulazione_fem = ValueList({"Beam con flessione e torsione": 5, "Truss solo assiale": 2}, selected="Beam con flessione e torsione")
correnti = BeamProperty(
    Name=correnti_nome_proprietà,
    Type=correnti_formulazione_fem,
    Section=correnti_reticolari,
    Material=materiale_carpenteria,
    Name_2=correnti_nome_proprietà,
    Type_2=correnti_formulazione_fem,
    Section_2=correnti_reticolari,
    Material_2=materiale_carpenteria,
    Release=1)  # -> Property, Property_2
proprietà_fem_correnti = ProprietàFEMCorrenti(correnti.Property_2)

# ---- group: 02 | MATERIALI E SEZIONI — acciaio, soletta e misto per concio / Montanti
montanti_nome_proprietà = Panel("Montanti")
montanti_formulazione_fem = ValueList({"Beam con flessione e torsione": 5, "Truss solo assiale": 2}, selected="Beam con flessione e torsione")
montanti = BeamProperty(
    Name=montanti_nome_proprietà,
    Type=montanti_formulazione_fem,
    Section=montanti_reticolari,
    Material=materiale_carpenteria,
    Name_2=montanti_nome_proprietà,
    Type_2=montanti_formulazione_fem,
    Section_2=montanti_reticolari,
    Material_2=materiale_carpenteria,
    Release=1)  # -> Property, Property_2
proprietà_fem_montanti = ProprietàFEMMontanti(montanti.Property_2)

# ---- group: 02 | MATERIALI E SEZIONI — acciaio, soletta e misto per concio / Diagonali
diagonali_nome_proprietà = Panel("Diagonali")
diagonali_formulazione_fem = ValueList({"Beam con flessione e torsione": 5, "Truss solo assiale": 2}, selected="Beam con flessione e torsione")
diagonali = BeamProperty(
    Name=diagonali_nome_proprietà,
    Type=diagonali_formulazione_fem,
    Section=diagonali_e_controventi,
    Material=materiale_carpenteria,
    Name_2=diagonali_nome_proprietà,
    Type_2=diagonali_formulazione_fem,
    Section_2=diagonali_e_controventi,
    Material_2=materiale_carpenteria,
    Release=1)  # -> Property, Property_2
proprietà_fem_diagonali = ProprietàFEMDiagonali(diagonali.Property_2)

# ---- group: 04 | MODELLO 0 · ACCIAIO (M01) — proprietà → carichi → FEM → fase 10 / M01_ACCIAIO | caso SOLETTA
m01_acciaio_nome_caso_soletta = Panel("M01_ACCIAIO_SOLETTA")
m01_acciaio_gravità_masse_non_struttural = M01_ACCIAIOGravitàMasseNonStrutturaliSOLETTA(False)
m01_acciaio_caso_soletta = LoadCase(Name=m01_acciaio_nome_caso_soletta, GravityNSM=m01_acciaio_gravità_masse_non_struttural)
m01_acciaio_m01_acciaio_caso_soletta = M01_ACCIAIOM01_ACCIAIOCasoSOLETTA(m01_acciaio_caso_soletta)

# ---- group: 04 | MODELLO 0 · ACCIAIO (M01) — proprietà → carichi → FEM → fase 10 / M01_ACCIAIO | caso TRAVI
m01_acciaio_nome_caso_travi = Panel("M01_ACCIAIO_TRAVI")
m01_acciaio_gravità_masse_non_struttural_2 = M01_ACCIAIOGravitàMasseNonStrutturaliTRAVI(False)
m01_acciaio_caso_travi = LoadCase(Name=m01_acciaio_nome_caso_travi, GravityNSM=m01_acciaio_gravità_masse_non_struttural_2)
m01_acciaio_m01_acciaio_caso_travi = M01_ACCIAIOM01_ACCIAIOCasoTRAVI(m01_acciaio_caso_travi)

# ----
results = ValueList({"Dead", "M01_ACCIAIO_SOLETTA", "M01_ACCIAIO_TRAVI", "M01-Solo Acciaio"}, selected="M01-Solo Acciaio")

# ---- group: 05 | MODELLO 1 · n∞ (M02) — proprietà → carichi → FEM → fase 20 / M02_NINF | caso SOLETTA
m02_ninf_nome_caso_soletta = Panel("M02_NINF_SOLETTA")
m02_ninf_gravità_masse_non_strutturali_s = M02_NINFGravitàMasseNonStrutturaliSOLETTA(False)
m02_ninf_caso_soletta = LoadCase(Name=m02_ninf_nome_caso_soletta, GravityNSM=m02_ninf_gravità_masse_non_strutturali_s)
m02_ninf_m02_ninf_caso_soletta = M02_NINFM02_NINFCasoSOLETTA(m02_ninf_caso_soletta)

# ---- group: 05 | MODELLO 1 · n∞ (M02) — proprietà → carichi → FEM → fase 20 / M02_NINF | caso TRAVI
m02_ninf_nome_caso_travi = Panel("M02_NINF_TRAVI")
m02_ninf_gravità_masse_non_strutturali_t = M02_NINFGravitàMasseNonStrutturaliTRAVI(False)
m02_ninf_caso_travi = LoadCase(Name=m02_ninf_nome_caso_travi, GravityNSM=m02_ninf_gravità_masse_non_strutturali_t)
m02_ninf_m02_ninf_caso_travi = M02_NINFM02_NINFCasoTRAVI(m02_ninf_caso_travi)

# ----
risposta_meccanica_1_n_infinito_2_n0 = Panel("1")

# ---- group: 06 | MODELLO 2 · n0 (M03) — proprietà → carichi → FEM → fase 30 / M03_N0 | caso SOLETTA
m03_n0_nome_caso_soletta = Panel("M03_N0_SOLETTA")
m03_n0_gravità_masse_non_strutturali_sol = M03_N0GravitàMasseNonStrutturaliSOLETTA(False)
m03_n0_caso_soletta = LoadCase(Name=m03_n0_nome_caso_soletta, GravityNSM=m03_n0_gravità_masse_non_strutturali_sol)
m03_n0_m03_n0_caso_soletta = M03_N0M03_N0CasoSOLETTA(m03_n0_caso_soletta)

# ---- group: 06 | MODELLO 2 · n0 (M03) — proprietà → carichi → FEM → fase 30 / M03_N0 | caso TRAVI
m03_n0_nome_caso_travi = Panel("M03_N0_TRAVI")
m03_n0_gravità_masse_non_strutturali_tra = M03_N0GravitàMasseNonStrutturaliTRAVI(False)
m03_n0_caso_travi = LoadCase(Name=m03_n0_nome_caso_travi, GravityNSM=m03_n0_gravità_masse_non_strutturali_tra)
m03_n0_m03_n0_caso_travi = M03_N0M03_N0CasoTRAVI(m03_n0_caso_travi)

# ----
risposta_meccanica_1_n_infinito_2_n0_2 = Panel("2")

# ---- group: 07 | MODELLO 3 · RITIRO (M04) — εcs → deformazioni → FEM → fase 40 / M04_NSH | caso RITIRO
m04_nsh_nome_caso_ritiro = Panel("M04_NSH_RITIRO")
m04_nsh_gravità_masse_non_strutturali_ri = M04_NSHGravitàMasseNonStrutturaliRITIRO(False)
m04_nsh_caso_ritiro = LoadCase(Name=m04_nsh_nome_caso_ritiro, GravityNSM=m04_nsh_gravità_masse_non_strutturali_ri)
m04_nsh_m04_nsh_caso_ritiro = M04_NSHM04_NSHCasoRITIRO(m04_nsh_caso_ritiro)

# ---- group: 08 | ASSEMBLAGGIO — quattro modelli + fasi + combinazioni; preview FEM / Tabella combinazioni da righe separate da ;
combinazioni_test_una_riga_per_risposta = Panel("""Combinazione;M01_ACCIAIO_SOLETTA;M01_ACCIAIO_TRAVI;M02_NINF_SOLETTA;M02_NINF_TRAVI;M03_N0_SOLETTA;M03_N0_TRAVI;M04_NSH_RITIRO
TEST_M01_ACCIAIO;1;1;0;0;0;0;0
TEST_M02_NINF;0;0;1;1;0;0;0
TEST_M03_N0;0;0;0;0;1;1;0
TEST_M04_NSH;0;0;0;0;0;0;1
DEMO_CUMULATIVA;1;1;1;1;1;1;1""")
separatore_della_tabella_combinazioni = Panel(";")
tabella_combinazioni_da_righe_separate_d = TextSplit(Text=combinazioni_test_una_riga_per_risposta, Separators=separatore_della_tabella_combinazioni)  # "Tabella combinazioni da righe separate da ;"

# ---- group: 08 | ASSEMBLAGGIO — quattro modelli + fasi + combinazioni; preview FEM / Opzioni preview
opzioni_preview_enabled = BooleanToggle(True)
opzioni_preview_geometry = BooleanToggle(True)
opzioni_preview_sections = BooleanToggle(True)
opzioni_preview_shaded = BooleanToggle(True)
opzioni_preview_reinforcement = BooleanToggle(True)
opzioni_preview_loads = BooleanToggle(False)
opzioni_preview_supports = BooleanToggle(True)
opzioni_preview_releases = BooleanToggle(False)
opzioni_preview_otherattributes = BooleanToggle(False)
opzioni_preview_axes = BooleanToggle(False)
opzioni_preview_labels = BooleanToggle(False)
opzioni_preview_symbol_scale = Slider(2, range=0..2)
opzioni_preview_load_scale = Slider(1, range=0..2)
opzioni_preview_transparency = Slider(0.65, range=0..1.3)
opzioni_preview_load_case_vuoto = Text("")
opzioni_preview = DisplaySettings(
    Enabled=opzioni_preview_enabled,
    Geometry=opzioni_preview_geometry,
    Sections=opzioni_preview_sections,
    Shaded=opzioni_preview_shaded,
    Reinforcement=opzioni_preview_reinforcement,
    Loads=opzioni_preview_loads,
    Supports=opzioni_preview_supports,
    Releases=opzioni_preview_releases,
    OtherAttributes=opzioni_preview_otherattributes,
    Axes=opzioni_preview_axes,
    Labels=opzioni_preview_labels,
    SymbolScale=opzioni_preview_symbol_scale,
    LoadScale=opzioni_preview_load_scale,
    Transparency=opzioni_preview_transparency,
    LoadCase=opzioni_preview_load_case_vuoto)

# ---- group: 09 | VERIFICHE — sezioni, pioli, irrigiditori e riepilogo / Opzioni delle verifiche locali — azioni già combinate
verifiche_locali_stato_limite_dei_carich = VerificheLocaliStatoLimiteDeiCarichiDEMO({"Ultimate — carichi di prova, non combinazioni normative": 0}, selected="Ultimate — carichi di prova, non combinazioni normative")
opzioni_delle_verifiche_locali_azioni_gi = Slider(1, range=0..10)
opzioni_delle_verifiche_locali_azioni_gi_2 = OpzioniDelleVerificheLocaliAzioniGiàCombinateClass4(True)
opzioni_delle_verifiche_locali_azioni_gi_3 = OpzioniDelleVerificheLocaliAzioniGiàCombinateTopFlangeBuckling(True)
opzioni_delle_verifiche_locali_azioni_gi_4 = OpzioniDelleVerificheLocaliAzioniGiàCombinateBottomFlangeBuckling(True)
opzioni_delle_verifiche_locali_azioni_gi_5 = OpzioniDelleVerificheLocaliAzioniGiàCombinateWebBuckling(True)
opzioni_delle_verifiche_locali_azioni_gi_6 = Slider(0, range=0..1)
opzioni_delle_verifiche_locali_azioni_gi_7 = Slider(1.05, range=0..2.1)
opzioni_delle_verifiche_locali_azioni_gi_8 = Slider(1.1, range=0..2.2)
opzioni_delle_verifiche_locali_azioni_gi_9 = Slider(1.25, range=0..2.5)
opzioni_delle_verifiche_locali_azioni_gi_10 = Slider(1.5, range=0..3)
opzioni_delle_verifiche_locali_azioni_gi_11 = Slider(1.15, range=0..2.3)
opzioni_delle_verifiche_locali_azioni_gi_12 = Slider(0.85, range=0..1.7)
opzioni_delle_verifiche_locali_azioni_gi_13 = Slider(1.2, range=0..2.4)
opzioni_delle_verifiche_locali_azioni_gi_14 = BridgeAnalysisOptions(
    Standard=opzioni_delle_verifiche_locali_azioni_gi,
    LimitState=verifiche_locali_stato_limite_dei_carich,
    Class4=opzioni_delle_verifiche_locali_azioni_gi_2,
    TopFlangeBuckling=opzioni_delle_verifiche_locali_azioni_gi_3,
    BottomFlangeBuckling=opzioni_delle_verifiche_locali_azioni_gi_4,
    WebBuckling=opzioni_delle_verifiche_locali_azioni_gi_5,
    CommonLoadY=opzioni_delle_verifiche_locali_azioni_gi_6,
    GammaM0=opzioni_delle_verifiche_locali_azioni_gi_7,
    GammaM1=opzioni_delle_verifiche_locali_azioni_gi_8,
    GammaM2=opzioni_delle_verifiche_locali_azioni_gi_9,
    GammaC=opzioni_delle_verifiche_locali_azioni_gi_10,
    GammaS=opzioni_delle_verifiche_locali_azioni_gi_11,
    AlphaCC=opzioni_delle_verifiche_locali_azioni_gi_12,
    ShearEta=opzioni_delle_verifiche_locali_azioni_gi_13)  # "Opzioni delle verifiche locali — azioni già combinate"

# ---- group: 09 | VERIFICHE — sezioni, pioli, irrigiditori e riepilogo / Pioli DEMO — tutte le sezioni
pioli_demo_tutte_le_sezioni_enabled = PioliDEMOTutteLeSezioniEnabled(True)
pioli_demo_tutte_le_sezioni_countperrow = Slider(2, range=0..4)
pioli_demo_tutte_le_sezioni_diameter = Slider(22, range=0..44)
pioli_demo_tutte_le_sezioni_height = Slider(180, range=0..360)
pioli_demo_tutte_le_sezioni_longitudinal = Slider(200, range=0..400)
pioli_demo_tutte_le_sezioni_transversepi = Slider(150, range=0..300)
pioli_demo_tutte_le_sezioni_fu = Slider(450, range=0..900)
pioli_demo_tutte_le_sezioni_gammav = Slider(1.25, range=0..2.5)
pioli_demo_tutte_le_sezioni_headdiameter = Slider(35, range=0..70)
pioli_demo_tutte_le_sezioni_headthicknes = Slider(10, range=0..20)
pioli_demo_tutte_le_sezioni_requiredcove = Slider(40, range=0..80)
pioli_demo_tutte_le_sezioni_repeatedacti = PioliDEMOTutteLeSezioniRepeatedActionDetail(True)
pioli_demo_tutte_le_sezioni = BridgeStuds(
    Enabled=pioli_demo_tutte_le_sezioni_enabled,
    CountPerRow=pioli_demo_tutte_le_sezioni_countperrow,
    Diameter=pioli_demo_tutte_le_sezioni_diameter,
    Height=pioli_demo_tutte_le_sezioni_height,
    LongitudinalPitch=pioli_demo_tutte_le_sezioni_longitudinal,
    TransversePitch=pioli_demo_tutte_le_sezioni_transversepi,
    Fu=pioli_demo_tutte_le_sezioni_fu,
    GammaV=pioli_demo_tutte_le_sezioni_gammav,
    HeadDiameter=pioli_demo_tutte_le_sezioni_headdiameter,
    HeadThickness=pioli_demo_tutte_le_sezioni_headthicknes,
    RequiredCover=pioli_demo_tutte_le_sezioni_requiredcove,
    RepeatedActionDetail=pioli_demo_tutte_le_sezioni_repeatedacti)

# ---- group: 09 | VERIFICHE — sezioni, pioli, irrigiditori e riepilogo / Definizione irrigiditori intermedi DEMO
irrigiditori_lunghezza_di_pannello_assun = Slider(12000, range=100..30000)
definizione_irrigiditori_intermedi_demo = DefinizioneIrrigiditoriIntermediDEMOEnabled(True)
definizione_irrigiditori_intermedi_demo_2 = Slider(0, range=0..10)
definizione_irrigiditori_intermedi_demo_3 = Slider(200, range=0..400)
definizione_irrigiditori_intermedi_demo_4 = Slider(20, range=0..40)
definizione_irrigiditori_intermedi_demo_5 = Slider(200, range=0..400)
definizione_irrigiditori_intermedi_demo_6 = Slider(20, range=0..40)
definizione_irrigiditori_intermedi_demo_7 = DefinizioneIrrigiditoriIntermediDEMOEqualPanels(True)
definizione_irrigiditori_intermedi_demo_8 = Slider(1, range=0..2)
definizione_irrigiditori_intermedi_demo_9 = Slider(0, range=0..1)
definizione_irrigiditori_intermedi_demo_10 = Slider(0, range=0..1)
definizione_irrigiditori_intermedi_demo_11 = DefinizioneIrrigiditoriIntermediDEMOCheckWelds(True)
definizione_irrigiditori_intermedi_demo_12 = Slider(6, range=0..12)
definizione_irrigiditori_intermedi_demo_13 = BridgeIntermediateStiffener(
    Enabled=definizione_irrigiditori_intermedi_demo,
    Layout=definizione_irrigiditori_intermedi_demo_2,
    Width=definizione_irrigiditori_intermedi_demo_3,
    Thickness=definizione_irrigiditori_intermedi_demo_4,
    RightWidth=definizione_irrigiditori_intermedi_demo_5,
    RightThickness=definizione_irrigiditori_intermedi_demo_6,
    LeftPanel=irrigiditori_lunghezza_di_pannello_assun,
    RightPanel=irrigiditori_lunghezza_di_pannello_assun,
    EqualPanels=definizione_irrigiditori_intermedi_demo_7,
    LengthFactor=definizione_irrigiditori_intermedi_demo_8,
    ExternalCompressionKN=definizione_irrigiditori_intermedi_demo_9,
    LoadX=definizione_irrigiditori_intermedi_demo_10,
    CheckWelds=definizione_irrigiditori_intermedi_demo_11,
    WeldThroat=definizione_irrigiditori_intermedi_demo_12)

# ---- group: M0 → MAPPA DEL MOMENTO → STATI n∞ / n0 — RITIRO NON FESSURATO
# PROCEDURA REV002 E IPOTESI: REV002 — mappa preliminare da Dead/BM2. Momento positivo: non fessurata; negativo: acciaio + armature.
# La mappa non è una determinazione normativa delle zone fessurate. I conci Excel restano fisici, le proprietà cambiano per asta FEM.
# Aste a segno variabile: scelta esplicita di approssimazione uniforme; non è un limite di sicurezza. Affinare Maximum Element Length e ricalcolare TUTTI i modelli per valutarne la sensibilità.
# M04 ritiro NON FESSURATO, per ipotesi esplicita: primario e secondario coerenti con la stessa deformazione. Verifica nel piano N–Mx–Vy.
# 1) Read Excel. 2) Run M01 includendo Dead. 3) Controlla mappa/stati. 4) Run M02, M03, M04. 5) Run Build BridGHe Model e Super Element Check. 6) Generate Report.
# Dopo ogni modifica a geometria, sezioni, carichi o politiche: ripetere le analisi. Nessun risultato FEM è incluso nel file consegnato.
# 01 | GEOMETRIA — tracciato, campate, travi, diaframmi e conci: 01 | GEOMETRIA — tracciato, campate, travi, diaframmi e conci
# Input espliciti a sinistra di ciascun componente; output nominati a destra. Seguire il flusso →
componente_del_momento = ComponenteDelMomento({"BM1 / Mx": 0, "BM2 / My — flessione principale": 1}, selected="BM2 / My — flessione principale")
aste_a_segno_variabile_approssimazione_f = AsteASegnoVariabileApprossimazioneFEM({"0 — Ferma: affinare la mesh": 0, "1 — Intera asta non fessurata": 1, "2 — Intera asta fessurata": 2}, selected="2 — Intera asta fessurata")
aste_con_momento_entro_tolleranza = AsteConMomentoEntroTolleranza({"0 — Non fessurata": 0, "1 — Fessurata": 1}, selected="0 — Non fessurata")
caso_per_la_mappa_peso_proprio = Panel("Dead")
tolleranza_momento_n_mm_1000_0_001_kn_m = Panel("1000")
segno_1_se_bm2_positivo_comprime_la_sole = Panel("1")

# ---- group: 01 | GEOMETRIA — tracciato, campate, travi, diaframmi e conci / Campate e tracciato
# 50 | QUATTRO MODELLI DI CALCOLO: 50 | STESSA GEOMETRIA, QUATTRO RISPOSTE: ACCIAIO / n infinito / n0 / n ritiro
# Conci e input geometrici come nel 49, che resta invariato. Sezioni a I per concio → sezioni miste → override per ID.
# Fasce trasversali della soletta con materiale cls di densità ZERO in tutti i modelli; E = 30000 MPa comune e modificabile.
# M01/M02/M03: pressione soletta e carico lineare travi. M04: SOLO ritiro, stessa epsilon per FEM e azione primaria.
# Ritiro calcolato da Creep And Shrinkage Concrete, quindi convertito in pre-strain + curvatura equivalente di ogni concio.
# CALCOLA I QUATTRO MODELLI = True, attendere le analisi, poi False. Run sul Build BridGHe Model per assemblare le quattro risposte.
# Run su Verifiche di tutte le travi → pioli / irrigiditori / riepilogo. Draw sui grafici; Generate sul report Word.
# Le TEST isolano le risposte; DEMO_CUMULATIVA somma tre incrementi meccanici distinti e un solo ritiro. Coefficienti dimostrativi.
# Verifica nel piano N–Mx–Vy: torsione T, flessione sull'asse debole M2 e taglio trasversale V1 sono trascurati nelle verifiche di sezione e dei dettagli; rimangono nei risultati FEM. I relativi effetti e interazioni non sono verificati.
# Le fasce cls sono attive anche nel ramo acciaio per questo confronto: non rappresenta automaticamente la fase fisica di getto fresco.
# Quote FEM, eccentricità e convenzione delle sezioni omogeneizzate seguono il flusso esistente. Vedere README dell'esempio 50.
numero_campate = Slider(5, range=1..12)
lunghezza_campata_regolare_mm = Slider(30000, range=5000..80000)
lunghezze_campate_diverse_mm_sostituisco = Number()  # "Lunghezze campate diverse [mm] — sostituiscono numero e luce (opzionale)"
numero_travi_longitudinali = Slider(3, range=2..10)
interasse_regolare_travi_mm = Slider(3500, range=1000..10000)
offset_trasversali_non_uniformi_mm_destr = Number()  # "Offset trasversali non uniformi [mm] — destra negativi (opzionale)"
sbalzo_laterale_sinistro_soletta_mm = Slider(1500, range=0..4000)
sbalzo_laterale_destro_soletta_mm = Slider(1500, range=0..4000)
prolungamento_prima_del_primo_appoggio_m = Slider(0, range=0..15000)  # "Prolungamento prima del primo appoggio [mm]"
prolungamento_dopo_ultimo_appoggio_mm = Slider(0, range=0..15000)
raggio_in_pianta_mm_0_rettilineo_segno_l = Slider(500000, range=-1000000..1000000)  # "Raggio in pianta [mm] — 0 rettilineo; segno = lato curva"
origine_del_tracciato_mm = Panel("0,0,0")
rotazione_iniziale_tracciato_deg = Slider(0, range=-180..180)
passo_massimo_controventi_longitudinali = Slider(5000, range=1000..15000)  # "Passo massimo controventi longitudinali [mm]"
tipi_appoggi_personalizzati_ordine_appog = Integer()  # "Tipi appoggi personalizzati — ordine appoggio poi trave (opzionale)"

# ----
line_sdl = LineSDL(Start=origine_del_tracciato_mm, Direction=unit_x, Length=Slider(200000, range=0..1000000))

# ---- group: 01 | GEOMETRIA — tracciato, campate, travi, diaframmi e conci / Campate e tracciato (continued)
tracciato_rhino_3d_lunghezza_campate_pro = Curve(line_sdl)  # "Tracciato Rhino 3D — lunghezza = campate + prolungamenti (opzionale)"

# ---- group: PREPARA GLI INPUT DAL TRACCIATO
# Procedura tracciato: Curva in mm. Progressive lungo la curva, ordinate automaticamente.
# Svuota APPOGGI per campate uguali. End Supports=False consente sbalzi.
# Conci e mesh FEM sono indipendenti. Dopo cambi ai conci aggiorna Excel.
appoggi_automatici_agli_estremi_della_cu = AppoggiAutomaticiAgliEstremiDellaCurva(True)
giunti_comuni_opzionali_mm_vuoto_usa_lun = GiuntiComuniOpzionaliMmVuotoUsaLunghezzaMassima()
appoggi_mm_distanze_dal_principio_della = Panel(panel)
tolleranza_normalizzazione_progressive_m = Panel("1")

# ---- group: 01 | GEOMETRIA — tracciato, campate, travi, diaframmi e conci / Ponte geometrico
quota_assi_travi_rispetto_all_estradosso = Slider(-1550, range=-5000..-300)  # "Quota assi travi rispetto all'estradosso [mm]"
spessore_soletta_mm = Slider(300, range=150..500)
pendenza_trasversale_soletta = Slider(0, range=-8..8)
lunghezza_massima_elementi_longitudinali = Slider(1000, range=500..6000)  # "Lunghezza massima elementi longitudinali [mm]"
tolleranza_discretizzazione_in_curva_mm = Slider(5, range=0.1..20)
sghembo_appoggi_deg_prevedere_prolungame = Slider(0, range=-45..45)  # "Sghembo appoggi [deg] — prevedere prolungamenti agli estremi"
mostra_etichette_geometriche = BooleanToggle(False)
passo_massimo_aste_trasversali_soletta_m = Slider(1000, range=500..6000)  # "Passo massimo aste trasversali soletta [mm]"
progressive_soletta_personalizzate_mm_so = Number()  # "Progressive soletta personalizzate [mm] — sostituiscono il passo (opzionale)"
quota_asse_soletta_mm_vuoto_metà_spessor = Number()  # "Quota asse soletta [mm] — vuoto = metà spessore (opzionale)"
diaframmi_reticolari_false_anima_piena = BooleanToggle(False)

# ---- group: 02 | MATERIALI E SEZIONI — acciaio, soletta e misto per concio / Sezione soletta per il misto
larghezza_efficace_soletta_per_singola_t = Slider(3000, range=500..10000)  # "Larghezza efficace soletta per singola trave [mm]"
area_totale_armatura_superiore_sulla_lar = Slider(3500, range=0..15000)  # "Area totale armatura superiore sulla larghezza efficace [mm²]"
distanza_asse_armatura_superiore_dall_es = Slider(50, range=10..150)  # "Distanza asse armatura superiore dall'estradosso [mm]"
area_totale_armatura_inferiore_sulla_lar = Slider(3500, range=0..15000)  # "Area totale armatura inferiore sulla larghezza efficace [mm²]"
distanza_asse_armatura_inferiore_dall_in = Slider(50, range=10..150)  # "Distanza asse armatura inferiore dall'intradosso [mm]"
sezione_soletta_per_il_misto = ConcreteSlabSection(
    Height=spessore_soletta_mm,
    Width=larghezza_efficace_soletta_per_singola_t,
    RebarArea=area_totale_armatura_superiore_sulla_lar,
    TopConcreteCover=distanza_asse_armatura_superiore_dall_es,
    BottomRebarArea=area_totale_armatura_inferiore_sulla_lar,
    BottomConcreteCover=distanza_asse_armatura_inferiore_dall_in)
soletta_con_due_file_di_armature_per_sez = SolettaConDueFileDiArmaturePerSezioneMista(sezione_soletta_per_il_misto)

# ---- group: 07 | MODELLO 3 · RITIRO (M04) — εcs → deformazioni → FEM → fase 40 / u = 2 × larghezza efficace
facce_della_soletta_esposte_all_essiccam = Panel("2")
u_2_larghezza_efficace = Multiplication(A=larghezza_efficace_soletta_per_singola_t, B=facce_della_soletta_esposte_all_essiccam)

# ---- group: 01 | GEOMETRIA — tracciato, campate, travi, diaframmi e conci / Conci di officina
giunti_mm_rami_0_comuni_n_trave_n_opzion = Number()  # "Giunti [mm] — rami {0} comuni, {n} trave n (opzionale)"
lunghezza_massima_concio_mm = Slider(12000, range=0..24000)

# ---- group: PREPARA GLI INPUT DAL TRACCIATO (continued)
tracciato_e_appoggi_per_progressiva = BridgeAlignmentInputs(
    Alignment=tracciato_rhino_3d_lunghezza_campate_pro,
    SupportStations=flatten(appoggi_mm_distanze_dal_principio_della),
    SpanCount=numero_campate,
    EndSupports=appoggi_automatici_agli_estremi_della_cu,
    JointStations=flatten(giunti_comuni_opzionali_mm_vuoto_usa_lun),
    MaximumSegmentLength=lunghezza_massima_concio_mm,
    MaximumElementLength=lunghezza_massima_elementi_longitudinali,
    StationTolerance=tolleranza_normalizzazione_progressive_m)  # -> Alignment, SpanLengths, StartOverhang, EndOverhang, SupportStations, SupportPoints, SpanCount, JointStations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

# ---- group: 01 | GEOMETRIA — tracciato, campate, travi, diaframmi e conci / Campate e tracciato (continued)
campate_e_tracciato = BridgeParametricLayout(
    SpanCount=tracciato_e_appoggi_per_progressiva.SpanCount,
    SpanLength=lunghezza_campata_regolare_mm,
    SpanLengths=tracciato_e_appoggi_per_progressiva.SpanLengths,
    GirderCount=numero_travi_longitudinali,
    GirderSpacing=interasse_regolare_travi_mm,
    GirderOffsets=offset_trasversali_non_uniformi_mm_destr,
    LeftOverhang=sbalzo_laterale_sinistro_soletta_mm,
    RightOverhang=sbalzo_laterale_destro_soletta_mm,
    StartOverhang=tracciato_e_appoggi_per_progressiva.StartOverhang,
    EndOverhang=tracciato_e_appoggi_per_progressiva.EndOverhang,
    Radius=raggio_in_pianta_mm_0_rettilineo_segno_l,
    Origin=origine_del_tracciato_mm,
    Heading=rotazione_iniziale_tracciato_deg,
    CustomAlignment=tracciato_e_appoggi_per_progressiva.Alignment,
    BracingSpacing=passo_massimo_controventi_longitudinali,
    BearingTypesOverride=tipi_appoggi_personalizzati_ordine_appog)  # -> Alignment, SupportStations, GirderOffsets, DeckWidths, SpanLengths, BearingTypes, Length, Information, BracingStations
tracciato_effettivo = TracciatoEffettivo(campate_e_tracciato.Alignment)
progressive_appoggi = ProgressiveAppoggi(campate_e_tracciato.SupportStations)
offset_effettivi_travi = OffsetEffettiviTravi(campate_e_tracciato.GirderOffsets)
luci_effettive_campate = LuciEffettiveCampate(campate_e_tracciato.SpanLengths)
progressive_campi_controventi = ProgressiveCampiControventi(campate_e_tracciato.BracingStations)

# ---- group: 01 | GEOMETRIA — tracciato, campate, travi, diaframmi e conci / Conci di officina (continued)
conci_di_officina = BridgeSegments(
    Joints=tracciato_e_appoggi_per_progressiva.JointStations,
    MaximumLength=tracciato_e_appoggi_per_progressiva.MaximumSegmentLength)

# ---- group: 01 | GEOMETRIA — tracciato, campate, travi, diaframmi e conci / Ponte geometrico (continued)
ponte_geometrico = SimpleBridge(
    Alignment=campate_e_tracciato.Alignment,
    SupportStations=campate_e_tracciato.SupportStations,
    GirderOffsets=campate_e_tracciato.GirderOffsets,
    GirderLevels=quota_assi_travi_rispetto_all_estradosso,
    DeckWidths=campate_e_tracciato.DeckWidths,
    DeckThickness=spessore_soletta_mm,
    Crossfall=pendenza_trasversale_soletta,
    Segments=conci_di_officina,
    Diaphragms=disposizione_diaframmi,
    MaximumElementLength=tracciato_e_appoggi_per_progressiva.MaximumElementLength,
    ChordTolerance=tolleranza_discretizzazione_in_curva_mm,
    SupportSkew=sghembo_appoggi_deg_prevedere_prolungame,
    Labels=mostra_etichette_geometriche,
    DeckBeamSpacing=passo_massimo_aste_trasversali_soletta_m,
    DeckBeamStations=progressive_soletta_personalizzate_mm_so,
    DeckBeamLevel=quota_asse_soletta_mm_vuoto_metà_spessor,
    TrussDiaphragms=diaframmi_reticolari_false_anima_piena)  # -> Members, MemberIDs, Longitudinals, DiaphragmMembers, Nodes, SupportPoints, JointPoints, Deck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
assi_carpenteria_per_famiglia = AssiCarpenteriaPerFamiglia(ponte_geometrico.Members)
id_degli_assi = IDDegliAssi(ponte_geometrico.MemberIDs)
travi_longitudinali_per_concio = TraviLongitudinaliPerConcio(ponte_geometrico.Longitudinals)
diaframmi_per_famiglia = DiaframmiPerFamiglia(ponte_geometrico.DiaphragmMembers)
nodi_geometrici_carpenteria = NodiGeometriciCarpenteria(ponte_geometrico.Nodes)
punti_di_appoggio = PuntiDiAppoggio(ponte_geometrico.SupportPoints)
punti_dei_giunti_di_concio = PuntiDeiGiuntiDiConcio(ponte_geometrico.JointPoints)
volume_geometrico_soletta = VolumeGeometricoSoletta(ponte_geometrico.Deck)
bordi_soletta = BordiSoletta(ponte_geometrico.DeckEdges)
riferimenti_locali = RiferimentiLocali(ponte_geometrico.Frames)
progressive_mesh = ProgressiveMesh(ponte_geometrico.Stations)
tabella_topologia = TabellaTopologia(ponte_geometrico.Topology)
tabella_conci = TabellaConci(ponte_geometrico.SegmentRanges)
informazioni_geometria = InformazioniGeometria(ponte_geometrico.Information)
geometria_carpenteria_di_base = GeometriaCarpenteriaDiBase(ponte_geometrico.BridgeGeometry)
assi_trasversali_soletta = AssiTrasversaliSoletta(ponte_geometrico.DeckBeams)
assi_eccentricità_trave_soletta = AssiEccentricitàTraveSoletta(ponte_geometrico.DeckConnections)
progressive_fasce_soletta = ProgressiveFasceSoletta(ponte_geometrico.DeckBeamStations)
larghezze_tributarie_fasce = LarghezzeTributarieFasce(ponte_geometrico.DeckStripWidths)
geometria_acciaio_fasce_soletta = GeometriaAcciaioFasceSoletta(ponte_geometrico.GrillageGeometry)
id_fasce_soletta = IDFasceSoletta(ponte_geometrico.DeckMemberIDs)

# ----
geometria_acciaio_fasce_soletta_2 = GeometriaAcciaioFasceSoletta(geometria_acciaio_fasce_soletta)
geometria_carpenteria_di_base_2 = GeometriaCarpenteriaDiBase(geometria_carpenteria_di_base)
travi_longitudinali_per_concio_2 = TraviLongitudinaliPerConcio(travi_longitudinali_per_concio)
assi_eccentricità_trave_soletta_2 = AssiEccentricitàTraveSoletta(assi_eccentricità_trave_soletta)
assi_carpenteria_per_famiglia_2 = AssiCarpenteriaPerFamiglia(assi_carpenteria_per_famiglia)
nodi_geometrici_carpenteria_2 = NodiGeometriciCarpenteria(nodi_geometrici_carpenteria)
volume_geometrico_soletta_2 = VolumeGeometricoSoletta(volume_geometrico_soletta)
larghezze_tributarie_fasce_2 = LarghezzeTributarieFasce(larghezze_tributarie_fasce)
punti_dei_giunti_di_concio_2 = PuntiDeiGiuntiDiConcio(punti_dei_giunti_di_concio)
progressive_fasce_soletta_2 = ProgressiveFasceSoletta(progressive_fasce_soletta)
informazioni_geometria_2 = InformazioniGeometria(informazioni_geometria)
diaframmi_per_famiglia_2 = DiaframmiPerFamiglia(diaframmi_per_famiglia)
assi_trasversali_soletta_2 = AssiTrasversaliSoletta(assi_trasversali_soletta)
punti_di_appoggio_2 = PuntiDiAppoggio(punti_di_appoggio)
progressive_mesh_2 = ProgressiveMesh(progressive_mesh)
tabella_topologia_2 = TabellaTopologia(tabella_topologia)
riferimenti_locali_2 = RiferimentiLocali(riferimenti_locali)
id_fasce_soletta_2 = IDFasceSoletta(id_fasce_soletta)
tabella_conci_2 = TabellaConci(tabella_conci)
bordi_soletta_2 = BordiSoletta(bordi_soletta)
id_degli_assi_2 = IDDegliAssi(id_degli_assi)

# ---- group: 01 | GEOMETRIA — tracciato, campate, travi, diaframmi e conci / Controventi longitudinali
campi_tra_travi_da_controventare_vuoto_t = Integer()  # "Campi tra travi da controventare — vuoto = tutti (opzionale)"
schema_controventi_longitudinali = ValueList({"X": 0, "V": 1, "Alternati": 2}, selected="X")
offset_normale_controventi_dagli_assi_tr = Slider(0, range=-3000..3000)  # "Offset normale controventi dagli assi travi [mm]"
nodo_all_incrocio_controventi_x = BooleanToggle(False)
numeri_campi_longitudinali_da_omettere_o = Integer()  # "Numeri campi longitudinali da omettere (opzionale)"
controventi_longitudinali = BridgeLongitudinalBracing(
    BridgeGeometry=ponte_geometrico.BridgeGeometry,
    Stations=campate_e_tracciato.BracingStations,
    Bays=campi_tra_travi_da_controventare_vuoto_t,
    Pattern=schema_controventi_longitudinali,
    NormalOffset=offset_normale_controventi_dagli_assi_tr,
    ConnectX=nodo_all_incrocio_controventi_x,
    OmittedPanels=numeri_campi_longitudinali_da_omettere_o)  # -> BridgeGeometry, AddedMembers, Information
assi_controventi_generati_secondo_selett = AssiControventiGeneratiSecondoSelettorePerIlModello(controventi_longitudinali.AddedMembers)

# ---- group: 01 | GEOMETRIA — tracciato, campate, travi, diaframmi e conci / Geometria con/senza controventi
aggiungi_controventi_longitudinali = BooleanToggle(True)
geometria_con_senza_controventi_wrap = BooleanToggle(True)
geometria_con_senza_controventi = ListItem(
    List=flatten([ponte_geometrico.BridgeGeometry, controventi_longitudinali.BridgeGeometry]),
    Index=aggiungi_controventi_longitudinali,
    Wrap=geometria_con_senza_controventi_wrap)
geometria_carpenteria_con_opzione_contro = GeometriaCarpenteriaConOpzioneControventi(geometria_con_senza_controventi)

# ---- group: CONCI E SEZIONI DA EXCEL
# Procedura Excel: File inizializzato con le tue sezioni. Modifica le celle gialle, salva Excel, premi Run in Read.
# Create genera un template nuovo. * segue Base Property. Non modificare ID/progressive.
# Il pannello originale mostra ora la tabella letta da Excel.
excel_create_read = EXCELCreateRead({"0 — Create template": 0, "1 — Read Excel": 1}, selected="0 — Create template")
consenti_sovrascrittura_excel_normalment = ConsentiSovrascritturaExcelNormalmenteFalse(True)
file_sezioni_conci = Panel("Sezioni_conci_REV002.xlsx")
conci_crea_excel_e_rileggi_le_sezioni = BridgeSegmentExcel(
    BridgeGeometry=geometria_carpenteria_con_opzione_contro,
    File=file_sezioni_conci,
    Mode=excel_create_read,
    BaseProperty=travi_principali.Property_2,
    Overwrite=consenti_sovrascrittura_excel_normalment,
    ExcelPath="C:\Users\g.pacini\Documents\Repository\BridGHe\example\50-ponte-quattro-modelli\Sezioni_conci_REV001.xlsx",
    SectionTable="""# ID; s_inizio_mm; s_fine_mm; b_inf_mm; b_sup_mm; h_mm; t_inf_mm; t_sup_mm; tw_mm; r_mm
G1-C1; 0; 11250; *; *; *; *; *; *; *
G1-C2; 11250; 22500; *; *; *; *; *; *; *
G1-C3; 22500; 33750; *; *; *; *; *; *; *
G1-C4; 33750; 45000; *; *; *; *; *; *; *
G1-C5; 45000; 56250; *; *; *; *; *; *; *
G1-C6; 56250; 67500; *; *; *; *; *; *; *
G1-C7; 67500; 78750; *; *; *; *; *; *; *
G1-C8; 78750; 90000; *; *; *; *; *; *; *
G2-C1; 0; 11250; *; *; *; *; *; *; *
G2-C2; 11250; 22500; *; *; *; *; *; *; *
G2-C3; 22500; 33750; *; *; *; *; *; *; *
G2-C4; 33750; 45000; *; *; *; *; *; *; *
G2-C5; 45000; 56250; *; *; *; *; *; *; *
G2-C6; 56250; 67500; *; *; *; *; *; *; *
G2-C7; 67500; 78750; *; *; *; *; *; *; *
G2-C8; 78750; 90000; *; *; *; *; *; *; *
G3-C1; 0; 11250; *; *; *; *; *; *; *
G3-C2; 11250; 22500; *; *; *; *; *; *; *
G3-C3; 22500; 33750; *; *; *; *; *; *; *
G3-C4; 33750; 45000; *; *; *; *; *; *; *
G3-C5; 45000; 56250; *; *; *; *; *; *; *
G3-C6; 56250; 67500; *; *; *; *; *; *; *
G3-C7; 67500; 78750; *; *; *; *; *; *; *
G3-C8; 78750; 90000; *; *; *; *; *; *; *""")  # -> Count, SegmentIDs, GirderIDs, CountsPerGirder, SectionTable, File, Information
numero_totale_di_conci_tutte_le_travi = NUMEROTOTALEDICONCITutteLeTravi(conci_crea_excel_e_rileggi_le_sezioni.Count)
id_dei_conci_una_riga_per_gx_cy = Panel(conci_crea_excel_e_rileggi_le_sezioni.SegmentIDs)
conci_per_trave_stesso_ordine_di_girder = Panel(conci_crea_excel_e_rileggi_le_sezioni.CountsPerGirder)

excel_create_read_2 = EXCELCreateRead({"0 — Create template": 0, "1 — Read Excel": 1}, selected="1 — Read Excel")
consenti_sovrascrittura_excel_normalment_2 = ConsentiSovrascritturaExcelNormalmenteFalse(False)
conci_crea_excel_e_rileggi_le_sezioni_2 = BridgeSegmentExcel(
    BridgeGeometry=geometria_carpenteria_con_opzione_contro,
    File=file_sezioni_conci,
    Mode=excel_create_read_2,
    BaseProperty=travi_principali.Property_2,
    Overwrite=consenti_sovrascrittura_excel_normalment_2,
    ExcelPath="C:\Users\g.pacini\Documents\Repository\BridGHe\example\50-ponte-quattro-modelli\Sezioni_conci_REV002.xlsx",
    SectionTable="""# ID; s_inizio_mm; s_fine_mm; b_inf_mm; b_sup_mm; h_mm; t_inf_mm; t_sup_mm; tw_mm; r_mm
G1-C1; 0; 11764.705882; 600; 600; 2500; 30; 30; 16; 0
G1-C2; 11764.705882; 23529.411765; 600; 600; 2500; 30; 30; 16; 0
G1-C3; 23529.411765; 35294.117647; 600; 600; 2500; 30; 30; 16; 0
G1-C4; 35294.117647; 47058.823529; 600; 600; 2500; 30; 30; 16; 0
G1-C5; 47058.823529; 58823.529412; 600; 600; 2500; 30; 30; 16; 0
G1-C6; 58823.529412; 70588.235294; 600; 600; 2500; 30; 30; 16; 0
G1-C7; 70588.235294; 82352.941176; 600; 600; 2500; 30; 30; 16; 0
G1-C8; 82352.941176; 94117.647059; 600; 600; 2500; 30; 30; 16; 0
G1-C9; 94117.647059; 105882.352941; 600; 600; 2500; 30; 30; 16; 0
G1-C10; 105882.352941; 117647.058824; 600; 600; 2500; 30; 30; 16; 0
G1-C11; 117647.058824; 129411.764706; 600; 600; 2500; 30; 30; 16; 0
G1-C12; 129411.764706; 141176.470588; 600; 600; 2500; 30; 30; 16; 0
G1-C13; 141176.470588; 152941.176471; 600; 600; 2500; 30; 30; 16; 0
G1-C14; 152941.176471; 164705.882353; 600; 600; 2500; 30; 30; 16; 0
G1-C15; 164705.882353; 176470.588235; 600; 600; 2500; 30; 30; 16; 0
G1-C16; 176470.588235; 188235.294118; 600; 600; 2500; 30; 30; 16; 0
G1-C17; 188235.294118; 200000; 600; 600; 2500; 30; 30; 16; 0
G2-C1; 0; 11764.705882; 600; 600; 2500; 30; 30; 16; 0
G2-C2; 11764.705882; 23529.411765; 600; 600; 2500; 30; 30; 16; 0
G2-C3; 23529.411765; 35294.117647; 600; 600; 2500; 30; 30; 16; 0
G2-C4; 35294.117647; 47058.823529; 600; 600; 2500; 30; 30; 16; 0
G2-C5; 47058.823529; 58823.529412; 600; 600; 2500; 30; 30; 16; 0
G2-C6; 58823.529412; 70588.235294; 600; 600; 2500; 30; 30; 16; 0
G2-C7; 70588.235294; 82352.941176; 600; 600; 2500; 30; 30; 16; 0
G2-C8; 82352.941176; 94117.647059; 600; 600; 2500; 30; 30; 16; 0
G2-C9; 94117.647059; 105882.352941; 600; 600; 2500; 30; 30; 16; 0
G2-C10; 105882.352941; 117647.058824; 600; 600; 2500; 30; 30; 16; 0
G2-C11; 117647.058824; 129411.764706; 600; 600; 2500; 30; 30; 16; 0
G2-C12; 129411.764706; 141176.470588; 600; 600; 2500; 30; 30; 16; 0
G2-C13; 141176.470588; 152941.176471; 600; 600; 2500; 30; 30; 16; 0
G2-C14; 152941.176471; 164705.882353; 600; 600; 2500; 30; 30; 16; 0
G2-C15; 164705.882353; 176470.588235; 600; 600; 2500; 30; 30; 16; 0
G2-C16; 176470.588235; 188235.294118; 600; 600; 2500; 30; 30; 16; 0
G2-C17; 188235.294118; 200000; 600; 600; 2500; 30; 30; 16; 0
G3-C1; 0; 11764.705882; 600; 600; 2500; 30; 30; 16; 0
G3-C2; 11764.705882; 23529.411765; 600; 600; 2500; 30; 30; 16; 0
G3-C3; 23529.411765; 35294.117647; 600; 600; 2500; 30; 30; 16; 0
G3-C4; 35294.117647; 47058.823529; 600; 600; 2500; 30; 30; 16; 0
G3-C5; 47058.823529; 58823.529412; 600; 600; 2500; 30; 30; 16; 0
G3-C6; 58823.529412; 70588.235294; 600; 600; 2500; 30; 30; 16; 0
G3-C7; 70588.235294; 82352.941176; 600; 600; 2500; 30; 30; 16; 0
G3-C8; 82352.941176; 94117.647059; 600; 600; 2500; 30; 30; 16; 0
G3-C9; 94117.647059; 105882.352941; 600; 600; 2500; 30; 30; 16; 0
G3-C10; 105882.352941; 117647.058824; 600; 600; 2500; 30; 30; 16; 0
G3-C11; 117647.058824; 129411.764706; 600; 600; 2500; 30; 30; 16; 0
G3-C12; 129411.764706; 141176.470588; 600; 600; 2500; 30; 30; 16; 0
G3-C13; 141176.470588; 152941.176471; 600; 600; 2500; 30; 30; 16; 0
G3-C14; 152941.176471; 164705.882353; 600; 600; 2500; 30; 30; 16; 0
G3-C15; 164705.882353; 176470.588235; 600; 600; 2500; 30; 30; 16; 0
G3-C16; 176470.588235; 188235.294118; 600; 600; 2500; 30; 30; 16; 0
G3-C17; 188235.294118; 200000; 600; 600; 2500; 30; 30; 16; 0""")  # -> Count, SegmentIDs, GirderIDs, CountsPerGirder, SectionTable, File, Information
numero_totale_di_conci_tutte_le_travi_2 = NUMEROTOTALEDICONCITutteLeTravi(conci_crea_excel_e_rileggi_le_sezioni_2.Count)
id_dei_conci_una_riga_per_gx_cy_2 = Panel(conci_crea_excel_e_rileggi_le_sezioni_2.SegmentIDs)
conci_per_trave_stesso_ordine_di_girder_2 = Panel(conci_crea_excel_e_rileggi_le_sezioni_2.CountsPerGirder)

# ---- group: 02 | MATERIALI E SEZIONI — acciaio, soletta e misto per concio / Sezione di ogni concio
sezioni_conci_mm_slider_sezione_base = Panel(conci_crea_excel_e_rileggi_le_sezioni_2.SectionTable)
sezione_di_ogni_concio = BridgeSegmentSections(
    BridgeGeometry=geometria_carpenteria_con_opzione_contro,
    BaseProperty=travi_principali.Property_2,
    SectionTable=sezioni_conci_mm_slider_sezione_base)  # -> Schedule, Properties, Sections, SegmentIDs, ResolvedTable, TopOffsets, Information
sezione_acciaio_di_ciascun_concio_per_se = SezioneAcciaioDiCiascunConcioPerSezioniMisteEOverride(sezione_di_ogni_concio.Sections)
proprietà_fem_di_ciascun_concio = ProprietàFEMDiCiascunConcio(sezione_di_ogni_concio.Properties)
id_ordinati_delle_sezioni_g_trave_c_conc = IDOrdinatiDelleSezioniGTraveCConcio(sezione_di_ogni_concio.SegmentIDs)
regole_effettive_di_assegnazione_delle_s = RegoleEffettiveDiAssegnazioneDelleSezioniAiConci(sezione_di_ogni_concio.Schedule)
dimensioni_effettive_di_ciascuna_sezione = DimensioniEffettiveDiCiascunaSezioneMm(sezione_di_ogni_concio.ResolvedTable)
quota_ala_superiore_rispetto_al_baricent = QuotaAlaSuperioreRispettoAlBaricentroPerConcioMm(sezione_di_ogni_concio.TopOffsets)
diagnostica_sezioni_e_aggiornamento_tabe = DiagnosticaSezioniEAggiornamentoTabellaConci(sezione_di_ogni_concio.Information)

# ---- group: 02 | MATERIALI E SEZIONI — acciaio, soletta e misto per concio / Sezioni miste di tutti i conci
n0_coefficiente_istantaneo = Slider(7, range=1..40)
n_infinito_coefficiente_a_lungo_termine = Slider(18, range=1..80)
n_ritiro_coefficiente_per_deformazioni_d = Slider(12, range=1..80)
considera_calcestruzzo_nella_sezione_mis = ConsideraCalcestruzzoNellaSezioneMista(True)
considera_armature_nella_sezione_mista = ConsideraArmatureNellaSezioneMista(True)
sezioni_miste_di_tutti_i_conci = CompositeBeamProperty(
    Name=sezione_di_ogni_concio.SegmentIDs,
    ConcreteSlabSection=sezione_soletta_per_il_misto,
    SteelSection=sezione_di_ogni_concio.Sections,
    ConcreteMaterial=materiale_soletta,
    SteelMaterial=materiale_carpenteria,
    ReinforcementMaterial=materiale_armature_b450c.Material,
    N0=n0_coefficiente_istantaneo,
    N=n_infinito_coefficiente_a_lungo_termine,
    NRitiro=n_ritiro_coefficiente_per_deformazioni_d,
    ConsiderConcrete=considera_calcestruzzo_nella_sezione_mis,
    ConsiderRebars=considera_armature_nella_sezione_mista)  # -> CompositeSection, OnlySteelProperty, N0BeamSection, NBeamSection, NRitiroBeamSection
sezioni_miste_per_concio_stesso_ordine_d = SezioniMistePerConcioStessoOrdineDegliID(sezioni_miste_di_tutti_i_conci.CompositeSection)
proprietà_per_concio_n_ritiro_beam_secti = ProprietàPerConcioNRitiroBeamSection(sezioni_miste_di_tutti_i_conci.NRitiroBeamSection)
proprietà_per_concio_n_beam_section = ProprietàPerConcioNBeamSection(sezioni_miste_di_tutti_i_conci.NBeamSection)
proprietà_per_concio_n0_beam_section = ProprietàPerConcioN0BeamSection(sezioni_miste_di_tutti_i_conci.N0BeamSection)

# ----
proprietà_per_concio_only_steel_beam_sec = ProprietàPerConcioN0BeamSection(sezioni_miste_di_tutti_i_conci.OnlySteelProperty)  # "Proprietà per concio | Only Steel Beam Section"

# ---- group: 03 | GRATICCIO COMUNE — aste, soletta, appoggi e collegamenti / Proprietà famiglia 1
famiglia_1_inizio_assegnazione_mm = Slider(0, range=0..200000)
codice_famiglia_1 = Slider(1, range=0..8)
proprietà_famiglia_1_group = Slider(0, range=0..10)
proprietà_famiglia_1_segment = Slider(0, range=0..10)
proprietà_famiglia_1_start_scale = Panel("1,1,0")
proprietà_famiglia_1_end_scale = Panel("1,1,0")
proprietà_famiglia_1 = BridgeSectionSchedule(
    Property=traversi_pieni.Property_2,
    Start=famiglia_1_inizio_assegnazione_mm,
    End=campate_e_tracciato.Length,
    Family=codice_famiglia_1,
    Group=proprietà_famiglia_1_group,
    Segment=proprietà_famiglia_1_segment,
    StartScale=proprietà_famiglia_1_start_scale,
    EndScale=proprietà_famiglia_1_end_scale)

# ---- group: 03 | GRATICCIO COMUNE — aste, soletta, appoggi e collegamenti / Proprietà famiglia 2
famiglia_2_inizio_assegnazione_mm = Slider(0, range=0..200000)
codice_famiglia_2 = Slider(2, range=0..8)
proprietà_famiglia_2_group = Slider(0, range=0..10)
proprietà_famiglia_2_segment = Slider(0, range=0..10)
proprietà_famiglia_2_start_scale = Panel("1,1,0")
proprietà_famiglia_2_end_scale = Panel("1,1,0")
proprietà_famiglia_2 = BridgeSectionSchedule(
    Property=correnti.Property_2,
    Start=famiglia_2_inizio_assegnazione_mm,
    End=campate_e_tracciato.Length,
    Family=codice_famiglia_2,
    Group=proprietà_famiglia_2_group,
    Segment=proprietà_famiglia_2_segment,
    StartScale=proprietà_famiglia_2_start_scale,
    EndScale=proprietà_famiglia_2_end_scale)

# ---- group: 03 | GRATICCIO COMUNE — aste, soletta, appoggi e collegamenti / Proprietà famiglia 3
famiglia_3_inizio_assegnazione_mm = Slider(0, range=0..200000)
codice_famiglia_3 = Slider(3, range=0..8)
proprietà_famiglia_3_group = Slider(0, range=0..10)
proprietà_famiglia_3_segment = Slider(0, range=0..10)
proprietà_famiglia_3_start_scale = Panel("1,1,0")
proprietà_famiglia_3_end_scale = Panel("1,1,0")
proprietà_famiglia_3 = BridgeSectionSchedule(
    Property=correnti.Property_2,
    Start=famiglia_3_inizio_assegnazione_mm,
    End=campate_e_tracciato.Length,
    Family=codice_famiglia_3,
    Group=proprietà_famiglia_3_group,
    Segment=proprietà_famiglia_3_segment,
    StartScale=proprietà_famiglia_3_start_scale,
    EndScale=proprietà_famiglia_3_end_scale)

# ---- group: 03 | GRATICCIO COMUNE — aste, soletta, appoggi e collegamenti / Proprietà famiglia 4
famiglia_4_inizio_assegnazione_mm = Slider(0, range=0..200000)
codice_famiglia_4 = Slider(4, range=0..8)
proprietà_famiglia_4_group = Slider(0, range=0..10)
proprietà_famiglia_4_segment = Slider(0, range=0..10)
proprietà_famiglia_4_start_scale = Panel("1,1,0")
proprietà_famiglia_4_end_scale = Panel("1,1,0")
proprietà_famiglia_4 = BridgeSectionSchedule(
    Property=montanti.Property_2,
    Start=famiglia_4_inizio_assegnazione_mm,
    End=campate_e_tracciato.Length,
    Family=codice_famiglia_4,
    Group=proprietà_famiglia_4_group,
    Segment=proprietà_famiglia_4_segment,
    StartScale=proprietà_famiglia_4_start_scale,
    EndScale=proprietà_famiglia_4_end_scale)

# ---- group: 03 | GRATICCIO COMUNE — aste, soletta, appoggi e collegamenti / Proprietà famiglia 5
famiglia_5_inizio_assegnazione_mm = Slider(0, range=0..200000)
codice_famiglia_5 = Slider(5, range=0..8)
proprietà_famiglia_5_group = Slider(0, range=0..10)
proprietà_famiglia_5_segment = Slider(0, range=0..10)
proprietà_famiglia_5_start_scale = Panel("1,1,0")
proprietà_famiglia_5_end_scale = Panel("1,1,0")
proprietà_famiglia_5 = BridgeSectionSchedule(
    Property=diagonali.Property_2,
    Start=famiglia_5_inizio_assegnazione_mm,
    End=campate_e_tracciato.Length,
    Family=codice_famiglia_5,
    Group=proprietà_famiglia_5_group,
    Segment=proprietà_famiglia_5_segment,
    StartScale=proprietà_famiglia_5_start_scale,
    EndScale=proprietà_famiglia_5_end_scale)

# ---- group: 03 | GRATICCIO COMUNE — aste, soletta, appoggi e collegamenti / Proprietà famiglia 6
famiglia_6_inizio_assegnazione_mm = Slider(0, range=0..200000)
codice_famiglia_6 = Slider(6, range=0..8)
proprietà_famiglia_6_group = Slider(0, range=0..10)
proprietà_famiglia_6_segment = Slider(0, range=0..10)
proprietà_famiglia_6_start_scale = Panel("1,1,0")
proprietà_famiglia_6_end_scale = Panel("1,1,0")
proprietà_famiglia_6 = BridgeSectionSchedule(
    Property=diagonali.Property_2,
    Start=famiglia_6_inizio_assegnazione_mm,
    End=campate_e_tracciato.Length,
    Family=codice_famiglia_6,
    Group=proprietà_famiglia_6_group,
    Segment=proprietà_famiglia_6_segment,
    StartScale=proprietà_famiglia_6_start_scale,
    EndScale=proprietà_famiglia_6_end_scale)

# ---- group: 03 | GRATICCIO COMUNE — aste, soletta, appoggi e collegamenti / Proprietà famiglia 7
famiglia_7_inizio_assegnazione_mm = Slider(0, range=0..200000)
codice_famiglia_7 = Slider(7, range=0..8)
proprietà_famiglia_7_group = Slider(0, range=0..10)
proprietà_famiglia_7_segment = Slider(0, range=0..10)
proprietà_famiglia_7_start_scale = Panel("1,1,0")
proprietà_famiglia_7_end_scale = Panel("1,1,0")
proprietà_famiglia_7 = BridgeSectionSchedule(
    Property=montanti.Property_2,
    Start=famiglia_7_inizio_assegnazione_mm,
    End=campate_e_tracciato.Length,
    Family=codice_famiglia_7,
    Group=proprietà_famiglia_7_group,
    Segment=proprietà_famiglia_7_segment,
    StartScale=proprietà_famiglia_7_start_scale,
    EndScale=proprietà_famiglia_7_end_scale)

# ---- group: 03 | GRATICCIO COMUNE — aste, soletta, appoggi e collegamenti / Carpenteria FEM per famiglia
# 03 | GRATICCIO COMUNE — aste, soletta, appoggi e collegamenti: 03 | GRATICCIO COMUNE — aste, soletta, appoggi e collegamenti
# Input espliciti a sinistra di ciascun componente; output nominati a destra. Seguire il flusso →
famiglia_proprietà_di_base_1_tutte_le_fa = Panel("-1")  # "Famiglia proprietà di base — -1 tutte le famiglie acciaio"
carpenteria_fem_per_famiglia = BridgeMemberAssignment(
    BridgeGeometry=geometria_carpenteria_con_opzione_contro,
    DefaultProperties=travi_principali.Property_2,
    Families=famiglia_proprietà_di_base_1_tutte_le_fa,
    Schedule=flatten([sezione_di_ogni_concio.Schedule, proprietà_famiglia_1, proprietà_famiglia_2, proprietà_famiglia_3, proprietà_famiglia_4, proprietà_famiglia_5, proprietà_famiglia_6, proprietà_famiglia_7]))  # -> Beams, PhysicalIDs, Unassigned, Information
elementi_fem_carpenteria = ElementiFEMCarpenteria(carpenteria_fem_per_famiglia.Beams)
id_fisici_carpenteria = IDFisiciCarpenteria(carpenteria_fem_per_famiglia.PhysicalIDs)
assi_privi_di_proprietà_deve_essere_vuot = AssiPriviDiProprietàDeveEssereVuoto(carpenteria_fem_per_famiglia.Unassigned)

# ---- group: 03 | GRATICCIO COMUNE — aste, soletta, appoggi e collegamenti / Fasce soletta FEM
fasce_soletta_fem_name = Panel("Soletta trasversale")
fasce_soletta_fem = BridgeSlabGrillage(GrillageGeometry=ponte_geometrico.GrillageGeometry, ConcreteMaterial=cls_soletta_senza_peso, Name=fasce_soletta_fem_name)  # -> Beams, Properties, StripWidths, MemberIDs, Information
larghezze_individuali_fasce_fem_mm = LarghezzeIndividualiFasceFEMMm(fasce_soletta_fem.StripWidths)
m04_nsh_fasce_soletta_senza_carichi = M04_NSHFasceSolettaSenzaCarichi(fasce_soletta_fem.Beams)
proprietà_individuali_fasce_soletta = ProprietàIndividualiFasceSoletta(fasce_soletta_fem.Properties)
elementi_fem_fasce_soletta = ElementiFEMFasceSoletta(fasce_soletta_fem.Beams)
id_fasce_fem = IDFasceFEM(fasce_soletta_fem.MemberIDs)

# ---- group: 03 | GRATICCIO COMUNE — aste, soletta, appoggi e collegamenti / Appoggi orientati
selezione_appoggi_vuoto_tutti_opzionale = Integer()
selezione_travi_agli_appoggi_vuoto_tutte = Integer()  # "Selezione travi agli appoggi — vuoto = tutte (opzionale)"
rotazione_guide_degli_appoggi_deg = Slider(0, range=-180..180)
rigidezze_elastiche_kx_ky_kz_n_mm = Panel("0,0,0")
rigidezze_elastiche_krx_kry_krz_n_mm_rad = Panel("0,0,0")
piano_degli_appoggi_vuoto_tangente_orizz = Plane()  # "Piano degli appoggi — vuoto = tangente orizzontale (opzionale)"
appoggi_orientati = BridgeBearings(
    BridgeGeometry=geometria_carpenteria_con_opzione_contro,
    Supports=selezione_appoggi_vuoto_tutti_opzionale,
    Girders=selezione_travi_agli_appoggi_vuoto_tutte,
    Types=campate_e_tracciato.BearingTypes,
    GuideAngle=rotazione_guide_degli_appoggi_deg,
    TranslationStiffness=rigidezze_elastiche_kx_ky_kz_n_mm,
    RotationStiffness=rigidezze_elastiche_krx_kry_krz_n_mm_rad,
    Orientation=piano_degli_appoggi_vuoto_tangente_orizz)  # -> Nodes, Frames, Labels
id_appoggio_e_tipo_vincolo = IDAppoggioETipoVincolo(appoggi_orientati.Labels)
nodi_con_vincoli_e_molle = NodiConVincoliEMolle(appoggi_orientati.Nodes)
piani_locali_dei_vincoli = PianiLocaliDeiVincoli(appoggi_orientati.Frames)

# ---- group: 03 | GRATICCIO COMUNE — aste, soletta, appoggi e collegamenti / Collegamenti eccentrici trave-soletta
collegamento_trave_soletta = ValueList({"Link cinematico rigido": 0, "Asta deformabile con proprietà esplicita": 1}, selected="Link cinematico rigido")
proprietà_aste_di_collegamento_necessari = Data()  # "Proprietà aste di collegamento — necessaria solo nel modo 1 (opzionale)"
collegamenti_eccentrici_trave_soletta_be = Data()  # "Collegamenti eccentrici trave-soletta | Beams (opzionale)"
collegamenti_eccentrici_trave_soletta_of = Panel("0,0,0")  # "Collegamenti eccentrici trave-soletta | Offset"
collegamenti_eccentrici_trave_soletta = BridgeConnections(
    Mode=collegamento_trave_soletta,
    Connections=flatten(ponte_geometrico.DeckConnections),
    Property=proprietà_aste_di_collegamento_necessari,
    Beams=collegamenti_eccentrici_trave_soletta_be,
    Offset=collegamenti_eccentrici_trave_soletta_of)  # -> Elements, Information
link_rigidi_oppure_aste_di_collegamento = LinkRigidiOppureAsteDiCollegamento(collegamenti_eccentrici_trave_soletta.Elements)

# ---- group: 04 | MODELLO 0 · ACCIAIO (M01) — proprietà → carichi → FEM → fase 10 / M01_ACCIAIO | proprietà longitudinali
m01_acciaio_proprietà_longitudinali_pres = M01_ACCIAIOProprietàLongitudinaliPreserveMass(True)
m01_acciaio_proprietà_longitudinali = BridgeSegmentOverride(
    Beams=carpenteria_fem_per_famiglia.Beams,
    SegmentIDs=sezione_di_ogni_concio.SegmentIDs,
    Properties=sezione_di_ogni_concio.Properties,
    PreserveMass=m01_acciaio_proprietà_longitudinali_pres)  # -> Girders, OtherSteel, BeamIDs, Information
m01_acciaio_id_travi_longitudinali = M01_ACCIAIOIDTraviLongitudinali(m01_acciaio_proprietà_longitudinali.BeamIDs)

# ----
m01_acciaio_id_travi_longitudinali_2 = M01_ACCIAIOIDTraviLongitudinali(m01_acciaio_id_travi_longitudinali)
sezioni_miste_per_concio_stesso_ordine_d_2 = SezioniMistePerConcioStessoOrdineDegliID(sezioni_miste_per_concio_stesso_ordine_d)
proprietà_per_concio_only_steel_beam_sec_2 = ProprietàPerConcioN0BeamSection(proprietà_per_concio_only_steel_beam_sec)  # "Proprietà per concio | Only Steel Beam Section"
proprietà_per_concio_n_ritiro_beam_secti_2 = ProprietàPerConcioNRitiroBeamSection(proprietà_per_concio_n_ritiro_beam_secti)
proprietà_per_concio_n_beam_section_2 = ProprietàPerConcioNBeamSection(proprietà_per_concio_n_beam_section)
proprietà_per_concio_n0_beam_section_2 = ProprietàPerConcioN0BeamSection(proprietà_per_concio_n0_beam_section)

# ---- group: 07 | MODELLO 3 · RITIRO (M04) — εcs → deformazioni → FEM → fase 40 / M04_NSH | proprietà longitudinali
m04_nsh_proprietà_longitudinali_preserve = M04_NSHProprietàLongitudinaliPreserveMass(True)
m04_nsh_proprietà_longitudinali = BridgeSegmentOverride(
    Beams=carpenteria_fem_per_famiglia.Beams,
    SegmentIDs=sezione_di_ogni_concio.SegmentIDs,
    Properties=sezioni_miste_di_tutti_i_conci.NRitiroBeamSection,
    PreserveMass=m04_nsh_proprietà_longitudinali_preserve)  # -> Girders, OtherSteel, BeamIDs, Information
m04_nsh_id_travi_longitudinali = M04_NSHIDTraviLongitudinali(m04_nsh_proprietà_longitudinali.BeamIDs)

# ---- group: 07 | MODELLO 3 · RITIRO (M04) — εcs → deformazioni → FEM → fase 40
# 07 | MODELLO 3 · RITIRO (M04) — εcs → deformazioni → FEM → fase 40: 07 | MODELLO 3 · RITIRO (M04) — εcs → deformazioni → FEM → fase 40
# Input espliciti a sinistra di ciascun componente; output nominati a destra. Seguire il flusso →
ac_larghezza_efficace_spessore = Multiplication(A=larghezza_efficace_soletta_per_singola_t, B=spessore_soletta_mm)
m04_sezione_mista_di_ogni_asta = BridgeSegmentComposite(
    Beams=flatten(m04_nsh_proprietà_longitudinali.Girders),
    SegmentIDs=sezione_di_ogni_concio.SegmentIDs,
    CompositeProperties=sezioni_miste_di_tutti_i_conci.CompositeSection)  # -> Girders, CompositeProperties, SegmentIDs, BeamIDs

# ---- group: 07 | MODELLO 3 · RITIRO (M04) — εcs → deformazioni → FEM → fase 40 / Ritiro soletta dal riferimento all'età finale
ritiro_fck_mpa_coerente_con_la_classe_cl = Slider(32, range=20..90)
ritiro_e_acciaio_mpa = Slider(210000, range=100000..250000)
ritiro_umidità_relativa = Slider(70, range=20..100)
viscosità_età_al_carico_giorni = Slider(28, range=1..365)
ritiro_età_finale_giorni = Slider(365, range=1..36500)
ritiro_fine_stagionatura_giorni = Slider(7, range=0..365)
ritiro_attivazione_del_vincolo_misto_gio = Slider(7, range=0..365)
ritiro_tipo_cemento = RitiroTipoCemento({"R": 0, "N": 1, "S": 2}, selected="N")
ritiro_soletta_dal_riferimento_all_età_f = CreepAndShrinkageConcrete(
    Fck=ritiro_fck_mpa_coerente_con_la_classe_cl,
    ElasticModulusSteel=ritiro_e_acciaio_mpa,
    ConcreteArea=ac_larghezza_efficace_spessore,
    RH=ritiro_umidità_relativa,
    U=u_2_larghezza_efficace,
    T0=viscosità_età_al_carico_giorni,
    T=ritiro_età_finale_giorni,
    CementType=ritiro_tipo_cemento,
    DryingStart=ritiro_fine_stagionatura_giorni,
    ReferenceAge=ritiro_attivazione_del_vincolo_misto_gio)  # -> N0, N, YTT0, Εcs, TotalShrinkage, DryingShrinkage, AutogenousShrinkage, NotionalSize; "Ritiro soletta dal riferimento all'età finale"
ritiro_incremento_εcs_negativo_unico_ing = RITIROIncrementoΕcsNegativoUnicoIngressoFEMEAzionePrimaria(ritiro_soletta_dal_riferimento_all_età_f.Εcs)
ritiro_spessore_fittizio_h0_mm = RITIROSpessoreFittizioH0Mm(ritiro_soletta_dal_riferimento_all_età_f.NotionalSize)

# ---- group: 07 | MODELLO 3 · RITIRO (M04) — εcs → deformazioni → FEM → fase 40 / M04 | deformazioni equivalenti per concio
m04_deformazioni_equivalenti_per_concio = CompositeShrinkageActions(
    CompositeProperty=m04_sezione_mista_di_ogni_asta.CompositeProperties,
    ConcreteStrain=ritiro_soletta_dal_riferimento_all_età_f.Εcs)  # -> StrausPreStrain, Axis2ThermalGradient, FreeCentroidStrain, FreeCurvature
ritiro_predeformazione_assiale_equivalen = RitiroPredeformazioneAssialeEquivalentePerAsta(m04_deformazioni_equivalenti_per_concio.StrausPreStrain)
ritiro_gradiente_equivalente_per_curvatu = RitiroGradienteEquivalentePerCurvaturaKMm(m04_deformazioni_equivalenti_per_concio.Axis2ThermalGradient)

# ---- group: 07 | MODELLO 3 · RITIRO (M04) — εcs → deformazioni → FEM → fase 40 / M04 | contrazione equivalente Straus
m04_tipo_predeformazione = M04TipoPredeformazione({"Strain — deformazione imposta": 1}, selected="Strain — deformazione imposta")
m04_contrazione_equivalente_straus = BeamPreLoad(
    Beam=m04_sezione_mista_di_ogni_asta.Girders,
    LoadCase=m04_nsh_caso_ritiro,
    Type=m04_tipo_predeformazione,
    Value=m04_deformazioni_equivalenti_per_concio.StrausPreStrain)

# ---- group: 07 | MODELLO 3 · RITIRO (M04) — εcs → deformazioni → FEM → fase 40 / M04 | curvatura equivalente del ritiro
m04_curvatura_equivalente_del_ritiro_axi = Slider(0, range=0..1)
m04_curvatura_equivalente_del_ritiro = BeamGradientLoad(
    Beam=m04_contrazione_equivalente_straus,
    LoadCase=m04_nsh_caso_ritiro,
    Axis1=m04_curvatura_equivalente_del_ritiro_axi,
    Axis2=m04_deformazioni_equivalenti_per_concio.Axis2ThermalGradient)
m04_nsh_travi_principali_con_proprietà_e = M04_NSHTraviPrincipaliConProprietàERitiro(m04_curvatura_equivalente_del_ritiro)

# ---- group: 04 | MODELLO 0 · ACCIAIO (M01) — proprietà → carichi → FEM → fase 10 / M01_ACCIAIO | pressione in N/mm²
conversione_pressione_kn_m²_n_mm² = Panel("0.001")

# ---- group: 05 | MODELLO 1 · n∞ (M02) — proprietà → carichi → FEM → fase 20 / M02_NINF | pressione in N/mm²
m02_ninf_pressione_verticale_soletta_kn = Slider(-1, range=-20..20)
m02_ninf_pressione_in_n_mm² = Multiplication(A=m02_ninf_pressione_verticale_soletta_kn, B=conversione_pressione_kn_m²_n_mm²)

# ---- group: 05 | MODELLO 1 · n∞ (M02) — proprietà → carichi → FEM → fase 20
# 05 | MODELLO 1 · n∞ (M02) — proprietà → carichi → FEM → fase 20: 05 | MODELLO 1 · n∞ (M02) — proprietà → carichi → FEM → fase 20
# Input espliciti a sinistra di ciascun componente; output nominati a destra. Seguire il flusso →
m02_ninf_q_pressione_fascia_tributaria = Multiplication(A=m02_ninf_pressione_in_n_mm², B=fasce_soletta_fem.StripWidths)

# ---- group: 06 | MODELLO 2 · n0 (M03) — proprietà → carichi → FEM → fase 30 / M03_N0 | pressione in N/mm²
m03_n0_pressione_verticale_soletta_kn_m² = Slider(-1, range=-20..20)
m03_n0_pressione_in_n_mm² = Multiplication(A=m03_n0_pressione_verticale_soletta_kn_m², B=conversione_pressione_kn_m²_n_mm²)

# ---- group: 06 | MODELLO 2 · n0 (M03) — proprietà → carichi → FEM → fase 30
# 06 | MODELLO 2 · n0 (M03) — proprietà → carichi → FEM → fase 30: 06 | MODELLO 2 · n0 (M03) — proprietà → carichi → FEM → fase 30
# Input espliciti a sinistra di ciascun componente; output nominati a destra. Seguire il flusso →
m03_n0_q_pressione_fascia_tributaria = Multiplication(A=m03_n0_pressione_in_n_mm², B=fasce_soletta_fem.StripWidths)

# ---- group: 04 | MODELLO 0 · ACCIAIO (M01) — proprietà → carichi → FEM → fase 10
# 04 | MODELLO 0 · ACCIAIO (M01) — proprietà → carichi → FEM → fase 10: 04 | MODELLO 0 · ACCIAIO (M01) — proprietà → carichi → FEM → fase 10
# Input espliciti a sinistra di ciascun componente; output nominati a destra. Seguire il flusso →
peso_cls_kn_m3 = Panel("25")
m01_acciaio_pressione_in_n_mm² = Multiplication(A=peso_cls_kn_m3, B=spessore_soletta_mm, C=0.001)

# ---- group: 04 | MODELLO 0 · ACCIAIO (M01) — proprietà → carichi → FEM → fase 10 / M01_ACCIAIO | pressione in N/mm² (continued)
m01_acciaio_pressione_in_n_mm²_2 = Multiplication(A=m01_acciaio_pressione_in_n_mm², B=conversione_pressione_kn_m²_n_mm², C=-1)
# ---- group: 04 | MODELLO 0 · ACCIAIO (M01) — proprietà → carichi → FEM → fase 10 (continued)
m01_acciaio_q_pressione_fascia_tributari = Multiplication(A=m01_acciaio_pressione_in_n_mm²_2, B=fasce_soletta_fem.StripWidths)  # "M01_ACCIAIO | q = pressione × fascia tributaria"

# ---- group: 04 | MODELLO 0 · ACCIAIO (M01) — proprietà → carichi → FEM → fase 10 / M01_ACCIAIO | carico soletta
schema_carichi_di_test = SchemaCarichiDiTest({"Uniforme": 0}, selected="Uniforme")
direzione_carichi_di_test = DirezioneCarichiDiTest({"Z globale": 2}, selected="Z globale")
sistema_di_riferimento_dei_carichi_globa = SistemaDiRiferimentoDeiCarichiGlobal(null)
m01_acciaio_carico_soletta_p1_opzionale = M01_ACCIAIOCaricoSolettaP1OpzionaleVuoto()
m01_acciaio_carico_soletta_pb_opzionale = M01_ACCIAIOCaricoSolettaPBOpzionaleVuoto()
m01_acciaio_carico_soletta_p2_opzionale = M01_ACCIAIOCaricoSolettaP2OpzionaleVuoto()
m01_acciaio_carico_soletta_a = Slider(0, range=0..1)
m01_acciaio_carico_soletta_b = Slider(0, range=0..1)
m01_acciaio_carico_soletta = BeamDistributedLoad(
    Beam=fasce_soletta_fem.Beams,
    LoadCase=m01_acciaio_caso_soletta,
    Type=schema_carichi_di_test,
    CoordinateSystem=sistema_di_riferimento_dei_carichi_globa,
    Direction=direzione_carichi_di_test,
    P1=m01_acciaio_carico_soletta_p1_opzionale,
    PA=m01_acciaio_q_pressione_fascia_tributari,
    PB=m01_acciaio_carico_soletta_pb_opzionale,
    P2=m01_acciaio_carico_soletta_p2_opzionale,
    A=m01_acciaio_carico_soletta_a,
    B=m01_acciaio_carico_soletta_b)
m01_acciaio_fasce_soletta_con_carico_tri = M01_ACCIAIOFasceSolettaConCaricoTributario(m01_acciaio_carico_soletta)

# ---- group: 04 | MODELLO 0 · ACCIAIO (M01) — proprietà → carichi → FEM → fase 10 / M01_ACCIAIO | carico travi
m01_acciaio_carico_verticale_travi_princ = Slider(0, range=-30..30)
m01_acciaio_carico_travi_p1_opzionale_vu = M01_ACCIAIOCaricoTraviP1OpzionaleVuoto()
m01_acciaio_carico_travi_pb_opzionale_vu = M01_ACCIAIOCaricoTraviPBOpzionaleVuoto()
m01_acciaio_carico_travi_p2_opzionale_vu = M01_ACCIAIOCaricoTraviP2OpzionaleVuoto()
m01_acciaio_carico_travi_a = Slider(0, range=0..1)
m01_acciaio_carico_travi_b = Slider(0, range=0..1)
m01_acciaio_carico_travi = BeamDistributedLoad(
    Beam=m01_acciaio_proprietà_longitudinali.Girders,
    LoadCase=m01_acciaio_caso_travi,
    Type=schema_carichi_di_test,
    CoordinateSystem=sistema_di_riferimento_dei_carichi_globa,
    Direction=direzione_carichi_di_test,
    P1=m01_acciaio_carico_travi_p1_opzionale_vu,
    PA=m01_acciaio_carico_verticale_travi_princ,
    PB=m01_acciaio_carico_travi_pb_opzionale_vu,
    P2=m01_acciaio_carico_travi_p2_opzionale_vu,
    A=m01_acciaio_carico_travi_a,
    B=m01_acciaio_carico_travi_b)
m01_acciaio_travi_principali_con_proprie = M01_ACCIAIOTraviPrincipaliConProprietàECarichi(m01_acciaio_carico_travi)

# ---- group: 04 | MODELLO 0 · ACCIAIO (M01) — proprietà → carichi → FEM → fase 10 / M01_ACCIAIO
m01_acciaio_nome_modello = Panel("M01_ACCIAIO")
modello_sola_carpenteria_staged_construc = Data()  # "Modello sola carpenteria | Staged constructions (opzionale)"
unità_dei_quattro_modelli = UnitàDeiQuattroModelli({"N mm MPa": 2}, selected="N mm MPa")
modello_sola_carpenteria_load_combinatio = LoadCombinations(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)  # "Modello sola carpenteria | Load Combinations (opzionale)"
m01_acciaio = BuildModel(
    Elements=flatten([m01_acciaio_carico_travi, m01_acciaio_proprietà_longitudinali.OtherSteel, m01_acciaio_carico_soletta, appoggi_orientati.Nodes, collegamenti_eccentrici_trave_soletta.Elements]),
    Name=m01_acciaio_nome_modello,
    Units=unità_dei_quattro_modelli,
    LoadCombinations=modello_sola_carpenteria_load_combinatio,
    StagedConstructions=modello_sola_carpenteria_staged_construc)
m01_acciaio_modello_fem_con_carichi_di_t = M01_ACCIAIOModelloFEMConCarichiDiTest(m01_acciaio)
m01_acciaio_modello_fem_caricato = M01_ACCIAIOMODELLOFEMCARICATO(m01_acciaio)

# ---- group: 04 | MODELLO 0 · ACCIAIO (M01) — proprietà → carichi → FEM → fase 10 / M01_ACCIAIO | analisi lineare
calcola_i_quattro_modelli_straus_poi_rip = CALCOLAIQUATTROMODELLISTRAUSPoiRiportareFalse(False)
m01_acciaio_file_straus = Panel("C:\Users\g.pacini\Documents\Repository\BridGHe\example\50-ponte-quattro-modelli\calcoli\REV002\M01_ACCIAIO.st7")
m01_acciaio_analisi_lineare_solver = Slider(0, range=0..10)
m01_acciaio_analisi_lineare = StrausR3Analysis(
    Model=m01_acciaio,
    Solver=m01_acciaio_analisi_lineare_solver,
    AnalysisResults=[results, caso_per_la_mappa_peso_proprio],
    OutputPath=m01_acciaio_file_straus,
    KeepRunning=calcola_i_quattro_modelli_straus_poi_rip,
    ElementGuids="[]")
m01_acciaio_modello_con_risultati_straus = M01_ACCIAIOMODELLOCONRISULTATISTRAUS(m01_acciaio_analisi_lineare)

# ---- group: M0 → MAPPA DEL MOMENTO → STATI n∞ / n0 — RITIRO NON FESSURATO (continued)
m0_calcolato_risultati_per_la_mappa_di_r = DecomposeModel(Model=m01_acciaio_analisi_lineare)  # -> Nodes, Beams, Plates; "M0 calcolato — risultati per la mappa di rigidezza"
solo_longitudinali_identità_dei_conci_in = BridgeSegmentComposite(
    Beams=m0_calcolato_risultati_per_la_mappa_di_r.Beams,
    SegmentIDs=sezione_di_ogni_concio.SegmentIDs,
    CompositeProperties=sezioni_miste_di_tutti_i_conci.CompositeSection)  # -> Girders, CompositeProperties, SegmentIDs, BeamIDs; "Solo longitudinali — identità dei conci invariata"
segno_di_bm2_sotto_peso_proprio_tutte_le = BeamMomentDispatch(
    Beams=solo_longitudinali_identità_dei_conci_in.Girders,
    Case=caso_per_la_mappa_peso_proprio,
    Tolerance=tolleranza_momento_n_mm_1000_0_001_kn_m,
    Component=componente_del_momento,
    Sign=segno_1_se_bm2_positivo_comprime_la_sole)  # -> Positive, Negative, Mixed, Zero, Missing, States, Information; "Segno di BM2 sotto peso proprio — tutte le stazioni"
aste_a_segno_variabile = ASTEASEGNOVARIABILEControllareLaMesh(segno_di_bm2_sotto_peso_proprio_tutte_le.Mixed)
mappa_aste_id_segno_estremi_m_n_mm = Panel(segno_di_bm2_sotto_peso_proprio_tutte_le.Information)

# ----
decompose_model = DecomposeModel(Model=m01_acciaio_analisi_lineare)  # -> Nodes, Beams, Plates
beam_filter = BeamFilter(Beams=decompose_model.Beams, IDs=m01_acciaio_id_travi_longitudinali_2, Units=2)  # -> Beams, Others

# ---- group: 04 | MODELLO 0 · ACCIAIO (M01) — proprietà → carichi → FEM → fase 10 / M01_ACCIAIO_SOLETTA | azione
m01_acciaio_soletta_identificativo_azion = Panel("M01_ACCIAIO_SOLETTA")
m01_acciaio_soletta_comportamento = M01_ACCIAIO_SOLETTAComportamento({"Acciaio": 0, "Lungo termine n infinito": 1, "Istantaneo n0": 2}, selected="Acciaio")
m01_acciaio_soletta_azione_beam_ids_opzi = M01_ACCIAIO_SOLETTAAzioneBeamIDsOpzionaleVuoto()
m01_acciaio_soletta_azione = BridgeAction(
    ActionID=m01_acciaio_soletta_identificativo_azion,
    Model=m01_acciaio_analisi_lineare,
    Case=m01_acciaio_caso_soletta,
    Behavior=m01_acciaio_soletta_comportamento,
    BeamIDs=m01_acciaio_soletta_azione_beam_ids_opzi)

# ---- group: 04 | MODELLO 0 · ACCIAIO (M01) — proprietà → carichi → FEM → fase 10 / M01_ACCIAIO_TRAVI | azione
m01_acciaio_travi_identificativo_azione = Panel("M01_ACCIAIO_TRAVI")
m01_acciaio_travi_comportamento = M01_ACCIAIO_TRAVIComportamento({"Acciaio": 0, "Lungo termine n infinito": 1, "Istantaneo n0": 2}, selected="Acciaio")
m01_acciaio_travi_azione_beam_ids_opzion = M01_ACCIAIO_TRAVIAzioneBeamIDsOpzionaleVuoto()
m01_acciaio_travi_azione = BridgeAction(
    ActionID=m01_acciaio_travi_identificativo_azione,
    Model=m01_acciaio_analisi_lineare,
    Case=m01_acciaio_caso_travi,
    Behavior=m01_acciaio_travi_comportamento,
    BeamIDs=m01_acciaio_travi_azione_beam_ids_opzion)

# ----
beam_results = BeamResults(Beam=simplify(beam_filter.Beams))  # -> LoadCases, Stations, Steps, ShearForces, simplify(BendingMoments), AxialForces, Torques
division_2 = Division(A=beam_results.BendingMoments, B=1000000)
deconstruct_vector = DeconstructVector(Vector=division_2)  # -> XComponent, YComponent, ZComponent
larger_than = LargerThan(FirstNumber=deconstruct_vector.YComponent, SecondNumber=0)  # -> LargerThan, OrEqualTo
mass_addition = MassAddition(Input=larger_than.LargerThan)  # -> Result, PartialResults

# ---- group: 04 | MODELLO 0 · ACCIAIO (M01) — proprietà → carichi → FEM → fase 10 / M01_ACCIAIO | fase di test
m01_acciaio_numero_fase = Slider(10, range=0..100)
m01_acciaio_nome_fase = Panel("M01_ACCIAIO")
m01_acciaio_stato_sezione = M01_ACCIAIOStatoSezione({"Acciaio": 0, "Misto attivo": 1}, selected="Acciaio")
m01_acciaio_fase_di_test_day_opzionale_v = M01_ACCIAIOFaseDiTestDayOpzionaleVuoto()
m01_acciaio_fase_di_test = BridgePhase(
    Number=m01_acciaio_numero_fase,
    Name=m01_acciaio_nome_fase,
    SectionState=m01_acciaio_stato_sezione,
    Actions=[m01_acciaio_soletta_azione, m01_acciaio_travi_azione],
    Day=m01_acciaio_fase_di_test_day_opzionale_v)
m01_acciaio_definizione_fase = M01_ACCIAIODefinizioneFase(m01_acciaio_fase_di_test)

# ----
dispatch = Dispatch(List=simplify(graft(beam_filter.Beams)), DispatchPattern=mass_addition.Result)  # -> ListA, ListB
brep = Brep(dispatch.ListA)
brep_2 = Brep(dispatch.ListB)
panel_2 = Panel(dispatch.ListA)
prova_rev001_non_collegata_ai_modelli = BeamOverride(Beam=dispatch.ListA)

# ---- group: 05 | MODELLO 1 · n∞ (M02) — proprietà → carichi → FEM → fase 20 / M02_NINF | proprietà longitudinali
m02_ninf_proprietà_longitudinali_preserv = M02_NINFProprietàLongitudinaliPreserveMass(True)
m02_ninf_proprietà_per_stato_di_ogni_ast = BridgeStateOverride(
    Beams=carpenteria_fem_per_famiglia.Beams,
    SegmentIDs=sezione_di_ogni_concio.SegmentIDs,
    CompositeSections=sezioni_miste_di_tutti_i_conci.CompositeSection,
    States=segno_di_bm2_sotto_peso_proprio_tutte_le.States,
    Response=risposta_meccanica_1_n_infinito_2_n0,
    MixedPolicy=aste_a_segno_variabile_approssimazione_f,
    ZeroPolicy=aste_con_momento_entro_tolleranza,
    PreserveMass=m02_ninf_proprietà_longitudinali_preserv)  # -> Girders, OtherSteel, BeamIDs, Information; "M02_NINF | proprietà per stato di ogni asta"
m02_ninf_id_travi_longitudinali = M02_NINFIDTraviLongitudinali(m02_ninf_proprietà_per_stato_di_ogni_ast.BeamIDs)

# ---- group: 05 | MODELLO 1 · n∞ (M02) — proprietà → carichi → FEM → fase 20 / M02_NINF | carico soletta
m02_ninf_carico_soletta_p1_opzionale_vuo = M02_NINFCaricoSolettaP1OpzionaleVuoto()
m02_ninf_carico_soletta_pb_opzionale_vuo = M02_NINFCaricoSolettaPBOpzionaleVuoto()
m02_ninf_carico_soletta_p2_opzionale_vuo = M02_NINFCaricoSolettaP2OpzionaleVuoto()
m02_ninf_carico_soletta_a = Slider(0, range=0..1)
m02_ninf_carico_soletta_b = Slider(0, range=0..1)
m02_ninf_carico_soletta = BeamDistributedLoad(
    Beam=fasce_soletta_fem.Beams,
    LoadCase=m02_ninf_caso_soletta,
    Type=schema_carichi_di_test,
    CoordinateSystem=sistema_di_riferimento_dei_carichi_globa,
    Direction=direzione_carichi_di_test,
    P1=m02_ninf_carico_soletta_p1_opzionale_vuo,
    PA=m02_ninf_q_pressione_fascia_tributaria,
    PB=m02_ninf_carico_soletta_pb_opzionale_vuo,
    P2=m02_ninf_carico_soletta_p2_opzionale_vuo,
    A=m02_ninf_carico_soletta_a,
    B=m02_ninf_carico_soletta_b)
m02_ninf_fasce_soletta_con_carico_tribut = M02_NINFFasceSolettaConCaricoTributario(m02_ninf_carico_soletta)

# ---- group: 05 | MODELLO 1 · n∞ (M02) — proprietà → carichi → FEM → fase 20 / M02_NINF | carico travi
m02_ninf_carico_verticale_travi_principa = Slider(-1, range=-30..30)
m02_ninf_carico_travi_p1_opzionale_vuoto = M02_NINFCaricoTraviP1OpzionaleVuoto()
m02_ninf_carico_travi_pb_opzionale_vuoto = M02_NINFCaricoTraviPBOpzionaleVuoto()
m02_ninf_carico_travi_p2_opzionale_vuoto = M02_NINFCaricoTraviP2OpzionaleVuoto()
m02_ninf_carico_travi_a = Slider(0, range=0..1)
m02_ninf_carico_travi_b = Slider(0, range=0..1)
m02_ninf_carico_travi = BeamDistributedLoad(
    Beam=m02_ninf_proprietà_per_stato_di_ogni_ast.Girders,
    LoadCase=m02_ninf_caso_travi,
    Type=schema_carichi_di_test,
    CoordinateSystem=sistema_di_riferimento_dei_carichi_globa,
    Direction=direzione_carichi_di_test,
    P1=m02_ninf_carico_travi_p1_opzionale_vuoto,
    PA=m02_ninf_carico_verticale_travi_principa,
    PB=m02_ninf_carico_travi_pb_opzionale_vuoto,
    P2=m02_ninf_carico_travi_p2_opzionale_vuoto,
    A=m02_ninf_carico_travi_a,
    B=m02_ninf_carico_travi_b)
m02_ninf_travi_principali_con_proprietà = M02_NINFTraviPrincipaliConProprietàECarichi(m02_ninf_carico_travi)

# ---- group: 05 | MODELLO 1 · n∞ (M02) — proprietà → carichi → FEM → fase 20 / M02_NINF
m02_ninf_nome_modello = Panel("M02_NINF")
modello_graticcio_con_soletta_staged_con = Data()  # "Modello graticcio con soletta | Staged constructions (opzionale)"
modello_graticcio_con_soletta_load_combi = LoadCombinations()  # "Modello graticcio con soletta | Load Combinations (opzionale)"
m02_ninf = BuildModel(
    Elements=flatten([m02_ninf_carico_travi, m02_ninf_proprietà_per_stato_di_ogni_ast.OtherSteel, m02_ninf_carico_soletta, appoggi_orientati.Nodes, collegamenti_eccentrici_trave_soletta.Elements]),
    Name=m02_ninf_nome_modello,
    Units=unità_dei_quattro_modelli,
    LoadCombinations=modello_graticcio_con_soletta_load_combi,
    StagedConstructions=modello_graticcio_con_soletta_staged_con)
m02_ninf_modello_fem_con_carichi_di_test = M02_NINFModelloFEMConCarichiDiTest(m02_ninf)
m02_ninf_modello_fem_caricato = M02_NINFMODELLOFEMCARICATO(m02_ninf)

# ---- group: 05 | MODELLO 1 · n∞ (M02) — proprietà → carichi → FEM → fase 20 / M02_NINF | analisi lineare
m02_ninf_file_straus = Panel("C:\Users\g.pacini\Documents\Repository\BridGHe\example\50-ponte-quattro-modelli\calcoli\REV002\M02_NINF.st7")
m02_ninf_casi_restituiti = Panel("""M02_NINF_SOLETTA
M02_NINF_TRAVI
Dead""")
m02_ninf_analisi_lineare_solver = Slider(0, range=0..10)
m02_ninf_analisi_lineare = StrausR3Analysis(
    Model=m02_ninf,
    Solver=m02_ninf_analisi_lineare_solver,
    AnalysisResults=m02_ninf_casi_restituiti,
    OutputPath=m02_ninf_file_straus,
    KeepRunning=calcola_i_quattro_modelli_straus_poi_rip,
    ElementGuids="[]")
m02_ninf_modello_con_risultati_straus = M02_NINFMODELLOCONRISULTATISTRAUS(m02_ninf_analisi_lineare)

# ---- group: 05 | MODELLO 1 · n∞ (M02) — proprietà → carichi → FEM → fase 20 / M02_NINF_SOLETTA | azione
m02_ninf_soletta_identificativo_azione = Panel("M02_NINF_SOLETTA")
m02_ninf_soletta_comportamento = M02_NINF_SOLETTAComportamento({"Acciaio": 0, "Lungo termine n infinito": 1, "Istantaneo n0": 2}, selected="Lungo termine n infinito")
m02_ninf_soletta_azione_beam_ids_opziona = M02_NINF_SOLETTAAzioneBeamIDsOpzionaleVuoto()
m02_ninf_soletta_azione = BridgeAction(
    ActionID=m02_ninf_soletta_identificativo_azione,
    Model=m02_ninf_analisi_lineare,
    Case=m02_ninf_caso_soletta,
    Behavior=m02_ninf_soletta_comportamento,
    BeamIDs=m02_ninf_soletta_azione_beam_ids_opziona)

# ---- group: 05 | MODELLO 1 · n∞ (M02) — proprietà → carichi → FEM → fase 20 / M02_NINF_TRAVI | azione
m02_ninf_travi_identificativo_azione = Panel("M02_NINF_TRAVI")
m02_ninf_travi_comportamento = M02_NINF_TRAVIComportamento({"Acciaio": 0, "Lungo termine n infinito": 1, "Istantaneo n0": 2}, selected="Lungo termine n infinito")
m02_ninf_travi_azione_beam_ids_opzionale = M02_NINF_TRAVIAzioneBeamIDsOpzionaleVuoto()
m02_ninf_travi_azione = BridgeAction(
    ActionID=m02_ninf_travi_identificativo_azione,
    Model=m02_ninf_analisi_lineare,
    Case=m02_ninf_caso_travi,
    Behavior=m02_ninf_travi_comportamento,
    BeamIDs=m02_ninf_travi_azione_beam_ids_opzionale)

# ---- group: 05 | MODELLO 1 · n∞ (M02) — proprietà → carichi → FEM → fase 20 / M02_NINF | fase di test
m02_ninf_numero_fase = Slider(20, range=0..100)
m02_ninf_nome_fase = Panel("M02_NINF")
m02_ninf_stato_sezione = M02_NINFStatoSezione({"Acciaio": 0, "Misto attivo": 1}, selected="Misto attivo")
m02_ninf_fase_di_test_day_opzionale_vuot = M02_NINFFaseDiTestDayOpzionaleVuoto()
m02_ninf_fase_di_test = BridgePhase(
    Number=m02_ninf_numero_fase,
    Name=m02_ninf_nome_fase,
    SectionState=m02_ninf_stato_sezione,
    Actions=[m02_ninf_soletta_azione, m02_ninf_travi_azione],
    Day=m02_ninf_fase_di_test_day_opzionale_vuot)
m02_ninf_definizione_fase = M02_NINFDefinizioneFase(m02_ninf_fase_di_test)

# ---- group: 06 | MODELLO 2 · n0 (M03) — proprietà → carichi → FEM → fase 30 / M03_N0 | proprietà longitudinali
m03_n0_proprietà_longitudinali_preserve = M03_N0ProprietàLongitudinaliPreserveMass(True)
m03_n0_proprietà_per_stato_di_ogni_asta = BridgeStateOverride(
    Beams=carpenteria_fem_per_famiglia.Beams,
    SegmentIDs=sezione_di_ogni_concio.SegmentIDs,
    CompositeSections=sezioni_miste_di_tutti_i_conci.CompositeSection,
    States=segno_di_bm2_sotto_peso_proprio_tutte_le.States,
    Response=risposta_meccanica_1_n_infinito_2_n0_2,
    MixedPolicy=aste_a_segno_variabile_approssimazione_f,
    ZeroPolicy=aste_con_momento_entro_tolleranza,
    PreserveMass=m03_n0_proprietà_longitudinali_preserve)  # -> Girders, OtherSteel, BeamIDs, Information
m03_n0_id_travi_longitudinali = M03_N0IDTraviLongitudinali(m03_n0_proprietà_per_stato_di_ogni_asta.BeamIDs)

# ---- group: 06 | MODELLO 2 · n0 (M03) — proprietà → carichi → FEM → fase 30 / M03_N0 | carico soletta
m03_n0_carico_soletta_p1_opzionale_vuoto = M03_N0CaricoSolettaP1OpzionaleVuoto()
m03_n0_carico_soletta_pb_opzionale_vuoto = M03_N0CaricoSolettaPBOpzionaleVuoto()
m03_n0_carico_soletta_p2_opzionale_vuoto = M03_N0CaricoSolettaP2OpzionaleVuoto()
m03_n0_carico_soletta_a = Slider(0, range=0..1)
m03_n0_carico_soletta_b = Slider(0, range=0..1)
m03_n0_carico_soletta = BeamDistributedLoad(
    Beam=fasce_soletta_fem.Beams,
    LoadCase=m03_n0_caso_soletta,
    Type=schema_carichi_di_test,
    CoordinateSystem=sistema_di_riferimento_dei_carichi_globa,
    Direction=direzione_carichi_di_test,
    P1=m03_n0_carico_soletta_p1_opzionale_vuoto,
    PA=m03_n0_q_pressione_fascia_tributaria,
    PB=m03_n0_carico_soletta_pb_opzionale_vuoto,
    P2=m03_n0_carico_soletta_p2_opzionale_vuoto,
    A=m03_n0_carico_soletta_a,
    B=m03_n0_carico_soletta_b)
m03_n0_fasce_soletta_con_carico_tributar = M03_N0FasceSolettaConCaricoTributario(m03_n0_carico_soletta)

# ---- group: 06 | MODELLO 2 · n0 (M03) — proprietà → carichi → FEM → fase 30 / M03_N0 | carico travi
m03_n0_carico_verticale_travi_principali = Slider(-1, range=-30..30)
m03_n0_carico_travi_p1_opzionale_vuoto = M03_N0CaricoTraviP1OpzionaleVuoto()
m03_n0_carico_travi_pb_opzionale_vuoto = M03_N0CaricoTraviPBOpzionaleVuoto()
m03_n0_carico_travi_p2_opzionale_vuoto = M03_N0CaricoTraviP2OpzionaleVuoto()
m03_n0_carico_travi_a = Slider(0, range=0..1)
m03_n0_carico_travi_b = Slider(0, range=0..1)
m03_n0_carico_travi = BeamDistributedLoad(
    Beam=m03_n0_proprietà_per_stato_di_ogni_asta.Girders,
    LoadCase=m03_n0_caso_travi,
    Type=schema_carichi_di_test,
    CoordinateSystem=sistema_di_riferimento_dei_carichi_globa,
    Direction=direzione_carichi_di_test,
    P1=m03_n0_carico_travi_p1_opzionale_vuoto,
    PA=m03_n0_carico_verticale_travi_principali,
    PB=m03_n0_carico_travi_pb_opzionale_vuoto,
    P2=m03_n0_carico_travi_p2_opzionale_vuoto,
    A=m03_n0_carico_travi_a,
    B=m03_n0_carico_travi_b)
m03_n0_travi_principali_con_proprietà_e = M03_N0TraviPrincipaliConProprietàECarichi(m03_n0_carico_travi)

# ---- group: 06 | MODELLO 2 · n0 (M03) — proprietà → carichi → FEM → fase 30 / M03_N0
m03_n0_nome_modello = Panel("M03_N0")
m03_n0_staged_constructions_opzionale_vu = M03_N0StagedConstructionsOpzionaleVuoto()
m03_n0_load_combinations_opzionale_vuoto = M03_N0LoadCombinationsOpzionaleVuoto()
m03_n0 = BuildModel(
    Elements=flatten([m03_n0_carico_travi, m03_n0_proprietà_per_stato_di_ogni_asta.OtherSteel, m03_n0_carico_soletta, appoggi_orientati.Nodes, collegamenti_eccentrici_trave_soletta.Elements]),
    Name=m03_n0_nome_modello,
    Units=unità_dei_quattro_modelli,
    LoadCombinations=m03_n0_load_combinations_opzionale_vuoto,
    StagedConstructions=m03_n0_staged_constructions_opzionale_vu)
m03_n0_modello_fem_caricato = M03_N0MODELLOFEMCARICATO(m03_n0)

# ---- group: 06 | MODELLO 2 · n0 (M03) — proprietà → carichi → FEM → fase 30 / M03_N0 | analisi lineare
m03_n0_file_straus = Panel("C:\Users\g.pacini\Documents\Repository\BridGHe\example\50-ponte-quattro-modelli\calcoli\REV002\M03_N0.st7")
m03_n0_casi_restituiti = Panel("""M03_N0_SOLETTA
M03_N0_TRAVI
Dead""")
m03_n0_analisi_lineare_solver = Slider(0, range=0..10)
m03_n0_analisi_lineare = StrausR3Analysis(
    Model=m03_n0,
    Solver=m03_n0_analisi_lineare_solver,
    AnalysisResults=m03_n0_casi_restituiti,
    OutputPath=m03_n0_file_straus,
    KeepRunning=calcola_i_quattro_modelli_straus_poi_rip,
    ElementGuids="[]")
m03_n0_modello_con_risultati_straus = M03_N0MODELLOCONRISULTATISTRAUS(m03_n0_analisi_lineare)

# ---- group: 06 | MODELLO 2 · n0 (M03) — proprietà → carichi → FEM → fase 30 / M03_N0_SOLETTA | azione
m03_n0_soletta_identificativo_azione = Panel("M03_N0_SOLETTA")
m03_n0_soletta_comportamento = M03_N0_SOLETTAComportamento({"Acciaio": 0, "Lungo termine n infinito": 1, "Istantaneo n0": 2}, selected="Istantaneo n0")
m03_n0_soletta_azione_beam_ids_opzionale = M03_N0_SOLETTAAzioneBeamIDsOpzionaleVuoto()
m03_n0_soletta_azione = BridgeAction(
    ActionID=m03_n0_soletta_identificativo_azione,
    Model=m03_n0_analisi_lineare,
    Case=m03_n0_caso_soletta,
    Behavior=m03_n0_soletta_comportamento,
    BeamIDs=m03_n0_soletta_azione_beam_ids_opzionale)

# ---- group: 06 | MODELLO 2 · n0 (M03) — proprietà → carichi → FEM → fase 30 / M03_N0_TRAVI | azione
m03_n0_travi_identificativo_azione = Panel("M03_N0_TRAVI")
m03_n0_travi_comportamento = M03_N0_TRAVIComportamento({"Acciaio": 0, "Lungo termine n infinito": 1, "Istantaneo n0": 2}, selected="Istantaneo n0")
m03_n0_travi_azione_beam_ids_opzionale_v = M03_N0_TRAVIAzioneBeamIDsOpzionaleVuoto()
m03_n0_travi_azione = BridgeAction(
    ActionID=m03_n0_travi_identificativo_azione,
    Model=m03_n0_analisi_lineare,
    Case=m03_n0_caso_travi,
    Behavior=m03_n0_travi_comportamento,
    BeamIDs=m03_n0_travi_azione_beam_ids_opzionale_v)

# ---- group: 06 | MODELLO 2 · n0 (M03) — proprietà → carichi → FEM → fase 30 / M03_N0 | fase di test
m03_n0_numero_fase = Slider(30, range=0..100)
m03_n0_nome_fase = Panel("M03_N0")
m03_n0_stato_sezione = M03_N0StatoSezione({"Acciaio": 0, "Misto attivo": 1}, selected="Misto attivo")
m03_n0_fase_di_test_day_opzionale_vuoto = M03_N0FaseDiTestDayOpzionaleVuoto()
m03_n0_fase_di_test = BridgePhase(
    Number=m03_n0_numero_fase,
    Name=m03_n0_nome_fase,
    SectionState=m03_n0_stato_sezione,
    Actions=[m03_n0_soletta_azione, m03_n0_travi_azione],
    Day=m03_n0_fase_di_test_day_opzionale_vuoto)
m03_n0_definizione_fase = M03_N0DefinizioneFase(m03_n0_fase_di_test)

# ---- group: 07 | MODELLO 3 · RITIRO (M04) — εcs → deformazioni → FEM → fase 40 / M04_NSH
m04_nsh_nome_modello = Panel("M04_NSH")
m04_nsh_staged_constructions_opzionale_v = M04_NSHStagedConstructionsOpzionaleVuoto()
m04_nsh_load_combinations_opzionale_vuot = M04_NSHLoadCombinationsOpzionaleVuoto()
m04_nsh = BuildModel(
    Elements=flatten([m04_curvatura_equivalente_del_ritiro, m04_nsh_proprietà_longitudinali.OtherSteel, fasce_soletta_fem.Beams, appoggi_orientati.Nodes, collegamenti_eccentrici_trave_soletta.Elements]),
    Name=m04_nsh_nome_modello,
    Units=unità_dei_quattro_modelli,
    LoadCombinations=m04_nsh_load_combinations_opzionale_vuot,
    StagedConstructions=m04_nsh_staged_constructions_opzionale_v)
m04_nsh_modello_fem_caricato = M04_NSHMODELLOFEMCARICATO(m04_nsh)

# ---- group: 07 | MODELLO 3 · RITIRO (M04) — εcs → deformazioni → FEM → fase 40 / M04_NSH | analisi lineare
m04_nsh_file_straus = Panel("C:\Users\g.pacini\Documents\Repository\BridGHe\example\50-ponte-quattro-modelli\calcoli\REV002\M04_NSH.st7")
m04_nsh_casi_restituiti = Panel("M04_NSH_RITIRO")
m04_nsh_analisi_lineare_solver = Slider(0, range=0..10)
m04_nsh_analisi_lineare = StrausR3Analysis(
    Model=m04_nsh,
    Solver=m04_nsh_analisi_lineare_solver,
    AnalysisResults=m04_nsh_casi_restituiti,
    OutputPath=m04_nsh_file_straus,
    KeepRunning=calcola_i_quattro_modelli_straus_poi_rip,
    ElementGuids="[]")
m04_nsh_modello_con_risultati_straus = M04_NSHMODELLOCONRISULTATISTRAUS(m04_nsh_analisi_lineare)

# ---- group: 07 | MODELLO 3 · RITIRO (M04) — εcs → deformazioni → FEM → fase 40 / M04_NSH_RITIRO | azione
m04_nsh_ritiro_identificativo_azione = Panel("M04_NSH_RITIRO")
m04_nsh_ritiro_solo_effetto_primario = M04_NSH_RITIROSoloEffettoPrimario(False)
m04_nsh_ritiro_risposta = M04_NSH_RITIRORisposta({"n ritiro": 0}, selected="n ritiro")
m04_nsh_ritiro_azione_beam_ids_opzionale = M04_NSH_RITIROAzioneBeamIDsOpzionaleVuoto()
m04_nsh_ritiro_azione = BridgeShrinkageAction(
    ActionID=m04_nsh_ritiro_identificativo_azione,
    Model=m04_nsh_analisi_lineare,
    Case=m04_nsh_caso_ritiro,
    StrainIncrement=ritiro_soletta_dal_riferimento_all_età_f.Εcs,
    BeamIDs=m04_nsh_ritiro_azione_beam_ids_opzionale,
    PrimaryOnly=m04_nsh_ritiro_solo_effetto_primario,
    Response=m04_nsh_ritiro_risposta)

# ---- group: 07 | MODELLO 3 · RITIRO (M04) — εcs → deformazioni → FEM → fase 40 / M04_NSH | fase di test
m04_nsh_numero_fase = Slider(40, range=0..100)
m04_nsh_nome_fase = Panel("M04_NSH")
m04_nsh_stato_sezione = M04_NSHStatoSezione({"Acciaio": 0, "Misto attivo": 1}, selected="Misto attivo")
m04_nsh_fase_di_test_day_opzionale_vuoto = M04_NSHFaseDiTestDayOpzionaleVuoto()
m04_nsh_fase_di_test = BridgePhase(
    Number=m04_nsh_numero_fase,
    Name=m04_nsh_nome_fase,
    SectionState=m04_nsh_stato_sezione,
    Actions=m04_nsh_ritiro_azione,
    Day=m04_nsh_fase_di_test_day_opzionale_vuoto)
m04_nsh_definizione_fase = M04_NSHDefinizioneFase(m04_nsh_fase_di_test)

# ---- group: 08 | ASSEMBLAGGIO — quattro modelli + fasi + combinazioni; preview FEM / ASSEMBLA QUATTRO MODELLI E FASI
metodo_build_bridghe_model = MetodoBuildBridGHeModel({"Cumulativo": 0, "Storia lineare": 1}, selected="Cumulativo")
consenti_elementi_aggiuntivi_nelle_fasi = ConsentiElementiAggiuntiviNelleFasiGeometrieIdentiche(False)
assembla_quattro_modelli_e_fasi = BuildBridGHeModel(
    Models=[m01_acciaio_analisi_lineare, m02_ninf_analisi_lineare, m03_n0_analisi_lineare, m04_nsh_analisi_lineare],
    Phases=[m01_acciaio_fase_di_test, m02_ninf_fase_di_test, m03_n0_fase_di_test, m04_nsh_fase_di_test],
    Combinations=tabella_combinazioni_da_righe_separate_d,
    Calculation=metodo_build_bridghe_model,
    AdditionalPhaseMembers=consenti_elementi_aggiuntivi_nelle_fasi)  # -> Model, Phases, Diagnostics
modello_bridghe_assemblato_dopo_analisi = MODELLOBRIDGHEASSEMBLATODopoAnalisiERun(assembla_quattro_modelli_e_fasi.Model)
riepilogo_delle_quattro_fasi_e_delle_set = RiepilogoDelleQuattroFasiEDelleSetteAzioni(assembla_quattro_modelli_e_fasi.Phases)
diagnostica_assemblaggio_delle_risposte = DiagnosticaAssemblaggioDelleRisposte(assembla_quattro_modelli_e_fasi.Diagnostics)

# ---- group: 08 | ASSEMBLAGGIO — quattro modelli + fasi + combinazioni; preview FEM / Modello FEM visualizzato
modello_fem_da_visualizzare = ModelloFEMDaVisualizzare({"M01_ACCIAIO": 0, "M02_NINF": 1, "M03_N0": 2, "M04_NSH": 3}, selected="M01_ACCIAIO")
modello_fem_visualizzato_wrap = ModelloFEMVisualizzatoWrap(True)
modello_fem_visualizzato = ListItem(
    List=flatten([m01_acciaio, m02_ninf, m03_n0, m04_nsh]),
    Index=modello_fem_da_visualizzare,
    Wrap=modello_fem_visualizzato_wrap)

# ---- group: 08 | ASSEMBLAGGIO — quattro modelli + fasi + combinazioni; preview FEM / Controllo connessioni e proprietà
tolleranza_audit_del_modello_mm = Slider(0.001, range=0.001..1)
controllo_connessioni_e_proprietà_bridge = Data()  # "Controllo connessioni e proprietà | Bridge Geometry (opzionale)"
controllo_connessioni_e_proprietà_phase = Data()  # "Controllo connessioni e proprietà | Phase Models (opzionale)"
controllo_connessioni_e_proprietà = BridgeModelAudit(
    Model=modello_fem_visualizzato,
    Tolerance=tolleranza_audit_del_modello_mm,
    BridgeGeometry=controllo_connessioni_e_proprietà_bridge,
    PhaseModels=controllo_connessioni_e_proprietà_phase)  # -> NoInputErrors, Severity, Code, Element, Description, Model
audit_assenza_errori_negli_input = AuditAssenzaErroriNegliInput(controllo_connessioni_e_proprietà.NoInputErrors)
codici_diagnostici = CodiciDiagnostici(controllo_connessioni_e_proprietà.Code)
descrizione_diagnostica_del_modello = DescrizioneDiagnosticaDelModello(controllo_connessioni_e_proprietà.Description)

# ---- group: 08 | ASSEMBLAGGIO — quattro modelli + fasi + combinazioni; preview FEM / Entità FEM assemblate
entità_fem_assemblate = DecomposeModel(Model=modello_fem_visualizzato)  # -> Nodes, Beams, Plates
tutti_i_nodi_fem_assemblati = TuttiINodiFEMAssemblati(entità_fem_assemblate.Nodes)
tutti_gli_elementi_beam_assemblati = TuttiGliElementiBeamAssemblati(entità_fem_assemblate.Beams)

# ---- group: 08 | ASSEMBLAGGIO — quattro modelli + fasi + combinazioni; preview FEM
# 08 | ASSEMBLAGGIO — quattro modelli + fasi + combinazioni; preview FEM: 08 | ASSEMBLAGGIO — quattro modelli + fasi + combinazioni; preview FEM
# Input espliciti a sinistra di ciascun componente; output nominati a destra. Seguire il flusso →
preview_del_graticcio = PreviewBridGHeModel(ModelElements=modello_fem_visualizzato, Settings=opzioni_preview)

# ---- group: 09 | VERIFICHE — sezioni, pioli, irrigiditori e riepilogo / Estrai aste dal modello unito con risultati
# IPOTESI DEL VERIFICATORE — conservate anche nel report: Verifica nel piano N–Mx–Vy: torsione T, flessione sull'asse debole M2 e taglio trasversale V1 sono trascurati nelle verifiche di sezione e dei dettagli; rimangono nei risultati FEM. I relativi effetti e interazioni non sono verificati.
estrai_aste_dal_modello_unito_con_risult = DecomposeModel(Model=assembla_quattro_modelli_e_fasi.Model)  # -> Nodes, Beams, Plates; "Estrai aste dal modello unito con risultati"

# ---- group: 09 | VERIFICHE — sezioni, pioli, irrigiditori e riepilogo
# 09 | VERIFICHE — sezioni, pioli, irrigiditori e riepilogo: 09 | VERIFICHE — sezioni, pioli, irrigiditori e riepilogo
# Input espliciti a sinistra di ciascun componente; output nominati a destra. Seguire il flusso →
sezioni_di_verifica_abbinate_ai_conci_ca = BridgeSegmentComposite(
    Beams=flatten(estrai_aste_dal_modello_unito_con_risult.Beams),
    SegmentIDs=sezione_di_ogni_concio.SegmentIDs,
    CompositeProperties=sezioni_miste_di_tutti_i_conci.CompositeSection)  # -> Girders, CompositeProperties, SegmentIDs, BeamIDs; "Sezioni di verifica abbinate ai conci calcolati"

# ---- group: 09 | VERIFICHE — sezioni, pioli, irrigiditori e riepilogo / Travi miste di verifica — tutte le travi e tutti i conci
travi_miste_di_verifica_tutte_le_travi_e = TraviMisteDiVerificaTutteLeTraviETuttiIConciSectionEndOpzionaleVuoto()
travi_miste_di_verifica_tutte_le_travi_e_2 = TraviMisteDiVerificaTutteLeTraviETuttiIConciGroupsOpzionaleVuoto()
travi_miste_di_verifica_tutte_le_travi_e_3 = CompositeBeam(
    Beam=sezioni_di_verifica_abbinate_ai_conci_ca.Girders,
    SectionStart=sezioni_di_verifica_abbinate_ai_conci_ca.CompositeProperties,
    SectionEnd=travi_miste_di_verifica_tutte_le_travi_e,
    Groups=travi_miste_di_verifica_tutte_le_travi_e_2)  # "Travi miste di verifica — tutte le travi e tutti i conci"

# ---- group: 09 | VERIFICHE — sezioni, pioli, irrigiditori e riepilogo / Verifiche di tutte le travi — Run dopo Build
verifiche_di_tutte_le_travi_run_dopo_bui = VerificheDiTutteLeTraviRunDopoBuildWebLocalInstability(True)
verifiche_di_tutte_le_travi_run_dopo_bui_2 = VerificheDiTutteLeTraviRunDopoBuildTopFlangeLocalInstability(True)
verifiche_di_tutte_le_travi_run_dopo_bui_3 = VerificheDiTutteLeTraviRunDopoBuildBottomFlangeLocalInstability(True)
verifiche_di_tutte_le_travi_run_dopo_bui_4 = SuperElementCheck(
    BridGHeModel=assembla_quattro_modelli_e_fasi.Model,
    SuperElementBeam=travi_miste_di_verifica_tutte_le_travi_e_3,
    WebLocalInstability=verifiche_di_tutte_le_travi_run_dopo_bui,
    TopFlangeLocalInstability=verifiche_di_tutte_le_travi_run_dopo_bui_2,
    BottomFlangeLocalInstability=verifiche_di_tutte_le_travi_run_dopo_bui_3)  # -> TensionCheck, TauB, TensionForces; "Verifiche di tutte le travi — Run dopo Build"

# ---- group: 09 | VERIFICHE — sezioni, pioli, irrigiditori e riepilogo / Sezioni e pioli — tutte le travi
sezioni_e_pioli_tutte_le_travi_intermedi = SezioniEPioliTutteLeTraviIntermediateStiffenerOpzionaleVuoto()
sezioni_e_pioli_tutte_le_travi_support_s = SezioniEPioliTutteLeTraviSupportStiffenerOpzionaleVuoto()
sezioni_e_pioli_tutte_le_travi_additiona = SezioniEPioliTutteLeTraviAdditionalDetailsOpzionaleVuoto()
sezioni_e_pioli_tutte_le_travi = BridgeDetailCheck(
    SectionResult=verifiche_di_tutte_le_travi_run_dopo_bui_4.TensionCheck,
    Studs=pioli_demo_tutte_le_sezioni,
    IntermediateStiffener=sezioni_e_pioli_tutte_le_travi_intermedi,
    SupportStiffener=sezioni_e_pioli_tutte_le_travi_support_s,
    Options=opzioni_delle_verifiche_locali_azioni_gi_14,
    AdditionalDetails=sezioni_e_pioli_tutte_le_travi_additiona)  # -> SectionResult, Check, Demand, Resistance, Units, Ratio, Status, Warnings
verifiche_ponte_sezioni_e_pioli_di_tutte = VERIFICHEPONTESezioniEPioliDiTutteLeTravi(sezioni_e_pioli_tutte_le_travi.SectionResult)

# ---- group: 09 | VERIFICHE — sezioni, pioli, irrigiditori e riepilogo / Irrigiditori intermedi ai giunti dei conci
irrigiditori_intermedi_ai_giunti_dei_con = IrrigiditoriIntermediAiGiuntiDeiConciPhasesOpzionaleVuoto()
irrigiditori_intermedi_ai_giunti_dei_con_2 = Panel("0,0,1")
irrigiditori_intermedi_ai_giunti_dei_con_3 = Slider(1e-06, range=0..1)
irrigiditori_intermedi_ai_giunti_dei_con_4 = BridgeDetailStations(
    Model=assembla_quattro_modelli_e_fasi.Model,
    Results=sezioni_e_pioli_tutte_le_travi.SectionResult,
    Locations=flatten(ponte_geometrico.JointPoints),
    Phases=irrigiditori_intermedi_ai_giunti_dei_con,
    Up=irrigiditori_intermedi_ai_giunti_dei_con_2,
    Tolerance=irrigiditori_intermedi_ai_giunti_dei_con_3)  # -> Results, CompressionKN, SignedReactionKN, EndType, Points; "Irrigiditori intermedi ai giunti dei conci"

# ---- group: 09 | VERIFICHE — sezioni, pioli, irrigiditori e riepilogo / Irrigiditori agli appoggi — reazioni delle stesse fasi
irrigiditori_agli_appoggi_reazioni_delle = Panel("0,0,1")
irrigiditori_agli_appoggi_reazioni_delle_2 = Slider(1e-06, range=0..1)
irrigiditori_agli_appoggi_reazioni_delle_3 = BridgeDetailStations(
    Model=assembla_quattro_modelli_e_fasi.Model,
    Results=sezioni_e_pioli_tutte_le_travi.SectionResult,
    Locations=flatten(ponte_geometrico.SupportPoints),
    Phases=[m01_acciaio_fase_di_test, m02_ninf_fase_di_test, m03_n0_fase_di_test, m04_nsh_fase_di_test],
    Up=irrigiditori_agli_appoggi_reazioni_delle,
    Tolerance=irrigiditori_agli_appoggi_reazioni_delle_2)  # -> Results, CompressionKN, SignedReactionKN, EndType, Points; "Irrigiditori agli appoggi — reazioni delle stesse fasi"
appoggi_reazioni_firmate_per_combinazion = APPOGGIReazioniFirmatePerCombinazioneKNNegativoSollevamento(irrigiditori_agli_appoggi_reazioni_delle_3.SignedReactionKN)

# ---- group: 09 | VERIFICHE — sezioni, pioli, irrigiditori e riepilogo / Definizione irrigiditori appoggi DEMO
definizione_irrigiditori_appoggi_demo_en = DefinizioneIrrigiditoriAppoggiDEMOEnabled(True)
definizione_irrigiditori_appoggi_demo_la = Slider(0, range=0..10)
definizione_irrigiditori_appoggi_demo_wi = Slider(250, range=0..500)
definizione_irrigiditori_appoggi_demo_th = Slider(25, range=0..50)
definizione_irrigiditori_appoggi_demo_ri = Slider(250, range=0..500)
definizione_irrigiditori_appoggi_demo_ri_2 = Slider(25, range=0..50)
definizione_irrigiditori_appoggi_demo_en_2 = Slider(250, range=0..500)
definizione_irrigiditori_appoggi_demo_lo = Slider(0, range=0..1)
definizione_irrigiditori_appoggi_demo_lo_2 = Slider(0, range=0..1)
definizione_irrigiditori_appoggi_demo_fo = Slider(400, range=0..800)
definizione_irrigiditori_appoggi_demo_fo_2 = Slider(600, range=0..1200)
definizione_irrigiditori_appoggi_demo_le = Slider(1, range=0..2)
definizione_irrigiditori_appoggi_demo_ri_3 = DefinizioneIrrigiditoriAppoggiDEMORigidEndPost(False)
definizione_irrigiditori_appoggi_demo_en_3 = Slider(300, range=0..600)
definizione_irrigiditori_appoggi_demo_ch = DefinizioneIrrigiditoriAppoggiDEMOCheckWelds(True)
definizione_irrigiditori_appoggi_demo_we = Slider(8, range=0..16)
definizione_irrigiditori_appoggi_demo = BridgeSupportStiffener(
    Enabled=definizione_irrigiditori_appoggi_demo_en,
    Layout=definizione_irrigiditori_appoggi_demo_la,
    Width=definizione_irrigiditori_appoggi_demo_wi,
    Thickness=definizione_irrigiditori_appoggi_demo_th,
    RightWidth=definizione_irrigiditori_appoggi_demo_ri,
    RightThickness=definizione_irrigiditori_appoggi_demo_ri_2,
    Location=irrigiditori_agli_appoggi_reazioni_delle_3.EndType,
    LeftPanel=irrigiditori_lunghezza_di_pannello_assun,
    RightPanel=irrigiditori_lunghezza_di_pannello_assun,
    ReactionKN=irrigiditori_agli_appoggi_reazioni_delle_3.CompressionKN,
    EndDistance=definizione_irrigiditori_appoggi_demo_en_2,
    LoadX=definizione_irrigiditori_appoggi_demo_lo,
    LoadZ=definizione_irrigiditori_appoggi_demo_lo_2,
    FootprintLength=definizione_irrigiditori_appoggi_demo_fo,
    FootprintWidth=definizione_irrigiditori_appoggi_demo_fo_2,
    LengthFactor=definizione_irrigiditori_appoggi_demo_le,
    RigidEndPost=definizione_irrigiditori_appoggi_demo_ri_3,
    EndPostSpacing=definizione_irrigiditori_appoggi_demo_en_3,
    CheckWelds=definizione_irrigiditori_appoggi_demo_ch,
    WeldThroat=definizione_irrigiditori_appoggi_demo_we)

# ---- group: 09 | VERIFICHE — sezioni, pioli, irrigiditori e riepilogo / Verifica irrigiditori ai giunti
verifica_irrigiditori_ai_giunti_studs_op = VerificaIrrigiditoriAiGiuntiStudsOpzionaleVuoto()
verifica_irrigiditori_ai_giunti_support = VerificaIrrigiditoriAiGiuntiSupportStiffenerOpzionaleVuoto()
verifica_irrigiditori_ai_giunti_options = VerificaIrrigiditoriAiGiuntiOptionsOpzionaleVuoto()
verifica_irrigiditori_ai_giunti_addition = VerificaIrrigiditoriAiGiuntiAdditionalDetailsOpzionaleVuoto()
verifica_irrigiditori_ai_giunti = BridgeDetailCheck(
    SectionResult=irrigiditori_intermedi_ai_giunti_dei_con_4.Results,
    Studs=verifica_irrigiditori_ai_giunti_studs_op,
    IntermediateStiffener=definizione_irrigiditori_intermedi_demo_13,
    SupportStiffener=verifica_irrigiditori_ai_giunti_support,
    Options=verifica_irrigiditori_ai_giunti_options,
    AdditionalDetails=verifica_irrigiditori_ai_giunti_addition)  # -> SectionResult, Check, Demand, Resistance, Units, Ratio, Status, Warnings
verifiche_ponte_irrigiditori_intermedi_a = VERIFICHEPONTEIrrigiditoriIntermediAiGiunti(verifica_irrigiditori_ai_giunti.SectionResult)

# ---- group: 09 | VERIFICHE — sezioni, pioli, irrigiditori e riepilogo / Verifica irrigiditori agli appoggi
verifica_irrigiditori_agli_appoggi_studs = VerificaIrrigiditoriAgliAppoggiStudsOpzionaleVuoto()
verifica_irrigiditori_agli_appoggi_inter = VerificaIrrigiditoriAgliAppoggiIntermediateStiffenerOpzionaleVuoto()
verifica_irrigiditori_agli_appoggi_optio = VerificaIrrigiditoriAgliAppoggiOptionsOpzionaleVuoto()
verifica_irrigiditori_agli_appoggi_addit = VerificaIrrigiditoriAgliAppoggiAdditionalDetailsOpzionaleVuoto()
verifica_irrigiditori_agli_appoggi = BridgeDetailCheck(
    SectionResult=irrigiditori_agli_appoggi_reazioni_delle_3.Results,
    Studs=verifica_irrigiditori_agli_appoggi_studs,
    IntermediateStiffener=verifica_irrigiditori_agli_appoggi_inter,
    SupportStiffener=definizione_irrigiditori_appoggi_demo,
    Options=verifica_irrigiditori_agli_appoggi_optio,
    AdditionalDetails=verifica_irrigiditori_agli_appoggi_addit)  # -> SectionResult, Check, Demand, Resistance, Units, Ratio, Status, Warnings
verifiche_ponte_irrigiditori_di_appoggio = VERIFICHEPONTEIrrigiditoriDiAppoggio(verifica_irrigiditori_agli_appoggi.SectionResult)

# ---- group: 09 | VERIFICHE — sezioni, pioli, irrigiditori e riepilogo / Etichette automatiche di tutte le verifiche
formato_etichette_del_riepilogo = FormatoEtichetteDelRiepilogo({"Completa": 0, "Trave e stazione": 1, "Combinazione": 2, "Fase": 3}, selected="Completa")
etichette_automatiche_di_tutte_le_verifi = BridgeResultLabels(
    Results=flatten([sezioni_e_pioli_tutte_le_travi.SectionResult, verifica_irrigiditori_ai_giunti.SectionResult, verifica_irrigiditori_agli_appoggi.SectionResult]),
    Format=formato_etichette_del_riepilogo)  # "Etichette automatiche di tutte le verifiche"

# ---- group: 09 | VERIFICHE — sezioni, pioli, irrigiditori e riepilogo / Riepilogo di tutte le travi, sezioni e dettagli
riepilogo_di_tutte_le_travi_sezioni_e_de = BridgeCheckSummary(
    Results=flatten([sezioni_e_pioli_tutte_le_travi.SectionResult, verifica_irrigiditori_ai_giunti.SectionResult, verifica_irrigiditori_agli_appoggi.SectionResult]),
    Labels=etichette_automatiche_di_tutte_le_verifi)  # -> Label, Phase, Check, Ratio, Status, Units, Notes, MaximumFiniteRatio, UnavailableRatios, GoverningLabels; "Riepilogo di tutte le travi, sezioni e dettagli"
verifiche_ponte_label = VERIFICHEPONTELabel(riepilogo_di_tutte_le_travi_sezioni_e_de.Label)
verifiche_ponte_phase = VERIFICHEPONTEPhase(riepilogo_di_tutte_le_travi_sezioni_e_de.Phase)
verifiche_ponte_check = VERIFICHEPONTECheck(riepilogo_di_tutte_le_travi_sezioni_e_de.Check)
verifiche_ponte_ratio = VERIFICHEPONTERatio(riepilogo_di_tutte_le_travi_sezioni_e_de.Ratio)
verifiche_ponte_status = VERIFICHEPONTEStatus(riepilogo_di_tutte_le_travi_sezioni_e_de.Status)
verifiche_ponte_units = VERIFICHEPONTEUnits(riepilogo_di_tutte_le_travi_sezioni_e_de.Units)
verifiche_ponte_notes = VERIFICHEPONTENotes(riepilogo_di_tutte_le_travi_sezioni_e_de.Notes)
verifiche_ponte_maximum_finite_ratio = VERIFICHEPONTEMaximumFiniteRatio(riepilogo_di_tutte_le_travi_sezioni_e_de.MaximumFiniteRatio)
verifiche_ponte_unavailable_ratios = VERIFICHEPONTEUnavailableRatios(riepilogo_di_tutte_le_travi_sezioni_e_de.UnavailableRatios)
verifiche_ponte_governing_labels = VERIFICHEPONTEGoverningLabels(riepilogo_di_tutte_le_travi_sezioni_e_de.GoverningLabels)

# ---- group: 10 | GRAFICI — selezione trave, diagrammi e anteprime Grasshopper / Momento Mx | selezione trave
trave_da_visualizzare_nei_grafici_numero = Slider(1, range=1..20)
momento_mx_selezione_trave = BridgeGirderResults(
    Beams=travi_miste_di_verifica_tutte_le_travi_e_3,
    Results=verifiche_di_tutte_le_travi_run_dopo_bui_4.TensionForces,
    Girder=trave_da_visualizzare_nei_grafici_numero)  # -> Beams, Results, Stations, AvailableGirders

# ---- group: 10 | GRAFICI — selezione trave, diagrammi e anteprime Grasshopper
# 10 | GRAFICI — selezione trave, diagrammi e anteprime Grasshopper: 10 | GRAFICI — selezione trave, diagrammi e anteprime Grasshopper
# Input espliciti a sinistra di ciascun componente; output nominati a destra. Seguire il flusso →
tensioni_acciaio_sigma_5_selezione_trave = BridgeGirderResults(
    Beams=travi_miste_di_verifica_tutte_le_travi_e_3,
    Results=sezioni_e_pioli_tutte_le_travi.SectionResult,
    Girder=trave_da_visualizzare_nei_grafici_numero)  # -> Beams, Results, Stations, AvailableGirders
tau_massima_selezione_trave = BridgeGirderResults(
    Beams=travi_miste_di_verifica_tutte_le_travi_e_3,
    Results=sezioni_e_pioli_tutte_le_travi.SectionResult,
    Girder=trave_da_visualizzare_nei_grafici_numero)  # -> Beams, Results, Stations, AvailableGirders
pioli_ed_e_rd_selezione_trave = BridgeGirderResults(
    Beams=travi_miste_di_verifica_tutte_le_travi_e_3,
    Results=sezioni_e_pioli_tutte_le_travi.SectionResult,
    Girder=trave_da_visualizzare_nei_grafici_numero)  # -> Beams, Results, Stations, AvailableGirders
irrigiditori_intermedi_wr_selezione_trav = BridgeGirderResults(
    Beams=travi_miste_di_verifica_tutte_le_travi_e_3,
    Results=verifica_irrigiditori_ai_giunti.SectionResult,
    Girder=trave_da_visualizzare_nei_grafici_numero)  # -> Beams, Results, Stations, AvailableGirders; "Irrigiditori intermedi WR | selezione trave"
irrigiditori_appoggi_wr_selezione_trave = BridgeGirderResults(
    Beams=travi_miste_di_verifica_tutte_le_travi_e_3,
    Results=verifica_irrigiditori_agli_appoggi.SectionResult,
    Girder=trave_da_visualizzare_nei_grafici_numero)  # -> Beams, Results, Stations, AvailableGirders

# ---- group: 10 | GRAFICI — selezione trave, diagrammi e anteprime Grasshopper / Momento Mx | Draw
momento_mx_grandezza = MomentoMxGrandezza({"N": 0, "Vx": 1, "Vy": 2, "T": 3, "Mx": 4, "My": 5}, selected="Mx")
momento_mx_titolo = Panel("Momento Mx — trave selezionata")
momento_mx_aggiornamento_automatico = MomentoMxAggiornamentoAutomatico(True)
momento_mx_draw_combinations_opzionale_v = MomentoMxDrawCombinationsOpzionaleVuoto()
momento_mx_draw_show_min_max_combo = MomentoMxDrawShowMinMaxCombo(True)
momento_mx_draw_file_path_opzionale_vuot = MomentoMxDrawFilePathOpzionaleVuoto()
momento_mx_draw = BridgeForcePlot(
    BridGHeModel=assembla_quattro_modelli_e_fasi.Model,
    SuperElementBeam=momento_mx_selezione_trave.Beams,
    Results=momento_mx_selezione_trave.Results,
    Quantity=momento_mx_grandezza,
    Combinations=momento_mx_draw_combinations_opzionale_v,
    ShowMinMaxCombo=momento_mx_draw_show_min_max_combo,
    FilePath=momento_mx_draw_file_path_opzionale_vuot,
    GraphicTitle=momento_mx_titolo,
    KeepRunning=momento_mx_aggiornamento_automatico)  # -> SVG, File, Minimum, Maximum
grafico_momento_mx = GRAFICOMomentoMx(momento_mx_draw.SVG)

# ---- group: 10 | GRAFICI — selezione trave, diagrammi e anteprime Grasshopper / Tensioni acciaio sigma 5 | Draw
tensioni_acciaio_sigma_5_grandezza = TensioniAcciaioSigma5Grandezza({"σ1 cls": 0, "σ2 armatura": 1, "σ4 cls": 2, "σ5 acciaio": 3, "σ6 acciaio": 4, "σ7 acciaio": 5, "σ8 acciaio": 6, "τ6": 7, "τ7": 8, "σ6 equivalente": 9, "σ7 equivalente": 10, "ε1 cls": 11, "ε8 acciaio": 12}, selected="σ5 acciaio")
tensioni_acciaio_sigma_5_titolo = Panel("Tensioni acciaio sigma 5 — trave selezionata")
tensioni_acciaio_sigma_5_aggiornamento_a = TensioniAcciaioSigma5AggiornamentoAutomatico(True)
tensioni_acciaio_sigma_5_draw_combinatio = TensioniAcciaioSigma5DrawCombinationsOpzionaleVuoto()
tensioni_acciaio_sigma_5_draw_show_min_m = TensioniAcciaioSigma5DrawShowMinMaxCombo(True)
tensioni_acciaio_sigma_5_draw_additional = TensioniAcciaioSigma5DrawAdditionalValuesOpzionaleVuoto()
tensioni_acciaio_sigma_5_draw_file_path = TensioniAcciaioSigma5DrawFilePathOpzionaleVuoto()
tensioni_acciaio_sigma_5_draw = BridgeStressPlot(
    BridGHeModel=assembla_quattro_modelli_e_fasi.Model,
    SuperElementBeam=tensioni_acciaio_sigma_5_selezione_trave.Beams,
    Results=tensioni_acciaio_sigma_5_selezione_trave.Results,
    Quantity=tensioni_acciaio_sigma_5_grandezza,
    Combinations=tensioni_acciaio_sigma_5_draw_combinatio,
    ShowMinMaxCombo=tensioni_acciaio_sigma_5_draw_show_min_m,
    AdditionalValues=tensioni_acciaio_sigma_5_draw_additional,
    FilePath=tensioni_acciaio_sigma_5_draw_file_path,
    GraphicTitle=tensioni_acciaio_sigma_5_titolo,
    KeepRunning=tensioni_acciaio_sigma_5_aggiornamento_a)  # -> SVG, File, Minimum, Maximum
grafico_tensioni_acciaio_sigma_5 = GRAFICOTensioniAcciaioSigma5(tensioni_acciaio_sigma_5_draw.SVG)

# ---- group: 10 | GRAFICI — selezione trave, diagrammi e anteprime Grasshopper / Tau massima | Draw
tau_massima_grandezza = TauMassimaGrandezza({"V": 0, "Tau media": 1, "Tau massima": 2, "Tensione equivalente": 3, "Resistenza anima": 4}, selected="Tau massima")
tau_massima_titolo = Panel("Tau massima — trave selezionata")
tau_massima_aggiornamento_automatico = TauMassimaAggiornamentoAutomatico(True)
tau_massima_draw_combinations_opzionale = TauMassimaDrawCombinationsOpzionaleVuoto()
tau_massima_draw_show_min_max_combo = TauMassimaDrawShowMinMaxCombo(True)
tau_massima_draw_file_path_opzionale_vuo = TauMassimaDrawFilePathOpzionaleVuoto()
tau_massima_draw = BridgeShearPlot(
    BridGHeModel=assembla_quattro_modelli_e_fasi.Model,
    SuperElementBeam=tau_massima_selezione_trave.Beams,
    Results=tau_massima_selezione_trave.Results,
    Quantity=tau_massima_grandezza,
    Combinations=tau_massima_draw_combinations_opzionale,
    ShowMinMaxCombo=tau_massima_draw_show_min_max_combo,
    FilePath=tau_massima_draw_file_path_opzionale_vuo,
    GraphicTitle=tau_massima_titolo,
    KeepRunning=tau_massima_aggiornamento_automatico)  # -> SVG, File, Minimum, Maximum
grafico_tau_massima = GRAFICOTauMassima(tau_massima_draw.SVG)

# ---- group: 10 | GRAFICI — selezione trave, diagrammi e anteprime Grasshopper / Momento Mx | anteprima GH
momento_mx_anteprima_gh_index = Slider(0, range=0..10)
momento_mx_anteprima_gh_width = Slider(600, range=0..1200)
momento_mx_anteprima_gh = BridgePlotPreview(SVG=flatten(momento_mx_draw.SVG), Index=momento_mx_anteprima_gh_index, Width=momento_mx_anteprima_gh_width)

# ---- group: 10 | GRAFICI — selezione trave, diagrammi e anteprime Grasshopper / Tensioni acciaio sigma 5 | anteprima GH
tensioni_acciaio_sigma_5_anteprima_gh_in = Slider(0, range=0..10)
tensioni_acciaio_sigma_5_anteprima_gh_wi = Slider(600, range=0..1200)
tensioni_acciaio_sigma_5_anteprima_gh = BridgePlotPreview(
    SVG=flatten(tensioni_acciaio_sigma_5_draw.SVG),
    Index=tensioni_acciaio_sigma_5_anteprima_gh_in,
    Width=tensioni_acciaio_sigma_5_anteprima_gh_wi)

# ---- group: 10 | GRAFICI — selezione trave, diagrammi e anteprime Grasshopper / Tau massima | anteprima GH
tau_massima_anteprima_gh_index = Slider(0, range=0..10)
tau_massima_anteprima_gh_width = Slider(600, range=0..1200)
tau_massima_anteprima_gh = BridgePlotPreview(SVG=flatten(tau_massima_draw.SVG), Index=tau_massima_anteprima_gh_index, Width=tau_massima_anteprima_gh_width)

# ---- group: 10 | GRAFICI — selezione trave, diagrammi e anteprime Grasshopper / Pioli Ed e Rd | Draw
pioli_ed_e_rd_grandezza = PioliEdERdGrandezza({"Flusso connessione": 0, "Forza per piolo": 1, "Resistenza per piolo": 2, "Resistenza per lunghezza": 3, "WR piolo": 4, "Pioli Ed/Rd": 5, "Flusso Ed/Rd": 6}, selected="Pioli Ed/Rd")
pioli_ed_e_rd_aggiornamento_automatico = PioliEdERdAggiornamentoAutomatico(True)
pioli_ed_e_rd_draw_show_min_max_combo = PioliEdERdDrawShowMinMaxCombo(True)
pioli_ed_e_rd_titolo = Panel("Pioli Ed e Rd — trave selezionata")
pioli_ed_e_rd_draw_combinations_opzional = PioliEdERdDrawCombinationsOpzionaleVuoto()
pioli_ed_e_rd_draw_file_path_opzionale_v = PioliEdERdDrawFilePathOpzionaleVuoto()
pioli_ed_e_rd_draw = BridgeStudPlot(
    BridGHeModel=assembla_quattro_modelli_e_fasi.Model,
    SuperElementBeam=pioli_ed_e_rd_selezione_trave.Beams,
    Results=pioli_ed_e_rd_selezione_trave.Results,
    Quantity=pioli_ed_e_rd_grandezza,
    Combinations=pioli_ed_e_rd_draw_combinations_opzional,
    ShowMinMaxCombo=pioli_ed_e_rd_draw_show_min_max_combo,
    FilePath=pioli_ed_e_rd_draw_file_path_opzionale_v,
    GraphicTitle=pioli_ed_e_rd_titolo,
    KeepRunning=pioli_ed_e_rd_aggiornamento_automatico)  # -> SVG, File, Minimum, Maximum
grafico_pioli_ed_e_rd = GRAFICOPioliEdERd(pioli_ed_e_rd_draw.SVG)

# ---- group: 10 | GRAFICI — selezione trave, diagrammi e anteprime Grasshopper / Irrigiditori intermedi WR | Draw
irrigiditori_intermedi_wr_verifica_oppur = IrrigiditoriIntermediWRVerificaOppureInviluppoWR({"Inviluppo WR di tutte le verifiche": 0, "Intermedio · rigidezza pannelli": 1, "Intermedio · stabilità e pressoflessione II ordine": 2, "Intermedio · freccia fuori piano": 3, "Intermedio · rigidezza torsionale": 4, "Intermedio · piatti entro classe 3": 5, "Intermedio · ingombro tra piattabande": 6, "Intermedio · saldature verticali all’anima": 7, "Intermedio · saldature alle flange": 8, "Intermedio · gola minima": 9, "Intermedio · lunghezza efficace cordone": 10, "Intermedio · collegamenti": 11}, selected="Inviluppo WR di tutte le verifiche")
irrigiditori_intermedi_wr_aggiornamento = IrrigiditoriIntermediWRAggiornamentoAutomatico(True)
irrigiditori_intermedi_wr_draw_show_min = IrrigiditoriIntermediWRDrawShowMinMaxCombo(True)
irrigiditori_intermedi_wr_titolo = Panel("Irrigiditori intermedi WR — trave selezionata")
irrigiditori_intermedi_wr_draw_combinati = IrrigiditoriIntermediWRDrawCombinationsOpzionaleVuoto()
irrigiditori_intermedi_wr_draw_file_path = IrrigiditoriIntermediWRDrawFilePathOpzionaleVuoto()
irrigiditori_intermedi_wr_draw_display = Slider(0, range=0..10)
irrigiditori_intermedi_wr_draw = BridgeIntermediateStiffenerPlot(
    BridGHeModel=assembla_quattro_modelli_e_fasi.Model,
    SuperElementBeam=irrigiditori_intermedi_wr_selezione_trav.Beams,
    Results=irrigiditori_intermedi_wr_selezione_trav.Results,
    Check=irrigiditori_intermedi_wr_verifica_oppur,
    Combinations=irrigiditori_intermedi_wr_draw_combinati,
    ShowMinMaxCombo=irrigiditori_intermedi_wr_draw_show_min,
    FilePath=irrigiditori_intermedi_wr_draw_file_path,
    GraphicTitle=irrigiditori_intermedi_wr_titolo,
    KeepRunning=irrigiditori_intermedi_wr_aggiornamento,
    Display=irrigiditori_intermedi_wr_draw_display,
    Stations=irrigiditori_intermedi_wr_selezione_trav.Stations)  # -> SVG, File, Minimum, Maximum, GoverningChecks, UnavailableChecks
grafico_irrigiditori_intermedi_wr = GRAFICOIrrigiditoriIntermediWR(irrigiditori_intermedi_wr_draw.SVG)

# ---- group: 10 | GRAFICI — selezione trave, diagrammi e anteprime Grasshopper / Irrigiditori appoggi WR | Draw
irrigiditori_appoggi_wr_verifica_oppure = IrrigiditoriAppoggiWRVerificaOppureInviluppoWR({"Inviluppo WR di tutte le verifiche": 0, "Appoggio · stabilità e pressoflessione II ordine": 1, "Appoggio · freccia fuori piano": 2, "Appoggio · rigidezza torsionale": 3, "Appoggio · piatti entro classe 3": 4, "Appoggio · ingombro tra piattabande": 5, "Appoggio · saldature verticali all’anima": 6, "Appoggio · saldature alle flange": 7, "Appoggio · gola minima": 8, "Appoggio · lunghezza efficace cordone": 9, "Appoggio · collegamenti": 10, "Appoggio · impronta trasversale sotto i piatti": 11, "Appoggio · impronta longitudinale": 12, "Appoggio · impronta entro l’estremità": 13, "Appoggio · contatto piatti/flangia": 14, "Terminale · due coppie bilaterali simmetriche": 15, "Terminale · area di ciascuna coppia": 16, "Terminale · distanza e > 0,1 hw": 17, "Terminale · e entro il pannello": 18, "Terminale · reazione e ancoraggio combinati": 19, "Seconda coppia terminale · stabilità e pressoflessione II ordine": 20, "Seconda coppia terminale · freccia fuori piano": 21, "Seconda coppia terminale · rigidezza torsionale": 22, "Seconda coppia terminale · piatti entro classe 3": 23, "Seconda coppia terminale · ingombro tra piattabande": 24, "Seconda coppia terminale · saldature verticali all’anima": 25, "Seconda coppia terminale · saldature alle flange": 26, "Seconda coppia terminale · gola minima": 27, "Seconda coppia terminale · lunghezza efficace cordone": 28, "Seconda coppia terminale · collegamenti": 29}, selected="Inviluppo WR di tutte le verifiche")
irrigiditori_appoggi_wr_aggiornamento_au = IrrigiditoriAppoggiWRAggiornamentoAutomatico(True)
irrigiditori_appoggi_wr_draw_show_min_ma = IrrigiditoriAppoggiWRDrawShowMinMaxCombo(True)
irrigiditori_appoggi_wr_titolo = Panel("Irrigiditori appoggi WR — trave selezionata")
irrigiditori_appoggi_wr_draw_combination = IrrigiditoriAppoggiWRDrawCombinationsOpzionaleVuoto()
irrigiditori_appoggi_wr_draw_file_path_o = IrrigiditoriAppoggiWRDrawFilePathOpzionaleVuoto()
irrigiditori_appoggi_wr_draw_display = Slider(0, range=0..10)
irrigiditori_appoggi_wr_draw = BridgeSupportStiffenerPlot(
    BridGHeModel=assembla_quattro_modelli_e_fasi.Model,
    SuperElementBeam=irrigiditori_appoggi_wr_selezione_trave.Beams,
    Results=irrigiditori_appoggi_wr_selezione_trave.Results,
    Check=irrigiditori_appoggi_wr_verifica_oppure,
    Combinations=irrigiditori_appoggi_wr_draw_combination,
    ShowMinMaxCombo=irrigiditori_appoggi_wr_draw_show_min_ma,
    FilePath=irrigiditori_appoggi_wr_draw_file_path_o,
    GraphicTitle=irrigiditori_appoggi_wr_titolo,
    KeepRunning=irrigiditori_appoggi_wr_aggiornamento_au,
    Display=irrigiditori_appoggi_wr_draw_display,
    Stations=irrigiditori_appoggi_wr_selezione_trave.Stations)  # -> SVG, File, Minimum, Maximum, GoverningChecks, UnavailableChecks
grafico_irrigiditori_appoggi_wr = GRAFICOIrrigiditoriAppoggiWR(irrigiditori_appoggi_wr_draw.SVG)

# ---- group: 10 | GRAFICI — selezione trave, diagrammi e anteprime Grasshopper / Pioli Ed e Rd | anteprima GH
pioli_ed_e_rd_anteprima_gh_index = Slider(0, range=0..10)
pioli_ed_e_rd_anteprima_gh_width = Slider(600, range=0..1200)
pioli_ed_e_rd_anteprima_gh = BridgePlotPreview(SVG=flatten(pioli_ed_e_rd_draw.SVG), Index=pioli_ed_e_rd_anteprima_gh_index, Width=pioli_ed_e_rd_anteprima_gh_width)

# ---- group: 10 | GRAFICI — selezione trave, diagrammi e anteprime Grasshopper / Irrigiditori intermedi WR | anteprima GH
irrigiditori_intermedi_wr_anteprima_gh_i = Slider(0, range=0..10)
irrigiditori_intermedi_wr_anteprima_gh_w = Slider(600, range=0..1200)
irrigiditori_intermedi_wr_anteprima_gh = BridgePlotPreview(
    SVG=flatten(irrigiditori_intermedi_wr_draw.SVG),
    Index=irrigiditori_intermedi_wr_anteprima_gh_i,
    Width=irrigiditori_intermedi_wr_anteprima_gh_w)

# ---- group: 10 | GRAFICI — selezione trave, diagrammi e anteprime Grasshopper / Irrigiditori appoggi WR | anteprima GH
irrigiditori_appoggi_wr_anteprima_gh_ind = Slider(0, range=0..10)
irrigiditori_appoggi_wr_anteprima_gh_wid = Slider(600, range=0..1200)
irrigiditori_appoggi_wr_anteprima_gh = BridgePlotPreview(
    SVG=flatten(irrigiditori_appoggi_wr_draw.SVG),
    Index=irrigiditori_appoggi_wr_anteprima_gh_ind,
    Width=irrigiditori_appoggi_wr_anteprima_gh_wid)

# ---- group: 11 | REPORT — contenuti, template Word e generazione / Report ponte completo — Generate dopo le verifiche
# 11 | REPORT — contenuti, template Word e generazione: 11 | REPORT — contenuti, template Word e generazione
# Input espliciti a sinistra di ciascun componente; output nominati a destra. Seguire il flusso →
report_template_word = Panel("Template_BridGHe.docx")
report_file_di_destinazione = Panel("Report_50_REV002.docx")
report_capitoli_da_includere = ReportCapitoliDaIncludere({"Modello": 0, "Sezioni e materiali": 1, "Fasi e combinazioni": 2, "Verifiche": 3, "Casi governanti": 4, "Grafici": 5, "Tabulato completo": 6}, selected=["Modello", "Sezioni e materiali", "Fasi e combinazioni", "Verifiche", "Casi governanti", "Grafici"])
report_titolo = Panel("Esempio 50 — verifiche delle travi principali del ponte misto")
report_ipotesi_e_campo_delle_verifiche = Panel("DEMO: carichi incrementali di prova, coefficienti non normativi; ritiro 7–365 giorni, RH70%; pannelli irrigiditori assunti 12 m. Tutte le travi principali; grafici della trave selezionata. Non include verifiche globali, fatica, traversi e flessione locale soletta. Verifica nel piano N–Mx–Vy: torsione T, flessione sull'asse debole M2 e taglio trasversale V1 sono trascurati nelle verifiche di sezione e dei dettagli; rimangono nei risultati FEM. I relativi effetti e interazioni non sono verificati.")
report_autore = Panel("BridGHe")
report_revisione = Panel("REV002 — stati locali meccanici, ritiro non fessurato")
report_ponte_completo_generate_dopo_le_v = ReportPonteCompletoGenerateDopoLeVerificheOverwrite(False)
report_ponte_completo_generate_dopo_le_v_2 = BridgeReport(
    Results=[sezioni_e_pioli_tutte_le_travi.SectionResult, verifica_irrigiditori_ai_giunti.SectionResult, verifica_irrigiditori_agli_appoggi.SectionResult],
    Template=report_template_word,
    File=report_file_di_destinazione,
    Topics=report_capitoli_da_includere,
    Model=assembla_quattro_modelli_e_fasi.Model,
    Title=report_titolo,
    Project=report_ipotesi_e_campo_delle_verifiche,
    Author=report_autore,
    Revision=report_revisione,
    SVG=[momento_mx_draw.SVG, tensioni_acciaio_sigma_5_draw.SVG, tau_massima_draw.SVG, pioli_ed_e_rd_draw.SVG, irrigiditori_intermedi_wr_draw.SVG, irrigiditori_appoggi_wr_draw.SVG],
    Overwrite=report_ponte_completo_generate_dopo_le_v)  # -> File, Summary, Warnings, ReportID; "Report ponte completo — Generate dopo le verifiche"
report_file = REPORTFile(report_ponte_completo_generate_dopo_le_v_2.File)
report_summary = REPORTSummary(report_ponte_completo_generate_dopo_le_v_2.Summary)
report_warnings = REPORTWarnings(report_ponte_completo_generate_dopo_le_v_2.Warnings)
report_report_id = REPORTReportID(report_ponte_completo_generate_dopo_le_v_2.ReportID)
