# Grasshopper definition flusso-acciaio-misto_REV003.ghx (Grasshopper 1.0.8)
# plug-ins: BridGHe

# Schema tridimensionale: Due travi G1/G2, interasse 3 m, campate 12+12 m, impalcato 5 m, soletta 300 mm.
# Conci 8 m e traversi pieni ogni 2 m; vincoli spaziali ai sei appoggi.
# La soletta è rappresentata dalle proprietà omogeneizzate delle travi e dalla preview geometrica.
# Nessuna shell aggiunta: rigidezza trasversale del graticcio affidata ai traversi in acciaio.
crossfalltable = BridgeCrossfallTable()  # -> Percentages, Stations
soliddiaphragms = BridgeSolidDiaphragms(MaximumSpacing=2000, AtSupports=True)
traversi_h800 = ISection(
    BottomFlangeWidth=300,
    TopFlangeWidth=300,
    Height=800,
    BottomFlangeThickness=20,
    TopFlangeThickness=20,
    WebThickness=12,
    Radius=0)
jointtree = BridgeJointTree()
# Preview Model Fase 2
# Preview Model Fase 3
meshsettings = BridgeMeshSettings(MaximumElementLength=2000, ChordTolerance=5, SlabBeamSpacing=0)
# Preview Model Fase 0
# Preview Model Fase 1
display_settings = DisplaySettings(
    Enabled=True,
    Geometry=True,
    Sections=True,
    Shaded=True,
    Reinforcement=True,
    Loads=False,
    Supports=True,
    Releases=True,
    OtherAttributes=True,
    Axes=False,
    Labels=False,
    SymbolScale=1,
    LoadScale=1,
    Transparency=0.65)
display_settings_2 = DisplaySettings(
    Enabled=True,
    Geometry=True,
    Sections=True,
    Shaded=True,
    Reinforcement=True,
    Loads=False,
    Supports=True,
    Releases=True,
    OtherAttributes=True,
    Axes=False,
    Labels=False,
    SymbolScale=1,
    LoadScale=1,
    Transparency=0.65)
display_settings_3 = DisplaySettings(
    Enabled=True,
    Geometry=True,
    Sections=True,
    Shaded=True,
    Reinforcement=True,
    Loads=False,
    Supports=True,
    Releases=True,
    OtherAttributes=True,
    Axes=False,
    Labels=False,
    SymbolScale=1,
    LoadScale=1,
    Transparency=0.65)
display_settings_4 = DisplaySettings(
    Enabled=True,
    Geometry=True,
    Sections=True,
    Shaded=True,
    Reinforcement=True,
    Loads=False,
    Supports=True,
    Releases=True,
    OtherAttributes=True,
    Axes=False,
    Labels=False,
    SymbolScale=1,
    LoadScale=1,
    Transparency=0.65)
# COME USARE: REV003 | Estensione del file personale 99. Analisi Straus memorizzate.
# Dopo modifiche: Run sulle 4 analisi; Run Excel in lettura; Run Build; Run Super Element Check; Generate Report.
# Geometria, coefficienti e ipotesi sono modificabili. Questa è una prova del flusso, non una combinazione normativa automatica.
calcola_4_modelli_straus = BooleanToggle(False)
display_settings_5 = DisplaySettings(
    Enabled=True,
    Geometry=True,
    Sections=True,
    Shaded=True,
    Reinforcement=True,
    Loads=False,
    Supports=True,
    Releases=True,
    OtherAttributes=True,
    Axes=False,
    Labels=False,
    SymbolScale=1,
    LoadScale=1,
    Transparency=0.65)
bridghe_panel = BridGHePanel()
# ORIGINE E FASE: Quattro fasi 10/20/30/40. Azioni G1, G2, RITIRO, Q e WIND.
# Il ritiro primario e secondario hanno un unico coefficiente. Nessun prefisso dipende dall'ordine dei modelli.
# Excel in lettura: Run; Build BridGHe Model: Run; Super Element Check: Run; Bridge Report: Generate.
modello_1 = Panel("G1_GETTO | solo acciaio")
# C:\Users\g.pacini\Documents\Repository\BridGHe\example\99-Ponte completo GPC\Straus File\F1.st7
panel = Panel("10")
panel_2 = Panel("SE_Travata 1")
panel_3 = Panel("C:\Temp\diagramma.png")
modello_2 = Panel("G2_PERMANENTI | n infinito = 18")
n0 = Panel("7")
# Ipotesi temporali: C32/40; RH70%; cemento N; 365 giorni. Fine cura e attivazione del misto a 7 giorni.
# Ac e perimetro da larghezza/spessore; due facce esposte, bordi trascurati.
# La stessa epsilon incrementale alimenta FEM e autotensioni. n ritiro = n a lungo termine in questo esempio.
n_infinito = Panel("18")
n_ritiro = Panel("12")
# C:\Users\g.pacini\Documents\Repository\BridGHe\example\99-Ponte completo GPC\Straus File\F2.st7
epsilon_ritiro = Panel("-0.00020000000000000001")
panel_4 = Panel("20")
super_element = ValueList({"SE_Travata 1"}, selected="SE_Travata 1")
# Input Curve della travata
# Nodo Iniziale
panel_6 = Panel("Travi Principali::Trave 1")
# Model Check
# Nodo Finale
pioli_2x22_passo200 = BridgeStuds(
    Enabled=True,
    CountPerRow=2,
    Diameter=22,
    Height=180,
    LongitudinalPitch=200,
    TransversePitch=150,
    Fu=450,
    GammaV=1.25,
    HeadDiameter=35,
    HeadThickness=10,
    RequiredCover=40,
    RepeatedActionDetail=True)
# Sequenza finale: 1 Run Excel in lettura. 2 Run Build. 3 Run Super Element Check. 4 Generate Report.
# Pioli, intermedi e appoggi hanno rami distinti per conservare posizioni e reazioni.
# Per i grafici selezionare una verifica o l'inviluppo WR; le anteprime sono sul canvas.
# PERCORSO E LIMITI: Pioli verificati per sezione/combinazione. Intermedi solo ai punti assegnati; appoggi a x=0/12/24 m.
# Le reazioni sono combinate dalle stesse fonti e dagli stessi coefficienti delle fasi. Sollevamento mantenuto con segno.
# Il modello deve essere ricalcolato prima di aggiornare le verifiche. Opzione Ultimate esplicita; coefficienti DEMO dichiarati nell'Excel.
path = Panel("C:\Users\g.pacini\Documents\Repository\BridGHe\example\99-Ponte completo GPC\Combo_REV002.xlsx")
panel_7 = Panel("30")
modello_3 = Panel("Q_TRAFFICO | n0 = 7")
# Nodo Intermedi
results = ValueList({"Dead", "Q_TRAFFICO", "WIND_1"}, selected=["Q_TRAFFICO", "WIND_1"])
intermedi_200x20_pannelli2m = BridgeIntermediateStiffener(
    Enabled=True,
    Layout=0,
    Width=200,
    Thickness=20,
    RightWidth=200,
    RightThickness=20,
    LeftPanel=2000,
    RightPanel=4000,
    EqualPanels=True,
    LengthFactor=1,
    ExternalCompressionKN=0,
    LoadX=0,
    CheckWelds=True,
    WeldThroat=6)
ultimate_solo_dimostrazione = BridgeAnalysisOptions(
    Standard=1,
    LimitState=0,
    Class4=True,
    TopFlangeBuckling=True,
    BottomFlangeBuckling=True,
    WebBuckling=True,
    CommonLoadY=0,
    GammaM0=1.05,
    GammaM1=1.1,
    GammaM2=1.25,
    GammaC=1.5,
    GammaS=1.15,
    AlphaCC=0.85,
    ShearEta=1.2)
# LIMITI DELL'ESEMPIO: Modello lineare a fasi incrementali, cls non fessurato.
# Combinazioni DEMO per esercitare il flusso; nessuna conformità normativa implicita.
# Verifiche locali di sezione, pioli e irrigiditori. Restano esclusi fatica, instabilità globale, sisma e progetto trasversale della soletta.
panel_9 = Panel("21")
modello_4 = Panel("RITIRO_FEM | n ritiro = 12")
panel_10 = Panel("RIT_P")
value_list = ValueList({"Only Steel": 0, "Composite": 1, "Concrete Excluded": 2}, selected="Composite")
value_list_2 = ValueList({"RITIRO_FEM"}, selected="RITIRO_FEM")
value_list_3 = ValueList({"Only Steel": 0, "Long Term": 1, "Short Term": 2}, selected="Long Term")
panel_11 = Panel("22")
panel_12 = Panel("RIT_S")
# Limite verificatore N Mx Vy: WIND è calcolato in Straus ma il suo coefficiente è ZERO nelle combinazioni di verifica.
# Il verificatore GPC adottato rifiuta correttamente flessione deviata/taglio trasversale/torsione.
# Il vento richiede un percorso di verifica dedicato; non è coperto da questo report.
panel_13 = Panel("-0.000035")

# ---- group: Bridge Support Lines
asse_impalcato_24_m = Curve(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)
supportlines = BridgeSupportLines(Alignment=asse_impalcato_24_m, SupportStations=[0, 12000, 24000], SkewAngles=0)  # -> SupportLines, SpanLengths, SupportCentres

# ---- group: Bridge Slab Layout
altezza_soletta = Slider(300, range=0..1000)
larghezza_soletta_collaborante = Slider(2500, range=0..10000)
slablayout = BridgeSlabLayout(
    SideWidths=larghezza_soletta_collaborante,
    Thickness=altezza_soletta,
    CrossfallPercent=crossfalltable.Percentages,
    CrossfallStations=crossfalltable.Stations)

# ---- group: Concrete
concrete = Concrete(Name="C32/40", Grade=6)

# ---- group: Steel
steel = Steel(Name="S355", Grade=2)

# ---- group: Load Case
panel_14 = Panel("G1_GETTO")
load_case = LoadCase(Name=panel_14, GravityNSM=False)

# ---- group: Cluster
diametro_armatura_superiore = Slider(16, range=10..32)
passo_armatura_superiore_cm = Slider(10, range=10..25)
cluster = Cluster(radius=diametro_armatura_superiore, A=larghezza_soletta_collaborante, B=passo_armatura_superiore_cm)

diametro_armatura_inferiore = Slider(16, range=10..32)
passo_armatura_inferiore_cm = Slider(10, range=10..25)
cluster_2 = Cluster(radius=diametro_armatura_inferiore, A=larghezza_soletta_collaborante, B=passo_armatura_inferiore_cm)

# ----
multiplication = Multiplication(A=larghezza_soletta_collaborante, B=altezza_soletta)

# ---- group: Multiplication
due_facce_esposte = Panel("2")
multiplication_2 = Multiplication(A=larghezza_soletta_collaborante, B=due_facce_esposte)

# ---- group: List Length
panel_15 = Panel("""G2_SOLETTA
G2_FINITURE
G2_BARRIERE""")
list_length = ListLength(List=panel_15)

# ---- group: I Section
larghezza_piattabanda_superiore = Slider(600, range=0..1000)
larghezza_piattabanda_inferiore = Slider(800, range=0..1000)
altezza = Slider(1800, range=0..10000)
spessore_piattabanda_superiore = Slider(30, range=0..100)
spessore_piattabanda_inferiore = Slider(40, range=0..100)
spessore_anima = Slider(15, range=0..100)
i_section = ISection(
    BottomFlangeWidth=larghezza_piattabanda_inferiore,
    TopFlangeWidth=larghezza_piattabanda_superiore,
    Height=altezza,
    BottomFlangeThickness=spessore_piattabanda_inferiore,
    TopFlangeThickness=spessore_piattabanda_superiore,
    WebThickness=spessore_anima,
    Radius=0)

# ----
list_item = ListItem(List=panel_15, Index=0, Wrap=True)  # -> Item, Item1, Item2
group = Group(panel_6)

# ---- group: Node
appoggio_fisso = Point(Point(0, 0, 0))
node = Node(Point=appoggio_fisso)

appoggi_scorrevoli = Point([Point(12000, 0, 0), Point(24000, 0, 0)])
node_2 = Node(Point=appoggi_scorrevoli)

nodi_intermedi_vincoli_fuori_piano = Point([Point(2000, 0, 0), Point(4000, 0, 0), Point(6000, 0, 0), Point(8000, 0, 0), Point(10000, 0, 0), Point(14000, 0, 0), Point(16000, 0, 0), Point(18000, 0, 0), Point(20000, 0, 0), Point(22000, 0, 0)])
node_3 = Node(Point=nodi_intermedi_vincoli_fuori_piano)

# ---- group: Load Case
load_case_2 = LoadCase(Name="Q_TRAFFICO", GravityNSM=False)

load_case_3 = LoadCase(Name="WIND_1", GravityNSM=False)

load_case_4 = LoadCase(Name="RITIRO_FEM_LIN", GravityNSM=False)

load_case_5 = LoadCase(Name="RITIRO_FEM_GRAD", GravityNSM=False)

# ----
list_length_2 = ListLength(List=panel_15)

# ---- group: Load Case
load_case_6 = LoadCase(Name="RITIRO_PRIMARIO", GravityNSM=False)

# ----
section_geometric_property = SectionGeometricProperty(SectionProperty=i_section)  # -> Name, Area, Xg, Yg, Jxx, Jyy, Angle, J₁₁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
s355_traversi = BeamProperty(
    Name="Traversi H800",
    Type=5,
    Section=traversi_h800,
    Material=steel,
    Name_2="Traversi H800",
    Type_2=5,
    Section_2=traversi_h800,
    Material_2=steel,
    Release=1)  # -> Property, Property_2

# ---- group: Concrete Slab Section
copriferro_superiore_mm = Slider(50, range=0..100)
copriferro_inferiore_mm = Slider(50, range=0..100)
concrete_slab_section = ConcreteSlabSection(
    Height=altezza_soletta,
    Width=larghezza_soletta_collaborante,
    RebarArea=cluster,
    TopConcreteCover=copriferro_superiore_mm,
    BottomRebarArea=cluster_2,
    BottomConcreteCover=copriferro_inferiore_mm)

# ----
ritiro_da_rh_geometria_ed_età = CreepAndShrinkageConcrete(
    Fck=32,
    ElasticModulusSteel=210000,
    ConcreteArea=multiplication,
    RH=70,
    U=multiplication_2,
    T0=28,
    T=365,
    CementType=1,
    DryingStart=7,
    ReferenceAge=7)  # -> N0, N, YTT0, Εcs, TotalShrinkage, DryingShrinkage, AutogenousShrinkage, NotionalSize
duplicate_data = DuplicateData(Data=1, Number=list_length, Order=True)
load_case_7 = LoadCase(Name=list_item.Item, GravityNSM=False)
load_case_8 = LoadCase(Name=list_item.Item1, GravityNSM=False)
load_case_9 = LoadCase(Name=list_item.Item2, GravityNSM=False)

# ---- group: Restraints
tx_ty_tz = TxTyTz([True, True, True])
rx_ry_rz = RxRyRz([True, False, True])
restraints = Restraints(Node=node, Transational=tx_ty_tz, Rotation=rx_ry_rz)

tx_ty_tz_2 = TxTyTz([False, True, True])
rx_ry_rz_2 = RxRyRz([True, False, True])
restraints_2 = Restraints(Node=node_2, Transational=tx_ty_tz_2, Rotation=rx_ry_rz_2)

tx_ty_tz_3 = TxTyTz([False, True, False])
rx_ry_rz_3 = RxRyRz([True, False, True])
restraints_3 = Restraints(Node=node_3, Transational=tx_ty_tz_3, Rotation=rx_ry_rz_3)

# ----
merge = Merge(Data1=load_case_4, Data2=load_case_5)
duplicate_data_2 = DuplicateData(Data=1, Number=list_length_2, Order=True)
subtraction = Subtraction(A=section_geometric_property.Yg, B=altezza)
bridge_section_schedule = BridgeSectionSchedule(
    Property=s355_traversi.Property_2,
    Start=0,
    End=24000,
    Family=1,
    Group=0,
    Segment=0,
    StartScale=Vector(1, 1, 0),
    EndScale=Vector(1, 1, 0))

# ---- group: Composite Beam Property
b450 = B450(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)
composite_beam_property = CompositeBeamProperty(
    Name="H1800 600x30 800x40 anima15 + soletta 2500x300",
    ConcreteSlabSection=concrete_slab_section,
    SteelSection=i_section,
    ConcreteMaterial=concrete,
    SteelMaterial=steel,
    ReinforcementMaterial=b450,
    N0=ritiro_da_rh_geometria_ed_età.N0,
    N=ritiro_da_rh_geometria_ed_età.N,
    NRitiro=ritiro_da_rh_geometria_ed_età.N,
    ConsiderRebars=True)  # -> CompositeSection, OnlySteelProperty, N0BeamSection, NBeamSection, NRitiroBeamSection

# ----
merge_2 = Merge(Data1=load_case_7, Data2=load_case_8, Data3=load_case_9)
merge_3 = Merge(Data2=flatten(restraints), Data3=flatten(restraints_2), Data4=flatten(restraints_3))

# ---- group: Load Combination
load_combination = LoadCombination(Name="RITIRO_FEM", LoadCases=merge, Coefficients=duplicate_data_2)

# ----
subtraction_2 = Subtraction(A=subtraction, B=altezza_soletta)
familyproperty = BridgeFamilyProperty(Property=composite_beam_property.OnlySteelProperty, Family=-1)
composite_shrinkage_actions = CompositeShrinkageActions(CompositeProperty=composite_beam_property.CompositeSection, ConcreteStrain=ritiro_da_rh_geometria_ed_età.Εcs)  # -> StrausPreStrain, Axis2ThermalGradient, FreeCentroidStrain, FreeCurvature

# ---- group: Load Combination
panel_16 = Panel("G2_PERMANENTI")
load_combination_2 = LoadCombination(Name=panel_16, LoadCases=merge_2, Coefficients=duplicate_data)

# ---- group: Beam
_12_elementi_2_campate_da_12000_mm = Curve([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])
beam = Beam(Line=_12_elementi_2_campate_da_12000_mm, Property=composite_beam_property.OnlySteelProperty, Groups=group, Angle=0)

# ----
girderaxes = BridgeGirderAxes(TransverseOffsets=[-1500, 1500], AxisLevels=subtraction_2)  # -> GirderAxes, GirderCount

# ---- group: Bridge Fabrication Segments
fabrication = BridgeFabricationSegments(
    Alignment=asse_impalcato_24_m,
    GirderAxes=girderaxes.GirderAxes,
    JointSets=jointtree,
    MaximumSegmentLength=Slider(1000, range=0..1000))  # -> FabricationPlan, SegmentCount, SegmentIDs, StartStations, EndStations, SegmentLengths

# ----
bridgeassembly = BridgeGeometryAssembly(
    Alignment=asse_impalcato_24_m,
    SupportLines=supportlines.SupportLines,
    GirderAxes=girderaxes.GirderAxes,
    SlabLayout=slablayout,
    FabricationPlan=fabrication.FabricationPlan,
    Diaphragms=soliddiaphragms)
ponte_12_12_m_due_travi_mesh = BridgeGrillageMesh(BridgeDefinition=bridgeassembly, MeshSettings=meshsettings, Labels=False)  # -> Members, MemberIDs, Longitudinals, DiaphragmMembers, Nodes, SupportPoints, JointPoints, Deck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
geometry = Geometry(ponte_12_12_m_due_travi_mesh.Deck)
femmembers = BridgeFEMMembers(
    BridgeGeometry=ponte_12_12_m_due_travi_mesh.BridgeGeometry,
    FamilyProperties=familyproperty,
    SectionRules=bridge_section_schedule)  # -> Beams, PhysicalIDs, Unassigned, Information
bridge_bearings = BridgeBearings(
    BridgeGeometry=ponte_12_12_m_due_travi_mesh.BridgeGeometry,
    Types=[0, 2, 1, 2, 1, 2],
    GuideAngle=0,
    TranslationStiffness=Vector(0, 0, 0),
    RotationStiffness=Vector(0, 0, 0))  # -> Nodes, Frames, Labels

# ---- group: Beam Output Stations
beam_output_stations = BeamOutputStations(Beam=femmembers.Beams, OutputStations=Slider(4, range=0..10))

# ---- group: Super Element
super_element_2 = SuperElement(Element=beam_output_stations, Name="SE_Travata 1")

# ----
build_model = BuildModel(Elements=[beam_output_stations, bridge_bearings.Nodes], Name="Base - solo acciaio", Units=2)
list_length_3 = ListLength(List=super_element_2)
decompose_model = DecomposeModel(Model=build_model)  # -> Nodes, Beams, Plates
bridge_model_audit = BridgeModelAudit(Model=build_model, Tolerance=1e-06)  # -> NoInputErrors, Severity, Code, Element, Description, Model
series = Series(Start=1, Step=1, Count=list_length_3)
beam_filter = BeamFilter(Beams=decompose_model.Beams, Units=2, PropertiesName="H1800 600x30 800x40 anima15 + soletta 2500x300OnlySteel")  # -> Beams, Others
panel_17 = Panel(bridge_model_audit.Description)

# ---- group: Beam Distributed Load
beam_distributed_load = BeamDistributedLoad(Beam=beam_filter.Beams, LoadCase=load_case, Type=0, Direction=1, PA=Slider(-10, range=-10..10), A=0, B=0)

# ----
beam_override = BeamOverride(Beam=beam_filter.Beams, Property=composite_beam_property.NBeamSection)  # -> simplify(graft(Beam))
beam_override_2 = BeamOverride(Beam=beam_filter.Beams, Property=composite_beam_property.N0BeamSection)
beam_override_3 = BeamOverride(Beam=beam_filter.Beams, Property=composite_beam_property.NRitiroBeamSection)
build_model_2 = BuildModel(Elements=flatten([beam_distributed_load, decompose_model.Nodes, beam_filter.Others]), Name="G1_GETTO", Units=2)

# ---- group: Beam Distributed Load
beam_distributed_load_2 = BeamDistributedLoad(Beam=simplify(beam_override), LoadCase=load_case_7, Type=0, Direction=1, PA=Slider(-10, range=-10..10), A=0, B=0)

beam_distributed_load_3 = BeamDistributedLoad(Beam=beam_override_2, LoadCase=load_case_2, Type=0, Direction=1, PA=Slider(-10, range=-10..10), A=0, B=0)

# ----
beam_preload = BeamPreLoad(Beam=beam_override_3, LoadCase=load_case_4, Type=1, Value=composite_shrinkage_actions.StrausPreStrain)
preview_bridghe_model = PreviewBridGHeModel(ModelElements=build_model_2, Settings=display_settings)

# ---- group: Bridge Analysis Cases
value_list_4 = ValueList({"G1_GETTO"}, selected="G1_GETTO")
straus_casi_richiesti_dalle_azioni = BridgeAnalysisCases(Model=build_model_2, RequiredCases=flatten(value_list_4), Solver=0)  # -> AnalysisResults, Information

# ---- group: Beam Distributed Load
beam_distributed_load_4 = BeamDistributedLoad(Beam=beam_distributed_load_2, LoadCase=load_case_8, Type=0, Direction=1, PA=Slider(-2, range=-10..10), A=0, B=0)

beam_distributed_load_5 = BeamDistributedLoad(Beam=beam_distributed_load_3, LoadCase=load_case_3, Type=0, Direction=0, PA=Slider(-5, range=-10..10), A=0, B=0)

# ----
beam_gradient_load = BeamGradientLoad(Beam=beam_preload, LoadCase=load_case_5, Axis1=0, Axis2=composite_shrinkage_actions.Axis2ThermalGradient)
straus_r3_analysis = StrausR3Analysis(
    Model=build_model_2,
    Solver=0,
    AnalysisResults=flatten([panel_14, straus_casi_richiesti_dalle_azioni.AnalysisResults]),
    OutputPath="C:\Users\g.pacini\Documents\Repository\BridGHe\example\99-Ponte completo GPC\REV003\calcoli\G1.st7",
    KeepRunning=False,
    ElementGuids="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")

# ---- group: Beam Distributed Load
beam_distributed_load_6 = BeamDistributedLoad(Beam=beam_distributed_load_4, LoadCase=load_case_9, Type=0, Direction=1, PA=Slider(-1, range=-10..10), A=0, B=0)

# ----
build_model_3 = BuildModel(Elements=flatten([beam_distributed_load_5, decompose_model.Nodes, beam_filter.Others]), Name="Q_TRAFFICO", Units=2)
build_model_4 = BuildModel(
    Elements=flatten([beam_gradient_load, decompose_model.Nodes, beam_filter.Others]),
    Name="RITIRO_FEM",
    Units=2,
    LoadCombinations=load_combination)
preview_bridghe_model_2 = PreviewBridGHeModel(ModelElements=build_model_3, Settings=display_settings_3)
preview_bridghe_model_3 = PreviewBridGHeModel(ModelElements=build_model_4, Settings=display_settings_4)
super_element_filter = SuperElementFilter(BridGHeModel=straus_r3_analysis, SuperElement="G1")

# ---- group: Bridge Action
value_list_5 = ValueList({"Only Steel": 0, "Long Term": 1, "Short Term": 2}, selected="Only Steel")
bridge_action = BridgeAction(ActionID="G1", Model=straus_r3_analysis, Case=value_list_4, Behavior=value_list_5)

# ----
build_model_5 = BuildModel(
    Elements=flatten([beam_distributed_load_6, decompose_model.Nodes, beam_filter.Others]),
    Name="G2_PERMANENTI",
    Units=2,
    LoadCombinations=load_combination_2)

# ---- group: Bridge Analysis Cases
caso_fem_richiesto_da_wind_dal_modello_q = CasoFEMRichiestoDaWINDDalModelloQ("WIND_1")
value_list_6 = ValueList({"Q_TRAFFICO", "WIND_1"}, selected="Q_TRAFFICO")
straus_casi_richiesti_dalle_azioni_2 = BridgeAnalysisCases(Model=build_model_3, RequiredCases=flatten([value_list_6, caso_fem_richiesto_da_wind_dal_modello_q]), Solver=0)  # -> AnalysisResults, Information

caso_fem_richiesto_da_bridge_shrinkage_a = CasoFEMRichiestoDaBridgeShrinkageAction("RITIRO_FEM")
straus_casi_richiesti_dalle_azioni_3 = BridgeAnalysisCases(Model=build_model_4, RequiredCases=flatten(caso_fem_richiesto_da_bridge_shrinkage_a), Solver=0)  # -> AnalysisResults, Information

# ----
preview_bridghe_model_4 = PreviewBridGHeModel(ModelElements=build_model_5, Settings=display_settings_2)

# ---- group: Bridge Analysis Cases
value_list_7 = ValueList({"G2_PERMANENTI"}, selected="G2_PERMANENTI")
straus_casi_richiesti_dalle_azioni_4 = BridgeAnalysisCases(Model=build_model_5, RequiredCases=flatten(value_list_7), Solver=0)  # -> AnalysisResults, Information

# ----
build_model_6 = BuildModel(Elements=flatten(super_element_filter), Units=2)

# ---- group: Bridge Phase
value_list_8 = ValueList({"Only Steel": 0, "Composite": 1, "Concrete Excluded": 2}, selected="Only Steel")
bridge_phase = BridgePhase(Number=10, Name=value_list_4, SectionState=value_list_8, Actions=flatten(bridge_action))

# ----
straus_r3_analysis_2 = StrausR3Analysis(
    Model=build_model_3,
    Solver=0,
    AnalysisResults=flatten(straus_casi_richiesti_dalle_azioni_2.AnalysisResults),
    OutputPath="C:\Users\g.pacini\Documents\Repository\BridGHe\example\99-Ponte completo GPC\REV003\calcoli\Q.st7",
    KeepRunning=False,
    ElementGuids="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")

# ---- group: Straus R3 Analysis
results_2 = ValueList({"Dead", "RITIRO_FEM_GRAD", "RITIRO_FEM_LIN", "RITIRO_FEM"}, selected="RITIRO_FEM")
straus_r3_analysis_3 = StrausR3Analysis(
    Model=build_model_4,
    Solver=0,
    AnalysisResults=flatten([results_2, straus_casi_richiesti_dalle_azioni_3.AnalysisResults]),
    OutputPath="C:\Users\g.pacini\Documents\Repository\BridGHe\example\99-Ponte completo GPC\REV003\calcoli\RITIRO.st7",
    KeepRunning=False,
    ElementGuids="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")

# ----
straus_r3_analysis_4 = StrausR3Analysis(
    Model=build_model_5,
    Solver=0,
    AnalysisResults=flatten([panel_16, straus_casi_richiesti_dalle_azioni_4.AnalysisResults]),
    OutputPath="C:\Users\g.pacini\Documents\Repository\BridGHe\example\99-Ponte completo GPC\REV003\calcoli\G2.st7",
    KeepRunning=False,
    ElementGuids="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")
super_element_filter_2 = SuperElementFilter(BridGHeModel=straus_r3_analysis_2, SuperElement="G1")

# ---- group: Bridge Action
value_list_9 = ValueList({"Only Steel": 0, "Long Term": 1, "Short Term": 2}, selected="Short Term")
bridge_action_2 = BridgeAction(ActionID="Q", Model=straus_r3_analysis_2, Case=value_list_6, Behavior=value_list_9)

# ----
wind_dal_modello_q = BridgeAction(ActionID="WIND", Model=straus_r3_analysis_2, Case="WIND_1", Behavior=2)
bridge_shrinkage_action = BridgeShrinkageAction(
    ActionID="RITIRO",
    Model=straus_r3_analysis_3,
    Case="RITIRO_FEM",
    StrainIncrement=ritiro_da_rh_geometria_ed_età.Εcs,
    PrimaryOnly=False,
    Response=0)
merge_4 = Merge(
    Data1=flatten(straus_r3_analysis),
    Data2=flatten(straus_r3_analysis_4),
    Data3=flatten(straus_r3_analysis_2),
    Data4=flatten(straus_r3_analysis_3))
super_element_filter_3 = SuperElementFilter(BridGHeModel=straus_r3_analysis_4, SuperElement="G1")

# ---- group: Bridge Action
value_list_10 = ValueList({"Only Steel": 0, "Long Term": 1, "Short Term": 2}, selected="Long Term")
bridge_action_3 = BridgeAction(ActionID="G2", Model=straus_r3_analysis_4, Case=value_list_7, Behavior=value_list_10)

# ----
build_model_7 = BuildModel(Elements=flatten(super_element_filter_2), Units=2)

# ---- group: Bridge Phase
value_list_11 = ValueList({"Only Steel": 0, "Composite": 1, "Concrete Excluded": 2}, selected="Composite")
bridge_phase_2 = BridgePhase(Number=40, Name=value_list_6, SectionState=value_list_11, Actions=flatten([bridge_action_2, wind_dal_modello_q]))

value_list_12 = ValueList({"Only Steel": 0, "Composite": 1, "Concrete Excluded": 2}, selected="Composite")
bridge_phase_3 = BridgePhase(Number=30, Name="Ritiro primario e secondario", SectionState=value_list_12, Actions=flatten(bridge_shrinkage_action))

# ----
build_model_8 = BuildModel(Elements=flatten(super_element_filter_3), Units=2)

# ---- group: Bridge Phase
value_list_13 = ValueList({"Only Steel": 0, "Composite": 1, "Concrete Excluded": 2}, selected="Composite")
bridge_phase_4 = BridgePhase(Number=20, Name=value_list_7, SectionState=value_list_13, Actions=flatten(bridge_action_3))

# ----
merge_5 = Merge(Data1=flatten(bridge_phase), Data2=flatten(bridge_phase_4), Data4=flatten(bridge_phase_3), Data5=flatten(bridge_phase_2))
bridge_phase_table = BridgePhaseTable(Phases=flatten([bridge_phase, bridge_phase_4, bridge_phase_3, bridge_phase_2]))  # -> Phases, Number, Name, Day, SectionState, ActionID, Behavior, Source, Case, Strain
bridge_combination_excel = BridgeCombinationExcel(
    Models=flatten([straus_r3_analysis, straus_r3_analysis_4, straus_r3_analysis_2, straus_r3_analysis_3]),
    Phases=flatten([bridge_phase, bridge_phase_4, bridge_phase_3, bridge_phase_2]),
    File="Combinazioni_REV003.xlsx",
    Mode=0,
    Rows=20,
    Overwrite=False)  # -> File, Table, ActionIDs, Summary
bridge_combination_excel_2 = BridgeCombinationExcel(
    Models=flatten([straus_r3_analysis, straus_r3_analysis_4, straus_r3_analysis_2, straus_r3_analysis_3]),
    Phases=flatten([bridge_phase, bridge_phase_4, bridge_phase_3, bridge_phase_2]),
    File="Combinazioni_REV003.xlsx",
    Mode=1,
    Rows=20,
    Overwrite=False)  # -> File, Table, ActionIDs, Summary
build_bridghe_model = BuildBridGHeModel(
    Models=flatten([straus_r3_analysis, straus_r3_analysis_4, straus_r3_analysis_2, straus_r3_analysis_3]),
    Phases=flatten([bridge_phase, bridge_phase_4, bridge_phase_3, bridge_phase_2]),
    Combinations=bridge_combination_excel_2.Table,
    Calculation=0,
    AdditionalPhaseMembers=False)  # -> Model, Phases, Diagnostics
panel_18 = Panel(bridge_phase_table.SectionState)
super_element_filter_4 = SuperElementFilter(BridGHeModel=build_bridghe_model.Model, SuperElement="G1")
panel_19 = Panel(build_bridghe_model.Diagnostics)
trave_g2 = SuperElementFilter(BridGHeModel=build_bridghe_model.Model, SuperElement="G2")
composite_beam = CompositeBeam(Beam=super_element_filter_4, SectionStart=composite_beam_property.CompositeSection)
misto_g2 = CompositeBeam(Beam=trave_g2, SectionStart=composite_beam_property.CompositeSection)
preview_bridghe_model_5 = PreviewBridGHeModel(ModelElements=composite_beam, Settings=display_settings_5)
super_element_check = SuperElementCheck(
    BridGHeModel=build_bridghe_model.Model,
    SuperElementBeam=composite_beam,
    WebLocalInstability=False,
    TopFlangeLocalInstability=False,
    BottomFlangeLocalInstability=False)  # -> TensionCheck, TauB, TensionForces
verifiche_g2 = SuperElementCheck(
    BridGHeModel=build_bridghe_model.Model,
    SuperElementBeam=misto_g2,
    WebLocalInstability=True,
    TopFlangeLocalInstability=True,
    BottomFlangeLocalInstability=True)  # -> TensionCheck, TauB, TensionForces
bridge_stress_plot = BridgeStressPlot(
    BridGHeModel=build_bridghe_model.Model,
    SuperElementBeam=composite_beam,
    Results=super_element_check.TensionCheck,
    Quantity=3,
    ShowMinMaxCombo=True,
    GraphicTitle="Trave 1 - Tensioni acciaio sigma 5",
    KeepRunning=True)  # -> SVG, File, Minimum, Maximum
bridge_force_plot = BridgeForcePlot(
    BridGHeModel=build_bridghe_model.Model,
    SuperElementBeam=composite_beam,
    Results=super_element_check.TensionForces,
    Quantity=4,
    ShowMinMaxCombo=True,
    GraphicTitle="Trave 1 - Momento Mx",
    KeepRunning=True)  # -> SVG, File, Minimum, Maximum
pioli_sulle_azioni_di_fase = BridgeDetailCheck(SectionResult=super_element_check.TensionCheck, Studs=pioli_2x22_passo200, Options=ultimate_solo_dimostrazione)  # -> SectionResult, Check, Demand, Resistance, Units, Ratio, Status, Warnings
composite_section_linear_tension_results = CompositeSectionLinearTensionResults(LinearTensionResults=super_element_check.TensionCheck)  # -> Point1_ConcreteEpsilon, Point1_ConcreteSigma, Point2_RebarSigma, Point3_RebarSigma, Point4_ConcreteSigma, Point5_SteelSigma, Point6_SteelSigma, Point6_SteelTau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
pioli_g2 = BridgeDetailCheck(SectionResult=verifiche_g2.TensionCheck, Studs=pioli_2x22_passo200, Options=ultimate_solo_dimostrazione)  # -> SectionResult, Check, Demand, Resistance, Units, Ratio, Status, Warnings
bridge_force_plot_g2 = BridgeForcePlot(
    BridGHeModel=build_bridghe_model.Model,
    SuperElementBeam=misto_g2,
    Results=verifiche_g2.TensionForces,
    Quantity=4,
    ShowMinMaxCombo=True,
    GraphicTitle="Trave 2 - Momento Mx",
    KeepRunning=True)  # -> SVG, File, Minimum, Maximum
bridge_stress_plot_g2 = BridgeStressPlot(
    BridGHeModel=build_bridghe_model.Model,
    SuperElementBeam=misto_g2,
    Results=verifiche_g2.TensionCheck,
    Quantity=3,
    ShowMinMaxCombo=True,
    GraphicTitle="Trave 2 - Tensioni acciaio sigma 5",
    KeepRunning=True)  # -> SVG, File, Minimum, Maximum
bridge_plot_preview = BridgePlotPreview(SVG=flatten(bridge_stress_plot.SVG), Index=0, Width=600)
bridge_plot_preview_2 = BridgePlotPreview(SVG=flatten(bridge_force_plot.SVG), Index=0, Width=600)
rapporti_stesso_ordine = Panel(pioli_sulle_azioni_di_fase.Ratio)
controlli = Panel(pioli_sulle_azioni_di_fase.Check)
pioli_per_stazione_e_combo = BridgeStudResults(SectionResult=pioli_sulle_azioni_di_fase.SectionResult)  # -> ConnectionFlow, ForcePerStud, ResistancePerStud, ResistancePerLength, ForceRatio, Phase, PhaseFlow, Warnings
sigma_cls_superiore_mpa = Panel(composite_section_linear_tension_results.Point1_ConcreteSigma)

# ---- group: Bridge Detail Stations
intermedi_passo_2_m = Point([Point(2000, -1500, -1359.318631), Point(4000, -1500, -1359.318631), Point(6000, -1500, -1359.318631), Point(8000, -1500, -1359.318631), Point(10000, -1500, -1359.318631), Point(14000, -1500, -1359.318631), Point(16000, -1500, -1359.318631), Point(18000, -1500, -1359.318631), Point(20000, -1500, -1359.318631), Point(22000, -1500, -1359.318631)])
sezioni_irrigiditori_intermedi = BridgeDetailStations(
    Model=build_bridghe_model.Model,
    Results=pioli_sulle_azioni_di_fase.SectionResult,
    Locations=intermedi_passo_2_m,
    Up=Vector(0, 0, 1),
    Tolerance=1e-06)  # -> Results, CompressionKN, SignedReactionKN, EndType, Points

# ---- group: Bridge Result Labels
value_list_14 = ValueList({"Completa": 0, "Trave e stazione": 1, "Combinazione": 2, "Fase": 3}, selected="Completa")
bridge_result_labels = BridgeResultLabels(Results=pioli_sulle_azioni_di_fase.SectionResult, Format=value_list_14)

# ----
sigma_armatura_superiore_mpa = Panel(composite_section_linear_tension_results.Point2_RebarSigma)
sigma_armatura_inferiore_mpa = Panel(composite_section_linear_tension_results.Point3_RebarSigma)

# ---- group: Bridge Detail Stations
appoggi_sugli_assi_fem = Point([Point(0, -1500, -1359.318631), Point(12000, -1500, -1359.318631), Point(24000, -1500, -1359.318631)])
appoggi_e_reazioni_reali = BridgeDetailStations(
    Model=build_bridghe_model.Model,
    Results=pioli_sulle_azioni_di_fase.SectionResult,
    Locations=appoggi_sugli_assi_fem,
    Phases=[bridge_phase, bridge_phase_4, bridge_phase_3, bridge_phase_2],
    Up=Vector(0, 0, 1),
    Tolerance=1e-06)  # -> Results, CompressionKN, SignedReactionKN, EndType, Points

# ----
sigma_acciaio_inferiore_mpa = Panel(composite_section_linear_tension_results.Point8_SteelSigma)
bridge_stud_plot = BridgeStudPlot(
    BridGHeModel=build_bridghe_model.Model,
    SuperElementBeam=composite_beam,
    Results=pioli_sulle_azioni_di_fase.SectionResult,
    Quantity=5,
    ShowMinMaxCombo=True,
    GraphicTitle="Trave 1 - Pioli Ed e Rd",
    KeepRunning=True)  # -> SVG, File, Minimum, Maximum

# ---- group: Bridge Detail Stations
intermedi_g2 = Point([Point(2000, 1500, -1359.318631), Point(4000, 1500, -1359.318631), Point(6000, 1500, -1359.318631), Point(8000, 1500, -1359.318631), Point(10000, 1500, -1359.318631), Point(14000, 1500, -1359.318631), Point(16000, 1500, -1359.318631), Point(18000, 1500, -1359.318631), Point(20000, 1500, -1359.318631), Point(22000, 1500, -1359.318631)])
intermedi_g2_2 = BridgeDetailStations(
    Model=build_bridghe_model.Model,
    Results=pioli_g2.SectionResult,
    Locations=intermedi_g2,
    Up=Vector(0, 0, 1),
    Tolerance=1e-06)  # -> Results, CompressionKN, SignedReactionKN, EndType, Points

appoggi_g2 = Point([Point(0, 1500, -1359.318631), Point(12000, 1500, -1359.318631), Point(24000, 1500, -1359.318631)])
appoggi_g2_2 = BridgeDetailStations(
    Model=build_bridghe_model.Model,
    Results=pioli_g2.SectionResult,
    Locations=appoggi_g2,
    Phases=[bridge_phase, bridge_phase_4, bridge_phase_3, bridge_phase_2],
    Up=Vector(0, 0, 1),
    Tolerance=1e-06)  # -> Results, CompressionKN, SignedReactionKN, EndType, Points

# ----
bridge_plot_preview_3 = BridgePlotPreview(SVG=flatten(bridge_force_plot_g2.SVG), Index=0, Width=600)
bridge_plot_preview_4 = BridgePlotPreview(SVG=flatten(bridge_stress_plot_g2.SVG), Index=0, Width=600)
bridge_stud_plot_g2 = BridgeStudPlot(
    BridGHeModel=build_bridghe_model.Model,
    SuperElementBeam=misto_g2,
    Results=pioli_g2.SectionResult,
    Quantity=5,
    ShowMinMaxCombo=True,
    GraphicTitle="Trave 2 - Pioli Ed e Rd",
    KeepRunning=True)  # -> SVG, File, Minimum, Maximum
flusso_n_mm = Panel(pioli_per_stazione_e_combo.ConnectionFlow)
forza_per_piolo_kn = Panel(pioli_per_stazione_e_combo.ForcePerStud)
rapporto_piolo = Panel(pioli_per_stazione_e_combo.ForceRatio)
verifica_intermedi = BridgeDetailCheck(SectionResult=sezioni_irrigiditori_intermedi.Results, IntermediateStiffener=intermedi_200x20_pannelli2m)  # -> SectionResult, Check, Demand, Resistance, Units, Ratio, Status, Warnings
appoggio_r_fem_per_combinazione = BridgeSupportStiffener(
    Enabled=True,
    Layout=0,
    Width=200,
    Thickness=25,
    RightWidth=250,
    RightThickness=25,
    Location=appoggi_e_reazioni_reali.EndType,
    LeftPanel=2000,
    RightPanel=2000,
    ReactionKN=appoggi_e_reazioni_reali.CompressionKN,
    EndDistance=250,
    LoadX=0,
    LoadZ=0,
    FootprintLength=400,
    FootprintWidth=600,
    LengthFactor=1,
    RigidEndPost=False,
    EndPostSpacing=300,
    CheckWelds=True,
    WeldThroat=10)
bridge_plot_preview_5 = BridgePlotPreview(SVG=flatten(bridge_stud_plot.SVG), Index=0, Width=600)
verifiche_intermedi_g2 = BridgeDetailCheck(SectionResult=intermedi_g2_2.Results, IntermediateStiffener=intermedi_200x20_pannelli2m)  # -> SectionResult, Check, Demand, Resistance, Units, Ratio, Status, Warnings
irrigiditori_appoggi_g2 = BridgeSupportStiffener(
    Enabled=True,
    Layout=0,
    Width=200,
    Thickness=25,
    RightWidth=250,
    RightThickness=25,
    Location=appoggi_g2_2.EndType,
    LeftPanel=2000,
    RightPanel=2000,
    ReactionKN=appoggi_g2_2.CompressionKN,
    EndDistance=250,
    LoadX=0,
    LoadZ=0,
    FootprintLength=400,
    FootprintWidth=600,
    LengthFactor=1,
    RigidEndPost=False,
    EndPostSpacing=300,
    CheckWelds=True,
    WeldThroat=10)
bridge_plot_preview_6 = BridgePlotPreview(SVG=flatten(bridge_stud_plot_g2.SVG), Index=0, Width=600)
verifica_agli_appoggi = BridgeDetailCheck(SectionResult=appoggi_e_reazioni_reali.Results, SupportStiffener=appoggio_r_fem_per_combinazione)  # -> SectionResult, Check, Demand, Resistance, Units, Ratio, Status, Warnings

# ---- group: Bridge Intermediate Stiffener Plot
value_list_15 = ValueList({"Inviluppo WR di tutte le verifiche": 0, "Intermedio · rigidezza pannelli": 1, "Intermedio · stabilità e pressoflessione II ordine": 2, "Intermedio · freccia fuori piano": 3, "Intermedio · rigidezza torsionale": 4, "Intermedio · piatti entro classe 3": 5, "Intermedio · ingombro tra piattabande": 6, "Intermedio · saldature verticali all’anima": 7, "Intermedio · saldature alle flange": 8, "Intermedio · gola minima": 9, "Intermedio · lunghezza efficace cordone": 10, "Intermedio · collegamenti": 11}, selected="Inviluppo WR di tutte le verifiche")
bridge_intermediate_stiffener_plot = BridgeIntermediateStiffenerPlot(
    BridGHeModel=build_bridghe_model.Model,
    SuperElementBeam=composite_beam,
    Results=verifica_intermedi.SectionResult,
    Check=value_list_15,
    ShowMinMaxCombo=True,
    GraphicTitle="Trave 1 - Irrigiditori intermedi WR",
    KeepRunning=True,
    Display=0,
    Stations=[2, 4, 6, 8, 10, 14, 16, 18, 20, 22])  # -> SVG, File, Minimum, Maximum, GoverningChecks, UnavailableChecks

# ----
verifiche_appoggi_g2 = BridgeDetailCheck(SectionResult=appoggi_g2_2.Results, SupportStiffener=irrigiditori_appoggi_g2)  # -> SectionResult, Check, Demand, Resistance, Units, Ratio, Status, Warnings
bridge_intermediate_stiffener_plot_g2 = BridgeIntermediateStiffenerPlot(
    BridGHeModel=build_bridghe_model.Model,
    SuperElementBeam=misto_g2,
    Results=verifiche_intermedi_g2.SectionResult,
    Check=value_list_15,
    ShowMinMaxCombo=True,
    GraphicTitle="Trave 2 - Irrigiditori intermedi WR",
    KeepRunning=True,
    Display=0,
    Stations=[2, 4, 6, 8, 10, 14, 16, 18, 20, 22])  # -> SVG, File, Minimum, Maximum, GoverningChecks, UnavailableChecks
tutti_gli_esiti_locali = BridgeCheckSummary(Results=[pioli_sulle_azioni_di_fase.SectionResult, verifica_intermedi.SectionResult, verifica_agli_appoggi.SectionResult, pioli_g2.SectionResult, verifiche_intermedi_g2.SectionResult, verifiche_appoggi_g2.SectionResult])  # -> Label, Phase, Check, Ratio, Status, Units, Notes, MaximumFiniteRatio, UnavailableRatios, GoverningLabels
bridge_plot_preview_7 = BridgePlotPreview(SVG=flatten(bridge_intermediate_stiffener_plot.SVG), Index=0, Width=600)

# ---- group: Bridge Support Stiffener Plot
value_list_16 = ValueList({"Inviluppo WR di tutte le verifiche": 0, "Appoggio · stabilità e pressoflessione II ordine": 1, "Appoggio · freccia fuori piano": 2, "Appoggio · rigidezza torsionale": 3, "Appoggio · piatti entro classe 3": 4, "Appoggio · ingombro tra piattabande": 5, "Appoggio · saldature verticali all’anima": 6, "Appoggio · saldature alle flange": 7, "Appoggio · gola minima": 8, "Appoggio · lunghezza efficace cordone": 9, "Appoggio · collegamenti": 10, "Appoggio · impronta trasversale sotto i piatti": 11, "Appoggio · impronta longitudinale": 12, "Appoggio · impronta entro l’estremità": 13, "Appoggio · contatto piatti/flangia": 14, "Terminale · due coppie bilaterali simmetriche": 15, "Terminale · area di ciascuna coppia": 16, "Terminale · distanza e > 0,1 hw": 17, "Terminale · e entro il pannello": 18, "Terminale · reazione e ancoraggio combinati": 19, "Seconda coppia terminale · stabilità e pressoflessione II ordine": 20, "Seconda coppia terminale · freccia fuori piano": 21, "Seconda coppia terminale · rigidezza torsionale": 22, "Seconda coppia terminale · piatti entro classe 3": 23, "Seconda coppia terminale · ingombro tra piattabande": 24, "Seconda coppia terminale · saldature verticali all’anima": 25, "Seconda coppia terminale · saldature alle flange": 26, "Seconda coppia terminale · gola minima": 27, "Seconda coppia terminale · lunghezza efficace cordone": 28, "Seconda coppia terminale · collegamenti": 29}, selected="Inviluppo WR di tutte le verifiche")
bridge_support_stiffener_plot = BridgeSupportStiffenerPlot(
    BridGHeModel=build_bridghe_model.Model,
    SuperElementBeam=composite_beam,
    Results=verifica_agli_appoggi.SectionResult,
    Check=value_list_16,
    ShowMinMaxCombo=True,
    GraphicTitle="Trave 1 - Irrigiditori agli appoggi WR",
    KeepRunning=True,
    Display=0,
    Stations=[0, 12, 24])  # -> SVG, File, Minimum, Maximum, GoverningChecks, UnavailableChecks

# ----
bridge_plot_preview_8 = BridgePlotPreview(SVG=flatten(bridge_intermediate_stiffener_plot_g2.SVG), Index=0, Width=600)
bridge_support_stiffener_plot_g2 = BridgeSupportStiffenerPlot(
    BridGHeModel=build_bridghe_model.Model,
    SuperElementBeam=misto_g2,
    Results=verifiche_appoggi_g2.SectionResult,
    Check=value_list_16,
    ShowMinMaxCombo=True,
    GraphicTitle="Trave 2 - Irrigiditori agli appoggi WR",
    KeepRunning=True,
    Display=0,
    Stations=[0, 12, 24])  # -> SVG, File, Minimum, Maximum, GoverningChecks, UnavailableChecks
riepilogo_controllo_governante_per_stazi = Panel(tutti_gli_esiti_locali.GoverningLabels)  # "Riepilogo — controllo governante per stazione"

# ---- group: Bridge Report
capitoli = ValueList({"Modello": 0, "Sezioni e materiali": 1, "Fasi e combinazioni": 2, "Verifiche": 3, "Casi governanti": 4, "Grafici": 5, "Tabulato completo": 6}, selected=["Fasi e combinazioni", "Grafici"])
report_completo_rev003 = BridgeReport(
    Results=[pioli_sulle_azioni_di_fase.SectionResult, verifica_intermedi.SectionResult, verifica_agli_appoggi.SectionResult, pioli_g2.SectionResult, verifiche_intermedi_g2.SectionResult, verifiche_appoggi_g2.SectionResult],
    Template="Template_BridGHe.docx",
    File="Report_REV003.docx",
    Topics=capitoli,
    Model=build_bridghe_model.Model,
    Title="Verifiche del flusso ponte misto REV003",
    Project="Esempio 99 | 12 + 12 m | combinazioni DEMO | RH70% cemento N 7-365 giorni",
    Author="BridGHe",
    Revision="REV003",
    SVG=[bridge_force_plot.SVG, bridge_stress_plot.SVG, bridge_stud_plot.SVG, bridge_intermediate_stiffener_plot.SVG, bridge_support_stiffener_plot.SVG, bridge_force_plot_g2.SVG, bridge_stress_plot_g2.SVG, bridge_stud_plot_g2.SVG, bridge_intermediate_stiffener_plot_g2.SVG, bridge_support_stiffener_plot_g2.SVG],
    Overwrite=False)  # -> File, Summary, Warnings, ReportID

# ----
bridge_plot_preview_9 = BridgePlotPreview(SVG=flatten(bridge_support_stiffener_plot.SVG), Index=0, Width=600)
bridge_plot_preview_10 = BridgePlotPreview(SVG=flatten(bridge_support_stiffener_plot_g2.SVG), Index=0, Width=600)

# ==== cluster Cluster
radius = ClusterInput()
A = ClusterInput()
B = ClusterInput()
circle = Circle(Plane=PlaneXY(0, 0, 0), Radius=expr("x/2", radius))
division = Division(A=A, B=B)
multiplication = Multiplication(A=division, B=0.1)
area = Area(Geometry=circle)  # -> Area, Centroid
multiplication_2 = Multiplication(A=area.Area, B=multiplication)
result = ClusterOutput(multiplication_2)
