# Grasshopper definition flusso-acciaio-misto_REV001.ghx (Grasshopper 1.0.8)
# plug-ins: BridGHe

# Preview Model Fase 2
# Preview Model Fase 3
# Preview Model Fase 0
# Preview Model Fase 1
display_settings = DisplaySettings(
    Enabled=True,
    Geometry=True,
    Sections=True,
    Shaded=True,
    Reinforcement=True,
    Loads=False,
    Supports=True,
    Releases=True,
    OtherAttributes=True,
    Axes=False,
    Labels=False,
    SymbolScale=1,
    LoadScale=1,
    Transparency=0.65)
display_settings_2 = DisplaySettings(
    Enabled=True,
    Geometry=True,
    Sections=True,
    Shaded=True,
    Reinforcement=True,
    Loads=False,
    Supports=True,
    Releases=True,
    OtherAttributes=True,
    Axes=False,
    Labels=False,
    SymbolScale=1,
    LoadScale=1,
    Transparency=0.65)
display_settings_3 = DisplaySettings(
    Enabled=True,
    Geometry=True,
    Sections=True,
    Shaded=True,
    Reinforcement=True,
    Loads=False,
    Supports=True,
    Releases=True,
    OtherAttributes=True,
    Axes=False,
    Labels=False,
    SymbolScale=1,
    LoadScale=1,
    Transparency=0.65)
display_settings_4 = DisplaySettings(
    Enabled=True,
    Geometry=True,
    Sections=True,
    Shaded=True,
    Reinforcement=True,
    Loads=False,
    Supports=True,
    Releases=True,
    OtherAttributes=True,
    Axes=False,
    Labels=False,
    SymbolScale=1,
    LoadScale=1,
    Transparency=0.65)
# COME USARE: 01 | Un unico modello acciaio assemblato.
# 02 | Tre copie con Beam Override: n infinito, n0, n ritiro.
# 03 | Quattro analisi Straus incrementali; non sommare modelli già cumulativi.
# 04 | Merge ordinato e matching esplicito dei casi; poi assegnazione della sezione mista e verifica.
# Aprire: risultati Straus già memorizzati. Premere Run su Build BridGHe Model, poi Run su Super Element Check.
# Se si modificano input: CALCOLA = true, poi false, poi i due Run.
# Esempio didattico di trave continua a due campate 12 + 12 m, N-mm-MPa. Non è un progetto completo di ponte.
display_settings_5 = DisplaySettings(
    Enabled=True,
    Geometry=True,
    Sections=True,
    Shaded=True,
    Reinforcement=True,
    Loads=False,
    Supports=True,
    Releases=True,
    OtherAttributes=True,
    Axes=False,
    Labels=False,
    SymbolScale=1,
    LoadScale=1,
    Transparency=0.65)
bridghe_panel = BridGHePanel()
# ORIGINE E FASE: REV002: matching delle fasi corretto.
# 4-RITIRO_FEM va nell'ultimo input, Phase n ritiro FEM Load Cases.
# 5-RITIRO_PRIMARIO va in Phase Ninf strain Load Cases.
# Il prefisso e quello dell'ordine dei cinque modelli nel merge.
# Combo_REV002.xlsx e invariato: manca la colonna 4-RITIRO_FEM, quindi le sue sollecitazioni non entrano nelle combinazioni attuali. Definirne i coefficienti per includerle.
# Risultati Straus memorizzati: CALCOLA=false; premere Run su Build BridGHe Model e Super Element Check.
modello_1 = Panel("G1_GETTO | solo acciaio")
altezza_soletta = Slider(300, range=0..1000)
modello_2 = Panel("G2_PERMANENTI | n infinito = 18")
# Input Curve della travata
# Nodo Iniziale
panel = Panel("Travi Principali::Trave 1")
# Model Check
# Nodo Finale
pioli_2x22_passo200 = BridgeStuds(
    Enabled=True,
    CountPerRow=2,
    Diameter=22,
    Height=180,
    LongitudinalPitch=200,
    TransversePitch=150,
    Fu=450,
    GammaV=1.25,
    HeadDiameter=35,
    HeadThickness=10,
    RequiredCover=40,
    RepeatedActionDetail=True)
# PERCORSO E LIMITI: Tension Check contiene BridgeStressResult, non soltanto tensioni. Conservare l'albero {indice beam;indice stazione}; gli item sono le combinazioni.
# Details di Layout è una lista di definizioni geometriche: non collegarla indiscriminatamente a Results. Suddividere le zone e associare il dettaglio alla sua stazione.
# Calculation=1 LinearHistory NON è supportato da Detail Check. L'opzione Ultimate non genera coefficienti né altera le azioni FEM.
# Per appoggi reali usare la reazione compressiva corretta, con unità e associazione di combinazione coerenti. R=900 in questo file è dimostrativa.
modello_3 = Panel("Q_TRAFFICO | n0 = 7")
# Nodo Intermedi
intermedi_200x20_pannelli2m = BridgeIntermediateStiffener(
    Enabled=True,
    Layout=0,
    Width=200,
    Thickness=20,
    RightWidth=200,
    RightThickness=20,
    LeftPanel=2000,
    RightPanel=4000,
    EqualPanels=True,
    LengthFactor=1,
    ExternalCompressionKN=0,
    LoadX=0,
    CheckWelds=True,
    WeldThroat=6)
appoggio_r900kn_assegnato = BridgeSupportStiffener(
    Enabled=True,
    Layout=0,
    Width=200,
    Thickness=25,
    RightWidth=250,
    RightThickness=25,
    Location=0,
    LeftPanel=2000,
    RightPanel=2000,
    ReactionKN=900,
    EndDistance=250,
    LoadX=0,
    LoadZ=0,
    FootprintLength=400,
    FootprintWidth=600,
    LengthFactor=1,
    RigidEndPost=False,
    EndPostSpacing=300,
    CheckWelds=True,
    WeldThroat=10)
ultimate_solo_dimostrazione = BridgeAnalysisOptions(
    Standard=1,
    LimitState=0,
    Class4=True,
    TopFlangeBuckling=True,
    BottomFlangeBuckling=True,
    WebBuckling=True,
    CommonLoadY=0,
    GammaM0=1.05,
    GammaM1=1.1,
    GammaM2=1.25,
    GammaC=1.5,
    GammaS=1.15,
    AlphaCC=0.85,
    ShearEta=1.2)
# LIMITI DELL'ESEMPIO: Analisi lineari incrementali di una trave nel piano, soletta non fessurata.
# Tre fasi di carico + ritiro FEM + autotensione.
# Le fasi usano le stesse geometrie, ID, assi e vincoli.
# J è quello dell'acciaio, come nel componente precedente.
# Coefficienti unitari didattici: nessuna combinazione normativa è implicita.
# Tau b resta NaN; non usare questo output come verifica della connessione.
# Restano da definire SLU, fatica, pioli, instabilità, soletta trasversale e azioni orizzontali.
modello_4 = Panel("RITIRO_FEM | n ritiro = 12")

# ---- group: Concrete
concrete = Concrete(Name="C32/40", Grade=6)

# ---- group: Steel
steel = Steel(Name="S355", Grade=2)

# ---- group: Load Case
panel_2 = Panel("G1_GETTO")
load_case = LoadCase(Name=panel_2, GravityNSM=False)

# ---- group: Cluster
larghezza_soletta_collaborante = Slider(2500, range=0..10000)
diametro_armatura_superiore = Slider(16, range=10..32)
passo_armatura_superiore_cm = Slider(10, range=10..25)
cluster = Cluster(radius=diametro_armatura_superiore, A=larghezza_soletta_collaborante, B=passo_armatura_superiore_cm)

diametro_armatura_inferiore = Slider(16, range=10..32)
passo_armatura_inferiore_cm = Slider(10, range=10..25)
cluster_2 = Cluster(radius=diametro_armatura_inferiore, A=larghezza_soletta_collaborante, B=passo_armatura_inferiore_cm)

# ---- group: List Length
panel_3 = Panel("""G2_SOLETTA
G2_FINITURE
G2_BARRIERE""")
list_length = ListLength(List=panel_3)

# ---- group: I Section
larghezza_piattabanda_superiore = Slider(600, range=0..1000)
larghezza_piattabanda_inferiore = Slider(800, range=0..1000)
altezza = Slider(1800, range=0..10000)
spessore_piattabanda_superiore = Slider(30, range=0..100)
spessore_piattabanda_inferiore = Slider(40, range=0..100)
spessore_anima = Slider(15, range=0..100)
i_section = ISection(
    BottomFlangeWidth=larghezza_piattabanda_superiore,
    TopFlangeWidth=larghezza_piattabanda_inferiore,
    Height=altezza,
    BottomFlangeThickness=spessore_piattabanda_superiore,
    TopFlangeThickness=spessore_piattabanda_inferiore,
    WebThickness=spessore_anima,
    Radius=0)

# ----
list_item = ListItem(List=panel_3, Index=0, Wrap=True)  # -> Item, Item1, Item2
group = Group(panel)

# ---- group: Node
appoggio_fisso = Point(Point(0, 0, 0))
node = Node(Point=appoggio_fisso)

appoggi_scorrevoli = Point([Point(12000, 0, 0), Point(24000, 0, 0)])
node_2 = Node(Point=appoggi_scorrevoli)

nodi_intermedi_vincoli_fuori_piano = Point([Point(2000, 0, 0), Point(4000, 0, 0), Point(6000, 0, 0), Point(8000, 0, 0), Point(10000, 0, 0), Point(14000, 0, 0), Point(16000, 0, 0), Point(18000, 0, 0), Point(20000, 0, 0), Point(22000, 0, 0)])
node_3 = Node(Point=nodi_intermedi_vincoli_fuori_piano)

# ---- group: Load Case
load_case_2 = LoadCase(Name="Q_TRAFFICO", GravityNSM=False)

load_case_3 = LoadCase(Name="WIND_1", GravityNSM=False)

load_case_4 = LoadCase(Name="RITIRO_FEM_LIN", GravityNSM=False)

load_case_5 = LoadCase(Name="RITIRO_FEM_GRAD", GravityNSM=False)

# ----
list_length_2 = ListLength(List=panel_3)

# ---- group: Load Case
panel_4 = Panel("RITIRO_PRIMARIO")
load_case_6 = LoadCase(Name=panel_4, GravityNSM=False)

# ---- group: Bridge Shrinkage Action
bridge_shrinkage_action = BridgeShrinkageAction(ActionID="RIT_S", StrainIncrement="-0.000035", PrimaryOnly=invert(False), Response=0)

# ---- group: Concrete Slab Section
copriferro_superiore_mm = Slider(50, range=0..100)
copriferro_inferiore_mm = Slider(50, range=0..100)
concrete_slab_section = ConcreteSlabSection(
    Height=250,
    Width=3000,
    RebarArea=cluster,
    TopConcreteCover=copriferro_superiore_mm,
    BottomRebarArea=cluster_2,
    BottomConcreteCover=copriferro_inferiore_mm)

# ----
duplicate_data = DuplicateData(Data=1, Number=list_length, Order=True)
load_case_7 = LoadCase(Name=list_item.Item, GravityNSM=False)
load_case_8 = LoadCase(Name=list_item.Item1, GravityNSM=False)
load_case_9 = LoadCase(Name=list_item.Item2, GravityNSM=False)

# ---- group: Restraints
tx_ty_tz = TxTyTz([True, True, True])
rx_ry_rz = RxRyRz([True, False, True])
restraints = Restraints(Node=node, Transational=tx_ty_tz, Rotation=rx_ry_rz)

tx_ty_tz_2 = TxTyTz([False, True, True])
rx_ry_rz_2 = RxRyRz([True, False, True])
restraints_2 = Restraints(Node=node_2, Transational=tx_ty_tz_2, Rotation=rx_ry_rz_2)

tx_ty_tz_3 = TxTyTz([False, True, False])
rx_ry_rz_3 = RxRyRz([True, False, True])
restraints_3 = Restraints(Node=node_3, Transational=tx_ty_tz_3, Rotation=rx_ry_rz_3)

# ----
merge = Merge(Data1=load_case_4, Data2=load_case_5)
duplicate_data_2 = DuplicateData(Data=1, Number=list_length_2, Order=True)

# ---- group: Bridge Phase
value_list = ValueList({"Only Steel": 0, "Composite": 1, "Concrete Excluded": 2}, selected="Composite")
bridge_phase = BridgePhase(Number="22", Name=panel_4, SectionState=value_list, Actions=bridge_shrinkage_action)

# ---- group: Composite Beam Property
b450 = B450(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)
n0 = Panel("7")
n_infinito = Panel("18")
n_ritiro = Panel("12")
composite_beam_property = CompositeBeamProperty(
    Name="H1600 + soletta 3000x250",
    ConcreteSlabSection=concrete_slab_section,
    SteelSection=i_section,
    ConcreteMaterial=concrete,
    SteelMaterial=steel,
    ReinforcementMaterial=b450,
    N0=n0,
    N=n_infinito,
    ConsiderConcrete_2=True,
    ConsiderRebars=n_ritiro)  # -> CompositeSection, OnlySteelProperty, N0BeamSection, NBeamSection, NRitiroBeamSection

# ----
merge_2 = Merge(Data1=load_case_7, Data2=load_case_8, Data3=load_case_9)

# ---- group: Load Combination
load_combination = LoadCombination(Name="RITIRO_FEM", LoadCases=merge, Coefficients=duplicate_data_2)

# ---- group: Composite Shrinkage Actions
epsilon_ritiro = Panel("-0.00020000000000000001")
composite_shrinkage_actions = CompositeShrinkageActions(CompositeProperty=composite_beam_property.CompositeSection, ConcreteStrain=epsilon_ritiro)  # -> StrausPreStrain, Axis2ThermalGradient, FreeCentroidStrain, FreeCurvature

# ---- group: Load Combination
panel_5 = Panel("G2_PERMANENTI")
load_combination_2 = LoadCombination(Name=panel_5, LoadCases=merge_2, Coefficients=duplicate_data)

# ---- group: Beam
_12_elementi_2_campate_da_12000_mm = Curve([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])
beam = Beam(Line=_12_elementi_2_campate_da_12000_mm, Property=composite_beam_property.OnlySteelProperty, Groups=group, Angle=0)

# ---- group: Beam Output Stations
beam_output_stations = BeamOutputStations(Beam=beam, OutputStations=Slider(4, range=0..10))

# ---- group: Super Element
super_element = SuperElement(Element=beam_output_stations, Name="SE_Travata 1")

# ----
list_length_3 = ListLength(List=super_element)
series = Series(Start=1, Step=1, Count=list_length_3)
element_id = ElementId(Element=super_element, ID=series)
merge_3 = Merge(Data1=flatten(element_id), Data2=flatten(restraints), Data3=flatten(restraints_2), Data4=flatten(restraints_3))
build_model = BuildModel(Elements=merge_3, Name="Base - solo acciaio", Units=2)
decompose_model = DecomposeModel(Model=build_model)  # -> Nodes, Beams, Plates
bridge_model_audit = BridgeModelAudit(Model=build_model, Tolerance=1e-06)  # -> NoInputErrors, Severity, Code, Element, Description, Model
beam_filter = BeamFilter(Beams=decompose_model.Beams, Units=2, Groups=group)  # -> Beams, Others
panel_6 = Panel(bridge_model_audit.Description)

# ---- group: Beam Distributed Load
beam_distributed_load = BeamDistributedLoad(Beam=beam_filter.Beams, LoadCase=load_case, Type=0, Direction=1, PA=Slider(-10, range=-10..10), A=0, B=0)

# ----
beam_override = BeamOverride(Beam=beam_filter.Beams, Property=composite_beam_property.NBeamSection)  # -> simplify(graft(Beam))
beam_override_2 = BeamOverride(Beam=beam_filter.Beams, Property=composite_beam_property.N0BeamSection)
beam_override_3 = BeamOverride(Beam=beam_filter.Beams, Property=composite_beam_property.NRitiroBeamSection)
build_model_2 = BuildModel(Elements=flatten([beam_distributed_load, decompose_model.Nodes]), Name="G1_GETTO", Units=2)

# ---- group: Beam Distributed Load
beam_distributed_load_2 = BeamDistributedLoad(Beam=simplify(beam_override), LoadCase=load_case_7, Type=0, Direction=1, PA=Slider(-10, range=-10..10), A=0, B=0)

beam_distributed_load_3 = BeamDistributedLoad(Beam=beam_override_2, LoadCase=load_case_2, Type=0, Direction=1, PA=Slider(-10, range=-10..10), A=0, B=0)

# ----
composite_beam_strain = CompositeBeamStrain(Beam=beam_override_3, LoadCase=load_case_6, Strain=epsilon_ritiro)
beam_preload = BeamPreLoad(Beam=beam_override_3, LoadCase=load_case_4, Type=1, Value=composite_shrinkage_actions.StrausPreStrain)
preview_bridghe_model = PreviewBridGHeModel(ModelElements=build_model_2, Settings=display_settings)

# ---- group: Straus R3 Analysis
calcola_4_modelli_straus = BooleanToggle(True)
panel_7 = Panel("C:\Users\g.pacini\Documents\Repository\BridGHe\example\99-Ponte completo GPC\Straus File\F1.st7")
straus_r3_analysis = StrausR3Analysis(
    Model=build_model_2,
    Solver=0,
    AnalysisResults=panel_2,
    OutputPath=panel_7,
    KeepRunning=calcola_4_modelli_straus,
    ElementGuids="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")

# ---- group: Beam Distributed Load
beam_distributed_load_4 = BeamDistributedLoad(Beam=beam_distributed_load_2, LoadCase=load_case_8, Type=0, Direction=1, PA=Slider(-2, range=-10..10), A=0, B=0)

beam_distributed_load_5 = BeamDistributedLoad(Beam=beam_distributed_load_3, LoadCase=load_case_3, Type=0, Direction=0, PA=Slider(-5, range=-10..10), A=0, B=0)

# ----
beam_gradient_load = BeamGradientLoad(Beam=beam_preload, LoadCase=load_case_5, Axis1=0, Axis2=composite_shrinkage_actions.Axis2ThermalGradient)

# ---- group: Super Element Filter
super_element_filter = SuperElementFilter(BridGHeModel=straus_r3_analysis, SuperElement="SE_Travata 1")

# ---- group: Beam Distributed Load
beam_distributed_load_6 = BeamDistributedLoad(Beam=beam_distributed_load_4, LoadCase=load_case_9, Type=0, Direction=1, PA=Slider(-1, range=-10..10), A=0, B=0)

# ----
build_model_3 = BuildModel(Elements=flatten([beam_distributed_load_5, decompose_model.Nodes]), Name="Q_TRAFFICO", Units=2)
build_model_4 = BuildModel(
    Elements=flatten([beam_gradient_load, decompose_model.Nodes]),
    Name="RITIRO_FEM",
    Units=2,
    LoadCombinations=load_combination)
preview_bridghe_model_2 = PreviewBridGHeModel(ModelElements=build_model_3, Settings=display_settings_3)
preview_bridghe_model_3 = PreviewBridGHeModel(ModelElements=build_model_4, Settings=display_settings_4)
build_model_5 = BuildModel(Elements=flatten(super_element_filter), Units=2)
build_model_6 = BuildModel(
    Elements=flatten([beam_distributed_load_6, decompose_model.Nodes]),
    Name="G2_PERMANENTI",
    Units=2,
    LoadCombinations=load_combination_2)

# ---- group: Straus R3 Analysis
results = ValueList({"Dead", "Q_TRAFFICO", "WIND_1"}, selected=["Q_TRAFFICO", "WIND_1"])
straus_r3_analysis_2 = StrausR3Analysis(
    Model=build_model_3,
    Solver=0,
    AnalysisResults=results,
    OutputPath="C:\Users\g.pacini\Documents\Repository\BridGHe\example\19-flusso-acciaio-misto\archivio\REV001\calcoli\Q_TRAFFICO.st7",
    KeepRunning=calcola_4_modelli_straus,
    ElementGuids="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")

# ---- group: Bridge Analysis Cases
value_list_2 = ValueList({"RITIRO_FEM"}, selected="RITIRO_FEM")
straus_casi_richiesti_dalle_azioni = BridgeAnalysisCases(Model=build_model_4, RequiredCases=flatten(value_list_2), Solver=0)  # -> AnalysisResults, Information

# ----
preview_bridghe_model_4 = PreviewBridGHeModel(ModelElements=build_model_6, Settings=display_settings_2)

# ---- group: Bridge Action
value_list_3 = ValueList({"G1_GETTO"}, selected="G1_GETTO")
value_list_4 = ValueList({"Only Steel": 0, "Long Term": 1, "Short Term": 2}, selected="Only Steel")
bridge_action = BridgeAction(ActionID="G1", Model=build_model_5, Case=value_list_3, Behavior=value_list_4)

# ---- group: Straus R3 Analysis
panel_8 = Panel("C:\Users\g.pacini\Documents\Repository\BridGHe\example\99-Ponte completo GPC\Straus File\F2.st7")
straus_r3_analysis_3 = StrausR3Analysis(
    Model=build_model_6,
    Solver=0,
    AnalysisResults=panel_5,
    OutputPath=panel_8,
    KeepRunning=calcola_4_modelli_straus,
    ElementGuids="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")

# ---- group: Super Element Filter
super_element_filter_2 = SuperElementFilter(BridGHeModel=straus_r3_analysis_2, SuperElement="SE_Travata 1")

# ---- group: Straus R3 Analysis
results_2 = ValueList({"Dead", "RITIRO_FEM_GRAD", "RITIRO_FEM_LIN", "RITIRO_FEM"}, selected="RITIRO_FEM")
straus_r3_analysis_4 = StrausR3Analysis(
    Model=build_model_4,
    Solver=0,
    AnalysisResults=flatten([results_2, straus_casi_richiesti_dalle_azioni.AnalysisResults]),
    OutputPath="C:\Users\g.pacini\Documents\Repository\BridGHe\example\19-flusso-acciaio-misto\archivio\REV002\calcoli\RITIRO_FEM.st7",
    KeepRunning=calcola_4_modelli_straus,
    ElementGuids="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")

# ---- group: Bridge Phase
value_list_5 = ValueList({"Only Steel": 0, "Composite": 1, "Concrete Excluded": 2}, selected="Only Steel")
bridge_phase_2 = BridgePhase(Number="10", Name=value_list_3, SectionState=value_list_5, Actions=bridge_action)

# ----
merge_4 = Merge(
    Data1=flatten(straus_r3_analysis),
    Data2=flatten(straus_r3_analysis_3),
    Data3=flatten(straus_r3_analysis_2),
    Data4=flatten(straus_r3_analysis_4))

# ---- group: Super Element Filter
super_element_filter_3 = SuperElementFilter(BridGHeModel=straus_r3_analysis_3, SuperElement="SE_Travata 1")

# ----
build_model_7 = BuildModel(Elements=flatten(super_element_filter_2), Units=2)

# ---- group: Bridge Action
value_list_6 = ValueList({"Only Steel": 0, "Long Term": 1, "Short Term": 2}, selected="Long Term")
bridge_action_2 = BridgeAction(ActionID="RIT_P", Model=straus_r3_analysis_4, Case=value_list_2, Behavior=value_list_6)

# ----
build_model_8 = BuildModel(Elements=flatten(super_element_filter_3), Units=2)

# ---- group: Bridge Action
value_list_7 = ValueList({"Q_TRAFFICO", "WIND_1"}, selected="Q_TRAFFICO")
value_list_8 = ValueList({"Only Steel": 0, "Long Term": 1, "Short Term": 2}, selected="Short Term")
bridge_action_3 = BridgeAction(ActionID="Q", Model=build_model_7, Case=value_list_7, Behavior=value_list_8)

# ---- group: Bridge Phase
value_list_9 = ValueList({"Only Steel": 0, "Composite": 1, "Concrete Excluded": 2}, selected="Composite")
bridge_phase_3 = BridgePhase(Number="21", Name=value_list_2, SectionState=value_list_9, Actions=bridge_action_2)

# ---- group: Bridge Action
value_list_10 = ValueList({"G2_PERMANENTI"}, selected="G2_PERMANENTI")
value_list_11 = ValueList({"Only Steel": 0, "Long Term": 1, "Short Term": 2}, selected="Long Term")
bridge_action_4 = BridgeAction(ActionID="G2", Model=build_model_8, Case=value_list_10, Behavior=value_list_11)

# ---- group: Bridge Phase
value_list_12 = ValueList({"Only Steel": 0, "Composite": 1, "Concrete Excluded": 2}, selected="Composite")
bridge_phase_4 = BridgePhase(Number="30", Name=value_list_7, SectionState=value_list_12, Actions=bridge_action_3)

value_list_13 = ValueList({"Only Steel": 0, "Composite": 1, "Concrete Excluded": 2}, selected="Composite")
bridge_phase_5 = BridgePhase(Number="20", Name=value_list_10, SectionState=value_list_13, Actions=bridge_action_4)

# ----
merge_5 = Merge(
    Data1=flatten(bridge_phase_2),
    Data2=flatten(bridge_phase_5),
    Data3=flatten(bridge_phase_3),
    Data4=flatten(bridge_phase),
    Data5=flatten(bridge_phase_4))
bridge_phase_table = BridgePhaseTable(Phases=merge_5)  # -> Phases, Number, Name, Day, SectionState, ActionID, Behavior, Source, Case, Strain

# ---- group: Bridge Combination Excel
path = Panel("C:\Users\g.pacini\Documents\Repository\BridGHe\example\99-Ponte completo GPC\Combo_REV002.xlsx")
bridge_combination_excel = BridgeCombinationExcel(Models=merge_4, Phases=merge_5, File=path, Mode=0, Rows=20, Overwrite=invert(False))  # -> File, Table, ActionIDs, Summary

# ----
bridge_combination_excel_2 = BridgeCombinationExcel(Models=merge_4, Phases=merge_5, File=path, Mode=1, Rows=20, Overwrite=False)  # -> File, Table, ActionIDs, Summary
build_bridghe_model = BuildBridGHeModel(
    Models=merge_4,
    Phases=merge_5,
    Combinations=bridge_combination_excel_2.Table,
    Calculation=0,
    AdditionalPhaseMembers=False)  # -> Model, Phases, Diagnostics
panel_9 = Panel(bridge_phase_table.SectionState)

# ---- group: Super Element Filter
super_element_2 = ValueList({"SE_Travata 1"}, selected="SE_Travata 1")
super_element_filter_4 = SuperElementFilter(BridGHeModel=build_bridghe_model.Model, SuperElement=super_element_2)

# ----
panel_10 = Panel(build_bridghe_model.Diagnostics)
composite_beam = CompositeBeam(Beam=super_element_filter_4, SectionStart=composite_beam_property.CompositeSection)
preview_bridghe_model_5 = PreviewBridGHeModel(ModelElements=composite_beam, Settings=display_settings_5)
super_element_check = SuperElementCheck(
    BridGHeModel=build_bridghe_model.Model,
    SuperElementBeam=composite_beam,
    WebLocalInstability=False,
    TopFlangeLocalInstability=False,
    BottomFlangeLocalInstability=False)  # -> TensionCheck, TauB, TensionForces

# ---- group: Bridge Stress Plot
panel_11 = Panel("C:\Temp\diagramma.png")
bridge_stress_plot = BridgeStressPlot(
    BridGHeModel=build_bridghe_model.Model,
    SuperElementBeam=composite_beam,
    Results=super_element_check.TensionCheck,
    Quantity=3,
    ShowMinMaxCombo=True,
    FilePath=panel_11,
    KeepRunning=False)  # -> SVG, File, Minimum, Maximum

# ----
bridge_force_plot = BridgeForcePlot(
    BridGHeModel=build_bridghe_model.Model,
    SuperElementBeam=composite_beam,
    Results=super_element_check.TensionForces,
    Quantity=4,
    ShowMinMaxCombo=True,
    FilePath=panel_11,
    KeepRunning=False)  # -> SVG, File, Minimum, Maximum
_3_dettagli_sulle_stesse_azioni = BridgeDetailCheck(
    SectionResult=super_element_check.TensionCheck,
    Studs=pioli_2x22_passo200,
    IntermediateStiffener=intermedi_200x20_pannelli2m,
    SupportStiffener=appoggio_r900kn_assegnato,
    Options=ultimate_solo_dimostrazione)  # -> SectionResult, Check, Demand, Resistance, Units, Ratio, Status, Warnings
composite_section_linear_tension_results = CompositeSectionLinearTensionResults(LinearTensionResults=super_element_check.TensionCheck)  # -> Point1_ConcreteEpsilon, Point1_ConcreteSigma, Point2_RebarSigma, Point3_RebarSigma, Point4_ConcreteSigma, Point5_SteelSigma, Point6_SteelSigma, Point6_SteelTau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
bridge_plot_preview = BridgePlotPreview(SVG=flatten(bridge_stress_plot.SVG), Index=0, Width=600)
bridge_plot_preview_2 = BridgePlotPreview(SVG=flatten(bridge_force_plot.SVG), Index=0, Width=600)
rapporti_stesso_ordine = Panel(_3_dettagli_sulle_stesse_azioni.Ratio)
controlli = Panel(_3_dettagli_sulle_stesse_azioni.Check)
pioli_per_stazione_e_combo = BridgeStudResults(SectionResult=_3_dettagli_sulle_stesse_azioni.SectionResult)  # -> ConnectionFlow, ForcePerStud, ResistancePerStud, ResistancePerLength, ForceRatio, Phase, PhaseFlow, Warnings
sigma_cls_superiore_mpa = Panel(composite_section_linear_tension_results.Point1_ConcreteSigma)

# ---- group: Bridge Result Labels
value_list_14 = ValueList({"Completa": 0, "Trave e stazione": 1, "Combinazione": 2, "Fase": 3}, selected="Completa")
bridge_result_labels = BridgeResultLabels(Results=_3_dettagli_sulle_stesse_azioni.SectionResult, Format=value_list_14)

# ----
sigma_armatura_superiore_mpa = Panel(composite_section_linear_tension_results.Point2_RebarSigma)
sigma_armatura_inferiore_mpa = Panel(composite_section_linear_tension_results.Point3_RebarSigma)
sigma_acciaio_inferiore_mpa = Panel(composite_section_linear_tension_results.Point8_SteelSigma)
flusso_n_mm = Panel(pioli_per_stazione_e_combo.ConnectionFlow)
forza_per_piolo_kn = Panel(pioli_per_stazione_e_combo.ForcePerStud)
rapporto_piolo = Panel(pioli_per_stazione_e_combo.ForceRatio)
tutti_gli_esiti_locali = BridgeCheckSummary(Results=_3_dettagli_sulle_stesse_azioni.SectionResult, Labels=bridge_result_labels)  # -> Label, Phase, Check, Ratio, Status, Units, Notes, MaximumFiniteRatio, UnavailableRatios, GoverningLabels
riepilogo_controllo_governante_per_stazi = Panel(tutti_gli_esiti_locali.GoverningLabels)  # "Riepilogo — controllo governante per stazione"

# ==== cluster Cluster
radius = ClusterInput()
A = ClusterInput()
B = ClusterInput()
circle = Circle(Plane=PlaneXY(0, 0, 0), Radius=expr("x/2", radius))
division = Division(A=A, B=B)
multiplication = Multiplication(A=division, B=0.1)
area = Area(Geometry=circle)  # -> Area, Centroid
multiplication_2 = Multiplication(A=area.Area, B=multiplication)
result = ClusterOutput(multiplication_2)
