# Grasshopper definition 19-flusso-acciaio-misto.ghx (Grasshopper 1.0.8)
# plug-ins: BridGHe

# ---- group: SEZIONE UNICA - proprietà di fase
# COME USARE: 01 | Un unico modello acciaio assemblato.
# 02 | Tre copie con Beam Override: n infinito, n0, n ritiro.
# 03 | Quattro analisi Straus incrementali; non sommare modelli già cumulativi.
# 04 | Merge ordinato e matching esplicito dei casi; poi assegnazione della sezione mista e verifica.
# Aprire: risultati Straus già memorizzati. Premere Run su Build BridGHe Model, poi Run su Super Element Check.
# Se si modificano input: CALCOLA = true, poi false, poi i due Run.
# Esempio didattico di trave continua a due campate 12 + 12 m, N-mm-MPa. Non è un progetto completo di ponte.
s355_210000_mpa = S355210000MPa(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)
c30 = C30(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)
b450 = B450(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)
I = ISection(
    BottomFlangeWidth=600,
    TopFlangeWidth=600,
    Height=1600,
    BottomFlangeThickness=40,
    TopFlangeThickness=40,
    WebThickness=16,
    Radius=0)
slab = ConcreteSlabSection(Height=250, Width=3000, RebarArea=3000, TopConcreteCover=45, BottomRebarArea=2000, BottomConcreteCover=50)
n0 = Panel("7")
n_infinito = Panel("18")
n_ritiro = Panel("12")
epsilon_ritiro = Panel("-0.00020000000000000001")
cs = CompositeBeamProperty(
    Name="H1600 + soletta 3000x250",
    ConcreteSlabSection=slab,
    SteelSection=I,
    ConcreteMaterial=c30,
    SteelMaterial=s355_210000_mpa,
    ReinforcementMaterial=b450,
    N0=n0,
    N=n_infinito,
    ConsiderConcrete=True,
    ConsiderRebars=True,
    NRitiro=n_ritiro)  # -> CompositeSection, OnlySteelProperty, N0BeamSection, NBeamSection, NRitiroBeamSection
shrinkage = CompositeShrinkageActions(CompositeProperty=cs.CompositeSection, ConcreteStrain=epsilon_ritiro)  # -> StrausPreStrain, Axis2ThermalGradient, FreeCentroidStrain, FreeCurvature

# ----
_12_elementi_2_campate_da_12000_mm = Curve([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])
appoggio_fisso = Point(Point(0, 0, 0))
appoggi_scorrevoli = Point([Point(12000, 0, 0), Point(24000, 0, 0)])
nodi_intermedi_vincoli_fuori_piano = Point([Point(2000, 0, 0), Point(4000, 0, 0), Point(6000, 0, 0), Point(8000, 0, 0), Point(10000, 0, 0), Point(14000, 0, 0), Point(16000, 0, 0), Point(18000, 0, 0), Point(20000, 0, 0), Point(22000, 0, 0)])
N = Node(Point=appoggio_fisso)
N_2 = Node(Point=appoggi_scorrevoli)
N_3 = Node(Point=nodi_intermedi_vincoli_fuori_piano)
bm = Beam(Line=_12_elementi_2_campate_da_12000_mm, Property=cs.OnlySteelProperty, Angle=0)
tx_ty_tz = TxTyTz([True, True, True])
rx_ry_rz = RxRyRz([True, False, True])
tx_ty_tz_2 = TxTyTz([False, True, True])
rx_ry_rz_2 = RxRyRz([True, False, True])
tx_ty_tz_3 = TxTyTz([False, True, False])
rx_ry_rz_3 = RxRyRz([True, False, True])
se = SuperElement(Element=bm, Name="MAIN")
id_stabili = Panel("""1
2
3
4
5
6
7
8
9
10
11
12""")
nr = Restraints(Node=N, Transational=tx_ty_tz, Rotation=rx_ry_rz)
nr_2 = Restraints(Node=N_2, Transational=tx_ty_tz_2, Rotation=rx_ry_rz_2)
nr_3 = Restraints(Node=N_3, Transational=tx_ty_tz_3, Rotation=rx_ry_rz_3)
ei = ElementId(Element=se, ID=id_stabili)
bm_2 = BuildModel(Elements=[ei, nr, nr_2, nr_3], Name="Base - solo acciaio", Units=2)
dm = DecomposeModel(Model=bm_2)  # -> Nodes, Beams, Plates
calcola_4_modelli_straus = BooleanToggle(False)

# ---- group: FASE 1
modello_1 = Panel("G1_GETTO | solo acciaio")
g1_getto = G1_GETTO(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)
bdl = BeamDistributedLoad(Beam=dm.Beams, LoadCase=g1_getto, Type=0, Direction=1, PA=-8, A=0, B=0)
bm_3 = BuildModel(Elements=[bdl, dm.Nodes], Name="G1_GETTO", Units=2)
sa = StrausR3Analysis(
    Model=bm_3,
    Solver=0,
    AnalysisResults="G1_GETTO",
    OutputPath="C:\Users\g.pacini\Documents\Repository\BridGHe\artifacts\bridge-workflow\G1_GETTO.st7",
    KeepRunning=calcola_4_modelli_straus,
    ElementGuids="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")
sef = SuperElementFilter(BridGHeModel=sa, SuperElement="MAIN")
# ORIGINE E FASE: Il prefisso 1,2,3,4 viene dall'ordine dei modelli nell'input.
# La fase è assegnata dal matching con i nomi qui sotto.
# Se si cambia l'ordine, aggiornare prefissi e combinazioni.
# RITIRO_FEM: sollecitazioni da Straus; RITIRO_PRIMARIO: autotensione gPC, una sola volta.
bm_4 = BuildModel(Elements=sef, Name="Risultati 1", Units=2)

# ---- group: FASE 2
modello_2 = Panel("G2_PERMANENTI | n infinito = 18")
g2_permanenti = G2_PERMANENTI(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)
bo = BeamOverride(Beam=dm.Beams, Property=cs.NBeamSection)
bdl_2 = BeamDistributedLoad(Beam=bo, LoadCase=g2_permanenti, Type=0, Direction=1, PA=-4, A=0, B=0)
bm_5 = BuildModel(Elements=[bdl_2, dm.Nodes], Name="G2_PERMANENTI", Units=2)
sa_2 = StrausR3Analysis(
    Model=bm_5,
    Solver=0,
    AnalysisResults="G2_PERMANENTI",
    OutputPath="C:\Users\g.pacini\Documents\Repository\BridGHe\artifacts\bridge-workflow\G2_PERMANENTI.st7",
    KeepRunning=calcola_4_modelli_straus,
    ElementGuids="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")
sef_2 = SuperElementFilter(BridGHeModel=sa_2, SuperElement="MAIN")
bm_6 = BuildModel(Elements=sef_2, Name="Risultati 2", Units=2)

# ---- group: FASE 3
modello_3 = Panel("Q_TRAFFICO | n0 = 7")
q_traffico = Q_TRAFFICO(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)
bo_2 = BeamOverride(Beam=dm.Beams, Property=cs.N0BeamSection)
bdl_3 = BeamDistributedLoad(Beam=bo_2, LoadCase=q_traffico, Type=0, Direction=1, PA=-12, A=0, B=0)
bm_7 = BuildModel(Elements=[bdl_3, dm.Nodes], Name="Q_TRAFFICO", Units=2)
sa_3 = StrausR3Analysis(
    Model=bm_7,
    Solver=0,
    AnalysisResults="Q_TRAFFICO",
    OutputPath="C:\Users\g.pacini\Documents\Repository\BridGHe\artifacts\bridge-workflow\Q_TRAFFICO.st7",
    KeepRunning=calcola_4_modelli_straus,
    ElementGuids="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")
sef_3 = SuperElementFilter(BridGHeModel=sa_3, SuperElement="MAIN")
bm_8 = BuildModel(Elements=sef_3, Name="Risultati 3", Units=2)

# ----
ritiro_primario = RITIRO_PRIMARIO(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)

# ---- group: FASE 4
modello_4 = Panel("RITIRO_FEM | n ritiro = 12")
ritiro_fem = RITIRO_FEM(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)
bo_3 = BeamOverride(Beam=dm.Beams, Property=cs.NRitiroBeamSection)
bpl = BeamPreLoad(Beam=bo_3, LoadCase=ritiro_fem, Type=1, Value=shrinkage.StrausPreStrain)
bgl = BeamGradientLoad(Beam=bpl, LoadCase=ritiro_fem, Axis1=0, Axis2=shrinkage.Axis2ThermalGradient)
bm_9 = BuildModel(Elements=[bgl, dm.Nodes], Name="RITIRO_FEM", Units=2)
sa_4 = StrausR3Analysis(
    Model=bm_9,
    Solver=0,
    AnalysisResults="RITIRO_FEM",
    OutputPath="C:\Users\g.pacini\Documents\Repository\BridGHe\artifacts\bridge-workflow\RITIRO_FEM.st7",
    KeepRunning=calcola_4_modelli_straus,
    ElementGuids="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")
sef_4 = SuperElementFilter(BridGHeModel=sa_4, SuperElement="MAIN")
cbs = CompositeBeamStrain(Beam=sef_4, LoadCase=ritiro_primario, Strain=epsilon_ritiro)
bm_10 = BuildModel(Elements=cbs, Name="Risultati 4", Units=2)

# ----
header_coefficienti_sls_unitari = Data(Tree({0}: ["", "1-G1_GETTO", "2-G2_PERMANENTI", "3-Q_TRAFFICO", "4-RITIRO_FEM", "4-RITIRO_PRIMARIO"], {1}: ["SLS_DEMO", "1", "1", "1", "1", "1"]))
matching_fase_2 = Panel("1-G1_GETTO")
matching_fase_3 = Panel("2-G2_PERMANENTI")
matching_fase_4 = Panel("3-Q_TRAFFICO")
matching_fase_5 = Panel("4-RITIRO_PRIMARIO")
matching_fase_7 = Panel("4-RITIRO_FEM")
bmcm = BuildBridGHeModel(
    BridGHeModels=[bm_4, bm_6, bm_8, bm_10],
    LoadCombinations=header_coefficienti_sls_unitari,
    PhaseInfLoadCases=matching_fase_2,
    PhaseNinfLoadCases=matching_fase_3,
    PhaseN0LoadCases=matching_fase_4,
    PhaseNinfStrainLoadCases=matching_fase_5,
    PhaseNRitiroFEMLoadCases=matching_fase_7)
sef_5 = SuperElementFilter(BridGHeModel=bmcm, SuperElement="MAIN")
display = DisplaySettings(
    Enabled=True,
    Geometry=True,
    Sections=True,
    Shaded=True,
    Reinforcement=True,
    Loads=False,
    Supports=True,
    Releases=True,
    OtherAttributes=True,
    Axes=False,
    Labels=False,
    SymbolScale=1,
    LoadScale=1,
    Transparency=0.65)
# LIMITI DELL'ESEMPIO: Analisi lineari incrementali di una trave nel piano, soletta non fessurata.
# Tre fasi di carico + ritiro FEM + autotensione.
# Le fasi usano le stesse geometrie, ID, assi e vincoli.
# J è quello dell'acciaio, come nel componente precedente.
# Coefficienti unitari didattici: nessuna combinazione normativa è implicita.
# Tau b resta NaN; non usare questo output come verifica della connessione.
# Restano da definire SLU, fatica, pioli, instabilità, soletta trasversale e azioni orizzontali.
cb = CompositeBeam(Beam=sef_5, SectionStart=cs.CompositeSection)
preview = PreviewBridGHeModel(ModelElements=cb, Settings=display)
sec = SuperElementCheck(
    BridGHeModel=bmcm,
    SuperElementBeam=cb,
    WebLocalInstability=False,
    TopFlangeLocalInstability=False,
    BottomFlangeLocalInstability=False)  # -> TensionCheck, TauB, TensionForces
bridghe = BridGHePanel()
csltr = CompositeSectionLinearTensionResults(LinearTensionResults=sec.TensionCheck)  # -> Point1_ConcreteEpsilon, Point1_ConcreteSigma, Point2_RebarSigma, Point3_RebarSigma, Point4_ConcreteSigma, Point5_SteelSigma, Point6_SteelSigma, Point6_SteelTau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
sigma_cls_superiore_mpa = Panel(csltr.Point1_ConcreteSigma)
sigma_armatura_superiore_mpa = Panel(csltr.Point2_RebarSigma)
sigma_armatura_inferiore_mpa = Panel(csltr.Point3_RebarSigma)
sigma_acciaio_inferiore_mpa = Panel(csltr.Point8_SteelSigma)
