# Grasshopper definition 11-ponte-graticcio.ghx (Grasshopper 1.0.8)
# plug-ins: BridGHe

appoggi_mm = Point([Point(0, -3750, 0), Point(30000, -3750, 0), Point(0, -1250, 0), Point(30000, -1250, 0), Point(0, 1250, 0), Point(30000, 1250, 0), Point(0, 3750, 0), Point(30000, 3750, 0)])
tx_ty_tz = TxTyTz([True, True, True])
rx_ry_rz = RxRyRz([False, False, True])
g1_getto = G1_GETTO(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)
forze_g1_getto_n = Vector([Vector(0, 0, -27534.325), Vector(0, 0, -27534.325), Vector(0, 0, -27534.325), Vector(0, 0, -27534.325), Vector(0, 0, -27534.325), Vector(0, 0, -27534.325), Vector(0, 0, -27534.325), Vector(0, 0, -27534.325)])
nodi_interni_mm = Point([Point(2500, -3750, 0), Point(5000, -3750, 0), Point(7500, -3750, 0), Point(10000, -3750, 0), Point(12500, -3750, 0), Point(15000, -3750, 0)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])
tx_ty_tz_2 = TxTyTz([True, True, False])
rx_ry_rz_2 = RxRyRz([False, False, True])
g1_getto_2 = G1_GETTO(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)
forze_g1_getto_n_2 = Vector([Vector(0, 0, -55068.65), Vector(0, 0, -55068.65), Vector(0, 0, -55068.65), Vector(0, 0, -55068.65), Vector(0, 0, -55068.65), Vector(0, 0, -55068.65)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])
assi_longitudinali_mm = Curve([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])
proprieta_a_i11_i22_j_n_mm = ProprietaAI11I22JNMm([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])
assi_trasversali_mm = Curve([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])
proprieta_a_i11_i22_j_n_mm_2 = ProprietaAI11I22JNMm([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])
appoggi_mm_2 = Point([Point(0, -3750, 0), Point(30000, -3750, 0), Point(0, -1250, 0), Point(30000, -1250, 0), Point(0, 1250, 0), Point(30000, 1250, 0), Point(0, 3750, 0), Point(30000, 3750, 0)])
tx_ty_tz_3 = TxTyTz([True, True, True])
rx_ry_rz_3 = RxRyRz([False, False, True])
g2_permanenti = G2_PERMANENTI(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)
forze_g2_permanenti_n = Vector([Vector(0, 0, -7812.5), Vector(0, 0, -7812.5), Vector(0, 0, -7812.5), Vector(0, 0, -7812.5), Vector(0, 0, -7812.5), Vector(0, 0, -7812.5), Vector(0, 0, -7812.5), Vector(0, 0, -7812.5)])
nodi_interni_mm_2 = Point([Point(2500, -3750, 0), Point(5000, -3750, 0), Point(7500, -3750, 0), Point(10000, -3750, 0), Point(12500, -3750, 0), Point(15000, -3750, 0)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])
tx_ty_tz_4 = TxTyTz([True, True, False])
rx_ry_rz_4 = RxRyRz([False, False, True])
g2_permanenti_2 = G2_PERMANENTI(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)
forze_g2_permanenti_n_2 = Vector([Vector(0, 0, -15625), Vector(0, 0, -15625), Vector(0, 0, -15625), Vector(0, 0, -15625), Vector(0, 0, -15625), Vector(0, 0, -15625)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])
assi_longitudinali_mm_2 = Curve([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])
proprieta_a_i11_i22_j_n_mm_3 = ProprietaAI11I22JNMm([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])
assi_trasversali_mm_2 = Curve([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])
proprieta_a_i11_i22_j_n_mm_4 = ProprietaAI11I22JNMm([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])
appoggi_mm_3 = Point([Point(0, -3750, 0), Point(30000, -3750, 0), Point(0, -1250, 0), Point(30000, -1250, 0), Point(0, 1250, 0), Point(30000, 1250, 0), Point(0, 3750, 0), Point(30000, 3750, 0)])
tx_ty_tz_5 = TxTyTz([True, True, True])
rx_ry_rz_5 = RxRyRz([False, False, True])
q_udl = Q_UDL(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)
forze_q_udl_n = Vector([Vector(0, 0, -7812.5), Vector(0, 0, -7812.5), Vector(0, 0, -7812.5), Vector(0, 0, -7812.5), Vector(0, 0, -7812.5), Vector(0, 0, -7812.5), Vector(0, 0, -7812.5), Vector(0, 0, -7812.5)])
q_ecc = Q_ECC(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)
forze_q_ecc_n = Vector([Vector(0, 0, 0), Vector(0, 0, 0), Vector(0, 0, 0), Vector(0, 0, 0), Vector(0, 0, 0), Vector(0, 0, 0), Vector(0, 0, 0), Vector(0, 0, 0)])
q_mirror = Q_MIRROR(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)
forze_q_mirror_n = Vector([Vector(0, 0, 0), Vector(0, 0, 0), Vector(0, 0, 0), Vector(0, 0, 0), Vector(0, 0, 0), Vector(0, 0, 0), Vector(0, 0, 0), Vector(0, 0, 0)])
nodi_interni_mm_3 = Point([Point(2500, -3750, 0), Point(5000, -3750, 0), Point(7500, -3750, 0), Point(10000, -3750, 0), Point(12500, -3750, 0), Point(15000, -3750, 0)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])
tx_ty_tz_6 = TxTyTz([True, True, False])
rx_ry_rz_6 = RxRyRz([False, False, True])
q_udl_2 = Q_UDL(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)
forze_q_udl_n_2 = Vector([Vector(0, 0, -15625), Vector(0, 0, -15625), Vector(0, 0, -15625), Vector(0, 0, -15625), Vector(0, 0, -15625), Vector(0, 0, -15625)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])
q_ecc_2 = Q_ECC(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)
forze_q_ecc_n_2 = Vector([Vector(0, 0, 0), Vector(0, 0, 0), Vector(0, 0, 0), Vector(0, 0, 0), Vector(0, 0, 0), Vector(0, 0, 0), Vector(0, 0, 0), Vector(0, 0, 0), Vector(0, 0, 0), Vector(0, 0, 0)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])
q_mirror_2 = Q_MIRROR(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)
forze_q_mirror_n_2 = Vector([Vector(0, 0, 0), Vector(0, 0, 0), Vector(0, 0, 0), Vector(0, 0, 0), Vector(0, 0, -45000), Vector(0, 0, -60000), Vector(0, 0, -45000), Vector(0, 0, 0), Vector(0, 0, 0), Vector(0, 0, 0)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])
assi_longitudinali_mm_3 = Curve([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])
proprieta_a_i11_i22_j_n_mm_5 = ProprietaAI11I22JNMm([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])
assi_trasversali_mm_3 = Curve([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])
proprieta_a_i11_i22_j_n_mm_6 = ProprietaAI11I22JNMm([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])
percorso_veicolo_2_assi = PercorsoVeicolo2Assi("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")
ritiro_inf = RITIRO_INF(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)
def_ist = DEF_IST(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)
sls_simmetrico_matrice_combinazioni = Data(Tree({0}: ["", "1-G1_GETTO", "2-G2_PERMANENTI", "3-Q_UDL", "2-RITIRO_INF", "3-DEF_IST"], {1}: ["SLS_SIMMETRICO", "1", "1", "1", "1", "1"]))
sezione_mista_h1600_soletta_250 = SezioneMistaH1600Soletta250(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)
# LEGGERE PRIMA: PONTE MISTO A GRATICCIO | N-mm-MPa
# Tre modelli elastici: acciaio / misto lungo termine / misto istantaneo.
# Geometria, carichi e proprieta sono visibili e modificabili nei parametri.
# Modificare parameters.json e rigenerare per cambiare coerentemente tutte le dipendenze.
# Run inizialmente false. File .st7 in TEMP, percorsi modificabili.
# BridgeChecks: usare solo la combinazione simmetrica; il traffico eccentrico richiede anche torsione.
# Soletta e diaframmi sono travi equivalenti: non e una verifica normativa completa.
# FASE 1: Ponte graticcio / G1_GETTO
# Nodi 52 | Beam 69
N = Node(Point=appoggi_mm)
nr = Restraints(Node=N, Transational=tx_ty_tz, Rotation=rx_ry_rz)
nl = NodeLoad(Node=nr, LoadCase=g1_getto, Force=forze_g1_getto_n)
N_2 = Node(Point=nodi_interni_mm)
nr_2 = Restraints(Node=N_2, Transational=tx_ty_tz_2, Rotation=rx_ry_rz_2)
nl_2 = NodeLoad(Node=nr_2, LoadCase=g1_getto_2, Force=forze_g1_getto_n_2)
bm = Beam(Line=assi_longitudinali_mm, Property=proprieta_a_i11_i22_j_n_mm, Angle=0)
bm_2 = Beam(Line=assi_trasversali_mm, Property=proprieta_a_i11_i22_j_n_mm_2, Angle=0)
N_3 = Node(Point=appoggi_mm_2)
nr_3 = Restraints(Node=N_3, Transational=tx_ty_tz_3, Rotation=rx_ry_rz_3)
nl_3 = NodeLoad(Node=nr_3, LoadCase=g2_permanenti, Force=forze_g2_permanenti_n)
N_4 = Node(Point=nodi_interni_mm_2)
nr_4 = Restraints(Node=N_4, Transational=tx_ty_tz_4, Rotation=rx_ry_rz_4)
nl_4 = NodeLoad(Node=nr_4, LoadCase=g2_permanenti_2, Force=forze_g2_permanenti_n_2)
bm_3 = Beam(Line=assi_longitudinali_mm_2, Property=proprieta_a_i11_i22_j_n_mm_3, Angle=0)
bm_4 = Beam(Line=assi_trasversali_mm_2, Property=proprieta_a_i11_i22_j_n_mm_4, Angle=0)
N_5 = Node(Point=appoggi_mm_3)
nr_5 = Restraints(Node=N_5, Transational=tx_ty_tz_5, Rotation=rx_ry_rz_5)
nl_5 = NodeLoad(Node=nr_5, LoadCase=q_udl, Force=forze_q_udl_n)
nl_6 = NodeLoad(Node=nl_5, LoadCase=q_ecc, Force=forze_q_ecc_n)
nl_7 = NodeLoad(Node=nl_6, LoadCase=q_mirror, Force=forze_q_mirror_n)
N_6 = Node(Point=nodi_interni_mm_3)
nr_6 = Restraints(Node=N_6, Transational=tx_ty_tz_6, Rotation=rx_ry_rz_6)
nl_8 = NodeLoad(Node=nr_6, LoadCase=q_udl_2, Force=forze_q_udl_n_2)
nl_9 = NodeLoad(Node=nl_8, LoadCase=q_ecc_2, Force=forze_q_ecc_n_2)
nl_10 = NodeLoad(Node=nl_9, LoadCase=q_mirror_2, Force=forze_q_mirror_n_2)
bm_5 = Beam(Line=assi_longitudinali_mm_3, Property=proprieta_a_i11_i22_j_n_mm_5, Angle=0)
bm_6 = Beam(Line=assi_trasversali_mm_3, Property=proprieta_a_i11_i22_j_n_mm_6, Angle=0)
# FASE 2: Ponte graticcio / G2_PERMANENTI
# Nodi 52 | Beam 87
super_elementi = Panel("""G1
G1
G1
G1
G1
G1
G1
G1
G1
G1
G1
G1
G2
G2
G2
G2
G2
G2
G2
G2
G2
G2
G2
G2
G3
G3
G3
G3
G3
G3
G3
G3
G3
G3
G3
G3
G4
G4
G4
G4
G4
G4
G4
G4
G4
G4
G4
G4""")
se = SuperElement(Element=bm, Name=super_elementi)
# FASE 3: Ponte graticcio / Q_UDL
# Nodi 52 | Beam 87
super_elementi_2 = Panel("""G1
G1
G1
G1
G1
G1
G1
G1
G1
G1
G1
G1
G2
G2
G2
G2
G2
G2
G2
G2
G2
G2
G2
G2
G3
G3
G3
G3
G3
G3
G3
G3
G3
G3
G3
G3
G4
G4
G4
G4
G4
G4
G4
G4
G4
G4
G4
G4""")
se_2 = SuperElement(Element=bm_3, Name=super_elementi_2)
super_elementi_3 = Panel("""G1
G1
G1
G1
G1
G1
G1
G1
G1
G1
G1
G1
G2
G2
G2
G2
G2
G2
G2
G2
G2
G2
G2
G2
G3
G3
G3
G3
G3
G3
G3
G3
G3
G3
G3
G3
G4
G4
G4
G4
G4
G4
G4
G4
G4
G4
G4
G4""")
se_3 = SuperElement(Element=bm_5, Name=super_elementi_3)
id_straus = Panel("""1
2
3
4
5
6
7
8
9
10
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""")
ei = ElementId(Element=se, ID=id_straus)
id_straus_2 = Panel("""49
50
51
55
56
57
61
62
63
67
68
69
73
74
75
79
80
81
85
86
87""")
ei_2 = ElementId(Element=bm_2, ID=id_straus_2)
bm_7 = BuildModel(Elements=[nl, nl_2, ei, ei_2], Name="Ponte graticcio / G1_GETTO", Units=2)
id_straus_3 = Panel("""1
2
3
4
5
6
7
8
9
10
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""")
ei_3 = ElementId(Element=se_2, ID=id_straus_3)
id_straus_4 = Panel("""49
50
51
52
53
54
55
56
57
58
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""")
ei_4 = ElementId(Element=bm_4, ID=id_straus_4)
bm_8 = BuildModel(Elements=[nl_3, nl_4, ei_3, ei_4], Name="Ponte graticcio / G2_PERMANENTI", Units=2)
id_straus_5 = Panel("""1
2
3
4
5
6
7
8
9
10
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""")
ei_5 = ElementId(Element=se_3, ID=id_straus_5)
id_straus_6 = Panel("""49
50
51
52
53
54
55
56
57
58
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""")
ei_6 = ElementId(Element=bm_6, ID=id_straus_6)
bm_9 = BuildModel(Elements=[nl_7, nl_10, ei_5, ei_6], Name="Ponte graticcio / Q_UDL", Units=2)
mlmodel = AttachMovingPaths(Model=bm_9, Paths=percorso_veicolo_2_assi)
casi_da_leggere = Panel("G1_GETTO")
file_straus = Panel("C:\Users\g.pacini\AppData\Local\Temp\BridGHe-ponte-fase-0.st7")
sa = StrausR3Analysis(Model=bm_7, Solver=0, AnalysisResults=casi_da_leggere, OutputPath=file_straus, KeepRunning=False, ElementGuids="[]")
dm = DecomposeModel(Model=sa)  # -> Nodes, Beams, Plates
nr_7 = NodeResults(Node=dm.Nodes)  # -> LoadCasesD, StepsD, Displacements, Rotations, LoadCasesF, StepsF, Forces, Moments
br = BeamResults(Beam=dm.Beams)  # -> LoadCases, Stations, Steps, ShearForces, BendingMoments, AxialForces, Torques
casi_da_leggere_2 = Panel("G2_PERMANENTI")
file_straus_2 = Panel("C:\Users\g.pacini\AppData\Local\Temp\BridGHe-ponte-fase-1.st7")
sa_2 = StrausR3Analysis(Model=bm_8, Solver=0, AnalysisResults=casi_da_leggere_2, OutputPath=file_straus_2, KeepRunning=False, ElementGuids="[]")
dm_2 = DecomposeModel(Model=sa_2)  # -> Nodes, Beams, Plates
nr_8 = NodeResults(Node=dm_2.Nodes)  # -> LoadCasesD, StepsD, Displacements, Rotations, LoadCasesF, StepsF, Forces, Moments
br_2 = BeamResults(Beam=dm_2.Beams)  # -> LoadCases, Stations, Steps, ShearForces, BendingMoments, AxialForces, Torques
casi_da_leggere_3 = Panel("""Q_UDL
Q_ECC
Q_MIRROR""")
file_straus_3 = Panel("C:\Users\g.pacini\AppData\Local\Temp\BridGHe-ponte-fase-2.st7")
sa_3 = StrausR3Analysis(Model=bm_9, Solver=0, AnalysisResults=casi_da_leggere_3, OutputPath=file_straus_3, KeepRunning=False, ElementGuids="[]")
dm_3 = DecomposeModel(Model=sa_3)  # -> Nodes, Beams, Plates
nr_9 = NodeResults(Node=dm_3.Nodes)  # -> LoadCasesD, StepsD, Displacements, Rotations, LoadCasesF, StepsF, Forces, Moments
br_3 = BeamResults(Beam=dm_3.Beams)  # -> LoadCases, Stations, Steps, ShearForces, BendingMoments, AxialForces, Torques
file_mobile = Panel("C:\Users\g.pacini\AppData\Local\Temp\BridGHe-ponte-mobile.st7")
mlanalysis = MovingStaticAnalysis(Model=mlmodel, OutputPath=file_mobile, Run=False)  # -> Model, Cases
posizioni_mobili_generate = Panel(mlanalysis.Cases)
spostamenti_mm = Panel(nr_7.Displacements)
bm1_bm2_n_mm = Panel(br.BendingMoments)
torsione_n_mm_conservata = Panel(br.Torques)
spostamenti_mm_2 = Panel(nr_8.Displacements)
bm1_bm2_n_mm_2 = Panel(br_2.BendingMoments)
torsione_n_mm_conservata_2 = Panel(br_2.Torques)
spostamenti_mm_3 = Panel(nr_9.Displacements)
bm1_bm2_n_mm_3 = Panel(br_3.BendingMoments)
torsione_n_mm_conservata_3 = Panel(br_3.Torques)
# BRIDGE_CHECKS - CAMPO COPERTO: Combinazione SLS simmetrica, coefficienti 1.0.
# Sezione lorda, soletta non fessurata, armature escluse.
# 5 contributi: G1, G2, Q_UDL, ritiro lungo termine, deformazione istantanea.
# Per il traffico eccentrico conservare T e usare un verificatore dedicato.
# Dopo le analisi: Run Build BridGHe Model, poi Run Super Element Check.
# Non alimentare questo merge con i risultati TOTALI delle fasi di getto.
travi_principali = Panel("""G1
G2
G3
G4""")
sef = SuperElementFilter(BridGHeModel=sa, SuperElement=travi_principali)
bm_10 = BuildModel(Elements=flatten(sef), Name="Risultati longitudinali fase 0", Units=2)
travi_principali_2 = Panel("""G1
G2
G3
G4""")
sef_2 = SuperElementFilter(BridGHeModel=sa_2, SuperElement=travi_principali_2)
cbs = CompositeBeamStrain(Beam=sef_2, LoadCase=ritiro_inf, Strain=-0.0001)
bm_11 = BuildModel(Elements=flatten(cbs), Name="Risultati longitudinali fase 1", Units=2)
travi_principali_3 = Panel("""G1
G2
G3
G4""")
sef_3 = SuperElementFilter(BridGHeModel=sa_3, SuperElement=travi_principali_3)
cbs_2 = CompositeBeamStrain(Beam=sef_3, LoadCase=def_ist, Strain=-5e-05)
bm_12 = BuildModel(Elements=flatten(cbs_2), Name="Risultati longitudinali fase 2", Units=2)
assegnazione_fase_2 = Panel("1-G1_GETTO")
assegnazione_fase_3 = Panel("2-G2_PERMANENTI")
assegnazione_fase_4 = Panel("""3-Q_UDL
3-Q_ECC
3-Q_MIRROR""")
assegnazione_fase_5 = Panel("2-RITIRO_INF")
assegnazione_fase_6 = Panel("3-DEF_IST")
bmcm = BuildBridGHeModel(
    BridGHeModels=[bm_10, bm_11, bm_12],
    LoadCombinations=sls_simmetrico_matrice_combinazioni,
    PhaseInfLoadCases=assegnazione_fase_2,
    PhaseNinfLoadCases=assegnazione_fase_3,
    PhaseN0LoadCases=assegnazione_fase_4,
    PhaseNinfStrainLoadCases=assegnazione_fase_5,
    PhaseN0StrainLoadCases=assegnazione_fase_6)
travi_verificate = Panel("""G1
G2
G3
G4""")
sef_4 = SuperElementFilter(BridGHeModel=bmcm, SuperElement=travi_verificate)
cb = CompositeBeam(Beam=sef_4, SectionStart=sezione_mista_h1600_soletta_250, SectionEnd=sezione_mista_h1600_soletta_250)
sec = SuperElementCheck(
    BridGHeModel=bmcm,
    SuperElementBeam=flatten(cb),
    WebLocalInstability=False,
    TopFlangeLocalInstability=False,
    BottomFlangeLocalInstability=False,
    EffectiveEpsilon=False)  # -> TensionCheck, TauB, TensionForces
csltr = CompositeSectionLinearTensionResults(LinearTensionResults=sec.TensionCheck)  # -> Point1_ConcreteEpsilon, Point1_ConcreteSigma, Point2_RebarSigma, Point3_RebarSigma, Point4_ConcreteSigma, Point5_SteelSigma, Point6_SteelSigma, Point6_SteelTau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
sigma_cls_superiore_mpa = Panel(csltr.Point1_ConcreteSigma)
# ESITI DA NON CONFONDERE: TauB non disponibile: output NaN.
# Tensioni elastiche non equivalgono a verifica SLU.
# Instabilita, connessione, fatica, soletta locale, appoggi e azioni orizzontali: da verificare a parte.
# La deformazione istantanea imposta e un incremento separato; non ripetere lo stesso ritiro.
sigma_acciaio_inferiore_mpa = Panel(csltr.Point8_SteelSigma)
