# Grasshopper definition 18-spina-curva-2campate.ghx (Grasshopper 1.0.8)
# plug-ins: BridGHe

nodi_mm = Point(Point(0, -4000, 0))
tx_ty_tz = TxTyTz([True, True, True])
rx_ry_rz = RxRyRz([False, False, False])
g1_getto = G1_GETTO(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)
forze_nodali_n = Vector(Vector(0, 0, -4282.225493))
nodi_mm_2 = Point([Point(269.097011, -3999.708011, 0), Point(538.1927547, -3998.832045, 0), Point(807.2859638, -3997.372107, 0), Point(1076.375371, -3995.328203, 0), Point(1345.459709, -3992.700342, 0), Point(1614.53771, -3989.488538, 0)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])
tx_ty_tz_2 = TxTyTz([False, False, False])
rx_ry_rz_2 = RxRyRz([False, False, False])
g1_getto_2 = G1_GETTO(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)
forze_nodali_n_2 = Vector([Vector(0, 0, -8564.450986), Vector(0, 0, -8564.450986), Vector(0, 0, -8564.450986), Vector(0, 0, -8564.450986), Vector(0, 0, -8564.450986), Vector(0, 0, -8564.450986)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])
nodi_mm_3 = Point([Point(25646.86538, -1318.74668, 0), Point(0, 0, 0), Point(24819.54715, 2594.761278, 0), Point(48565.74763, 10266.83201, 0), Point(0, 4000, 0), Point(23992.22891, 6508.269235, 0), Point(46946.88937, 13924.60428, 0)])
tx_ty_tz_3 = TxTyTz([False, False, True])
rx_ry_rz_3 = RxRyRz([False, False, False])
g1_getto_3 = G1_GETTO(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)
forze_nodali_n_3 = Vector([Vector(0, 0, -8564.450986), Vector(0, 0, -4611.000554), Vector(0, 0, -9222.001107), Vector(0, 0, -4611.000554), Vector(0, 0, -4005.952881), Vector(0, 0, -8011.905761), Vector(0, 0, -4005.952881)])
nodi_mm_4 = Point(Point(50184.60588, 6609.059742, 0))
tx_ty_tz_4 = TxTyTz([False, True, True])
rx_ry_rz_4 = RxRyRz([False, False, False])
g1_getto_4 = G1_GETTO(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)
forze_nodali_n_4 = Vector(Vector(0, 0, -4282.225493))
assi_longitudinali = Curve([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])
proprieta_equivalenti_a_i11_i22_j = ProprietaEquivalentiAI11I22J(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)
assi_longitudinali_2 = Curve([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])
proprieta_equivalenti_a_i11_i22_j_2 = ProprietaEquivalentiAI11I22J(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)
assi_trasversali = Curve([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])
proprieta_equivalenti_a_i11_i22_j_3 = ProprietaEquivalentiAI11I22J([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])
nodi_mm_5 = Point(Point(0, -4000, 0))
tx_ty_tz_5 = TxTyTz([True, True, True])
rx_ry_rz_5 = RxRyRz([False, False, False])
g2_permanenti = G2_PERMANENTI(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)
forze_nodali_n_5 = Vector(Vector(0, 0, -1345.485847))
nodi_mm_6 = Point([Point(269.097011, -3999.708011, 0), Point(538.1927547, -3998.832045, 0), Point(807.2859638, -3997.372107, 0), Point(1076.375371, -3995.328203, 0), Point(1345.459709, -3992.700342, 0), Point(1614.53771, -3989.488538, 0)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])
tx_ty_tz_6 = TxTyTz([False, False, False])
rx_ry_rz_6 = RxRyRz([False, False, False])
g2_permanenti_2 = G2_PERMANENTI(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)
forze_nodali_n_6 = Vector([Vector(0, 0, -2690.971694), Vector(0, 0, -2690.971694), Vector(0, 0, -2690.971694), Vector(0, 0, -2690.971694), Vector(0, 0, -2690.971694), Vector(0, 0, -2690.971694)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])
nodi_mm_7 = Point([Point(25646.86538, -1318.74668, 0), Point(0, 0, 0), Point(24819.54715, 2594.761278, 0), Point(48565.74763, 10266.83201, 0), Point(0, 4000, 0), Point(23992.22891, 6508.269235, 0), Point(46946.88937, 13924.60428, 0)])
tx_ty_tz_7 = TxTyTz([False, False, True])
rx_ry_rz_7 = RxRyRz([False, False, False])
g2_permanenti_3 = G2_PERMANENTI(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)
forze_nodali_n_7 = Vector([Vector(0, 0, -2690.971694), Vector(0, 0, -1302.083078), Vector(0, 0, -2604.166156), Vector(0, 0, -1302.083078), Vector(0, 0, -1258.680309), Vector(0, 0, -2517.360617), Vector(0, 0, -1258.680309)])
nodi_mm_8 = Point(Point(50184.60588, 6609.059742, 0))
tx_ty_tz_8 = TxTyTz([False, True, True])
rx_ry_rz_8 = RxRyRz([False, False, False])
g2_permanenti_4 = G2_PERMANENTI(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)
forze_nodali_n_8 = Vector(Vector(0, 0, -1345.485847))
assi_longitudinali_3 = Curve([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])
proprieta_equivalenti_a_i11_i22_j_4 = ProprietaEquivalentiAI11I22J(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)
assi_longitudinali_4 = Curve([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])
proprieta_equivalenti_a_i11_i22_j_5 = ProprietaEquivalentiAI11I22J(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)
assi_trasversali_2 = Curve([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])
proprieta_equivalenti_a_i11_i22_j_6 = ProprietaEquivalentiAI11I22J([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])
nodi_mm_9 = Point(Point(0, -4000, 0))
tx_ty_tz_9 = TxTyTz([True, True, True])
rx_ry_rz_9 = RxRyRz([False, False, False])
q_traffico = Q_TRAFFICO(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)
forze_nodali_n_9 = Vector(Vector(0, 0, -1345.485847))
nodi_mm_10 = Point([Point(269.097011, -3999.708011, 0), Point(538.1927547, -3998.832045, 0), Point(807.2859638, -3997.372107, 0), Point(1076.375371, -3995.328203, 0), Point(1345.459709, -3992.700342, 0), Point(1614.53771, -3989.488538, 0)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])
tx_ty_tz_10 = TxTyTz([False, False, False])
rx_ry_rz_10 = RxRyRz([False, False, False])
q_traffico_2 = Q_TRAFFICO(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)
forze_nodali_n_10 = Vector([Vector(0, 0, -2690.971694), Vector(0, 0, -2690.971694), Vector(0, 0, -2690.971694), Vector(0, 0, -2690.971694), Vector(0, 0, -2690.971694), Vector(0, 0, -2690.971694)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])
nodi_mm_11 = Point([Point(25646.86538, -1318.74668, 0), Point(0, 0, 0), Point(24819.54715, 2594.761278, 0), Point(48565.74763, 10266.83201, 0), Point(0, 4000, 0), Point(23992.22891, 6508.269235, 0), Point(46946.88937, 13924.60428, 0)])
tx_ty_tz_11 = TxTyTz([False, False, True])
rx_ry_rz_11 = RxRyRz([False, False, False])
q_traffico_3 = Q_TRAFFICO(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)
forze_nodali_n_11 = Vector([Vector(0, 0, -2690.971694), Vector(0, 0, -1302.083078), Vector(0, 0, -2604.166156), Vector(0, 0, -1302.083078), Vector(0, 0, -1258.680309), Vector(0, 0, -2517.360617), Vector(0, 0, -1258.680309)])
nodi_mm_12 = Point(Point(50184.60588, 6609.059742, 0))
tx_ty_tz_12 = TxTyTz([False, True, True])
rx_ry_rz_12 = RxRyRz([False, False, False])
q_traffico_4 = Q_TRAFFICO(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)
forze_nodali_n_12 = Vector(Vector(0, 0, -1345.485847))
assi_longitudinali_5 = Curve([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])
proprieta_equivalenti_a_i11_i22_j_7 = ProprietaEquivalentiAI11I22J(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)
assi_longitudinali_6 = Curve([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])
proprieta_equivalenti_a_i11_i22_j_8 = ProprietaEquivalentiAI11I22J(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)
assi_trasversali_3 = Curve([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])
proprieta_equivalenti_a_i11_i22_j_9 = ProprietaEquivalentiAI11I22J([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])
nodi_mm_13 = Point(Point(0, -4000, 0))
tx_ty_tz_13 = TxTyTz([True, True, True])
rx_ry_rz_13 = RxRyRz([False, False, False])
ritiro = RITIRO(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)
forze_nodali_n_13 = Vector(Vector(0, 0, 0))
nodi_mm_14 = Point([Point(269.097011, -3999.708011, 0), Point(538.1927547, -3998.832045, 0), Point(807.2859638, -3997.372107, 0), Point(1076.375371, -3995.328203, 0), Point(1345.459709, -3992.700342, 0), Point(1614.53771, -3989.488538, 0)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])
tx_ty_tz_14 = TxTyTz([False, False, False])
rx_ry_rz_14 = RxRyRz([False, False, False])
ritiro_2 = RITIRO(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)
forze_nodali_n_14 = Vector([Vector(0, 0, 0), Vector(0, 0, 0), Vector(0, 0, 0), Vector(0, 0, 0), Vector(0, 0, 0), Vector(0, 0, 0)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])
nodi_mm_15 = Point([Point(25646.86538, -1318.74668, 0), Point(0, 0, 0), Point(24819.54715, 2594.761278, 0), Point(48565.74763, 10266.83201, 0), Point(0, 4000, 0), Point(23992.22891, 6508.269235, 0), Point(46946.88937, 13924.60428, 0)])
tx_ty_tz_15 = TxTyTz([False, False, True])
rx_ry_rz_15 = RxRyRz([False, False, False])
ritiro_3 = RITIRO(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)
forze_nodali_n_15 = Vector([Vector(0, 0, 0), Vector(0, 0, 0), Vector(0, 0, 0), Vector(0, 0, 0), Vector(0, 0, 0), Vector(0, 0, 0), Vector(0, 0, 0)])
nodi_mm_16 = Point(Point(50184.60588, 6609.059742, 0))
tx_ty_tz_16 = TxTyTz([False, True, True])
rx_ry_rz_16 = RxRyRz([False, False, False])
ritiro_4 = RITIRO(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)
forze_nodali_n_16 = Vector(Vector(0, 0, 0))
assi_longitudinali_7 = Curve([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])
proprieta_equivalenti_a_i11_i22_j_10 = ProprietaEquivalentiAI11I22J(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)
ritiro_nativo = RitiroNativo(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)
assi_longitudinali_8 = Curve([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])
proprieta_equivalenti_a_i11_i22_j_11 = ProprietaEquivalentiAI11I22J(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)
ritiro_nativo_2 = RitiroNativo(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)
assi_trasversali_4 = Curve([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])
proprieta_equivalenti_a_i11_i22_j_12 = ProprietaEquivalentiAI11I22J([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])
ritiro_primario = RITIRO_PRIMARIO(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)
combinazione_sls = Data(Tree({0}: ["", "1-G1_GETTO", "2-G2_PERMANENTI", "3-Q_TRAFFICO", "4-RITIRO", "4-RITIRO_PRIMARIO"], {1}: ["SLS_3F_RITIRO", "1", "1", "1", "1", "1"]))
h2000_soletta_250_b_4000 = H2000Soletta250B4000(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)
# LEGGERE: Spina centrale curva: 25 + 25 m / R 120 m | N-mm-MPa
# 3 FASI + RITIRO LONGITUDINALE: quattro analisi incrementali con le rispettive rigidezze.
# G1 acciaio/getto; G2 misto lungo termine; Q misto istantaneo; RITIRO misto lungo termine.
# Ritiro: pre-strain e gradiente per effetti globali + una sola autotensione di sezione.
# Geometrie e proprieta editabili. Per modifiche coerenti usare parameters.json e rigenerare.
# Attivare CALCOLA 4 MODELLI; poi Run Build BridGHe Model e Run Super Element Check.
# Per i ponti curvi il checker segnala la torsione non supportata: consultare tutti i risultati FEM.
# CONTRIBUTO 1: Spina centrale curva: 25 + 25 m / R 120 m / G1_GETTO
calcola_4_modelli = BooleanToggle(False)
N = Node(Point=nodi_mm)
nr = Restraints(Node=N, Transational=tx_ty_tz, Rotation=rx_ry_rz)
nl = NodeLoad(Node=nr, LoadCase=g1_getto, Force=forze_nodali_n)
N_2 = Node(Point=nodi_mm_2)
nr_2 = Restraints(Node=N_2, Transational=tx_ty_tz_2, Rotation=rx_ry_rz_2)
nl_2 = NodeLoad(Node=nr_2, LoadCase=g1_getto_2, Force=forze_nodali_n_2)
N_3 = Node(Point=nodi_mm_3)
nr_3 = Restraints(Node=N_3, Transational=tx_ty_tz_3, Rotation=rx_ry_rz_3)
nl_3 = NodeLoad(Node=nr_3, LoadCase=g1_getto_3, Force=forze_nodali_n_3)
N_4 = Node(Point=nodi_mm_4)
nr_4 = Restraints(Node=N_4, Transational=tx_ty_tz_4, Rotation=rx_ry_rz_4)
nl_4 = NodeLoad(Node=nr_4, LoadCase=g1_getto_4, Force=forze_nodali_n_4)
bm = Beam(Line=assi_longitudinali, Property=proprieta_equivalenti_a_i11_i22_j, Angle=0)
bm_2 = Beam(Line=assi_longitudinali_2, Property=proprieta_equivalenti_a_i11_i22_j_2, Angle=0)
bm_3 = Beam(Line=assi_trasversali, Property=proprieta_equivalenti_a_i11_i22_j_3, Angle=0)
N_5 = Node(Point=nodi_mm_5)
nr_5 = Restraints(Node=N_5, Transational=tx_ty_tz_5, Rotation=rx_ry_rz_5)
nl_5 = NodeLoad(Node=nr_5, LoadCase=g2_permanenti, Force=forze_nodali_n_5)
N_6 = Node(Point=nodi_mm_6)
nr_6 = Restraints(Node=N_6, Transational=tx_ty_tz_6, Rotation=rx_ry_rz_6)
nl_6 = NodeLoad(Node=nr_6, LoadCase=g2_permanenti_2, Force=forze_nodali_n_6)
N_7 = Node(Point=nodi_mm_7)
nr_7 = Restraints(Node=N_7, Transational=tx_ty_tz_7, Rotation=rx_ry_rz_7)
nl_7 = NodeLoad(Node=nr_7, LoadCase=g2_permanenti_3, Force=forze_nodali_n_7)
N_8 = Node(Point=nodi_mm_8)
nr_8 = Restraints(Node=N_8, Transational=tx_ty_tz_8, Rotation=rx_ry_rz_8)
nl_8 = NodeLoad(Node=nr_8, LoadCase=g2_permanenti_4, Force=forze_nodali_n_8)
bm_4 = Beam(Line=assi_longitudinali_3, Property=proprieta_equivalenti_a_i11_i22_j_4, Angle=0)
bm_5 = Beam(Line=assi_longitudinali_4, Property=proprieta_equivalenti_a_i11_i22_j_5, Angle=0)
bm_6 = Beam(Line=assi_trasversali_2, Property=proprieta_equivalenti_a_i11_i22_j_6, Angle=0)
N_9 = Node(Point=nodi_mm_9)
nr_9 = Restraints(Node=N_9, Transational=tx_ty_tz_9, Rotation=rx_ry_rz_9)
nl_9 = NodeLoad(Node=nr_9, LoadCase=q_traffico, Force=forze_nodali_n_9)
N_10 = Node(Point=nodi_mm_10)
nr_10 = Restraints(Node=N_10, Transational=tx_ty_tz_10, Rotation=rx_ry_rz_10)
nl_10 = NodeLoad(Node=nr_10, LoadCase=q_traffico_2, Force=forze_nodali_n_10)
N_11 = Node(Point=nodi_mm_11)
nr_11 = Restraints(Node=N_11, Transational=tx_ty_tz_11, Rotation=rx_ry_rz_11)
nl_11 = NodeLoad(Node=nr_11, LoadCase=q_traffico_3, Force=forze_nodali_n_11)
N_12 = Node(Point=nodi_mm_12)
nr_12 = Restraints(Node=N_12, Transational=tx_ty_tz_12, Rotation=rx_ry_rz_12)
nl_12 = NodeLoad(Node=nr_12, LoadCase=q_traffico_4, Force=forze_nodali_n_12)
bm_7 = Beam(Line=assi_longitudinali_5, Property=proprieta_equivalenti_a_i11_i22_j_7, Angle=0)
bm_8 = Beam(Line=assi_longitudinali_6, Property=proprieta_equivalenti_a_i11_i22_j_8, Angle=0)
bm_9 = Beam(Line=assi_trasversali_3, Property=proprieta_equivalenti_a_i11_i22_j_9, Angle=0)
N_13 = Node(Point=nodi_mm_13)
nr_13 = Restraints(Node=N_13, Transational=tx_ty_tz_13, Rotation=rx_ry_rz_13)
nl_13 = NodeLoad(Node=nr_13, LoadCase=ritiro, Force=forze_nodali_n_13)
N_14 = Node(Point=nodi_mm_14)
nr_14 = Restraints(Node=N_14, Transational=tx_ty_tz_14, Rotation=rx_ry_rz_14)
nl_14 = NodeLoad(Node=nr_14, LoadCase=ritiro_2, Force=forze_nodali_n_14)
N_15 = Node(Point=nodi_mm_15)
nr_15 = Restraints(Node=N_15, Transational=tx_ty_tz_15, Rotation=rx_ry_rz_15)
nl_15 = NodeLoad(Node=nr_15, LoadCase=ritiro_3, Force=forze_nodali_n_15)
N_16 = Node(Point=nodi_mm_16)
nr_16 = Restraints(Node=N_16, Transational=tx_ty_tz_16, Rotation=rx_ry_rz_16)
nl_16 = NodeLoad(Node=nr_16, LoadCase=ritiro_4, Force=forze_nodali_n_16)
bm_10 = Beam(Line=assi_longitudinali_7, Property=proprieta_equivalenti_a_i11_i22_j_10, Angle=0)
bm_11 = Beam(Line=assi_longitudinali_8, Property=proprieta_equivalenti_a_i11_i22_j_11, Angle=0)
bm_12 = Beam(Line=assi_trasversali_4, Property=proprieta_equivalenti_a_i11_i22_j_12, Angle=0)
studs = BridgeStuds(
    Enabled=True,
    CountPerRow=2,
    Diameter=22,
    Height=180,
    LongitudinalPitch=200,
    TransversePitch=150,
    Fu=450,
    GammaV=1.25,
    HeadDiameter=35,
    HeadThickness=10,
    RequiredCover=40,
    RepeatedActionDetail=True)
intstiff = BridgeIntermediateStiffener(
    Enabled=True,
    Layout=0,
    Width=200,
    Thickness=20,
    RightWidth=200,
    RightThickness=20,
    LeftPanel=4166.666667,
    RightPanel=4166.666667,
    EqualPanels=True,
    LengthFactor=1,
    ExternalCompressionKN=0,
    LoadX=0,
    CheckWelds=True,
    WeldThroat=6)
supstiff = BridgeSupportStiffener(
    Enabled=True,
    Layout=0,
    Width=250,
    Thickness=25,
    RightWidth=250,
    RightThickness=25,
    Location=1,
    LeftPanel=4166.666667,
    RightPanel=4166.666667,
    ReactionKN=684.2351539,
    EndDistance=250,
    LoadX=0,
    LoadZ=0,
    FootprintLength=400,
    FootprintWidth=600,
    LengthFactor=1,
    RigidEndPost=False,
    EndPostSpacing=300,
    CheckWelds=True,
    WeldThroat=8)
gruppi_longitudinali = Panel("""G1
G1
G1
G1
G1
G1
G1
G1
G1
G1
G1
G1
G1
G1
G1
G1
G1
G1
G1
G1
G1
G1
G1
G1
G1
G1
G1
G1
G1
G1
G1
G1
G1
G1
G1
G1
G1
G1
G1
G1
G1
G1
G1
G1
G1
G1
G1
G1
G1
G1
G1
G1
G1
G1
G1
G1
G1
G1
G1
G1
G1
G1
G1
G1
G1
G1
G1
G1
G1
G1
G1
G1
G1
G1
G1
G1
G1
G1
G1
G1
G1
G1
G1
G1
G1
G1
G1
G1
G1
G1
G1
G1
G1
G1
G1
G1
G1
G1
G1
G1
G1
G1
G1
G1
G1
G1
G1
G1
G1
G1
G1
G1
G1
G1
G1
G1
G1
G1
G1
G1
G1
G1
G1
G1
G1
G1
G1
G1
G1
G1
G1
G1
G1
G1
G1
G1
G1
G1
G1
G1
G1
G1
G1
G1
G1
G1
G1
G1
G1
G1
G1
G1
G1
G1
G1
G1
G1
G1
G1
G1
G1
G1
G1
G1
G1
G1
G1
G1
G1
G1
G1
G1
G1
G1
G1
G1
G1
G1
G1
G1
G1
G1
G1
G1
G1
G1
G1
G1
G1
G1
G1
G1
G3
G3
G3
G3
G3
G3
G3
G3
G3
G3
G3
G3
G3
G3
G3
G3
G3
G3
G3
G3
G3
G3
G3
G3
G3
G3
G3
G3
G3
G3
G3
G3
G3
G3
G3
G3
G3
G3
G3
G3
G3
G3
G3
G3
G3
G3
G3
G3
G3
G3
G3
G3
G3
G3
G3
G3
G3
G3
G3
G3
G3
G3
G3
G3
G3
G3
G3
G3
G3
G3
G3
G3
G3
G3
G3
G3
G3
G3
G3
G3
G3
G3
G3
G3
G3
G3
G3
G3
G3
G3
G3
G3
G3
G3
G3
G3
G3
G3
G3
G3
G3
G3
G3
G3
G3
G3
G3
G3
G3
G3
G3
G3
G3
G3
G3
G3
G3
G3
G3
G3
G3
G3
G3
G3
G3
G3
G3
G3
G3
G3
G3
G3
G3
G3
G3
G3
G3
G3
G3
G3
G3
G3
G3
G3
G3
G3
G3
G3
G3
G3
G3
G3
G3
G3
G3
G3
G3
G3
G3
G3
G3
G3
G3
G3
G3
G3
G3
G3
G3
G3
G3
G3
G3
G3
G3
G3
G3
G3
G3
G3
G3
G3
G3
G3
G3
G3
G3
G3
G3
G3
G3
G3""")
se = SuperElement(Element=bm, Name=gruppi_longitudinali)
# CONTRIBUTO 2: Spina centrale curva: 25 + 25 m / R 120 m / G2_PERMANENTI
gruppi_longitudinali_2 = Panel("""G2
G2
G2
G2
G2
G2
G2
G2
G2
G2
G2
G2
G2
G2
G2
G2
G2
G2
G2
G2
G2
G2
G2
G2
G2
G2
G2
G2
G2
G2
G2
G2
G2
G2
G2
G2
G2
G2
G2
G2
G2
G2
G2
G2
G2
G2
G2
G2
G2
G2
G2
G2
G2
G2
G2
G2
G2
G2
G2
G2
G2
G2
G2
G2
G2
G2
G2
G2
G2
G2
G2
G2
G2
G2
G2
G2
G2
G2
G2
G2
G2
G2
G2
G2
G2
G2
G2
G2
G2
G2
G2
G2
G2
G2
G2
G2
G2
G2
G2
G2
G2
G2
G2
G2
G2
G2
G2
G2
G2
G2
G2
G2
G2
G2
G2
G2
G2
G2
G2
G2
G2
G2
G2
G2
G2
G2
G2
G2
G2
G2
G2
G2
G2
G2
G2
G2
G2
G2
G2
G2
G2
G2
G2
G2
G2
G2
G2
G2
G2
G2
G2
G2
G2
G2
G2
G2
G2
G2
G2
G2
G2
G2
G2
G2
G2
G2
G2
G2
G2
G2
G2
G2
G2
G2
G2
G2
G2
G2
G2
G2
G2
G2
G2
G2
G2
G2
G2
G2
G2
G2
G2
G2""")
se_2 = SuperElement(Element=bm_2, Name=gruppi_longitudinali_2)
gruppi_longitudinali_3 = Panel("""G1
G1
G1
G1
G1
G1
G1
G1
G1
G1
G1
G1
G1
G1
G1
G1
G1
G1
G1
G1
G1
G1
G1
G1
G1
G1
G1
G1
G1
G1
G1
G1
G1
G1
G1
G1
G1
G1
G1
G1
G1
G1
G1
G1
G1
G1
G1
G1
G1
G1
G1
G1
G1
G1
G1
G1
G1
G1
G1
G1
G1
G1
G1
G1
G1
G1
G1
G1
G1
G1
G1
G1
G1
G1
G1
G1
G1
G1
G1
G1
G1
G1
G1
G1
G1
G1
G1
G1
G1
G1
G1
G1
G1
G1
G1
G1
G1
G1
G1
G1
G1
G1
G1
G1
G1
G1
G1
G1
G1
G1
G1
G1
G1
G1
G1
G1
G1
G1
G1
G1
G1
G1
G1
G1
G1
G1
G1
G1
G1
G1
G1
G1
G1
G1
G1
G1
G1
G1
G1
G1
G1
G1
G1
G1
G1
G1
G1
G1
G1
G1
G1
G1
G1
G1
G1
G1
G1
G1
G1
G1
G1
G1
G1
G1
G1
G1
G1
G1
G1
G1
G1
G1
G1
G1
G1
G1
G1
G1
G1
G1
G1
G1
G1
G1
G1
G1
G1
G1
G1
G1
G1
G1
G3
G3
G3
G3
G3
G3
G3
G3
G3
G3
G3
G3
G3
G3
G3
G3
G3
G3
G3
G3
G3
G3
G3
G3
G3
G3
G3
G3
G3
G3
G3
G3
G3
G3
G3
G3
G3
G3
G3
G3
G3
G3
G3
G3
G3
G3
G3
G3
G3
G3
G3
G3
G3
G3
G3
G3
G3
G3
G3
G3
G3
G3
G3
G3
G3
G3
G3
G3
G3
G3
G3
G3
G3
G3
G3
G3
G3
G3
G3
G3
G3
G3
G3
G3
G3
G3
G3
G3
G3
G3
G3
G3
G3
G3
G3
G3
G3
G3
G3
G3
G3
G3
G3
G3
G3
G3
G3
G3
G3
G3
G3
G3
G3
G3
G3
G3
G3
G3
G3
G3
G3
G3
G3
G3
G3
G3
G3
G3
G3
G3
G3
G3
G3
G3
G3
G3
G3
G3
G3
G3
G3
G3
G3
G3
G3
G3
G3
G3
G3
G3
G3
G3
G3
G3
G3
G3
G3
G3
G3
G3
G3
G3
G3
G3
G3
G3
G3
G3
G3
G3
G3
G3
G3
G3
G3
G3
G3
G3
G3
G3
G3
G3
G3
G3
G3
G3
G3
G3
G3
G3
G3
G3""")
se_3 = SuperElement(Element=bm_4, Name=gruppi_longitudinali_3)
# CONTRIBUTO 3: Spina centrale curva: 25 + 25 m / R 120 m / Q_TRAFFICO
gruppi_longitudinali_4 = Panel("""G2
G2
G2
G2
G2
G2
G2
G2
G2
G2
G2
G2
G2
G2
G2
G2
G2
G2
G2
G2
G2
G2
G2
G2
G2
G2
G2
G2
G2
G2
G2
G2
G2
G2
G2
G2
G2
G2
G2
G2
G2
G2
G2
G2
G2
G2
G2
G2
G2
G2
G2
G2
G2
G2
G2
G2
G2
G2
G2
G2
G2
G2
G2
G2
G2
G2
G2
G2
G2
G2
G2
G2
G2
G2
G2
G2
G2
G2
G2
G2
G2
G2
G2
G2
G2
G2
G2
G2
G2
G2
G2
G2
G2
G2
G2
G2
G2
G2
G2
G2
G2
G2
G2
G2
G2
G2
G2
G2
G2
G2
G2
G2
G2
G2
G2
G2
G2
G2
G2
G2
G2
G2
G2
G2
G2
G2
G2
G2
G2
G2
G2
G2
G2
G2
G2
G2
G2
G2
G2
G2
G2
G2
G2
G2
G2
G2
G2
G2
G2
G2
G2
G2
G2
G2
G2
G2
G2
G2
G2
G2
G2
G2
G2
G2
G2
G2
G2
G2
G2
G2
G2
G2
G2
G2
G2
G2
G2
G2
G2
G2
G2
G2
G2
G2
G2
G2
G2
G2
G2
G2
G2
G2""")
se_4 = SuperElement(Element=bm_5, Name=gruppi_longitudinali_4)
gruppi_longitudinali_5 = Panel("""G1
G1
G1
G1
G1
G1
G1
G1
G1
G1
G1
G1
G1
G1
G1
G1
G1
G1
G1
G1
G1
G1
G1
G1
G1
G1
G1
G1
G1
G1
G1
G1
G1
G1
G1
G1
G1
G1
G1
G1
G1
G1
G1
G1
G1
G1
G1
G1
G1
G1
G1
G1
G1
G1
G1
G1
G1
G1
G1
G1
G1
G1
G1
G1
G1
G1
G1
G1
G1
G1
G1
G1
G1
G1
G1
G1
G1
G1
G1
G1
G1
G1
G1
G1
G1
G1
G1
G1
G1
G1
G1
G1
G1
G1
G1
G1
G1
G1
G1
G1
G1
G1
G1
G1
G1
G1
G1
G1
G1
G1
G1
G1
G1
G1
G1
G1
G1
G1
G1
G1
G1
G1
G1
G1
G1
G1
G1
G1
G1
G1
G1
G1
G1
G1
G1
G1
G1
G1
G1
G1
G1
G1
G1
G1
G1
G1
G1
G1
G1
G1
G1
G1
G1
G1
G1
G1
G1
G1
G1
G1
G1
G1
G1
G1
G1
G1
G1
G1
G1
G1
G1
G1
G1
G1
G1
G1
G1
G1
G1
G1
G1
G1
G1
G1
G1
G1
G1
G1
G1
G1
G1
G1
G3
G3
G3
G3
G3
G3
G3
G3
G3
G3
G3
G3
G3
G3
G3
G3
G3
G3
G3
G3
G3
G3
G3
G3
G3
G3
G3
G3
G3
G3
G3
G3
G3
G3
G3
G3
G3
G3
G3
G3
G3
G3
G3
G3
G3
G3
G3
G3
G3
G3
G3
G3
G3
G3
G3
G3
G3
G3
G3
G3
G3
G3
G3
G3
G3
G3
G3
G3
G3
G3
G3
G3
G3
G3
G3
G3
G3
G3
G3
G3
G3
G3
G3
G3
G3
G3
G3
G3
G3
G3
G3
G3
G3
G3
G3
G3
G3
G3
G3
G3
G3
G3
G3
G3
G3
G3
G3
G3
G3
G3
G3
G3
G3
G3
G3
G3
G3
G3
G3
G3
G3
G3
G3
G3
G3
G3
G3
G3
G3
G3
G3
G3
G3
G3
G3
G3
G3
G3
G3
G3
G3
G3
G3
G3
G3
G3
G3
G3
G3
G3
G3
G3
G3
G3
G3
G3
G3
G3
G3
G3
G3
G3
G3
G3
G3
G3
G3
G3
G3
G3
G3
G3
G3
G3
G3
G3
G3
G3
G3
G3
G3
G3
G3
G3
G3
G3
G3
G3
G3
G3
G3
G3""")
se_5 = SuperElement(Element=bm_7, Name=gruppi_longitudinali_5)
# CONTRIBUTO 4: Spina centrale curva: 25 + 25 m / R 120 m / RITIRO
gruppi_longitudinali_6 = Panel("""G2
G2
G2
G2
G2
G2
G2
G2
G2
G2
G2
G2
G2
G2
G2
G2
G2
G2
G2
G2
G2
G2
G2
G2
G2
G2
G2
G2
G2
G2
G2
G2
G2
G2
G2
G2
G2
G2
G2
G2
G2
G2
G2
G2
G2
G2
G2
G2
G2
G2
G2
G2
G2
G2
G2
G2
G2
G2
G2
G2
G2
G2
G2
G2
G2
G2
G2
G2
G2
G2
G2
G2
G2
G2
G2
G2
G2
G2
G2
G2
G2
G2
G2
G2
G2
G2
G2
G2
G2
G2
G2
G2
G2
G2
G2
G2
G2
G2
G2
G2
G2
G2
G2
G2
G2
G2
G2
G2
G2
G2
G2
G2
G2
G2
G2
G2
G2
G2
G2
G2
G2
G2
G2
G2
G2
G2
G2
G2
G2
G2
G2
G2
G2
G2
G2
G2
G2
G2
G2
G2
G2
G2
G2
G2
G2
G2
G2
G2
G2
G2
G2
G2
G2
G2
G2
G2
G2
G2
G2
G2
G2
G2
G2
G2
G2
G2
G2
G2
G2
G2
G2
G2
G2
G2
G2
G2
G2
G2
G2
G2
G2
G2
G2
G2
G2
G2
G2
G2
G2
G2
G2
G2""")
se_6 = SuperElement(Element=bm_8, Name=gruppi_longitudinali_6)
gruppi_longitudinali_7 = Panel("""G1
G1
G1
G1
G1
G1
G1
G1
G1
G1
G1
G1
G1
G1
G1
G1
G1
G1
G1
G1
G1
G1
G1
G1
G1
G1
G1
G1
G1
G1
G1
G1
G1
G1
G1
G1
G1
G1
G1
G1
G1
G1
G1
G1
G1
G1
G1
G1
G1
G1
G1
G1
G1
G1
G1
G1
G1
G1
G1
G1
G1
G1
G1
G1
G1
G1
G1
G1
G1
G1
G1
G1
G1
G1
G1
G1
G1
G1
G1
G1
G1
G1
G1
G1
G1
G1
G1
G1
G1
G1
G1
G1
G1
G1
G1
G1
G1
G1
G1
G1
G1
G1
G1
G1
G1
G1
G1
G1
G1
G1
G1
G1
G1
G1
G1
G1
G1
G1
G1
G1
G1
G1
G1
G1
G1
G1
G1
G1
G1
G1
G1
G1
G1
G1
G1
G1
G1
G1
G1
G1
G1
G1
G1
G1
G1
G1
G1
G1
G1
G1
G1
G1
G1
G1
G1
G1
G1
G1
G1
G1
G1
G1
G1
G1
G1
G1
G1
G1
G1
G1
G1
G1
G1
G1
G1
G1
G1
G1
G1
G1
G1
G1
G1
G1
G1
G1
G1
G1
G1
G1
G1
G1
G3
G3
G3
G3
G3
G3
G3
G3
G3
G3
G3
G3
G3
G3
G3
G3
G3
G3
G3
G3
G3
G3
G3
G3
G3
G3
G3
G3
G3
G3
G3
G3
G3
G3
G3
G3
G3
G3
G3
G3
G3
G3
G3
G3
G3
G3
G3
G3
G3
G3
G3
G3
G3
G3
G3
G3
G3
G3
G3
G3
G3
G3
G3
G3
G3
G3
G3
G3
G3
G3
G3
G3
G3
G3
G3
G3
G3
G3
G3
G3
G3
G3
G3
G3
G3
G3
G3
G3
G3
G3
G3
G3
G3
G3
G3
G3
G3
G3
G3
G3
G3
G3
G3
G3
G3
G3
G3
G3
G3
G3
G3
G3
G3
G3
G3
G3
G3
G3
G3
G3
G3
G3
G3
G3
G3
G3
G3
G3
G3
G3
G3
G3
G3
G3
G3
G3
G3
G3
G3
G3
G3
G3
G3
G3
G3
G3
G3
G3
G3
G3
G3
G3
G3
G3
G3
G3
G3
G3
G3
G3
G3
G3
G3
G3
G3
G3
G3
G3
G3
G3
G3
G3
G3
G3
G3
G3
G3
G3
G3
G3
G3
G3
G3
G3
G3
G3
G3
G3
G3
G3
G3
G3""")
se_7 = SuperElement(Element=bm_10, Name=gruppi_longitudinali_7)
bpl = BeamPreLoad(Beam=se_7, LoadCase=ritiro_nativo, Type=1, Value=8.37687126e-05)
bgl = BeamGradientLoad(Beam=bpl, LoadCase=ritiro_nativo, Axis1=0, Axis2=-0.00932805293)
gruppi_longitudinali_8 = Panel("""G2
G2
G2
G2
G2
G2
G2
G2
G2
G2
G2
G2
G2
G2
G2
G2
G2
G2
G2
G2
G2
G2
G2
G2
G2
G2
G2
G2
G2
G2
G2
G2
G2
G2
G2
G2
G2
G2
G2
G2
G2
G2
G2
G2
G2
G2
G2
G2
G2
G2
G2
G2
G2
G2
G2
G2
G2
G2
G2
G2
G2
G2
G2
G2
G2
G2
G2
G2
G2
G2
G2
G2
G2
G2
G2
G2
G2
G2
G2
G2
G2
G2
G2
G2
G2
G2
G2
G2
G2
G2
G2
G2
G2
G2
G2
G2
G2
G2
G2
G2
G2
G2
G2
G2
G2
G2
G2
G2
G2
G2
G2
G2
G2
G2
G2
G2
G2
G2
G2
G2
G2
G2
G2
G2
G2
G2
G2
G2
G2
G2
G2
G2
G2
G2
G2
G2
G2
G2
G2
G2
G2
G2
G2
G2
G2
G2
G2
G2
G2
G2
G2
G2
G2
G2
G2
G2
G2
G2
G2
G2
G2
G2
G2
G2
G2
G2
G2
G2
G2
G2
G2
G2
G2
G2
G2
G2
G2
G2
G2
G2
G2
G2
G2
G2
G2
G2
G2
G2
G2
G2
G2
G2""")
se_8 = SuperElement(Element=bm_11, Name=gruppi_longitudinali_8)
bpl_2 = BeamPreLoad(Beam=se_8, LoadCase=ritiro_nativo_2, Type=1, Value=6.127564753e-05)
bgl_2 = BeamGradientLoad(Beam=bpl_2, LoadCase=ritiro_nativo_2, Axis1=0, Axis2=-0.006092738251)
id_elementi = Panel("""1
2
3
4
5
6
7
8
9
10
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""")
ei = ElementId(Element=se, ID=id_elementi)
id_elementi_2 = Panel("""193
194
195
196
197
198
199
200
201
202
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""")
ei_2 = ElementId(Element=se_2, ID=id_elementi_2)
id_elementi_3 = Panel("""577
578
609
610
641
642
673
674
705
706
737
738
769
770
801
802
833
834
865
866
897
898
929
930
961
962""")
ei_3 = ElementId(Element=bm_3, ID=id_elementi_3)
bm_13 = BuildModel(Elements=[nl, nl_2, nl_3, nl_4, ei, ei_2, ei_3], Name="Spina centrale curva: 25 + 25 m / R 120 m / G1_GETTO", Units=2)
id_elementi_4 = Panel("""1
2
3
4
5
6
7
8
9
10
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""")
ei_4 = ElementId(Element=se_3, ID=id_elementi_4)
id_elementi_5 = Panel("""193
194
195
196
197
198
199
200
201
202
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""")
ei_5 = ElementId(Element=se_4, ID=id_elementi_5)
id_elementi_6 = Panel("""577
578
579
580
581
582
583
584
585
586
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""")
ei_6 = ElementId(Element=bm_6, ID=id_elementi_6)
bm_14 = BuildModel(
    Elements=[nl_5, nl_6, nl_7, nl_8, ei_4, ei_5, ei_6],
    Name="Spina centrale curva: 25 + 25 m / R 120 m / G2_PERMANENTI",
    Units=2)
id_elementi_7 = Panel("""1
2
3
4
5
6
7
8
9
10
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""")
ei_7 = ElementId(Element=se_5, ID=id_elementi_7)
id_elementi_8 = Panel("""193
194
195
196
197
198
199
200
201
202
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""")
ei_8 = ElementId(Element=se_6, ID=id_elementi_8)
id_elementi_9 = Panel("""577
578
579
580
581
582
583
584
585
586
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""")
ei_9 = ElementId(Element=bm_9, ID=id_elementi_9)
bm_15 = BuildModel(
    Elements=[nl_9, nl_10, nl_11, nl_12, ei_7, ei_8, ei_9],
    Name="Spina centrale curva: 25 + 25 m / R 120 m / Q_TRAFFICO",
    Units=2)
id_elementi_10 = Panel("""1
2
3
4
5
6
7
8
9
10
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""")
ei_10 = ElementId(Element=bgl, ID=id_elementi_10)
id_elementi_11 = Panel("""193
194
195
196
197
198
199
200
201
202
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""")
ei_11 = ElementId(Element=bgl_2, ID=id_elementi_11)
id_elementi_12 = Panel("""577
578
579
580
581
582
583
584
585
586
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""")
ei_12 = ElementId(Element=bm_12, ID=id_elementi_12)
bm_16 = BuildModel(
    Elements=[nl_13, nl_14, nl_15, nl_16, ei_10, ei_11, ei_12],
    Name="Spina centrale curva: 25 + 25 m / R 120 m / RITIRO",
    Units=2)
file_straus = Panel("C:\Users\g.pacini\AppData\Local\Temp\BridGHe-18-spina-curva-2campate-G1_GETTO.st7")
sa = StrausR3Analysis(
    Model=bm_13,
    Solver=0,
    AnalysisResults="G1_GETTO",
    OutputPath=file_straus,
    KeepRunning=calcola_4_modelli,
    ElementGuids="[]")
dm = DecomposeModel(Model=sa)  # -> Nodes, Beams, Plates
nr_17 = NodeResults(Node=dm.Nodes)  # -> LoadCasesD, StepsD, Displacements, Rotations, LoadCasesF, StepsF, Forces, Moments
br = BeamResults(Beam=dm.Beams)  # -> LoadCases, Stations, Steps, ShearForces, BendingMoments, AxialForces, Torques
file_straus_2 = Panel("C:\Users\g.pacini\AppData\Local\Temp\BridGHe-18-spina-curva-2campate-G2_PERMANENTI.st7")
sa_2 = StrausR3Analysis(
    Model=bm_14,
    Solver=0,
    AnalysisResults="G2_PERMANENTI",
    OutputPath=file_straus_2,
    KeepRunning=calcola_4_modelli,
    ElementGuids="[]")
dm_2 = DecomposeModel(Model=sa_2)  # -> Nodes, Beams, Plates
nr_18 = NodeResults(Node=dm_2.Nodes)  # -> LoadCasesD, StepsD, Displacements, Rotations, LoadCasesF, StepsF, Forces, Moments
br_2 = BeamResults(Beam=dm_2.Beams)  # -> LoadCases, Stations, Steps, ShearForces, BendingMoments, AxialForces, Torques
file_straus_3 = Panel("C:\Users\g.pacini\AppData\Local\Temp\BridGHe-18-spina-curva-2campate-Q_TRAFFICO.st7")
sa_3 = StrausR3Analysis(
    Model=bm_15,
    Solver=0,
    AnalysisResults="Q_TRAFFICO",
    OutputPath=file_straus_3,
    KeepRunning=calcola_4_modelli,
    ElementGuids="[]")
dm_3 = DecomposeModel(Model=sa_3)  # -> Nodes, Beams, Plates
nr_19 = NodeResults(Node=dm_3.Nodes)  # -> LoadCasesD, StepsD, Displacements, Rotations, LoadCasesF, StepsF, Forces, Moments
br_3 = BeamResults(Beam=dm_3.Beams)  # -> LoadCases, Stations, Steps, ShearForces, BendingMoments, AxialForces, Torques
file_straus_4 = Panel("C:\Users\g.pacini\AppData\Local\Temp\BridGHe-18-spina-curva-2campate-RITIRO.st7")
sa_4 = StrausR3Analysis(
    Model=bm_16,
    Solver=0,
    AnalysisResults="RITIRO",
    OutputPath=file_straus_4,
    KeepRunning=calcola_4_modelli,
    ElementGuids="[]")
dm_4 = DecomposeModel(Model=sa_4)  # -> Nodes, Beams, Plates
nr_20 = NodeResults(Node=dm_4.Nodes)  # -> LoadCasesD, StepsD, Displacements, Rotations, LoadCasesF, StepsF, Forces, Moments
br_4 = BeamResults(Beam=dm_4.Beams)  # -> LoadCases, Stations, Steps, ShearForces, BendingMoments, AxialForces, Torques
u_mm = Panel(nr_17.Displacements)
bm1_bm2_nmm = Panel(br.BendingMoments)
t_nmm_conservata = Panel(br.Torques)
# PIOLI E IRRIGIDITORI gPC: Definizioni dei dettagli collegate ai risultati di sezione.
# Prima trave selezionata: appoggio e primo diaframma interno.
# Pioli: 2 x diam.22, h180, passo200 mm. Piatti intermedi 200x20, appoggio 250x25 mm.
# Reazione d'appoggio dimostrativa SLS: somma dei quattro casi; sostituire con inviluppo SLU per il progetto.
# Le verifiche conservano lo stato limite del risultato sorgente. Nei curvi BridgeChecks blocca prima la torsione H.
# I dettagli non aggiungono automaticamente rigidezza o peso al graticcio equivalente.
u_mm_2 = Panel(nr_18.Displacements)
bm1_bm2_nmm_2 = Panel(br_2.BendingMoments)
t_nmm_conservata_2 = Panel(br_2.Torques)
u_mm_3 = Panel(nr_19.Displacements)
bm1_bm2_nmm_3 = Panel(br_3.BendingMoments)
t_nmm_conservata_3 = Panel(br_3.Torques)
u_mm_4 = Panel(nr_20.Displacements)
bm1_bm2_nmm_4 = Panel(br_4.BendingMoments)
t_nmm_conservata_4 = Panel(br_4.Torques)
# BridGHe: SLS dimostrativo con coefficienti unitari: G1 + G2 + Q + ritiro primario e secondario.
# Il secondario del ritiro usa la rigidezza Ninf e viene aggregato a G2 solo nell'adattatore.
# Nei CSV i quattro contributi restano distinti. Soletta lorda non fessurata, armature escluse.
# CURVE: non attivare la verifica aspettandosi un esito completo. Il motore N-M-V rifiuta T/M2.
# Nessuna cancellazione o proiezione delle sollecitazioni non supportate.
longitudinali = Panel("G2")
sef = SuperElementFilter(BridGHeModel=sa, SuperElement=longitudinali)
bm_17 = BuildModel(Elements=flatten(sef), Units=2)
longitudinali_2 = Panel("G2")
sef_2 = SuperElementFilter(BridGHeModel=sa_2, SuperElement=longitudinali_2)
bm_18 = BuildModel(Elements=flatten(sef_2), Units=2)
longitudinali_3 = Panel("G2")
sef_3 = SuperElementFilter(BridGHeModel=sa_3, SuperElement=longitudinali_3)
bm_19 = BuildModel(Elements=flatten(sef_3), Units=2)
longitudinali_4 = Panel("G2")
sef_4 = SuperElementFilter(BridGHeModel=sa_4, SuperElement=longitudinali_4)
cbs = CompositeBeamStrain(Beam=sef_4, LoadCase=ritiro_primario, Strain=-0.0002)
bm_20 = BuildModel(Elements=flatten(cbs), Units=2)
fasi_2 = Panel("1-G1_GETTO")
fasi_3 = Panel("""2-G2_PERMANENTI
4-RITIRO""")
fasi_4 = Panel("3-Q_TRAFFICO")
fasi_5 = Panel("4-RITIRO_PRIMARIO")
bmcm = BuildBridGHeModel(
    BridGHeModels=[bm_17, bm_18, bm_19, bm_20],
    LoadCombinations=combinazione_sls,
    PhaseInfLoadCases=fasi_2,
    PhaseNinfLoadCases=fasi_3,
    PhaseN0LoadCases=fasi_4,
    PhaseNinfStrainLoadCases=fasi_5)
travi = Panel("G2")
sef_5 = SuperElementFilter(BridGHeModel=bmcm, SuperElement=travi)
cb = CompositeBeam(Beam=sef_5, SectionStart=h2000_soletta_250_b_4000, SectionEnd=h2000_soletta_250_b_4000)
sec = SuperElementCheck(
    BridGHeModel=bmcm,
    SuperElementBeam=flatten(cb),
    WebLocalInstability=False,
    TopFlangeLocalInstability=False,
    BottomFlangeLocalInstability=False)  # -> TensionCheck, TauB, TensionForces
csltr = CompositeSectionLinearTensionResults(LinearTensionResults=sec.TensionCheck)  # -> Point1_ConcreteEpsilon, Point1_ConcreteSigma, Point2_RebarSigma, Point3_RebarSigma, Point4_ConcreteSigma, Point5_SteelSigma, Point6_SteelSigma, Point6_SteelTau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
item = ListItem(List=flatten(sec.TensionCheck), Index=0, Wrap=True)
detailcheck = BridgeDetailCheck(SectionResult=item, Studs=studs, SupportStiffener=supstiff)  # -> SectionResult, Check, Demand, Resistance, Units, Ratio, Status, Warnings
item_2 = ListItem(List=flatten(sec.TensionCheck), Index=80, Wrap=True)
detailcheck_2 = BridgeDetailCheck(SectionResult=item_2, Studs=studs, IntermediateStiffener=intstiff)  # -> SectionResult, Check, Demand, Resistance, Units, Ratio, Status, Warnings
dettagli_appoggio = Panel(detailcheck.Status)
dettagli_intermedio = Panel(detailcheck_2.Status)
sigma_cls_mpa = Panel(csltr.Point1_ConcreteSigma)
sigma_acciaio_mpa = Panel(csltr.Point8_SteelSigma)
